# Grasshopper definition 02_Digital Building Library_Baseline_THSF archetypes.gh (Grasshopper 1.0.8)

opaquemat = HBOpaqueMaterial(
    name="InternalPlaster",
    thickness="0.020",
    conductivity="0.700",
    density="1400",
    spec_heat="1000",
    roughness="MediumSmooth")  # -> mat; plug-in component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

opaquemat_2 = HBOpaqueMaterial(name="Brick&Stone", thickness="0.360", conductivity="0.900", density="2000", spec_heat="1000", roughness="Rough")  # -> mat; plug-in component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

opaquemat_3 = HBOpaqueMaterial(
    name="InternalPlaster",
    thickness="0.020",
    conductivity="0.700",
    density="1400",
    spec_heat="1000",
    roughness="MediumSmooth")  # -> mat; plug-in component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

opaquemat_4 = HBOpaqueMaterial(
    name="InternalPlaster",
    thickness="0.020",
    conductivity="0.700",
    density="1400",
    spec_heat="1000",
    roughness="MediumSmooth")  # -> mat; plug-in component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

opaquemat_5 = HBOpaqueMaterial(name="CeramicTile", thickness="0.015", conductivity="1.470", density="1700", spec_heat="1000", roughness="MediumSmooth")  # -> mat; plug-in component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

opaquemat_6 = HBOpaqueMaterial(name="CementMortar", thickness="0.020", conductivity="1.400", density="2000", spec_heat="1000", roughness="Rough")  # -> mat; plug-in component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

opaquemat_7 = HBOpaqueMaterial(
    name="InternalPlaster",
    thickness="0.020",
    conductivity="0.700",
    density="1400",
    spec_heat="1000",
    roughness="MediumSmooth")  # -> mat; plug-in component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

opaquemat_8 = HBOpaqueMaterial(name="SolidBrick", thickness="0.233", conductivity="0.720", density="1800", spec_heat="1000", roughness="Rough")  # -> mat; plug-in component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

opaquemat_9 = HBOpaqueMaterial(name="SolidBrick", thickness="0.233", conductivity="0.720", density="1800", spec_heat="1000", roughness="Rough")  # -> mat; plug-in component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

opaquemat_10 = HBOpaqueMaterial(name="CeramicTile", thickness="0.015", conductivity="1.470", density="1700", spec_heat="1000", roughness="MediumSmooth")  # -> mat; plug-in component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

opaquemat_11 = HBOpaqueMaterial(name="CementMortar", thickness="0.020", conductivity="1.400", density="2000", spec_heat="1000", roughness="Rough")  # -> mat; plug-in component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

opaquemat_12 = HBOpaqueMaterial(name="ExternalPlaster", thickness=".020", conductivity="0.900", density="1800", spec_heat="1000", roughness="Rough")  # -> mat; plug-in component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

glassmat = HBGlassMaterial(
    name="Glass_01.01_Single",
    thickness="0.003",
    transmittance="0.817",
    reflectance="0.075",
    emiss_front="0.84",
    emiss_back="0.84",
    conductivity="0.0845")  # -> mat; plug-in component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

opaquemat_13 = HBOpaqueMaterial(name="CeramicTile", thickness="0.015", conductivity="1.470", density="1700", spec_heat="1000", roughness="MediumSmooth")  # -> mat; plug-in component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

opaquemat_14 = HBOpaqueMaterial(name="SolidBrick", thickness="0.233", conductivity="0.720", density="1800", spec_heat="1000", roughness="Rough")  # -> mat; plug-in component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

opaquemat_15 = HBOpaqueMaterial(name="CementMortar", thickness="0.020", conductivity="1.400", density="2000", spec_heat="1000", roughness="Rough")  # -> mat; plug-in component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

opaquemat_16 = HBOpaqueMaterial(name="ExternalPlaster", thickness=".020", conductivity="0.900", density="1800", spec_heat="1000", roughness="Rough")  # -> mat; plug-in component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

opaquemat_17 = HBOpaqueMaterial(name="CeramicTile", thickness="0.015", conductivity="1.470", density="1700", spec_heat="1000", roughness="MediumSmooth")  # -> mat; plug-in component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

opaquemat_18 = HBOpaqueMaterial(name="CementMortar", thickness="0.020", conductivity="1.400", density="2000", spec_heat="1000", roughness="Rough")  # -> mat; plug-in component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

opaquemat_19 = HBOpaqueMaterial(name="SolidBrick", thickness="0.233", conductivity="0.720", density="1800", spec_heat="1000", roughness="Rough")  # -> mat; plug-in component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

opaquemat_20 = HBOpaqueMaterial(name="SolidBrick", thickness="0.233", conductivity="0.720", density="1800", spec_heat="1000", roughness="Rough")  # -> mat; plug-in component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

opaquemat_21 = HBOpaqueMaterial(name="CementMortar", thickness="0.020", conductivity="1.400", density="2000", spec_heat="1000", roughness="Rough")  # -> mat; plug-in component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

opaquemat_22 = HBOpaqueMaterial(name="SolidBrick", thickness=".400", conductivity="0.720", density="1800", spec_heat="1000", roughness="Rough")  # -> mat; plug-in component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

opaquemat_23 = HBOpaqueMaterial(name="WoodPlanking", thickness="0.063", conductivity="0.150", density="550", spec_heat="1600", roughness="Rough")  # -> mat; plug-in component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

opaquemat_24 = HBOpaqueMaterial(name="ExternalPlaster", thickness=".020", conductivity="0.900", density="1800", spec_heat="1000", roughness="Rough")  # -> mat; plug-in component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

opaquemat_25 = HBOpaqueMaterial(name="CeramicTile", thickness="0.015", conductivity="1.470", density="1700", spec_heat="1000", roughness="MediumSmooth")  # -> mat; plug-in component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

opaquemat_26 = HBOpaqueMaterial(
    name="InternalPlaster",
    thickness="0.020",
    conductivity="0.700",
    density="1400",
    spec_heat="1000",
    roughness="MediumSmooth")  # -> mat; plug-in component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

opaquemat_27 = HBOpaqueMaterial(name="Brick&Stone", thickness="0.360", conductivity="0.900", density="2000", spec_heat="1000", roughness="Rough")  # -> mat; plug-in component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

opaquemat_28 = HBOpaqueMaterial(
    name="InternalPlaster",
    thickness="0.020",
    conductivity="0.700",
    density="1400",
    spec_heat="1000",
    roughness="MediumSmooth")  # -> mat; plug-in component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

opaquemat_29 = HBOpaqueMaterial(name="WoodPlanking", thickness="0.063", conductivity="0.150", density="550", spec_heat="1600", roughness="Rough")  # -> mat; plug-in component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

opaquemat_30 = HBOpaqueMaterial(
    name="InternalPlaster",
    thickness="0.020",
    conductivity="0.700",
    density="1400",
    spec_heat="1000",
    roughness="MediumSmooth")  # -> mat; plug-in component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

# ----
# R1TH
opaquemat_31 = HBOpaqueMaterial(name="ExternalPlaster", thickness=".020", conductivity="0.900", density="1800", spec_heat="1000", roughness="Rough")  # -> mat; plug-in component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

opaquemat_32 = HBOpaqueMaterial(name="Brick&Stone", thickness="0.360", conductivity="0.900", density="2000", spec_heat="1000", roughness="VeryRough")  # -> mat; plug-in component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

opaquemat_33 = HBOpaqueMaterial(
    name="InternalPlaster",
    thickness="0.020",
    conductivity="0.700",
    density="1400",
    spec_heat="1000",
    roughness="MediumSmooth")  # -> mat; plug-in component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

opaquemat_34 = HBOpaqueMaterial(name="CeramicTile", thickness="0.015", conductivity="1.470", density="1700", spec_heat="1000", roughness="MediumSmooth")  # -> mat; plug-in component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

opaquemat_35 = HBOpaqueMaterial(name="CementMortar", thickness="0.020", conductivity="1.400", density="2000", spec_heat="1000", roughness="Rough")  # -> mat; plug-in component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

opaquemat_36 = HBOpaqueMaterial(
    name="InternalPlaster",
    thickness="0.020",
    conductivity="0.700",
    density="1400",
    spec_heat="1000",
    roughness="MediumSmooth")  # -> mat; plug-in component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

opaquemat_37 = HBOpaqueMaterial(name="WoodDoor_Single", thickness="0.045", conductivity="0.2813", density="1600", spec_heat="550", roughness="Smooth")  # -> mat; plug-in component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

opaquemat_38 = HBOpaqueMaterial(
    name="InternalPlaster",
    thickness="0.020",
    conductivity="0.700",
    density="1400",
    spec_heat="1000",
    roughness="MediumSmooth")  # -> mat; plug-in component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

opaquemat_39 = HBOpaqueMaterial(name="SolidBrick", thickness="0.233", conductivity="0.720", density="1800", spec_heat="1000", roughness="Rough")  # -> mat; plug-in component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

opaquemat_40 = HBOpaqueMaterial(name="Brick&Stone", thickness="0.360", conductivity="0.900", density="2000", spec_heat="1000", roughness="VeryRough")  # -> mat; plug-in component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

# ----
# R1SF
opaquemat_41 = HBOpaqueMaterial(name="ExternalPlaster", thickness=".020", conductivity="0.900", density="1800", spec_heat="1000", roughness="Rough")  # -> mat; plug-in component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

opaquemat_42 = HBOpaqueMaterial(name="CeramicTile", thickness="0.015", conductivity="1.470", density="1700", spec_heat="1000", roughness="MediumSmooth")  # -> mat; plug-in component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

opaquemat_43 = HBOpaqueMaterial(name="SolidBrick", thickness="0.233", conductivity="0.720", density="1800", spec_heat="1000", roughness="Rough")  # -> mat; plug-in component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

opaquemat_44 = HBOpaqueMaterial(name="CeramicTile", thickness="0.015", conductivity="1.470", density="1700", spec_heat="1000", roughness="MediumSmooth")  # -> mat; plug-in component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

opaquemat_45 = HBOpaqueMaterial(name="CementMortar", thickness="0.020", conductivity="1.400", density="2000", spec_heat="1000", roughness="Rough")  # -> mat; plug-in component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

opaquemat_46 = HBOpaqueMaterial(name="Concrete_Reg", thickness="0.100", conductivity="1.160", density="2000", spec_heat="1000", roughness="Rough")  # -> mat; plug-in component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

opaquemat_47 = HBOpaqueMaterial(name="CementMortar_Thick", thickness="0.030", conductivity="1.400", density="2000", spec_heat="1000", roughness="Rough")  # -> mat; plug-in component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

opaquemat_48 = HBOpaqueMaterial(name="GravelRiverStone", thickness=".147", conductivity="1.200", density="1700", spec_heat="1000", roughness="VeryRough")  # -> mat; plug-in component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

opaquemat_49 = HBOpaqueMaterial(name="SolidBrick", thickness=".400", conductivity="0.720", density="1800", spec_heat="1000", roughness="Rough")  # -> mat; plug-in component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

opaquemat_50 = HBOpaqueMaterial(name="CeramicTile", thickness="0.015", conductivity="1.470", density="1700", spec_heat="1000", roughness="MediumSmooth")  # -> mat; plug-in component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

opaquemat_51 = HBOpaqueMaterial(name="CementMortar_Thick", thickness="0.030", conductivity="1.400", density="2000", spec_heat="1000", roughness="Rough")  # -> mat; plug-in component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

opaquemat_52 = HBOpaqueMaterial(name="Concrete_Reg", thickness="0.100", conductivity="1.160", density="2000", spec_heat="1000", roughness="Rough")  # -> mat; plug-in component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

opaquemat_53 = HBOpaqueMaterial(name="GravelRiverStone", thickness=".147", conductivity="1.200", density="1700", spec_heat="1000", roughness="VeryRough")  # -> mat; plug-in component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

opaquemat_54 = HBOpaqueMaterial(name="CeramicTile", thickness="0.015", conductivity="1.470", density="1700", spec_heat="1000", roughness="MediumSmooth")  # -> mat; plug-in component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

opaquemat_55 = HBOpaqueMaterial(name="CementMortar_Thick", thickness="0.030", conductivity="1.400", density="2000", spec_heat="1000", roughness="Rough")  # -> mat; plug-in component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

opaquemat_56 = HBOpaqueMaterial(name="Concrete_Reg", thickness="0.100", conductivity="1.160", density="2000", spec_heat="1000", roughness="Rough")  # -> mat; plug-in component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

opaquemat_57 = HBOpaqueMaterial(name="WoodDoor_Single", thickness="0.045", conductivity="0.2813", density="1600", spec_heat="550", roughness="Smooth")  # -> mat; plug-in component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

opaquemat_58 = HBOpaqueMaterial(name="GravelRiverStone", thickness=".147", conductivity="1.200", density="1700", spec_heat="1000", roughness="VeryRough")  # -> mat; plug-in component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

glassmat_2 = HBGlassMaterial(
    name="Glass_01.02_Single",
    thickness="0.003",
    transmittance="0.835",
    reflectance="0.075",
    emiss_front="0.84",
    emiss_back="0.84",
    conductivity="0.435")  # -> mat; plug-in component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

merge = Merge(Data1=opaquemat_5, Data2=opaquemat_6, Data3=opaquemat_8, Data4=opaquemat_7)
opaqueconstr = HBOpaqueConstruction(name="Floor_01.01_IntClg", materials=merge)  # -> constr; plug-in component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

merge_2 = Merge(Data1=opaquemat, Data2=opaquemat_2, Data3=opaquemat_3)
opaqueconstr_2 = HBOpaqueConstruction(name="Wall_01.03_Interior", materials=merge_2)  # -> constr; plug-in component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

merge_3 = Merge(Data1=opaquemat_34, Data2=opaquemat_35, Data3=opaquemat_39, Data4=opaquemat_36)
opaqueconstr_3 = HBOpaqueConstruction(name="Floor_01.01_IntClg", materials=merge_3)  # -> constr; plug-in component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

# ----
# Subface Subset
panel = Panel("Window_01.02")
opaqueconstr_4 = HBOpaqueConstruction(name="Door_01.01", materials=opaquemat_57)  # -> constr; plug-in component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
windowconstr = HBWindowConstruction(name=panel, materials=glassmat_2)  # -> constr; plug-in component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
decnstrconstr = HBDeconstructConstruction(constr=windowconstr)  # -> materials, layers, r_val_si, r_val_ip, u_fac_si, u_fac_ip, shgc, t_sol, t_vis; plug-in component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
decnstrconstr_2 = HBDeconstructConstruction(constr=opaqueconstr_4)  # -> materials, layers, r_val_si, r_val_ip, u_fac_si, u_fac_ip, shgc, t_sol, t_vis; plug-in component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
subfacesubset = HBSubfaceSubset(window=windowconstr, skylight=windowconstr, operable=windowconstr, exterior_door=opaqueconstr_4, glass_door=windowconstr)  # -> subface_set; plug-in component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
panel_2 = Panel([decnstrconstr.r_val_si, decnstrconstr.u_fac_si, decnstrconstr.shgc])
panel_3 = Panel([decnstrconstr_2.r_val_si, decnstrconstr_2.u_fac_si, decnstrconstr_2.shgc])

merge_4 = Merge(Data1=opaquemat_23)
opaqueconstr_5 = HBOpaqueConstruction(name="Roof_01.01", materials=merge_4)  # -> constr; plug-in component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

merge_5 = Merge(Data1=opaquemat_16, Data2=opaquemat_20, Data3=opaquemat_21, Data4=opaquemat_25)
opaqueconstr_6 = HBOpaqueConstruction(name="Floor_01.01_GRfloor", materials=merge_5)  # -> constr; plug-in component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

merge_6 = Merge(Data1=opaquemat_29)
opaqueconstr_7 = HBOpaqueConstruction(name="Roof_01.01", materials=merge_6)  # -> constr; plug-in component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

merge_7 = Merge(Data1=opaquemat_4, Data2=opaquemat_9, Data3=opaquemat_11, Data4=opaquemat_10)
opaqueconstr_8 = HBOpaqueConstruction(name="Floor_01.01_IntFlr", materials=merge_7)  # -> constr; plug-in component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

merge_8 = Merge(Data1=opaquemat_13, Data2=opaquemat_15, Data3=opaquemat_14, Data4=opaquemat_12)
opaqueconstr_9 = HBOpaqueConstruction(name="Floor_01.01_GRroof", materials=merge_8)  # -> constr; plug-in component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

# ----
# Ground Subset -
# same as interior floors,
# ground & roof must be inverse.
# 
# Base ground & roof construction
# on exterior floor for same archetype
# Make this same thickness as W1
panel_4 = Panel("Wall_01.03_UGwall")
opaqueconstr_10 = HBOpaqueConstruction(name=panel_4, materials=opaquemat_22)  # -> constr; plug-in component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
groundsubset = HBGroundConstructionSubset(ground_wall=opaqueconstr_10, ground_roof=opaqueconstr_9, ground_floor=opaqueconstr_6)  # -> ground_set; plug-in component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
decnstrmat = HBDeconstructMaterial(mat=groundsubset)  # -> values, attr_names, r_val_si, r_val_ip; plug-in component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
panel_5 = Panel(groundsubset)
panel_6 = Panel(decnstrmat.r_val_si)

merge_9 = Merge(Data1=opaquemat_26, Data2=opaquemat_27, Data3=opaquemat_30)
opaqueconstr_11 = HBOpaqueConstruction(name="Wall_01.03_Interior", materials=merge_9)  # -> constr; plug-in component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

# ----
# Subface Subset
panel_7 = Panel("Window_01.01")
windowconstr_2 = HBWindowConstruction(name=panel_7, materials=glassmat)  # -> constr; plug-in component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
opaqueconstr_12 = HBOpaqueConstruction(name="Door_01.01", materials=opaquemat_37)  # -> constr; plug-in component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
decnstrconstr_3 = HBDeconstructConstruction(constr=opaqueconstr_12)  # -> materials, layers, r_val_si, r_val_ip, u_fac_si, u_fac_ip, shgc, t_sol, t_vis; plug-in component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
decnstrconstr_4 = HBDeconstructConstruction(constr=windowconstr_2)  # -> materials, layers, r_val_si, r_val_ip, u_fac_si, u_fac_ip, shgc, t_sol, t_vis; plug-in component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
subfacesubset_2 = HBSubfaceSubset(
    window=windowconstr_2,
    skylight=windowconstr_2,
    operable=windowconstr_2,
    exterior_door=opaqueconstr_12,
    glass_door=windowconstr_2)  # -> subface_set; plug-in component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
panel_8 = Panel(subfacesubset_2)
panel_9 = Panel([decnstrconstr_3.r_val_si, decnstrconstr_3.u_fac_si, decnstrconstr_3.shgc])
panel_10 = Panel([decnstrconstr_4.r_val_si, decnstrconstr_4.u_fac_si, decnstrconstr_4.shgc])

merge_10 = Merge(Data1=opaquemat_53, Data2=opaquemat_52, Data3=opaquemat_51, Data4=opaquemat_50)
opaqueconstr_13 = HBOpaqueConstruction(name="Floor_01.04_GRfloor", materials=merge_10)  # -> constr; plug-in component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

merge_11 = Merge(Data1=opaquemat_33, Data2=opaquemat_43, Data3=opaquemat_45, Data4=opaquemat_44)
opaqueconstr_14 = HBOpaqueConstruction(name="Floor_01.01_IntFlr", materials=merge_11)  # -> constr; plug-in component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

merge_12 = Merge(Data1=opaquemat_31, Data2=opaquemat_32, Data3=opaquemat_28)
opaqueconstr_15 = HBOpaqueConstruction(name="Wall_01.03", materials=merge_12)  # -> constr; plug-in component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

merge_13 = Merge(Data1=opaquemat_54, Data2=opaquemat_55, Data3=opaquemat_56, Data4=opaquemat_58)
opaqueconstr_16 = HBOpaqueConstruction(name="Floor_01.04_GRroof", materials=merge_13)  # -> constr; plug-in component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

merge_14 = Merge(Data1=opaquemat_24, Data2=opaquemat_19, Data3=opaquemat_18, Data4=opaquemat_17)
opaqueconstr_17 = HBOpaqueConstruction(name="Floor_01.01", materials=merge_14)  # -> constr; plug-in component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

merge_15 = Merge(Data1=opaquemat_41, Data2=opaquemat_40, Data3=opaquemat_38)
opaqueconstr_18 = HBOpaqueConstruction(name="Wall_01.03", materials=merge_15)  # -> constr; plug-in component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

# ----
# Ground Subset -
# same as interior floors,
# ground & roof must be inverse.
# 
# Base ground & roof construction
# on exterior floor for same archetype
# Make this same thickness as W1
panel_11 = Panel("Wall_01.03_UGwall")
opaqueconstr_19 = HBOpaqueConstruction(name=panel_11, materials=opaquemat_49)  # -> constr; plug-in component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
groundsubset_2 = HBGroundConstructionSubset(ground_wall=opaqueconstr_19, ground_roof=opaqueconstr_16, ground_floor=opaqueconstr_13)  # -> ground_set; plug-in component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
decnstrmat_2 = HBDeconstructMaterial(mat=groundsubset_2)  # -> values, attr_names, r_val_si, r_val_ip; plug-in component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
panel_12 = Panel(groundsubset_2)
panel_13 = Panel(decnstrmat_2.r_val_si)

merge_16 = Merge(Data1=opaquemat_48, Data2=opaquemat_46, Data3=opaquemat_47, Data4=opaquemat_42)
opaqueconstr_20 = HBOpaqueConstruction(name="Floor_01.04", materials=merge_16)  # -> constr; plug-in component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

# ----
# Exterior Subset
exteriorsubset = HBExteriorConstructionSubset(exterior_wall=opaqueconstr_15, exterior_roof=opaqueconstr_5, exposed_floor=opaqueconstr_17)  # -> exterior_set; plug-in component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
panel_14 = Panel(exteriorsubset)
decnstrmat_3 = HBDeconstructMaterial(mat=exteriorsubset)  # -> values, attr_names, r_val_si, r_val_ip; plug-in component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
panel_15 = Panel(decnstrmat_3.r_val_si)

# ----
# Exterior Subset
exteriorsubset_2 = HBExteriorConstructionSubset(exterior_wall=opaqueconstr_18, exterior_roof=opaqueconstr_7, exposed_floor=opaqueconstr_20)  # -> exterior_set; plug-in component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
panel_16 = Panel(exteriorsubset_2)
decnstrmat_4 = HBDeconstructMaterial(mat=exteriorsubset_2)  # -> values, attr_names, r_val_si, r_val_ip; plug-in component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
panel_17 = Panel(decnstrmat_4.r_val_si)

# ----
# Interior Subset -
# Note interior floors & ceilings must
# be inverse of each other
interiorsubset = HBInteriorConstructionSubset(interior_wall=opaqueconstr_2, ceiling=opaqueconstr, interior_floor=opaqueconstr_8)  # -> interior_set; plug-in component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
panel_18 = Panel(interiorsubset)

# ----
# Interior Subset -
# Note interior floors & ceilings must
# be inverse of each other
interiorsubset_2 = HBInteriorConstructionSubset(interior_wall=opaqueconstr_11, ceiling=opaqueconstr_3, interior_floor=opaqueconstr_14)  # -> interior_set; plug-in component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
panel_19 = Panel(interiorsubset_2)

# ----
# EXPORT TO JSON
panel_20 = Panel("pre_1980::ClimateZone4::Mass")
constructionset = HBConstructionSet(
    name="R1SF_CSet",
    base_constr_set=panel_20,
    exterior_subset=exteriorsubset_2,
    ground_subset=groundsubset_2,
    interior_subset=interiorsubset_2,
    subface_subset=subfacesubset)  # -> constr_set; plug-in component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
objtostr = HBObjectToString(hb_obj=constructionset)  # -> hb_str; plug-in component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

# ----
# EXPORT TO JSON
panel_21 = Panel("pre_1980::ClimateZone4::Mass")
constructionset_2 = HBConstructionSet(
    name="R1TH_CSet",
    base_constr_set=panel_21,
    exterior_subset=exteriorsubset,
    ground_subset=groundsubset,
    interior_subset=interiorsubset,
    subface_subset=subfacesubset_2)  # -> constr_set; plug-in component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
objtostr_2 = HBObjectToString(hb_obj=constructionset_2)  # -> hb_str; plug-in component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

# ----
# Library Date Feb 10, 2023
# TH & SF
# BASELINE (as per TABULA)
r1sf_cset = Data("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")
r1th_cset = Data("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")
r2sf_cset = Data("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")
r2th_cset = Data("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")
r3sf_cset = Data("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")
r3th_cset = Data("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")
r4sf_cset = Data("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")
r4th_cset = Data("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")
r5th_cset = Data("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")
r6sf_cset = Data("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")
r6th_cset = Data("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")
r7sf_cset = Data("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")
r7th_cset = Data("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")
r8sf_cset = Data("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")
r8th_cset = Data("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")

r5sf_cset = Data("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")

opaquemat_59 = HBOpaqueMaterial(name="Brick&Stone", thickness="0.360", conductivity="0.900", density="2000", spec_heat="1000", roughness="Rough")  # -> mat; plug-in component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

glassmat_3 = HBGlassMaterial(
    name="Glass_01.01_Single",
    thickness="0.003",
    transmittance="0.817",
    reflectance="0.075",
    emiss_front="0.84",
    emiss_back="0.84",
    conductivity="0.0845")  # -> mat; plug-in component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

opaquemat_60 = HBOpaqueMaterial(
    name="InternalPlaster",
    thickness="0.020",
    conductivity="0.700",
    density="1400",
    spec_heat="1000",
    roughness="MediumSmooth")  # -> mat; plug-in component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

opaquemat_61 = HBOpaqueMaterial(name="CementMortar", thickness="0.020", conductivity="1.400", density="2000", spec_heat="1000", roughness="Rough")  # -> mat; plug-in component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

opaquemat_62 = HBOpaqueMaterial(
    name="InternalPlaster",
    thickness="0.020",
    conductivity="0.700",
    density="1400",
    spec_heat="1000",
    roughness="MediumSmooth")  # -> mat; plug-in component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

opaquemat_63 = HBOpaqueMaterial(
    name="BrickSlabs_ModConductivity",
    thickness=".060",
    conductivity="0.600",
    density="900",
    spec_heat="1000",
    roughness="Rough")  # -> mat; plug-in component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

opaquemat_64 = HBOpaqueMaterial(
    name="InternalPlaster",
    thickness="0.020",
    conductivity="0.700",
    density="1400",
    spec_heat="1000",
    roughness="MediumSmooth")  # -> mat; plug-in component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

opaquemat_65 = HBOpaqueMaterial(name="CeramicTile", thickness="0.015", conductivity="1.470", density="1700", spec_heat="1000", roughness="MediumSmooth")  # -> mat; plug-in component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

opaquemat_66 = HBOpaqueMaterial(
    name="InternalPlaster",
    thickness="0.020",
    conductivity="0.700",
    density="1400",
    spec_heat="1000",
    roughness="MediumSmooth")  # -> mat; plug-in component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

opaquemat_67 = HBOpaqueMaterial(name="CeramicTile", thickness="0.015", conductivity="1.470", density="1700", spec_heat="1000", roughness="MediumSmooth")  # -> mat; plug-in component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

opaquemat_68 = HBOpaqueMaterial(name="CeramicTile", thickness="0.015", conductivity="1.470", density="1700", spec_heat="1000", roughness="MediumSmooth")  # -> mat; plug-in component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

opaquemat_69 = HBOpaqueMaterial(name="Concrete_Reg", thickness="0.100", conductivity="1.160", density="2000", spec_heat="1000", roughness="Rough")  # -> mat; plug-in component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

opaquemat_70 = HBOpaqueMaterial(name="CementMortar_Thick", thickness="0.030", conductivity="1.400", density="2000", spec_heat="1000", roughness="Rough")  # -> mat; plug-in component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

opaquemat_71 = HBOpaqueMaterial(name="CementMortar", thickness="0.020", conductivity="1.400", density="2000", spec_heat="1000", roughness="Rough")  # -> mat; plug-in component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

opaquemat_72 = HBOpaqueMaterial(name="GravelRiverStone", thickness=".147", conductivity="1.200", density="1700", spec_heat="1000", roughness="VeryRough")  # -> mat; plug-in component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

opaquemat_73 = HBOpaqueMaterial(
    name="InternalPlaster",
    thickness="0.020",
    conductivity="0.700",
    density="1400",
    spec_heat="1000",
    roughness="MediumSmooth")  # -> mat; plug-in component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

opaquemat_74 = HBOpaqueMaterial(
    name="BrickSlabs_ModConductivity",
    thickness=".060",
    conductivity="0.600",
    density="900",
    spec_heat="1000",
    roughness="Rough")  # -> mat; plug-in component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

opaquemat_75 = HBOpaqueMaterial(name="Brick&Stone", thickness="0.360", conductivity="0.900", density="2000", spec_heat="1000", roughness="Rough")  # -> mat; plug-in component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

opaquemat_76 = HBOpaqueMaterial(name="WoodDecking", thickness="0.063", conductivity="0.150", density="550", spec_heat="1600", roughness="Rough")  # -> mat; plug-in component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

# ----
# R2TH
opaquemat_77 = HBOpaqueMaterial(name="ExternalPlaster", thickness=".020", conductivity="0.900", density="1800", spec_heat="1000", roughness="Rough")  # -> mat; plug-in component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

opaquemat_78 = HBOpaqueMaterial(name="SolidBrick", thickness=".400", conductivity="0.720", density="1800", spec_heat="1000", roughness="Rough")  # -> mat; plug-in component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

opaquemat_79 = HBOpaqueMaterial(name="CeramicTile", thickness="0.015", conductivity="1.470", density="1700", spec_heat="1000", roughness="MediumSmooth")  # -> mat; plug-in component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

opaquemat_80 = HBOpaqueMaterial(name="CementMortar_Thick", thickness="0.030", conductivity="1.400", density="2000", spec_heat="1000", roughness="Rough")  # -> mat; plug-in component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

opaquemat_81 = HBOpaqueMaterial(name="Concrete_Reg", thickness="0.100", conductivity="1.160", density="2000", spec_heat="1000", roughness="Rough")  # -> mat; plug-in component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

opaquemat_82 = HBOpaqueMaterial(name="GravelRiverStone", thickness=".147", conductivity="1.200", density="1700", spec_heat="1000", roughness="VeryRough")  # -> mat; plug-in component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

opaquemat_83 = HBOpaqueMaterial(name="CeramicTile", thickness="0.015", conductivity="1.470", density="1700", spec_heat="1000", roughness="MediumSmooth")  # -> mat; plug-in component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

opaquemat_84 = HBOpaqueMaterial(name="CementMortar_Thick", thickness="0.030", conductivity="1.400", density="2000", spec_heat="1000", roughness="Rough")  # -> mat; plug-in component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

opaquemat_85 = HBOpaqueMaterial(name="Concrete_Reg", thickness="0.100", conductivity="1.160", density="2000", spec_heat="1000", roughness="Rough")  # -> mat; plug-in component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

opaquemat_86 = HBOpaqueMaterial(name="GravelRiverStone", thickness=".147", conductivity="1.200", density="1700", spec_heat="1000", roughness="VeryRough")  # -> mat; plug-in component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

opaquemat_87 = HBOpaqueMaterial(name="WoodDoor_Single", thickness="0.045", conductivity="0.2813", density="1600", spec_heat="550", roughness="Smooth")  # -> mat; plug-in component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

opaquemat_88 = HBOpaqueMaterial(
    name="InternalPlaster",
    thickness="0.020",
    conductivity="0.700",
    density="1400",
    spec_heat="1000",
    roughness="MediumSmooth")  # -> mat; plug-in component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

opaquemat_89 = HBOpaqueMaterial(name="Brick&Stone", thickness="0.360", conductivity="0.900", density="2000", spec_heat="1000", roughness="Rough")  # -> mat; plug-in component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

opaquemat_90 = HBOpaqueMaterial(name="CementMortar", thickness="0.020", conductivity="1.400", density="2000", spec_heat="1000", roughness="Rough")  # -> mat; plug-in component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

opaquemat_91 = HBOpaqueMaterial(
    name="InternalPlaster",
    thickness="0.020",
    conductivity="0.700",
    density="1400",
    spec_heat="1000",
    roughness="MediumSmooth")  # -> mat; plug-in component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

# ----
# R2SF
opaquemat_92 = HBOpaqueMaterial(name="ExternalPlaster", thickness=".020", conductivity="0.900", density="1800", spec_heat="1000", roughness="Rough")  # -> mat; plug-in component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

opaquemat_93 = HBOpaqueMaterial(
    name="InternalPlaster",
    thickness="0.020",
    conductivity="0.700",
    density="1400",
    spec_heat="1000",
    roughness="MediumSmooth")  # -> mat; plug-in component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

opaquemat_94 = HBOpaqueMaterial(
    name="BrickSlabs_ModConductivity",
    thickness=".060",
    conductivity="0.600",
    density="900",
    spec_heat="1000",
    roughness="Rough")  # -> mat; plug-in component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

opaquemat_95 = HBOpaqueMaterial(name="Brick&Stone", thickness="0.360", conductivity="0.900", density="2000", spec_heat="1000", roughness="VeryRough")  # -> mat; plug-in component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

opaquemat_96 = HBOpaqueMaterial(
    name="InternalPlaster",
    thickness="0.020",
    conductivity="0.700",
    density="1400",
    spec_heat="1000",
    roughness="MediumSmooth")  # -> mat; plug-in component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

opaquemat_97 = HBOpaqueMaterial(name="WoodPlanking", thickness="0.063", conductivity="0.150", density="550", spec_heat="1600", roughness="Rough")  # -> mat; plug-in component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

opaquemat_98 = HBOpaqueMaterial(
    name="InternalPlaster",
    thickness="0.020",
    conductivity="0.700",
    density="1400",
    spec_heat="1000",
    roughness="MediumSmooth")  # -> mat; plug-in component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

opaquemat_99 = HBOpaqueMaterial(name="CeramicTile", thickness="0.015", conductivity="1.470", density="1700", spec_heat="1000", roughness="MediumSmooth")  # -> mat; plug-in component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

opaquemat_100 = HBOpaqueMaterial(name="CeramicTile", thickness="0.015", conductivity="1.470", density="1700", spec_heat="1000", roughness="MediumSmooth")  # -> mat; plug-in component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

opaquemat_101 = HBOpaqueMaterial(name="CeramicTile", thickness="0.015", conductivity="1.470", density="1700", spec_heat="1000", roughness="MediumSmooth")  # -> mat; plug-in component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

opaquemat_102 = HBOpaqueMaterial(name="Concrete_Reg", thickness="0.100", conductivity="1.160", density="2000", spec_heat="1000", roughness="Rough")  # -> mat; plug-in component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

opaquemat_103 = HBOpaqueMaterial(name="CementMortar", thickness="0.020", conductivity="1.400", density="2000", spec_heat="1000", roughness="Rough")  # -> mat; plug-in component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

opaquemat_104 = HBOpaqueMaterial(name="CementMortar_Thick", thickness="0.030", conductivity="1.400", density="2000", spec_heat="1000", roughness="Rough")  # -> mat; plug-in component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

opaquemat_105 = HBOpaqueMaterial(
    name="BrickSlabs_ModConductivity",
    thickness=".060",
    conductivity="0.600",
    density="900",
    spec_heat="1000",
    roughness="Rough")  # -> mat; plug-in component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

opaquemat_106 = HBOpaqueMaterial(name="GravelRiverStone", thickness=".147", conductivity="1.200", density="1700", spec_heat="1000", roughness="VeryRough")  # -> mat; plug-in component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

opaquemat_107 = HBOpaqueMaterial(name="SolidBrick", thickness=".400", conductivity="0.720", density="1800", spec_heat="1000", roughness="Rough")  # -> mat; plug-in component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

opaquemat_108 = HBOpaqueMaterial(name="CeramicTile", thickness="0.015", conductivity="1.470", density="1700", spec_heat="1000", roughness="MediumSmooth")  # -> mat; plug-in component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

opaquemat_109 = HBOpaqueMaterial(name="CementMortar_Thick", thickness="0.030", conductivity="1.400", density="2000", spec_heat="1000", roughness="Rough")  # -> mat; plug-in component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

opaquemat_110 = HBOpaqueMaterial(name="Concrete_Reg", thickness="0.100", conductivity="1.160", density="2000", spec_heat="1000", roughness="Rough")  # -> mat; plug-in component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

opaquemat_111 = HBOpaqueMaterial(name="GravelRiverStone", thickness=".147", conductivity="1.200", density="1700", spec_heat="1000", roughness="VeryRough")  # -> mat; plug-in component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

opaquemat_112 = HBOpaqueMaterial(name="CeramicTile", thickness="0.015", conductivity="1.470", density="1700", spec_heat="1000", roughness="MediumSmooth")  # -> mat; plug-in component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

opaquemat_113 = HBOpaqueMaterial(name="CementMortar_Thick", thickness="0.030", conductivity="1.400", density="2000", spec_heat="1000", roughness="Rough")  # -> mat; plug-in component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

opaquemat_114 = HBOpaqueMaterial(name="Concrete_Reg", thickness="0.100", conductivity="1.160", density="2000", spec_heat="1000", roughness="Rough")  # -> mat; plug-in component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

opaquemat_115 = HBOpaqueMaterial(name="WoodDoor_Single", thickness="0.045", conductivity="0.2813", density="1600", spec_heat="550", roughness="Smooth")  # -> mat; plug-in component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

opaquemat_116 = HBOpaqueMaterial(name="GravelRiverStone", thickness=".147", conductivity="1.200", density="1700", spec_heat="1000", roughness="VeryRough")  # -> mat; plug-in component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

glassmat_4 = HBGlassMaterial(
    name="Glass_01.02_Single",
    thickness="0.003",
    transmittance="0.835",
    reflectance="0.075",
    emiss_front="0.84",
    emiss_back="0.84",
    conductivity="0.435")  # -> mat; plug-in component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

merge_17 = Merge(Data1=opaquemat_65, Data2=opaquemat_61, Data3=opaquemat_63, Data4=opaquemat_66)
opaqueconstr_21 = HBOpaqueConstruction(name="Ceiling_02.02_IntClg", materials=merge_17)  # -> constr; plug-in component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

merge_18 = Merge(Data3=opaquemat_76)
opaqueconstr_22 = HBOpaqueConstruction(name="Roof_01.01", materials=merge_18)  # -> constr; plug-in component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

merge_19 = Merge(Data1=opaquemat_60, Data2=opaquemat_59, Data3=opaquemat_64)
opaqueconstr_23 = HBOpaqueConstruction(name="Wall_01.07_Interior", materials=merge_19)  # -> constr; plug-in component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

merge_20 = Merge(Data1=opaquemat_82, Data2=opaquemat_81, Data3=opaquemat_80, Data4=opaquemat_79)
opaqueconstr_24 = HBOpaqueConstruction(name="Floor_01.04_GRfloor", materials=merge_20)  # -> constr; plug-in component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

merge_21 = Merge(Data1=opaquemat_62, Data2=opaquemat_74, Data3=opaquemat_71, Data4=opaquemat_68)
opaqueconstr_25 = HBOpaqueConstruction(name="Ceiling_02.02_IntFlr", materials=merge_21)  # -> constr; plug-in component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

merge_22 = Merge(Data1=opaquemat_83, Data2=opaquemat_84, Data3=opaquemat_85, Data4=opaquemat_86)
opaqueconstr_26 = HBOpaqueConstruction(name="Floor_01.04_GRroof", materials=merge_22)  # -> constr; plug-in component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

# ----
# Ground Subset -
# same as interior floors,
# ground & roof must be inverse.
# 
# Base ground & roof construction
# on exterior floor for same archetype
# Make this same thickness as W1
panel_22 = Panel("Wall_01.03_UGwall")
opaqueconstr_27 = HBOpaqueConstruction(name=panel_22, materials=opaquemat_78)  # -> constr; plug-in component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
groundsubset_3 = HBGroundConstructionSubset(ground_wall=opaqueconstr_27, ground_roof=opaqueconstr_26, ground_floor=opaqueconstr_24)  # -> ground_set; plug-in component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
decnstrmat_5 = HBDeconstructMaterial(mat=groundsubset_3)  # -> values, attr_names, r_val_si, r_val_ip; plug-in component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
panel_23 = Panel(groundsubset_3)
panel_24 = Panel(decnstrmat_5.r_val_si)

merge_23 = Merge(Data1=opaquemat_77, Data2=opaquemat_75, Data3=opaquemat_73)
opaqueconstr_28 = HBOpaqueConstruction(name="Wall_01.03", materials=merge_23)  # -> constr; plug-in component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

merge_24 = Merge(Data1=opaquemat_72, Data2=opaquemat_69, Data3=opaquemat_70, Data4=opaquemat_67)
opaqueconstr_29 = HBOpaqueConstruction(name="Floor_01.04", materials=merge_24)  # -> constr; plug-in component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

merge_25 = Merge(Data1=opaquemat_97)
opaqueconstr_30 = HBOpaqueConstruction(name="Roof_01.01", materials=merge_25)  # -> constr; plug-in component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

# ----
# Subface Subset
panel_25 = Panel("Window_01.02")
opaqueconstr_31 = HBOpaqueConstruction(name="Door_01.01", materials=opaquemat_115)  # -> constr; plug-in component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
windowconstr_3 = HBWindowConstruction(name=panel_25, materials=glassmat_4)  # -> constr; plug-in component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
decnstrconstr_5 = HBDeconstructConstruction(constr=opaqueconstr_31)  # -> materials, layers, r_val_si, r_val_ip, u_fac_si, u_fac_ip, shgc, t_sol, t_vis; plug-in component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
decnstrconstr_6 = HBDeconstructConstruction(constr=windowconstr_3)  # -> materials, layers, r_val_si, r_val_ip, u_fac_si, u_fac_ip, shgc, t_sol, t_vis; plug-in component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
subfacesubset_3 = HBSubfaceSubset(
    window=windowconstr_3,
    skylight=windowconstr_3,
    operable=windowconstr_3,
    exterior_door=opaqueconstr_31,
    glass_door=windowconstr_3)  # -> subface_set; plug-in component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
panel_26 = Panel([decnstrconstr_6.r_val_si, decnstrconstr_6.u_fac_si, decnstrconstr_6.shgc])
panel_27 = Panel([decnstrconstr_5.r_val_si, decnstrconstr_5.u_fac_si, decnstrconstr_5.shgc])

# ----
# Subface Subset
panel_28 = Panel("Window_01.01")
windowconstr_4 = HBWindowConstruction(name=panel_28, materials=glassmat_3)  # -> constr; plug-in component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
opaqueconstr_32 = HBOpaqueConstruction(name="Door_01.01", materials=opaquemat_87)  # -> constr; plug-in component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
decnstrconstr_7 = HBDeconstructConstruction(constr=opaqueconstr_32)  # -> materials, layers, r_val_si, r_val_ip, u_fac_si, u_fac_ip, shgc, t_sol, t_vis; plug-in component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
decnstrconstr_8 = HBDeconstructConstruction(constr=windowconstr_4)  # -> materials, layers, r_val_si, r_val_ip, u_fac_si, u_fac_ip, shgc, t_sol, t_vis; plug-in component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
subfacesubset_4 = HBSubfaceSubset(
    window=windowconstr_4,
    skylight=windowconstr_4,
    operable=windowconstr_4,
    exterior_door=opaqueconstr_32,
    glass_door=windowconstr_4)  # -> subface_set; plug-in component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
panel_29 = Panel(subfacesubset_4)
panel_30 = Panel([decnstrconstr_7.r_val_si, decnstrconstr_7.u_fac_si, decnstrconstr_7.shgc])
panel_31 = Panel([decnstrconstr_8.r_val_si, decnstrconstr_8.u_fac_si, decnstrconstr_8.shgc])

merge_26 = Merge(Data1=opaquemat_99, Data2=opaquemat_90, Data3=opaquemat_94, Data4=opaquemat_96)
opaqueconstr_33 = HBOpaqueConstruction(name="Ceiling_02.02_IntClg", materials=merge_26)  # -> constr; plug-in component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

merge_27 = Merge(Data1=opaquemat_88, Data2=opaquemat_89, Data3=opaquemat_98)
opaqueconstr_34 = HBOpaqueConstruction(name="Wall_01.03_Interior", materials=merge_27)  # -> constr; plug-in component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

merge_28 = Merge(Data1=opaquemat_111, Data2=opaquemat_110, Data3=opaquemat_109, Data4=opaquemat_108)
opaqueconstr_35 = HBOpaqueConstruction(name="Floor_01.04_GRfloor", materials=merge_28)  # -> constr; plug-in component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

merge_29 = Merge(Data1=opaquemat_91, Data2=opaquemat_105, Data3=opaquemat_103, Data4=opaquemat_101)
opaqueconstr_36 = HBOpaqueConstruction(name="Ceiling_02.02_IntFlr", materials=merge_29)  # -> constr; plug-in component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

merge_30 = Merge(Data1=opaquemat_112, Data2=opaquemat_113, Data3=opaquemat_114, Data4=opaquemat_116)
opaqueconstr_37 = HBOpaqueConstruction(name="Floor_01.04_GRroof", materials=merge_30)  # -> constr; plug-in component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

merge_31 = Merge(Data1=opaquemat_92, Data2=opaquemat_95, Data3=opaquemat_93)
opaqueconstr_38 = HBOpaqueConstruction(name="Wall_01.03", materials=merge_31)  # -> constr; plug-in component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

# ----
# Ground Subset -
# same as interior floors,
# ground & roof must be inverse.
# 
# Base ground & roof construction
# on exterior floor for same archetype
# Make this same thickness as W1
panel_32 = Panel("Wall_01.03_UGwall")
opaqueconstr_39 = HBOpaqueConstruction(name=panel_32, materials=opaquemat_107)  # -> constr; plug-in component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
groundsubset_4 = HBGroundConstructionSubset(ground_wall=opaqueconstr_39, ground_roof=opaqueconstr_37, ground_floor=opaqueconstr_35)  # -> ground_set; plug-in component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
decnstrmat_6 = HBDeconstructMaterial(mat=groundsubset_4)  # -> values, attr_names, r_val_si, r_val_ip; plug-in component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
panel_33 = Panel(groundsubset_4)
panel_34 = Panel(decnstrmat_6.r_val_si)

merge_32 = Merge(Data1=opaquemat_106, Data2=opaquemat_102, Data3=opaquemat_104, Data4=opaquemat_100)
opaqueconstr_40 = HBOpaqueConstruction(name="Floor_01.04", materials=merge_32)  # -> constr; plug-in component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

# ----
# Interior Subset -
# Note interior floors & ceilings must
# be inverse of each other
interiorsubset_3 = HBInteriorConstructionSubset(interior_wall=opaqueconstr_23, ceiling=opaqueconstr_21, interior_floor=opaqueconstr_25)  # -> interior_set; plug-in component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
panel_35 = Panel(interiorsubset_3)

# ----
# Exterior Subset
exteriorsubset_3 = HBExteriorConstructionSubset(exterior_wall=opaqueconstr_28, exterior_roof=opaqueconstr_22, exposed_floor=opaqueconstr_29)  # -> exterior_set; plug-in component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
panel_36 = Panel(exteriorsubset_3)
decnstrmat_7 = HBDeconstructMaterial(mat=exteriorsubset_3)  # -> values, attr_names, r_val_si, r_val_ip; plug-in component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
panel_37 = Panel(decnstrmat_7.r_val_si)

# ----
# Interior Subset -
# Note interior floors & ceilings must
# be inverse of each other
interiorsubset_4 = HBInteriorConstructionSubset(interior_wall=opaqueconstr_34, ceiling=opaqueconstr_33, interior_floor=opaqueconstr_36)  # -> interior_set; plug-in component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
panel_38 = Panel(interiorsubset_4)

# ----
# Exterior Subset
exteriorsubset_4 = HBExteriorConstructionSubset(exterior_wall=opaqueconstr_38, exterior_roof=opaqueconstr_30, exposed_floor=opaqueconstr_40)  # -> exterior_set; plug-in component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
panel_39 = Panel(exteriorsubset_4)
decnstrmat_8 = HBDeconstructMaterial(mat=exteriorsubset_4)  # -> values, attr_names, r_val_si, r_val_ip; plug-in component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
panel_40 = Panel(decnstrmat_8.r_val_si)

# ----
# EXPORT TO JSON
panel_41 = Panel("pre_1980::ClimateZone4::Mass")
constructionset_3 = HBConstructionSet(
    name="R2TH_CSet",
    base_constr_set=panel_41,
    exterior_subset=exteriorsubset_3,
    ground_subset=groundsubset_3,
    interior_subset=interiorsubset_3,
    subface_subset=subfacesubset_4)  # -> constr_set; plug-in component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
objtostr_3 = HBObjectToString(hb_obj=constructionset_3)  # -> hb_str; plug-in component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

panel_42 = Panel(objtostr_3)

# ----
# EXPORT TO JSON
panel_43 = Panel("pre_1980::ClimateZone4::Mass")
constructionset_4 = HBConstructionSet(
    name="R2SF_CSet",
    base_constr_set=panel_43,
    exterior_subset=exteriorsubset_4,
    ground_subset=groundsubset_4,
    interior_subset=interiorsubset_4,
    subface_subset=subfacesubset_3)  # -> constr_set; plug-in component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
objtostr_4 = HBObjectToString(hb_obj=constructionset_4)  # -> hb_str; plug-in component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

panel_44 = Panel(objtostr_4)

opaquemat_117 = HBOpaqueMaterial(
    name="InternalPlaster",
    thickness="0.020",
    conductivity="0.700",
    density="1400",
    spec_heat="1000",
    roughness="MediumSmooth")  # -> mat; plug-in component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

opaquemat_118 = HBOpaqueMaterial(name="SolidBrick", thickness="0.200", conductivity="0.720", density="1800", spec_heat="1000", roughness="Rough")  # -> mat; plug-in component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

opaquemat_119 = HBOpaqueMaterial(
    name="InternalPlaster",
    thickness="0.020",
    conductivity="0.700",
    density="1400",
    spec_heat="1000",
    roughness="MediumSmooth")  # -> mat; plug-in component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

opaquemat_120 = HBOpaqueMaterial(name="CementMortar", thickness="0.020", conductivity="1.400", density="2000", spec_heat="1000", roughness="Rough")  # -> mat; plug-in component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

opaquemat_121 = HBOpaqueMaterial(
    name="InternalPlaster",
    thickness="0.020",
    conductivity="0.700",
    density="1400",
    spec_heat="1000",
    roughness="MediumSmooth")  # -> mat; plug-in component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

opaquemat_122 = HBOpaqueMaterial(
    name="BrickSlabs_ModConductivity",
    thickness=".060",
    conductivity="0.600",
    density="900",
    spec_heat="1000",
    roughness="Rough")  # -> mat; plug-in component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

opaquemat_123 = HBOpaqueMaterial(
    name="InternalPlaster",
    thickness="0.020",
    conductivity="0.700",
    density="1400",
    spec_heat="1000",
    roughness="MediumSmooth")  # -> mat; plug-in component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

opaquemat_124 = HBOpaqueMaterial(name="CeramicTile", thickness="0.015", conductivity="1.470", density="1700", spec_heat="1000", roughness="MediumSmooth")  # -> mat; plug-in component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

opaquemat_125 = HBOpaqueMaterial(name="CeramicTile", thickness="0.015", conductivity="1.470", density="1700", spec_heat="1000", roughness="MediumSmooth")  # -> mat; plug-in component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

opaquemat_126 = HBOpaqueMaterial(name="CementMortar", thickness="0.020", conductivity="1.400", density="2000", spec_heat="1000", roughness="Rough")  # -> mat; plug-in component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

opaquemat_127 = HBOpaqueMaterial(
    name="BrickSlabs_ModConductivity",
    thickness=".060",
    conductivity="0.600",
    density="900",
    spec_heat="1000",
    roughness="Rough")  # -> mat; plug-in component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

opaquemat_128 = HBOpaqueMaterial(name="SolidBrick", thickness=".240", conductivity="0.720", density="1800", spec_heat="1000", roughness="Rough")  # -> mat; plug-in component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

opaquemat_129 = HBOpaqueMaterial(name="CeramicTile", thickness="0.015", conductivity="1.470", density="1700", spec_heat="1000", roughness="MediumSmooth")  # -> mat; plug-in component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

opaquemat_130 = HBOpaqueMaterial(name="CeramicTile", thickness="0.015", conductivity="1.470", density="1700", spec_heat="1000", roughness="MediumSmooth")  # -> mat; plug-in component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

opaquemat_131 = HBOpaqueMaterial(name="CementMortar_Thick", thickness="0.030", conductivity="1.400", density="2000", spec_heat="1000", roughness="Rough")  # -> mat; plug-in component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

opaquemat_132 = HBOpaqueMaterial(name="CementMortar_Thick", thickness="0.030", conductivity="1.400", density="2000", spec_heat="1000", roughness="Rough")  # -> mat; plug-in component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

opaquemat_133 = HBOpaqueMaterial(name="Concrete_Reg", thickness="0.100", conductivity="1.160", density="2000", spec_heat="1000", roughness="Rough")  # -> mat; plug-in component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

opaquemat_134 = HBOpaqueMaterial(name="Concrete_Reg", thickness="0.100", conductivity="1.160", density="2000", spec_heat="1000", roughness="Rough")  # -> mat; plug-in component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

opaquemat_135 = HBOpaqueMaterial(name="GravelRiverStone", thickness=".147", conductivity="1.200", density="1700", spec_heat="1000", roughness="VeryRough")  # -> mat; plug-in component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

opaquematnomass = HBOpaqueMaterialNoMass(name="FictitiousLayer_R0.3", r_value="0.3")  # -> mat; plug-in component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

opaquemat_136 = HBOpaqueMaterial(name="GravelRiverStone", thickness=".147", conductivity="1.200", density="1700", spec_heat="1000", roughness="VeryRough")  # -> mat; plug-in component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

opaquemat_137 = HBOpaqueMaterial(name="CementMortar", thickness="0.020", conductivity="1.400", density="2000", spec_heat="1000", roughness="Rough")  # -> mat; plug-in component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

opaquemat_138 = HBOpaqueMaterial(
    name="BrickSlabs_ModConductivity",
    thickness=".060",
    conductivity="0.600",
    density="900",
    spec_heat="1000",
    roughness="Rough")  # -> mat; plug-in component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

opaquemat_139 = HBOpaqueMaterial(
    name="InternalPlaster",
    thickness="0.020",
    conductivity="0.700",
    density="1400",
    spec_heat="1000",
    roughness="MediumSmooth")  # -> mat; plug-in component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

opaquemat_140 = HBOpaqueMaterial(name="CeramicTile", thickness="0.015", conductivity="1.470", density="1700", spec_heat="1000", roughness="MediumSmooth")  # -> mat; plug-in component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

opaquemat_141 = HBOpaqueMaterial(name="CementMortar_Thick", thickness="0.030", conductivity="1.400", density="2000", spec_heat="1000", roughness="Rough")  # -> mat; plug-in component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

opaquemat_142 = HBOpaqueMaterial(name="Concrete_Reg", thickness="0.100", conductivity="1.160", density="2000", spec_heat="1000", roughness="Rough")  # -> mat; plug-in component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

opaquemat_143 = HBOpaqueMaterial(name="GravelRiverStone", thickness=".147", conductivity="1.200", density="1700", spec_heat="1000", roughness="VeryRough")  # -> mat; plug-in component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

opaquemat_144 = HBOpaqueMaterial(
    name="InternalPlaster",
    thickness="0.020",
    conductivity="0.700",
    density="1400",
    spec_heat="1000",
    roughness="MediumSmooth")  # -> mat; plug-in component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

opaquemat_145 = HBOpaqueMaterial(name="SolidBrick", thickness="0.200", conductivity="0.720", density="1800", spec_heat="1000", roughness="Rough")  # -> mat; plug-in component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

# ----
# R3TH
opaquemat_146 = HBOpaqueMaterial(name="ExternalPlaster", thickness=".020", conductivity="0.900", density="1800", spec_heat="1000", roughness="Rough")  # -> mat; plug-in component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

opaquemat_147 = HBOpaqueMaterial(
    name="InternalPlaster",
    thickness="0.020",
    conductivity="0.700",
    density="1400",
    spec_heat="1000",
    roughness="MediumSmooth")  # -> mat; plug-in component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

opaquemat_148 = HBOpaqueMaterial(name="WoodPlanking", thickness="0.063", conductivity="0.150", density="550", spec_heat="1600", roughness="Rough")  # -> mat; plug-in component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

opaquemat_149 = HBOpaqueMaterial(name="SolidBrick", thickness="0.330", conductivity="0.720", density="1800", spec_heat="1000", roughness="Rough")  # -> mat; plug-in component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

# ----
# R3SF
opaquemat_150 = HBOpaqueMaterial(name="ExternalPlaster", thickness=".020", conductivity="0.900", density="1800", spec_heat="1000", roughness="Rough")  # -> mat; plug-in component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

opaquemat_151 = HBOpaqueMaterial(name="CeramicTile", thickness="0.015", conductivity="1.470", density="1700", spec_heat="1000", roughness="MediumSmooth")  # -> mat; plug-in component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

opaquemat_152 = HBOpaqueMaterial(name="Concrete_Reg", thickness="0.100", conductivity="1.160", density="2000", spec_heat="1000", roughness="Rough")  # -> mat; plug-in component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

opaquemat_153 = HBOpaqueMaterial(name="CementMortar_Thick", thickness="0.030", conductivity="1.400", density="2000", spec_heat="1000", roughness="Rough")  # -> mat; plug-in component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

opaquemat_154 = HBOpaqueMaterial(name="GravelRiverStone", thickness=".147", conductivity="1.200", density="1700", spec_heat="1000", roughness="VeryRough")  # -> mat; plug-in component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

opaquemat_155 = HBOpaqueMaterial(name="WoodDoor_Single", thickness="0.045", conductivity="0.2813", density="1600", spec_heat="550", roughness="Smooth")  # -> mat; plug-in component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

opaquemat_156 = HBOpaqueMaterial(name="SolidBrick", thickness="0.330", conductivity="0.720", density="1800", spec_heat="1000", roughness="Rough")  # -> mat; plug-in component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

opaquemat_157 = HBOpaqueMaterial(
    name="InternalPlaster",
    thickness="0.020",
    conductivity="0.700",
    density="1400",
    spec_heat="1000",
    roughness="MediumSmooth")  # -> mat; plug-in component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

opaquemat_158 = HBOpaqueMaterial(
    name="InternalPlaster",
    thickness="0.020",
    conductivity="0.700",
    density="1400",
    spec_heat="1000",
    roughness="MediumSmooth")  # -> mat; plug-in component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

opaquemat_159 = HBOpaqueMaterial(name="CementMortar", thickness="0.020", conductivity="1.400", density="2000", spec_heat="1000", roughness="Rough")  # -> mat; plug-in component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

opaquemat_160 = HBOpaqueMaterial(
    name="InternalPlaster",
    thickness="0.020",
    conductivity="0.700",
    density="1400",
    spec_heat="1000",
    roughness="MediumSmooth")  # -> mat; plug-in component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

opaquemat_161 = HBOpaqueMaterial(
    name="BrickSlabs_ModConductivity",
    thickness=".060",
    conductivity="0.600",
    density="900",
    spec_heat="1000",
    roughness="Rough")  # -> mat; plug-in component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

opaquemat_162 = HBOpaqueMaterial(
    name="InternalPlaster",
    thickness="0.020",
    conductivity="0.700",
    density="1400",
    spec_heat="1000",
    roughness="MediumSmooth")  # -> mat; plug-in component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

opaquemat_163 = HBOpaqueMaterial(name="CeramicTile", thickness="0.015", conductivity="1.470", density="1700", spec_heat="1000", roughness="MediumSmooth")  # -> mat; plug-in component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

opaquemat_164 = HBOpaqueMaterial(name="CeramicTile", thickness="0.015", conductivity="1.470", density="1700", spec_heat="1000", roughness="MediumSmooth")  # -> mat; plug-in component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

opaquemat_165 = HBOpaqueMaterial(name="CementMortar", thickness="0.020", conductivity="1.400", density="2000", spec_heat="1000", roughness="Rough")  # -> mat; plug-in component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

opaquemat_166 = HBOpaqueMaterial(
    name="BrickSlabs_ModConductivity",
    thickness=".060",
    conductivity="0.600",
    density="900",
    spec_heat="1000",
    roughness="Rough")  # -> mat; plug-in component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

opaquemat_167 = HBOpaqueMaterial(name="SolidBrick", thickness=".370", conductivity="0.720", density="1800", spec_heat="1000", roughness="Rough")  # -> mat; plug-in component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

opaquemat_168 = HBOpaqueMaterial(name="CeramicTile", thickness="0.015", conductivity="1.470", density="1700", spec_heat="1000", roughness="MediumSmooth")  # -> mat; plug-in component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

opaquemat_169 = HBOpaqueMaterial(name="CementMortar_Thick", thickness="0.030", conductivity="1.400", density="2000", spec_heat="1000", roughness="Rough")  # -> mat; plug-in component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

opaquemat_170 = HBOpaqueMaterial(name="Concrete_Reg", thickness="0.100", conductivity="1.160", density="2000", spec_heat="1000", roughness="Rough")  # -> mat; plug-in component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

opaquemat_171 = HBOpaqueMaterial(name="GravelRiverStone", thickness=".147", conductivity="1.200", density="1700", spec_heat="1000", roughness="VeryRough")  # -> mat; plug-in component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

opaquemat_172 = HBOpaqueMaterial(name="CeramicTile", thickness="0.015", conductivity="1.470", density="1700", spec_heat="1000", roughness="MediumSmooth")  # -> mat; plug-in component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

opaquemat_173 = HBOpaqueMaterial(name="CementMortar_Thick", thickness="0.030", conductivity="1.400", density="2000", spec_heat="1000", roughness="Rough")  # -> mat; plug-in component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

opaquemat_174 = HBOpaqueMaterial(name="Concrete_Reg", thickness="0.100", conductivity="1.160", density="2000", spec_heat="1000", roughness="Rough")  # -> mat; plug-in component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

opaquemat_175 = HBOpaqueMaterial(name="GravelRiverStone", thickness=".147", conductivity="1.200", density="1700", spec_heat="1000", roughness="VeryRough")  # -> mat; plug-in component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

opaquemat_176 = HBOpaqueMaterial(name="WoodDoor_Single", thickness="0.045", conductivity="0.2813", density="1600", spec_heat="550", roughness="Smooth")  # -> mat; plug-in component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

glassmat_5 = HBGlassMaterial(
    name="Glass_01.01_Single",
    thickness="0.003",
    transmittance="0.817",
    reflectance="0.075",
    emiss_front="0.84",
    emiss_back="0.84",
    conductivity="0.0845")  # -> mat; plug-in component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

merge_33 = Merge(Data1=opaquemat_124, Data2=opaquemat_120, Data3=opaquemat_122, Data4=opaquemat_123)
opaqueconstr_41 = HBOpaqueConstruction(name="Ceiling_02.02_IntClg", materials=merge_33)  # -> constr; plug-in component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

merge_34 = Merge(Data1=opaquemat_117, Data2=opaquemat_118, Data3=opaquemat_119)
opaqueconstr_42 = HBOpaqueConstruction(name="Wall_01.05_Interior", materials=merge_34)  # -> constr; plug-in component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

merge_35 = Merge(Data1=opaquemat_121, Data2=opaquemat_127, Data3=opaquemat_126, Data4=opaquemat_125)
opaqueconstr_43 = HBOpaqueConstruction(name="Ceiling_02.02_IntFlr", materials=merge_35)  # -> constr; plug-in component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

merge_36 = Merge(Data1=opaquemat_135, Data2=opaquemat_134, Data3=opaquemat_131, Data4=opaquemat_129)
opaqueconstr_44 = HBOpaqueConstruction(name="Floor_01.04_GRfloor", materials=merge_36)  # -> constr; plug-in component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

merge_37 = Merge(Data1=opaquemat_140, Data2=opaquemat_141, Data3=opaquemat_142, Data4=opaquemat_143)
opaqueconstr_45 = HBOpaqueConstruction(name="Floor_01.04_GRroof", materials=merge_37)  # -> constr; plug-in component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

# ----
# Ground Subset -
# same as interior floors,
# ground & roof must be inverse.
# 
# Base ground & roof construction
# on exterior floor for same archetype
# Make this same thickness as W1
panel_45 = Panel("Wall_01.05_UGwall")
opaqueconstr_46 = HBOpaqueConstruction(name=panel_45, materials=opaquemat_128)  # -> constr; plug-in component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
groundsubset_5 = HBGroundConstructionSubset(ground_wall=opaqueconstr_46, ground_roof=opaqueconstr_45, ground_floor=opaqueconstr_44)  # -> ground_set; plug-in component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
decnstrmat_9 = HBDeconstructMaterial(mat=groundsubset_5)  # -> values, attr_names, r_val_si, r_val_ip; plug-in component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
panel_46 = Panel(groundsubset_5)
panel_47 = Panel(decnstrmat_9.r_val_si)

merge_38 = Merge(Data1=opaquemat_148)
opaqueconstr_47 = HBOpaqueConstruction(name="Roof_01.01", materials=merge_38)  # -> constr; plug-in component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

merge_39 = Merge(Data1=opaquemat_136, Data2=opaquemat_133, Data3=opaquemat_132, Data4=opaquemat_130)
opaqueconstr_48 = HBOpaqueConstruction(name="Floor_01.04", materials=merge_39)  # -> constr; plug-in component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

merge_40 = Merge(Data1=opaquematnomass, Data2=opaquemat_137, Data3=opaquemat_138, Data4=opaquemat_139)
opaqueconstr_49 = HBOpaqueConstruction(name="Ceiling_02.02", materials=merge_40)  # -> constr; plug-in component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

merge_41 = Merge(Data1=opaquemat_146, Data2=opaquemat_145, Data3=opaquemat_144)
opaqueconstr_50 = HBOpaqueConstruction(name="Wall_01.05", materials=merge_41)  # -> constr; plug-in component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

merge_42 = Merge(Data1=opaquemat_150, Data2=opaquemat_149, Data3=opaquemat_147)
opaqueconstr_51 = HBOpaqueConstruction(name="Wall_01.06", materials=merge_42)  # -> constr; plug-in component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

# ----
# Subface Subset
panel_48 = Panel("Glass_01.02_Single")
glassmat_6 = HBGlassMaterial(
    name=panel_48,
    thickness="0.003",
    transmittance="0.835",
    reflectance="0.075",
    emiss_front="0.84",
    emiss_back="0.84",
    conductivity="0.435")  # -> mat; plug-in component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
windowconstr_5 = HBWindowConstruction(name="Window_01.02", materials=glassmat_6)  # -> constr; plug-in component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
opaqueconstr_52 = HBOpaqueConstruction(name="Door_01.01", materials=opaquemat_155)  # -> constr; plug-in component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
decnstrconstr_9 = HBDeconstructConstruction(constr=opaqueconstr_52)  # -> materials, layers, r_val_si, r_val_ip, u_fac_si, u_fac_ip, shgc, t_sol, t_vis; plug-in component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
decnstrconstr_10 = HBDeconstructConstruction(constr=windowconstr_5)  # -> materials, layers, r_val_si, r_val_ip, u_fac_si, u_fac_ip, shgc, t_sol, t_vis; plug-in component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
subfacesubset_5 = HBSubfaceSubset(
    window=windowconstr_5,
    skylight=windowconstr_5,
    operable=windowconstr_5,
    exterior_door=opaqueconstr_52,
    glass_door=windowconstr_5)  # -> subface_set; plug-in component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
panel_49 = Panel(subfacesubset_5)
panel_50 = Panel([decnstrconstr_9.r_val_si, decnstrconstr_9.u_fac_si, decnstrconstr_9.shgc])
panel_51 = Panel([decnstrconstr_10.r_val_si, decnstrconstr_10.u_fac_si, decnstrconstr_10.shgc])

merge_43 = Merge(Data1=opaquemat_154, Data2=opaquemat_152, Data3=opaquemat_153, Data4=opaquemat_151)
opaqueconstr_53 = HBOpaqueConstruction(name="Floor_01.04", materials=merge_43)  # -> constr; plug-in component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

merge_44 = Merge(Data1=opaquemat_163, Data2=opaquemat_159, Data3=opaquemat_161, Data4=opaquemat_162)
opaqueconstr_54 = HBOpaqueConstruction(name="Ceiling_02.02_IntClg", materials=merge_44)  # -> constr; plug-in component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

merge_45 = Merge(Data1=opaquemat_157, Data2=opaquemat_156, Data3=opaquemat_158)
opaqueconstr_55 = HBOpaqueConstruction(name="Wall_01.06_Interior", materials=merge_45)  # -> constr; plug-in component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

merge_46 = Merge(Data1=opaquemat_171, Data2=opaquemat_170, Data3=opaquemat_169, Data4=opaquemat_168)
opaqueconstr_56 = HBOpaqueConstruction(name="Floor_01.04_GRfloor", materials=merge_46)  # -> constr; plug-in component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

merge_47 = Merge(Data1=opaquemat_160, Data2=opaquemat_166, Data3=opaquemat_165, Data4=opaquemat_164)
opaqueconstr_57 = HBOpaqueConstruction(name="Ceiling_02.02_IntFlr", materials=merge_47)  # -> constr; plug-in component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

# ----
# Subface Subset
panel_52 = Panel("Window_01.01")
windowconstr_6 = HBWindowConstruction(name=panel_52, materials=glassmat_5)  # -> constr; plug-in component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
opaqueconstr_58 = HBOpaqueConstruction(name="Door_01.01", materials=opaquemat_176)  # -> constr; plug-in component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
decnstrconstr_11 = HBDeconstructConstruction(constr=opaqueconstr_58)  # -> materials, layers, r_val_si, r_val_ip, u_fac_si, u_fac_ip, shgc, t_sol, t_vis; plug-in component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
decnstrconstr_12 = HBDeconstructConstruction(constr=windowconstr_6)  # -> materials, layers, r_val_si, r_val_ip, u_fac_si, u_fac_ip, shgc, t_sol, t_vis; plug-in component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
subfacesubset_6 = HBSubfaceSubset(
    window=windowconstr_6,
    skylight=windowconstr_6,
    operable=windowconstr_6,
    exterior_door=opaqueconstr_58,
    glass_door=windowconstr_6)  # -> subface_set; plug-in component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
panel_53 = Panel(subfacesubset_6)
panel_54 = Panel([decnstrconstr_11.r_val_si, decnstrconstr_11.u_fac_si, decnstrconstr_11.shgc])
panel_55 = Panel([decnstrconstr_12.r_val_si, decnstrconstr_12.u_fac_si, decnstrconstr_12.shgc])

merge_48 = Merge(Data1=opaquemat_172, Data2=opaquemat_173, Data3=opaquemat_174, Data4=opaquemat_175)
opaqueconstr_59 = HBOpaqueConstruction(name="Floor_01.04_GRroof", materials=merge_48)  # -> constr; plug-in component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

# ----
# Ground Subset -
# same as interior floors,
# ground & roof must be inverse.
# 
# Base ground & roof construction
# on exterior floor for same archetype
# Make this same thickness as W1
panel_56 = Panel("Wall_01.06_UGwall")
opaqueconstr_60 = HBOpaqueConstruction(name=panel_56, materials=opaquemat_167)  # -> constr; plug-in component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
groundsubset_6 = HBGroundConstructionSubset(ground_wall=opaqueconstr_60, ground_roof=opaqueconstr_59, ground_floor=opaqueconstr_56)  # -> ground_set; plug-in component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
decnstrmat_10 = HBDeconstructMaterial(mat=groundsubset_6)  # -> values, attr_names, r_val_si, r_val_ip; plug-in component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
panel_57 = Panel(groundsubset_6)
panel_58 = Panel(decnstrmat_10.r_val_si)

# ----
# Interior Subset -
# Note interior floors & ceilings must
# be inverse of each other
interiorsubset_5 = HBInteriorConstructionSubset(interior_wall=opaqueconstr_42, ceiling=opaqueconstr_41, interior_floor=opaqueconstr_43)  # -> interior_set; plug-in component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
panel_59 = Panel(interiorsubset_5)

# ----
# Exterior Subset
exteriorsubset_5 = HBExteriorConstructionSubset(exterior_wall=opaqueconstr_50, exterior_roof=opaqueconstr_49, exposed_floor=opaqueconstr_48)  # -> exterior_set; plug-in component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
panel_60 = Panel(exteriorsubset_5)
decnstrmat_11 = HBDeconstructMaterial(mat=exteriorsubset_5)  # -> values, attr_names, r_val_si, r_val_ip; plug-in component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
panel_61 = Panel(decnstrmat_11.r_val_si)

# ----
# Exterior Subset
exteriorsubset_6 = HBExteriorConstructionSubset(exterior_wall=opaqueconstr_51, exterior_roof=opaqueconstr_47, exposed_floor=opaqueconstr_53)  # -> exterior_set; plug-in component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
panel_62 = Panel(exteriorsubset_6)
decnstrmat_12 = HBDeconstructMaterial(mat=exteriorsubset_6)  # -> values, attr_names, r_val_si, r_val_ip; plug-in component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
panel_63 = Panel(decnstrmat_12.r_val_si)

# ----
# Interior Subset -
# Note interior floors & ceilings must
# be inverse of each other
interiorsubset_6 = HBInteriorConstructionSubset(interior_wall=opaqueconstr_55, ceiling=opaqueconstr_54, interior_floor=opaqueconstr_57)  # -> interior_set; plug-in component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
panel_64 = Panel(interiorsubset_6)

# ----
# EXPORT TO JSON
panel_65 = Panel("pre_1980::ClimateZone4::Mass")
constructionset_5 = HBConstructionSet(
    name="R3TH_CSet",
    base_constr_set=panel_65,
    exterior_subset=exteriorsubset_5,
    ground_subset=groundsubset_5,
    interior_subset=interiorsubset_5,
    subface_subset=subfacesubset_5)  # -> constr_set; plug-in component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
objtostr_5 = HBObjectToString(hb_obj=constructionset_5)  # -> hb_str; plug-in component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

panel_66 = Panel(objtostr_5)

# ----
# EXPORT TO JSON
panel_67 = Panel("pre_1980::ClimateZone4::Mass")
constructionset_6 = HBConstructionSet(
    name="R3SF_CSet",
    base_constr_set=panel_67,
    exterior_subset=exteriorsubset_6,
    ground_subset=groundsubset_6,
    interior_subset=interiorsubset_6,
    subface_subset=subfacesubset_6)  # -> constr_set; plug-in component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
objtostr_6 = HBObjectToString(hb_obj=constructionset_6)  # -> hb_str; plug-in component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

panel_68 = Panel(objtostr_6)

opaquemat_177 = HBOpaqueMaterial(name="LtwtConcScreed_6.5cm", thickness=".065", conductivity=".580", density="900", spec_heat="1000", roughness="Rough")  # -> mat; plug-in component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

opaquemat_178 = HBOpaqueMaterial(
    name="InternalPlaster",
    thickness="0.020",
    conductivity="0.700",
    density="1400",
    spec_heat="1000",
    roughness="MediumSmooth")  # -> mat; plug-in component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

opaquemat_179 = HBOpaqueMaterial(name="SolidBrick", thickness="0.330", conductivity="0.720", density="1800", spec_heat="1000", roughness="Rough")  # -> mat; plug-in component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

opaquemat_180 = HBOpaqueMaterial(name="CementMortar", thickness="0.020", conductivity="1.400", density="2000", spec_heat="1000", roughness="Rough")  # -> mat; plug-in component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

opaquemat_181 = HBOpaqueMaterial(
    name="InternalPlaster",
    thickness="0.020",
    conductivity="0.700",
    density="1400",
    spec_heat="1000",
    roughness="MediumSmooth")  # -> mat; plug-in component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

opaquemat_182 = HBOpaqueMaterial(
    name="Slab_BrickBlkConc_24cm",
    thickness=".240",
    conductivity="0.715",
    density="900",
    spec_heat="1000",
    roughness="Rough")  # -> mat; plug-in component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

opaquemat_183 = HBOpaqueMaterial(name="CeramicTile", thickness="0.015", conductivity="1.470", density="1700", spec_heat="1000", roughness="MediumSmooth")  # -> mat; plug-in component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

opaquemat_184 = HBOpaqueMaterial(name="CementMortar", thickness="0.020", conductivity="1.400", density="2000", spec_heat="1000", roughness="Rough")  # -> mat; plug-in component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

opaquemat_185 = HBOpaqueMaterial(
    name="InternalPlaster",
    thickness="0.020",
    conductivity="0.700",
    density="1400",
    spec_heat="1000",
    roughness="MediumSmooth")  # -> mat; plug-in component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

opaquemat_186 = HBOpaqueMaterial(
    name="InternalPlaster",
    thickness="0.020",
    conductivity="0.700",
    density="1400",
    spec_heat="1000",
    roughness="MediumSmooth")  # -> mat; plug-in component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

opaquemat_187 = HBOpaqueMaterial(name="CementMortar", thickness="0.020", conductivity="1.400", density="2000", spec_heat="1000", roughness="Rough")  # -> mat; plug-in component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

opaquemat_188 = HBOpaqueMaterial(
    name="Slab_BrickBlkConc_24cm",
    thickness=".240",
    conductivity="0.715",
    density="900",
    spec_heat="1000",
    roughness="Rough")  # -> mat; plug-in component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

opaquemat_189 = HBOpaqueMaterial(name="LtwtConcScreed_6.5cm", thickness=".065", conductivity=".580", density="900", spec_heat="1000", roughness="Rough")  # -> mat; plug-in component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

opaquemat_190 = HBOpaqueMaterial(name="CementMortar", thickness="0.020", conductivity="1.400", density="2000", spec_heat="1000", roughness="Rough")  # -> mat; plug-in component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

opaquemat_191 = HBOpaqueMaterial(name="CeramicTile", thickness="0.015", conductivity="1.470", density="1700", spec_heat="1000", roughness="MediumSmooth")  # -> mat; plug-in component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

opaquemat_192 = HBOpaqueMaterial(name="CeramicTile", thickness="0.015", conductivity="1.470", density="1700", spec_heat="1000", roughness="MediumSmooth")  # -> mat; plug-in component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

opaquemat_193 = HBOpaqueMaterial(name="Concrete_Reg", thickness="0.100", conductivity="1.160", density="2000", spec_heat="1000", roughness="Rough")  # -> mat; plug-in component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

opaquemat_194 = HBOpaqueMaterial(name="CementMortar_Thick", thickness="0.030", conductivity="1.400", density="2000", spec_heat="1000", roughness="Rough")  # -> mat; plug-in component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

opaquemat_195 = HBOpaqueMaterial(name="CementMortar", thickness="0.020", conductivity="1.400", density="2000", spec_heat="1000", roughness="Rough")  # -> mat; plug-in component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

opaquemat_196 = HBOpaqueMaterial(name="SolidBrick", thickness=".370", conductivity="0.720", density="1800", spec_heat="1000", roughness="Rough")  # -> mat; plug-in component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

opaquemat_197 = HBOpaqueMaterial(
    name="InternalPlaster",
    thickness="0.020",
    conductivity="0.700",
    density="1400",
    spec_heat="1000",
    roughness="MediumSmooth")  # -> mat; plug-in component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

opaquemat_198 = HBOpaqueMaterial(name="CeramicTile", thickness="0.015", conductivity="1.470", density="1700", spec_heat="1000", roughness="MediumSmooth")  # -> mat; plug-in component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

opaquemat_199 = HBOpaqueMaterial(name="ReinforcedConcrete", thickness="0.040", conductivity="1.910", density="2400", spec_heat="1000", roughness="Rough")  # -> mat; plug-in component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

opaquemat_200 = HBOpaqueMaterial(
    name="Slab_BrickBlkConc_16cm",
    thickness=".160",
    conductivity="0.582",
    density="900",
    spec_heat="1000",
    roughness="Rough")  # -> mat; plug-in component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

opaquemat_201 = HBOpaqueMaterial(name="WoodDoor_Single", thickness="0.045", conductivity="0.2813", density="1600", spec_heat="550", roughness="Smooth")  # -> mat; plug-in component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

opaquemat_202 = HBOpaqueMaterial(name="CementMortar_Thick", thickness="0.030", conductivity="1.400", density="2000", spec_heat="1000", roughness="Rough")  # -> mat; plug-in component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

# ----
# R4SF
opaquemat_203 = HBOpaqueMaterial(name="ExternalPlaster", thickness=".020", conductivity="0.900", density="1800", spec_heat="1000", roughness="Rough")  # -> mat; plug-in component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

opaquemat_204 = HBOpaqueMaterial(name="SolidBrick", thickness="0.330", conductivity="0.720", density="1800", spec_heat="1000", roughness="Rough")  # -> mat; plug-in component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

opaquemat_205 = HBOpaqueMaterial(name="GravelRiverStone", thickness=".147", conductivity="1.200", density="1700", spec_heat="1000", roughness="VeryRough")  # -> mat; plug-in component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

opaquemat_206 = HBOpaqueMaterial(name="Concrete_Reg", thickness="0.100", conductivity="1.160", density="2000", spec_heat="1000", roughness="Rough")  # -> mat; plug-in component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

opaquemat_207 = HBOpaqueMaterial(name="GravelRiverStone", thickness=".147", conductivity="1.200", density="1700", spec_heat="1000", roughness="VeryRough")  # -> mat; plug-in component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

glassmat_7 = HBGlassMaterial(
    name="Glass_01.01_Single",
    thickness="0.003",
    transmittance="0.817",
    reflectance="0.075",
    emiss_front="0.84",
    emiss_back="0.84",
    conductivity="0.0845")  # -> mat; plug-in component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

opaquemat_208 = HBOpaqueMaterial(name="SolidBrick", thickness=".300", conductivity="0.720", density="1800", spec_heat="1000", roughness="Rough")  # -> mat; plug-in component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

opaquemat_209 = HBOpaqueMaterial(name="CeramicTile", thickness="0.015", conductivity="1.470", density="1700", spec_heat="1000", roughness="MediumSmooth")  # -> mat; plug-in component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

opaquemat_210 = HBOpaqueMaterial(name="CementMortar_Thick", thickness="0.030", conductivity="1.400", density="2000", spec_heat="1000", roughness="Rough")  # -> mat; plug-in component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

opaquemat_211 = HBOpaqueMaterial(
    name="Slab_BrickBlkConc_24cm",
    thickness=".240",
    conductivity="0.715",
    density="900",
    spec_heat="1000",
    roughness="Rough")  # -> mat; plug-in component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

opaquemat_212 = HBOpaqueMaterial(name="Concrete_Reg", thickness="0.100", conductivity="1.160", density="2000", spec_heat="1000", roughness="Rough")  # -> mat; plug-in component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

opaquematnomass_2 = HBOpaqueMaterialNoMass(name="FictitiousLayer_R0.3", r_value="0.3")  # -> mat; plug-in component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

opaquemat_213 = HBOpaqueMaterial(name="ExternalPlaster", thickness=".020", conductivity="0.900", density="1800", spec_heat="1000", roughness="Rough")  # -> mat; plug-in component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

opaquemat_214 = HBOpaqueMaterial(name="LtwtConcScreed_6.5cm", thickness=".065", conductivity=".580", density="900", spec_heat="1000", roughness="Rough")  # -> mat; plug-in component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

opaquemat_215 = HBOpaqueMaterial(name="CeramicTile", thickness="0.015", conductivity="1.470", density="1700", spec_heat="1000", roughness="MediumSmooth")  # -> mat; plug-in component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

opaquemat_216 = HBOpaqueMaterial(name="CementMortar", thickness="0.020", conductivity="1.400", density="2000", spec_heat="1000", roughness="Rough")  # -> mat; plug-in component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

opaquemat_217 = HBOpaqueMaterial(name="GravelRiverStone", thickness=".147", conductivity="1.200", density="1700", spec_heat="1000", roughness="VeryRough")  # -> mat; plug-in component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

opaquemat_218 = HBOpaqueMaterial(name="CementMortar", thickness="0.020", conductivity="1.400", density="2000", spec_heat="1000", roughness="Rough")  # -> mat; plug-in component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

opaquemat_219 = HBOpaqueMaterial(name="LtwtConcScreed_6.5cm", thickness=".065", conductivity=".580", density="900", spec_heat="1000", roughness="Rough")  # -> mat; plug-in component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
opaquematnomass_3 = HBOpaqueMaterialNoMass(name="FictitiousLayer_R0.3", r_value="0.3")  # -> mat; plug-in component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

opaquemat_220 = HBOpaqueMaterial(
    name="InternalPlaster",
    thickness="0.020",
    conductivity="0.700",
    density="1400",
    spec_heat="1000",
    roughness="MediumSmooth")  # -> mat; plug-in component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

opaquemat_221 = HBOpaqueMaterial(name="Concrete_Prefab", thickness="0.140", conductivity="0.500", density="2400", spec_heat="1000", roughness="Rough")  # -> mat; plug-in component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

opaquemat_222 = HBOpaqueMaterial(name="CementMortar", thickness="0.020", conductivity="1.400", density="2000", spec_heat="1000", roughness="Rough")  # -> mat; plug-in component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

opaquemat_223 = HBOpaqueMaterial(
    name="InternalPlaster",
    thickness="0.020",
    conductivity="0.700",
    density="1400",
    spec_heat="1000",
    roughness="MediumSmooth")  # -> mat; plug-in component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

opaquemat_224 = HBOpaqueMaterial(name="ExternalPlaster", thickness=".020", conductivity="0.900", density="1800", spec_heat="1000", roughness="Rough")  # -> mat; plug-in component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

opaquemat_225 = HBOpaqueMaterial(name="CeramicTile", thickness="0.015", conductivity="1.470", density="1700", spec_heat="1000", roughness="MediumSmooth")  # -> mat; plug-in component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

opaquemat_226 = HBOpaqueMaterial(
    name="Slab_BrickBlkConc_24cm",
    thickness=".240",
    conductivity="0.715",
    density="900",
    spec_heat="1000",
    roughness="Rough")  # -> mat; plug-in component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

opaquemat_227 = HBOpaqueMaterial(name="CementMortar", thickness="0.020", conductivity="1.400", density="2000", spec_heat="1000", roughness="Rough")  # -> mat; plug-in component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

opaquemat_228 = HBOpaqueMaterial(
    name="InternalPlaster",
    thickness="0.020",
    conductivity="0.700",
    density="1400",
    spec_heat="1000",
    roughness="MediumSmooth")  # -> mat; plug-in component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

opaquemat_229 = HBOpaqueMaterial(name="CementMortar", thickness="0.020", conductivity="1.400", density="2000", spec_heat="1000", roughness="Rough")  # -> mat; plug-in component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

opaquemat_230 = HBOpaqueMaterial(
    name="InternalPlaster_XThin",
    thickness="0.0045",
    conductivity="0.700",
    density="1400",
    spec_heat="1000",
    roughness="MediumSmooth")  # -> mat; plug-in component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

opaquemat_231 = HBOpaqueMaterial(name="CeramicTile", thickness="0.015", conductivity="1.470", density="1700", spec_heat="1000", roughness="MediumSmooth")  # -> mat; plug-in component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

opaquemat_232 = HBOpaqueMaterial(name="LtwtConcScreed_6.5cm", thickness=".065", conductivity=".580", density="900", spec_heat="1000", roughness="Rough")  # -> mat; plug-in component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

opaquemat_233 = HBOpaqueMaterial(name="CementMortar", thickness="0.020", conductivity="1.400", density="2000", spec_heat="1000", roughness="Rough")  # -> mat; plug-in component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

opaquemat_234 = HBOpaqueMaterial(name="CementMortar", thickness="0.020", conductivity="1.400", density="2000", spec_heat="1000", roughness="Rough")  # -> mat; plug-in component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

opaquemat_235 = HBOpaqueMaterial(
    name="InternalPlaster",
    thickness="0.020",
    conductivity="0.700",
    density="1400",
    spec_heat="1000",
    roughness="MediumSmooth")  # -> mat; plug-in component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

opaquemat_236 = HBOpaqueMaterial(
    name="Slab_BrickBlkConc_24cm",
    thickness=".240",
    conductivity="0.715",
    density="900",
    spec_heat="1000",
    roughness="Rough")  # -> mat; plug-in component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

opaquemat_237 = HBOpaqueMaterial(
    name="Slab_BrickBlkConc_24cm",
    thickness=".240",
    conductivity="0.715",
    density="900",
    spec_heat="1000",
    roughness="Rough")  # -> mat; plug-in component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

opaquemat_238 = HBOpaqueMaterial(name="LtwtConcScreed_6.5cm", thickness=".065", conductivity=".580", density="900", spec_heat="1000", roughness="Rough")  # -> mat; plug-in component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

opaquemat_239 = HBOpaqueMaterial(name="HollowBrick_8cm", thickness="0.080", conductivity="0.400", density="800", spec_heat="1000", roughness="Rough")  # -> mat; plug-in component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

# ----
# R4TH
opaquemat_240 = HBOpaqueMaterial(
    name="ExternalPlaster_XThin",
    thickness=".0045",
    conductivity="0.900",
    density="1800",
    spec_heat="1000",
    roughness="Rough")  # -> mat; plug-in component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

opaquemat_241 = HBOpaqueMaterial(name="HollowBrick_12cm", thickness="0.120", conductivity="0.387", density="800", spec_heat="1000", roughness="Rough")  # -> mat; plug-in component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

opaquemat_242 = HBOpaqueMaterial(name="CementMortar", thickness="0.020", conductivity="1.400", density="2000", spec_heat="1000", roughness="Rough")  # -> mat; plug-in component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

opaquematnomass_4 = HBOpaqueMaterialNoMass(name="CavityWallGap_R0.18", r_value="0.18")  # -> mat; plug-in component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

opaquemat_243 = HBOpaqueMaterial(name="CeramicTile", thickness="0.015", conductivity="1.470", density="1700", spec_heat="1000", roughness="MediumSmooth")  # -> mat; plug-in component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

opaquemat_244 = HBOpaqueMaterial(name="CementMortar", thickness="0.020", conductivity="1.400", density="2000", spec_heat="1000", roughness="Rough")  # -> mat; plug-in component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

opaquemat_245 = HBOpaqueMaterial(name="ReinforcedConcrete", thickness="0.040", conductivity="1.910", density="2400", spec_heat="1000", roughness="Rough")  # -> mat; plug-in component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

opaquemat_246 = HBOpaqueMaterial(
    name="Slab_BrickBlkConc_16cm",
    thickness=".160",
    conductivity="0.582",
    density="900",
    spec_heat="1000",
    roughness="Rough")  # -> mat; plug-in component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

opaquematnomass_5 = HBOpaqueMaterialNoMass(name="FictitiousLayer_R0.3", r_value="0.3")  # -> mat; plug-in component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

opaquemat_247 = HBOpaqueMaterial(name="CeramicTile", thickness="0.015", conductivity="1.470", density="1700", spec_heat="1000", roughness="MediumSmooth")  # -> mat; plug-in component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

glassmat_8 = HBGlassMaterial(
    name="Glass_01.01_Single",
    thickness="0.003",
    transmittance="0.817",
    reflectance="0.075",
    emiss_front="0.84",
    emiss_back="0.84",
    conductivity="0.0845")  # -> mat; plug-in component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

opaquemat_248 = HBOpaqueMaterial(
    name="Slab_BrickBlkConc_24cm",
    thickness=".240",
    conductivity="0.715",
    density="900",
    spec_heat="1000",
    roughness="Rough")  # -> mat; plug-in component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

opaquemat_249 = HBOpaqueMaterial(name="CementMortar", thickness="0.020", conductivity="1.400", density="2000", spec_heat="1000", roughness="Rough")  # -> mat; plug-in component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

opaquemat_250 = HBOpaqueMaterial(name="CementMortar", thickness="0.020", conductivity="1.400", density="2000", spec_heat="1000", roughness="Rough")  # -> mat; plug-in component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

opaquemat_251 = HBOpaqueMaterial(name="LtwtConcScreed_6.5cm", thickness=".065", conductivity=".580", density="900", spec_heat="1000", roughness="Rough")  # -> mat; plug-in component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

opaquemat_252 = HBOpaqueMaterial(name="ExternalPlaster", thickness=".020", conductivity="0.900", density="1800", spec_heat="1000", roughness="Rough")  # -> mat; plug-in component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

opaquemat_253 = HBOpaqueMaterial(name="WoodDoor_Single", thickness="0.045", conductivity="0.2813", density="1600", spec_heat="550", roughness="Smooth")  # -> mat; plug-in component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

merge_49 = Merge(Data1=opaquemat_178, Data2=opaquemat_179, Data3=opaquemat_181)
opaqueconstr_61 = HBOpaqueConstruction(name="Wall_01.06_Interior", materials=merge_49)  # -> constr; plug-in component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

# ----
# Subface Subset
panel_69 = Panel("Window_01.01")
windowconstr_7 = HBWindowConstruction(name=panel_69, materials=glassmat_7)  # -> constr; plug-in component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
opaqueconstr_62 = HBOpaqueConstruction(name="Door_01.01", materials=opaquemat_201)  # -> constr; plug-in component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
decnstrconstr_13 = HBDeconstructConstruction(constr=opaqueconstr_62)  # -> materials, layers, r_val_si, r_val_ip, u_fac_si, u_fac_ip, shgc, t_sol, t_vis; plug-in component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
decnstrconstr_14 = HBDeconstructConstruction(constr=windowconstr_7)  # -> materials, layers, r_val_si, r_val_ip, u_fac_si, u_fac_ip, shgc, t_sol, t_vis; plug-in component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
subfacesubset_7 = HBSubfaceSubset(
    window=windowconstr_7,
    skylight=windowconstr_7,
    operable=windowconstr_7,
    exterior_door=opaqueconstr_62,
    glass_door=windowconstr_7)  # -> subface_set; plug-in component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
panel_70 = Panel(subfacesubset_7)
panel_71 = Panel([decnstrconstr_13.r_val_si, decnstrconstr_13.u_fac_si, decnstrconstr_13.shgc])
panel_72 = Panel([decnstrconstr_14.r_val_si, decnstrconstr_14.u_fac_si, decnstrconstr_14.shgc])

merge_50 = Merge(Data1=opaquemat_187, Data2=opaquemat_199, Data3=opaquemat_200)
opaqueconstr_63 = HBOpaqueConstruction(name="Roof_03.01", materials=merge_50)  # -> constr; plug-in component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

merge_51 = Merge(Data1=opaquemat_207, Data2=opaquemat_206, Data3=opaquemat_202, Data4=opaquemat_198)
opaqueconstr_64 = HBOpaqueConstruction(name="Floor_01.04_GRfloor", materials=merge_51)  # -> constr; plug-in component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

merge_52 = Merge(Data1=opaquemat_209, Data2=opaquemat_210, Data3=opaquemat_212, Data4=opaquemat_217)
opaqueconstr_65 = HBOpaqueConstruction(name="Floor_01.04_GRroof", materials=merge_52)  # -> constr; plug-in component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

# ----
# Ground Subset -
# same as interior floors,
# ground & roof must be inverse.
# 
# Base ground & roof construction
# on exterior floor for same archetype
# Make this same thickness as W1
panel_73 = Panel("Wall_01.06_UGwall")
opaqueconstr_66 = HBOpaqueConstruction(name=panel_73, materials=opaquemat_196)  # -> constr; plug-in component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
groundsubset_7 = HBGroundConstructionSubset(ground_wall=opaqueconstr_66, ground_roof=opaqueconstr_65, ground_floor=opaqueconstr_64)  # -> ground_set; plug-in component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
decnstrmat_13 = HBDeconstructMaterial(mat=groundsubset_7)  # -> values, attr_names, r_val_si, r_val_ip; plug-in component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
panel_74 = Panel(groundsubset_7)
panel_75 = Panel(decnstrmat_13.r_val_si)

merge_53 = Merge(Data1=opaquemat_203, Data2=opaquemat_204, Data3=opaquemat_197)
opaqueconstr_67 = HBOpaqueConstruction(name="Wall_01.06", materials=merge_53)  # -> constr; plug-in component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

merge_54 = Merge(Data1=opaquemat_205, Data2=opaquemat_193, Data3=opaquemat_194, Data4=opaquemat_191)
opaqueconstr_68 = HBOpaqueConstruction(name="Floor_01.04", materials=merge_54)  # -> constr; plug-in component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

merge_55 = Merge(Data1=opaquemat_220, Data2=opaquemat_221, Data3=opaquemat_223)
opaqueconstr_69 = HBOpaqueConstruction(name="Wall_04.03_Interior", materials=merge_55)  # -> constr; plug-in component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

merge_56 = Merge(
    Data1=opaquemat_183,
    Data2=opaquemat_184,
    Data3=opaquemat_177,
    Data4=opaquemat_180,
    Data5=opaquemat_182,
    Data6=opaquemat_185)
opaqueconstr_70 = HBOpaqueConstruction(name="Floor_03.01_IntClg", materials=merge_56)  # -> constr; plug-in component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

merge_57 = Merge(Data1=opaquemat_240, Data2=opaquemat_241, Data3=opaquematnomass_4, Data4=opaquemat_239, Data5=opaquemat_230)
opaqueconstr_71 = HBOpaqueConstruction(name="Wall_03.01", materials=merge_57)  # -> constr; plug-in component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

merge_58 = Merge(Data1=opaquemat_234, Data2=opaquemat_245, Data3=opaquemat_246)
opaqueconstr_72 = HBOpaqueConstruction(name="Roof_03.01", materials=merge_58)  # -> constr; plug-in component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

merge_59 = Merge(
    Data1=opaquemat_231,
    Data2=opaquemat_229,
    Data3=opaquemat_232,
    Data4=opaquemat_233,
    Data5=opaquemat_236,
    Data6=opaquemat_224,
    Data7=opaquematnomass_3)
opaqueconstr_73 = HBOpaqueConstruction(name="Floor_03.01_GRroof", materials=merge_59)  # -> constr; plug-in component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

# ----
# Subface Subset
panel_76 = Panel("Window_01.01")
windowconstr_8 = HBWindowConstruction(name=panel_76, materials=glassmat_8)  # -> constr; plug-in component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
opaqueconstr_74 = HBOpaqueConstruction(name="Door_01.01", materials=opaquemat_253)  # -> constr; plug-in component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
decnstrconstr_15 = HBDeconstructConstruction(constr=opaqueconstr_74)  # -> materials, layers, r_val_si, r_val_ip, u_fac_si, u_fac_ip, shgc, t_sol, t_vis; plug-in component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
decnstrconstr_16 = HBDeconstructConstruction(constr=windowconstr_8)  # -> materials, layers, r_val_si, r_val_ip, u_fac_si, u_fac_ip, shgc, t_sol, t_vis; plug-in component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
subfacesubset_8 = HBSubfaceSubset(
    window=windowconstr_8,
    skylight=windowconstr_8,
    operable=windowconstr_8,
    exterior_door=opaqueconstr_74,
    glass_door=windowconstr_8)  # -> subface_set; plug-in component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
panel_77 = Panel(subfacesubset_8)
panel_78 = Panel([decnstrconstr_15.r_val_si, decnstrconstr_15.u_fac_si, decnstrconstr_15.shgc])
panel_79 = Panel([decnstrconstr_16.r_val_si, decnstrconstr_16.u_fac_si, decnstrconstr_16.shgc])

merge_60 = Merge(
    Data1=opaquemat_225,
    Data2=opaquemat_227,
    Data3=opaquemat_219,
    Data4=opaquemat_222,
    Data5=opaquemat_226,
    Data6=opaquemat_228)
opaqueconstr_75 = HBOpaqueConstruction(name="Floor_03.01_IntClg", materials=merge_60)  # -> constr; plug-in component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

merge_61 = Merge(
    Data1=opaquematnomass_2,
    Data2=opaquemat_213,
    Data3=opaquemat_211,
    Data4=opaquemat_218,
    Data5=opaquemat_214,
    Data6=opaquemat_216,
    Data7=opaquemat_215)
opaqueconstr_76 = HBOpaqueConstruction(name="Floor_03.01_GRfloor", materials=merge_61)  # -> constr; plug-in component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

# ----
# Ground Subset -
# same as interior floors,
# ground & roof must be inverse.
# 
# Base ground & roof construction
# on exterior floor for same archetype
# Make this same thickness as W1
panel_80 = Panel("Wall_03.01_UGwall")
opaqueconstr_77 = HBOpaqueConstruction(name=panel_80, materials=opaquemat_208)  # -> constr; plug-in component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
groundsubset_8 = HBGroundConstructionSubset(ground_wall=opaqueconstr_77, ground_roof=opaqueconstr_73, ground_floor=opaqueconstr_76)  # -> ground_set; plug-in component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
decnstrmat_14 = HBDeconstructMaterial(mat=groundsubset_8)  # -> values, attr_names, r_val_si, r_val_ip; plug-in component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
panel_81 = Panel(groundsubset_8)
panel_82 = Panel(decnstrmat_14.r_val_si)

merge_62 = Merge(
    Data1=opaquemat_186,
    Data2=opaquemat_188,
    Data3=opaquemat_190,
    Data4=opaquemat_189,
    Data5=opaquemat_195,
    Data6=opaquemat_192)
opaqueconstr_78 = HBOpaqueConstruction(name="Floor_03.01_IntFlr", materials=merge_62)  # -> constr; plug-in component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

merge_63 = Merge(
    Data1=opaquemat_235,
    Data2=opaquemat_237,
    Data3=opaquemat_242,
    Data4=opaquemat_238,
    Data5=opaquemat_244,
    Data6=opaquemat_243)
opaqueconstr_79 = HBOpaqueConstruction(name="Floor_03.01_IntFlr", materials=merge_63)  # -> constr; plug-in component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

merge_64 = Merge(
    Data1=opaquematnomass_5,
    Data2=opaquemat_252,
    Data3=opaquemat_248,
    Data4=opaquemat_249,
    Data5=opaquemat_251,
    Data6=opaquemat_250,
    Data7=opaquemat_247)
opaqueconstr_80 = HBOpaqueConstruction(name="Floor_03.01", materials=merge_64)  # -> constr; plug-in component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

# ----
# Interior Subset -
# Note interior floors & ceilings must
# be inverse of each other
interiorsubset_7 = HBInteriorConstructionSubset(interior_wall=opaqueconstr_61, ceiling=opaqueconstr_70, interior_floor=opaqueconstr_78)  # -> interior_set; plug-in component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
panel_83 = Panel(interiorsubset_7)

# ----
# Exterior Subset
exteriorsubset_7 = HBExteriorConstructionSubset(exterior_wall=opaqueconstr_67, exterior_roof=opaqueconstr_63, exposed_floor=opaqueconstr_68)  # -> exterior_set; plug-in component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
panel_84 = Panel(exteriorsubset_7)
decnstrmat_15 = HBDeconstructMaterial(mat=exteriorsubset_7)  # -> values, attr_names, r_val_si, r_val_ip; plug-in component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
panel_85 = Panel(decnstrmat_15.r_val_si)

# ----
# Interior Subset -
# Note interior floors & ceilings must
# be inverse of each other
interiorsubset_8 = HBInteriorConstructionSubset(interior_wall=opaqueconstr_69, ceiling=opaqueconstr_75, interior_floor=opaqueconstr_79)  # -> interior_set; plug-in component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
panel_86 = Panel(interiorsubset_8)

# ----
# Exterior Subset
exteriorsubset_8 = HBExteriorConstructionSubset(exterior_wall=opaqueconstr_71, exterior_roof=opaqueconstr_72, exposed_floor=opaqueconstr_80)  # -> exterior_set; plug-in component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
panel_87 = Panel(exteriorsubset_8)
decnstrmat_16 = HBDeconstructMaterial(mat=exteriorsubset_8)  # -> values, attr_names, r_val_si, r_val_ip; plug-in component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
panel_88 = Panel(decnstrmat_16.r_val_si)

# ----
# EXPORT TO JSON
panel_89 = Panel("pre_1980::ClimateZone4::Mass")
constructionset_7 = HBConstructionSet(
    name="R4SF_CSet",
    base_constr_set=panel_89,
    exterior_subset=exteriorsubset_7,
    ground_subset=groundsubset_7,
    interior_subset=interiorsubset_7,
    subface_subset=subfacesubset_7)  # -> constr_set; plug-in component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
objtostr_7 = HBObjectToString(hb_obj=constructionset_7)  # -> hb_str; plug-in component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

panel_90 = Panel(objtostr_7)

# ----
# EXPORT TO JSON
panel_91 = Panel("pre_1980::ClimateZone4::Mass")
constructionset_8 = HBConstructionSet(
    name="R4TH_CSet",
    base_constr_set=panel_91,
    exterior_subset=exteriorsubset_8,
    ground_subset=groundsubset_8,
    interior_subset=interiorsubset_8,
    subface_subset=subfacesubset_8)  # -> constr_set; plug-in component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
objtostr_8 = HBObjectToString(hb_obj=constructionset_8)  # -> hb_str; plug-in component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

panel_92 = Panel(objtostr_8)

opaquemat_254 = HBOpaqueMaterial(name="LtwtConcScreed_6.5cm", thickness=".065", conductivity=".580", density="900", spec_heat="1000", roughness="Rough")  # -> mat; plug-in component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

opaquemat_255 = HBOpaqueMaterial(name="CeramicTile", thickness="0.015", conductivity="1.470", density="1700", spec_heat="1000", roughness="MediumSmooth")  # -> mat; plug-in component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

opaquemat_256 = HBOpaqueMaterial(name="CementMortar", thickness="0.020", conductivity="1.400", density="2000", spec_heat="1000", roughness="Rough")  # -> mat; plug-in component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

opaquemat_257 = HBOpaqueMaterial(name="CementMortar", thickness="0.020", conductivity="1.400", density="2000", spec_heat="1000", roughness="Rough")  # -> mat; plug-in component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

opaquemat_258 = HBOpaqueMaterial(
    name="InternalPlaster",
    thickness="0.020",
    conductivity="0.700",
    density="1400",
    spec_heat="1000",
    roughness="MediumSmooth")  # -> mat; plug-in component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

opaquemat_259 = HBOpaqueMaterial(
    name="InternalPlaster",
    thickness="0.020",
    conductivity="0.700",
    density="1400",
    spec_heat="1000",
    roughness="MediumSmooth")  # -> mat; plug-in component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

opaquemat_260 = HBOpaqueMaterial(
    name="InternalPlaster",
    thickness="0.020",
    conductivity="0.700",
    density="1400",
    spec_heat="1000",
    roughness="MediumSmooth")  # -> mat; plug-in component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

opaquemat_261 = HBOpaqueMaterial(
    name="Slab_BrickBlkConc_24cm",
    thickness=".240",
    conductivity="0.715",
    density="900",
    spec_heat="1000",
    roughness="Rough")  # -> mat; plug-in component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

opaquemat_262 = HBOpaqueMaterial(name="SolidBrick", thickness=".270", conductivity="0.720", density="1800", spec_heat="1000", roughness="Rough")  # -> mat; plug-in component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

opaquemat_263 = HBOpaqueMaterial(name="CeramicTile", thickness="0.015", conductivity="1.470", density="1700", spec_heat="1000", roughness="MediumSmooth")  # -> mat; plug-in component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

opaquemat_264 = HBOpaqueMaterial(name="CementMortar_Thick", thickness="0.030", conductivity="1.400", density="2000", spec_heat="1000", roughness="Rough")  # -> mat; plug-in component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

opaquemat_265 = HBOpaqueMaterial(name="HollowBricks_Mod", thickness="0.250", conductivity="0.420", density="1000", spec_heat="1000", roughness="Rough")  # -> mat; plug-in component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

opaquemat_266 = HBOpaqueMaterial(
    name="InternalPlaster",
    thickness="0.020",
    conductivity="0.700",
    density="1400",
    spec_heat="1000",
    roughness="MediumSmooth")  # -> mat; plug-in component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

opaquemat_267 = HBOpaqueMaterial(name="Concrete_Reg", thickness="0.100", conductivity="1.160", density="2000", spec_heat="1000", roughness="Rough")  # -> mat; plug-in component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

opaquemat_268 = HBOpaqueMaterial(name="CementMortar", thickness="0.020", conductivity="1.400", density="2000", spec_heat="1000", roughness="Rough")  # -> mat; plug-in component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

opaquemat_269 = HBOpaqueMaterial(name="GravelRiverStone", thickness=".147", conductivity="1.200", density="1700", spec_heat="1000", roughness="VeryRough")  # -> mat; plug-in component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

opaquemat_270 = HBOpaqueMaterial(name="CeramicTile", thickness="0.015", conductivity="1.470", density="1700", spec_heat="1000", roughness="MediumSmooth")  # -> mat; plug-in component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

opaquemat_271 = HBOpaqueMaterial(
    name="Slab_BrickBlkConc_24cm",
    thickness=".240",
    conductivity="0.715",
    density="900",
    spec_heat="1000",
    roughness="Rough")  # -> mat; plug-in component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

opaquemat_272 = HBOpaqueMaterial(name="LtwtConcScreed_6.5cm", thickness=".065", conductivity=".580", density="900", spec_heat="1000", roughness="Rough")  # -> mat; plug-in component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

opaquemat_273 = HBOpaqueMaterial(name="CementMortar", thickness="0.020", conductivity="1.400", density="2000", spec_heat="1000", roughness="Rough")  # -> mat; plug-in component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

opaquemat_274 = HBOpaqueMaterial(name="CeramicTile", thickness="0.015", conductivity="1.470", density="1700", spec_heat="1000", roughness="MediumSmooth")  # -> mat; plug-in component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

opaquemat_275 = HBOpaqueMaterial(name="CementMortar_Thick", thickness="0.030", conductivity="1.400", density="2000", spec_heat="1000", roughness="Rough")  # -> mat; plug-in component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

opaquemat_276 = HBOpaqueMaterial(name="Concrete_Reg", thickness="0.100", conductivity="1.160", density="2000", spec_heat="1000", roughness="Rough")  # -> mat; plug-in component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

opaquemat_277 = HBOpaqueMaterial(name="GravelRiverStone", thickness=".147", conductivity="1.200", density="1700", spec_heat="1000", roughness="VeryRough")  # -> mat; plug-in component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

glassmat_9 = HBGlassMaterial(
    name="Glass_01.01_Single",
    thickness="0.003",
    transmittance="0.817",
    reflectance="0.075",
    emiss_front="0.84",
    emiss_back="0.84",
    conductivity="0.0845")  # -> mat; plug-in component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

opaquemat_278 = HBOpaqueMaterial(name="CementMortar", thickness="0.020", conductivity="1.400", density="2000", spec_heat="1000", roughness="Rough")  # -> mat; plug-in component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

opaquemat_279 = HBOpaqueMaterial(name="HollowBricks_Mod", thickness="0.250", conductivity="0.420", density="1000", spec_heat="1000", roughness="Rough")  # -> mat; plug-in component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

opaquemat_280 = HBOpaqueMaterial(name="CeramicTile", thickness="0.015", conductivity="1.470", density="1700", spec_heat="1000", roughness="MediumSmooth")  # -> mat; plug-in component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

opaquemat_281 = HBOpaqueMaterial(name="CementMortar_Thick", thickness="0.030", conductivity="1.400", density="2000", spec_heat="1000", roughness="Rough")  # -> mat; plug-in component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

# ----
# R5SF
opaquemat_282 = HBOpaqueMaterial(name="ExternalPlaster_Thin", thickness=".010", conductivity="0.900", density="1800", spec_heat="1000", roughness="Rough")  # -> mat; plug-in component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

opaquemat_283 = HBOpaqueMaterial(
    name="InternalPlaster_Thin",
    thickness="0.010",
    conductivity="0.700",
    density="1400",
    spec_heat="1000",
    roughness="MediumSmooth")  # -> mat; plug-in component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

opaquemat_284 = HBOpaqueMaterial(name="Concrete_Reg", thickness="0.100", conductivity="1.160", density="2000", spec_heat="1000", roughness="Rough")  # -> mat; plug-in component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

opaquemat_285 = HBOpaqueMaterial(name="GravelRiverStone", thickness=".147", conductivity="1.200", density="1700", spec_heat="1000", roughness="VeryRough")  # -> mat; plug-in component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

opaquemat_286 = HBOpaqueMaterial(name="ReinforcedConcrete", thickness="0.040", conductivity="1.910", density="2400", spec_heat="1000", roughness="Rough")  # -> mat; plug-in component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

opaquemat_287 = HBOpaqueMaterial(
    name="Slab_BrickBlkConc_16cm",
    thickness=".160",
    conductivity="0.582",
    density="900",
    spec_heat="1000",
    roughness="Rough")  # -> mat; plug-in component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

opaquemat_288 = HBOpaqueMaterial(name="WoodDoor_Single", thickness="0.045", conductivity="0.2813", density="1600", spec_heat="550", roughness="Smooth")  # -> mat; plug-in component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

opaquemat_289 = HBOpaqueMaterial(name="LtwtConcScreed_6.5cm", thickness=".065", conductivity=".580", density="900", spec_heat="1000", roughness="Rough")  # -> mat; plug-in component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

opaquemat_290 = HBOpaqueMaterial(name="CeramicTile", thickness="0.015", conductivity="1.470", density="1700", spec_heat="1000", roughness="MediumSmooth")  # -> mat; plug-in component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

opaquemat_291 = HBOpaqueMaterial(name="CementMortar", thickness="0.020", conductivity="1.400", density="2000", spec_heat="1000", roughness="Rough")  # -> mat; plug-in component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

opaquemat_292 = HBOpaqueMaterial(name="CementMortar", thickness="0.020", conductivity="1.400", density="2000", spec_heat="1000", roughness="Rough")  # -> mat; plug-in component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

opaquemat_293 = HBOpaqueMaterial(
    name="InternalPlaster",
    thickness="0.020",
    conductivity="0.700",
    density="1400",
    spec_heat="1000",
    roughness="MediumSmooth")  # -> mat; plug-in component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

opaquemat_294 = HBOpaqueMaterial(
    name="InternalPlaster",
    thickness="0.020",
    conductivity="0.700",
    density="1400",
    spec_heat="1000",
    roughness="MediumSmooth")  # -> mat; plug-in component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

opaquemat_295 = HBOpaqueMaterial(
    name="InternalPlaster",
    thickness="0.020",
    conductivity="0.700",
    density="1400",
    spec_heat="1000",
    roughness="MediumSmooth")  # -> mat; plug-in component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

opaquemat_296 = HBOpaqueMaterial(
    name="Slab_BrickBlkConc_24cm",
    thickness=".240",
    conductivity="0.715",
    density="900",
    spec_heat="1000",
    roughness="Rough")  # -> mat; plug-in component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

opaquemat_297 = HBOpaqueMaterial(name="SolidBrick", thickness=".270", conductivity="0.720", density="1800", spec_heat="1000", roughness="Rough")  # -> mat; plug-in component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

opaquemat_298 = HBOpaqueMaterial(name="CeramicTile", thickness="0.015", conductivity="1.470", density="1700", spec_heat="1000", roughness="MediumSmooth")  # -> mat; plug-in component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

opaquemat_299 = HBOpaqueMaterial(name="CementMortar_Thick", thickness="0.030", conductivity="1.400", density="2000", spec_heat="1000", roughness="Rough")  # -> mat; plug-in component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

opaquemat_300 = HBOpaqueMaterial(name="HollowBricks_Mod", thickness="0.250", conductivity="0.420", density="1000", spec_heat="1000", roughness="Rough")  # -> mat; plug-in component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

opaquemat_301 = HBOpaqueMaterial(
    name="InternalPlaster",
    thickness="0.020",
    conductivity="0.700",
    density="1400",
    spec_heat="1000",
    roughness="MediumSmooth")  # -> mat; plug-in component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

opaquemat_302 = HBOpaqueMaterial(name="Concrete_Reg", thickness="0.100", conductivity="1.160", density="2000", spec_heat="1000", roughness="Rough")  # -> mat; plug-in component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

opaquemat_303 = HBOpaqueMaterial(name="CeramicTile", thickness="0.015", conductivity="1.470", density="1700", spec_heat="1000", roughness="MediumSmooth")  # -> mat; plug-in component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

opaquemat_304 = HBOpaqueMaterial(name="CementMortar_Thick", thickness="0.030", conductivity="1.400", density="2000", spec_heat="1000", roughness="Rough")  # -> mat; plug-in component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

opaquemat_305 = HBOpaqueMaterial(name="CementMortar", thickness="0.020", conductivity="1.400", density="2000", spec_heat="1000", roughness="Rough")  # -> mat; plug-in component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

opaquemat_306 = HBOpaqueMaterial(name="GravelRiverStone", thickness=".147", conductivity="1.200", density="1700", spec_heat="1000", roughness="VeryRough")  # -> mat; plug-in component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

opaquemat_307 = HBOpaqueMaterial(name="CeramicTile", thickness="0.015", conductivity="1.470", density="1700", spec_heat="1000", roughness="MediumSmooth")  # -> mat; plug-in component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

opaquemat_308 = HBOpaqueMaterial(name="Concrete_Reg", thickness="0.100", conductivity="1.160", density="2000", spec_heat="1000", roughness="Rough")  # -> mat; plug-in component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

opaquemat_309 = HBOpaqueMaterial(
    name="Slab_BrickBlkConc_24cm",
    thickness=".240",
    conductivity="0.715",
    density="900",
    spec_heat="1000",
    roughness="Rough")  # -> mat; plug-in component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

opaquemat_310 = HBOpaqueMaterial(name="LtwtConcScreed_6.5cm", thickness=".065", conductivity=".580", density="900", spec_heat="1000", roughness="Rough")  # -> mat; plug-in component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

# ----
# R5TH
opaquemat_311 = HBOpaqueMaterial(name="ExternalPlaster_Thin", thickness=".010", conductivity="0.900", density="1800", spec_heat="1000", roughness="Rough")  # -> mat; plug-in component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

opaquemat_312 = HBOpaqueMaterial(name="HollowBricks_Mod", thickness="0.250", conductivity="0.420", density="1000", spec_heat="1000", roughness="Rough")  # -> mat; plug-in component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

opaquemat_313 = HBOpaqueMaterial(name="GravelRiverStone", thickness=".147", conductivity="1.200", density="1700", spec_heat="1000", roughness="VeryRough")  # -> mat; plug-in component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

opaquemat_314 = HBOpaqueMaterial(
    name="InternalPlaster_Thin",
    thickness="0.010",
    conductivity="0.700",
    density="1400",
    spec_heat="1000",
    roughness="MediumSmooth")  # -> mat; plug-in component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

opaquemat_315 = HBOpaqueMaterial(name="CementMortar", thickness="0.020", conductivity="1.400", density="2000", spec_heat="1000", roughness="Rough")  # -> mat; plug-in component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

opaquemat_316 = HBOpaqueMaterial(
    name="InternalPlaster",
    thickness="0.020",
    conductivity="0.700",
    density="1400",
    spec_heat="1000",
    roughness="MediumSmooth")  # -> mat; plug-in component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

opaquemat_317 = HBOpaqueMaterial(
    name="Slab_BrickBlkConc_16cm",
    thickness=".160",
    conductivity="0.740",
    density="900",
    spec_heat="1000",
    roughness="Rough")  # -> mat; plug-in component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

opaquemat_318 = HBOpaqueMaterial(name="CementMortar", thickness="0.020", conductivity="1.400", density="2000", spec_heat="1000", roughness="Rough")  # -> mat; plug-in component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

opaquemat_319 = HBOpaqueMaterial(
    name="ReinforcedConcrete_Poured",
    thickness=".040",
    conductivity="1.910",
    density="2400",
    spec_heat="1000",
    roughness="Rough")  # -> mat; plug-in component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

opaquemat_320 = HBOpaqueMaterial(name="CeramicTile", thickness="0.015", conductivity="1.470", density="1700", spec_heat="1000", roughness="MediumSmooth")  # -> mat; plug-in component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

opaquemat_321 = HBOpaqueMaterial(name="CementMortar_Thick", thickness="0.030", conductivity="1.400", density="2000", spec_heat="1000", roughness="Rough")  # -> mat; plug-in component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

opaquemat_322 = HBOpaqueMaterial(name="Concrete_Reg", thickness="0.100", conductivity="1.160", density="2000", spec_heat="1000", roughness="Rough")  # -> mat; plug-in component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

opaquemat_323 = HBOpaqueMaterial(name="GravelRiverStone", thickness=".147", conductivity="1.200", density="1700", spec_heat="1000", roughness="VeryRough")  # -> mat; plug-in component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

glassmat_10 = HBGlassMaterial(
    name="Glass_01.01_Single",
    thickness="0.003",
    transmittance="0.817",
    reflectance="0.075",
    emiss_front="0.84",
    emiss_back="0.84",
    conductivity="0.0845")  # -> mat; plug-in component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

opaquemat_324 = HBOpaqueMaterial(name="WoodDoor_Single", thickness="0.045", conductivity="0.2813", density="1600", spec_heat="550", roughness="Smooth")  # -> mat; plug-in component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

# ----
# Subface Subset
panel_93 = Panel("Window_01.01")
windowconstr_9 = HBWindowConstruction(name=panel_93, materials=glassmat_9)  # -> constr; plug-in component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
opaqueconstr_81 = HBOpaqueConstruction(name="Door_01.01", materials=opaquemat_288)  # -> constr; plug-in component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
decnstrconstr_17 = HBDeconstructConstruction(constr=opaqueconstr_81)  # -> materials, layers, r_val_si, r_val_ip, u_fac_si, u_fac_ip, shgc, t_sol, t_vis; plug-in component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
decnstrconstr_18 = HBDeconstructConstruction(constr=windowconstr_9)  # -> materials, layers, r_val_si, r_val_ip, u_fac_si, u_fac_ip, shgc, t_sol, t_vis; plug-in component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
subfacesubset_9 = HBSubfaceSubset(
    window=windowconstr_9,
    skylight=windowconstr_9,
    operable=windowconstr_9,
    exterior_door=opaqueconstr_81,
    glass_door=windowconstr_9)  # -> subface_set; plug-in component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
panel_94 = Panel(subfacesubset_9)
panel_95 = Panel([decnstrconstr_17.r_val_si, decnstrconstr_17.u_fac_si, decnstrconstr_17.shgc])
panel_96 = Panel([decnstrconstr_18.r_val_si, decnstrconstr_18.u_fac_si, decnstrconstr_18.shgc])

merge_65 = Merge(Data1=opaquemat_269, Data2=opaquemat_267, Data3=opaquemat_264, Data4=opaquemat_263)
opaqueconstr_82 = HBOpaqueConstruction(name="Floor_01.04_GRfloor", materials=merge_65)  # -> constr; plug-in component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

merge_66 = Merge(Data1=opaquemat_259, Data2=opaquemat_265, Data3=opaquemat_260)
opaqueconstr_83 = HBOpaqueConstruction(name="Wall_04.02_Interior", materials=merge_66)  # -> constr; plug-in component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

merge_67 = Merge(Data1=opaquemat_274, Data2=opaquemat_275, Data3=opaquemat_276, Data4=opaquemat_277)
opaqueconstr_84 = HBOpaqueConstruction(name="Floor_01.04_GRroof", materials=merge_67)  # -> constr; plug-in component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

# ----
# Ground Subset -
# same as interior floors,
# ground & roof must be inverse.
# 
# Base ground & roof construction
# on exterior floor for same archetype
# Make this same thickness as W1
panel_97 = Panel("Wall_04.02_UGwall")
opaqueconstr_85 = HBOpaqueConstruction(name=panel_97, materials=opaquemat_262)  # -> constr; plug-in component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
groundsubset_9 = HBGroundConstructionSubset(ground_wall=opaqueconstr_85, ground_roof=opaqueconstr_84, ground_floor=opaqueconstr_82)  # -> ground_set; plug-in component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
decnstrmat_17 = HBDeconstructMaterial(mat=groundsubset_9)  # -> values, attr_names, r_val_si, r_val_ip; plug-in component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
panel_98 = Panel(groundsubset_9)
panel_99 = Panel(decnstrmat_17.r_val_si)

merge_68 = Merge(Data1=opaquemat_282, Data2=opaquemat_279, Data3=opaquemat_283)
opaqueconstr_86 = HBOpaqueConstruction(name="Wall_04.02", materials=merge_68)  # -> constr; plug-in component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

merge_69 = Merge(
    Data1=opaquemat_255,
    Data2=opaquemat_256,
    Data3=opaquemat_254,
    Data4=opaquemat_257,
    Data5=opaquemat_261,
    Data6=opaquemat_258)
opaqueconstr_87 = HBOpaqueConstruction(name="Floor_03.01_IntClg", materials=merge_69)  # -> constr; plug-in component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

merge_70 = Merge(Data1=opaquemat_278, Data2=opaquemat_286, Data3=opaquemat_287)
opaqueconstr_88 = HBOpaqueConstruction(name="Roof_03.01", materials=merge_70)  # -> constr; plug-in component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

merge_71 = Merge(Data1=opaquemat_285, Data2=opaquemat_284, Data3=opaquemat_281, Data4=opaquemat_280)
opaqueconstr_89 = HBOpaqueConstruction(name="Floor_01.04", materials=merge_71)  # -> constr; plug-in component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

merge_72 = Merge(
    Data1=opaquemat_266,
    Data2=opaquemat_271,
    Data3=opaquemat_268,
    Data4=opaquemat_272,
    Data5=opaquemat_273,
    Data6=opaquemat_270)
opaqueconstr_90 = HBOpaqueConstruction(name="Floor_03.01_IntFlr", materials=merge_72)  # -> constr; plug-in component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

merge_73 = Merge(Data1=opaquemat_306, Data2=opaquemat_302, Data3=opaquemat_299, Data4=opaquemat_298)
opaqueconstr_91 = HBOpaqueConstruction(name="Floor_01.04_GRfloor", materials=merge_73)  # -> constr; plug-in component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

merge_74 = Merge(Data1=opaquemat_294, Data2=opaquemat_300, Data3=opaquemat_295)
opaqueconstr_92 = HBOpaqueConstruction(name="Wall_04.02_Interior", materials=merge_74)  # -> constr; plug-in component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

merge_75 = Merge(Data1=opaquemat_320, Data2=opaquemat_321, Data3=opaquemat_322, Data4=opaquemat_323)
opaqueconstr_93 = HBOpaqueConstruction(name="Floor_01.04_GRroof", materials=merge_75)  # -> constr; plug-in component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

# ----
# Ground Subset -
# same as interior floors,
# ground & roof must be inverse.
# 
# Base ground & roof construction
# on exterior floor for same archetype
# Make this same thickness as W1
panel_100 = Panel("Wall_04.02_UGwall")
opaqueconstr_94 = HBOpaqueConstruction(name=panel_100, materials=opaquemat_297)  # -> constr; plug-in component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
groundsubset_10 = HBGroundConstructionSubset(ground_wall=opaqueconstr_94, ground_roof=opaqueconstr_93, ground_floor=opaqueconstr_91)  # -> ground_set; plug-in component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
decnstrmat_18 = HBDeconstructMaterial(mat=groundsubset_10)  # -> values, attr_names, r_val_si, r_val_ip; plug-in component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
panel_101 = Panel(groundsubset_10)
panel_102 = Panel(decnstrmat_18.r_val_si)

merge_76 = Merge(Data1=opaquemat_311, Data2=opaquemat_312, Data3=opaquemat_314)
opaqueconstr_95 = HBOpaqueConstruction(name="Wall_04.02", materials=merge_76)  # -> constr; plug-in component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

merge_77 = Merge(Data1=opaquemat_318, Data2=opaquemat_319, Data3=opaquemat_317, Data4=opaquemat_316)
opaqueconstr_96 = HBOpaqueConstruction(name="Roof_03.02", materials=merge_77)  # -> constr; plug-in component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

merge_78 = Merge(Data1=opaquemat_313, Data2=opaquemat_308, Data3=opaquemat_304, Data4=opaquemat_303)
opaqueconstr_97 = HBOpaqueConstruction(name="Floor_01.04", materials=merge_78)  # -> constr; plug-in component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

# ----
# Subface Subset
panel_103 = Panel("Window_01.01")
windowconstr_10 = HBWindowConstruction(name=panel_103, materials=glassmat_10)  # -> constr; plug-in component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
opaqueconstr_98 = HBOpaqueConstruction(name="Door_01.01", materials=opaquemat_324)  # -> constr; plug-in component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
decnstrconstr_19 = HBDeconstructConstruction(constr=opaqueconstr_98)  # -> materials, layers, r_val_si, r_val_ip, u_fac_si, u_fac_ip, shgc, t_sol, t_vis; plug-in component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
decnstrconstr_20 = HBDeconstructConstruction(constr=windowconstr_10)  # -> materials, layers, r_val_si, r_val_ip, u_fac_si, u_fac_ip, shgc, t_sol, t_vis; plug-in component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
subfacesubset_10 = HBSubfaceSubset(
    window=windowconstr_10,
    skylight=windowconstr_10,
    operable=windowconstr_10,
    exterior_door=opaqueconstr_98,
    glass_door=windowconstr_10)  # -> subface_set; plug-in component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
panel_104 = Panel(subfacesubset_10)
panel_105 = Panel([decnstrconstr_19.r_val_si, decnstrconstr_19.u_fac_si, decnstrconstr_19.shgc])
panel_106 = Panel([decnstrconstr_20.r_val_si, decnstrconstr_20.u_fac_si, decnstrconstr_20.shgc])

merge_79 = Merge(
    Data1=opaquemat_290,
    Data2=opaquemat_291,
    Data3=opaquemat_289,
    Data4=opaquemat_292,
    Data5=opaquemat_296,
    Data6=opaquemat_293)
opaqueconstr_99 = HBOpaqueConstruction(name="Floor_03.01_IntClg", materials=merge_79)  # -> constr; plug-in component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

# ----
# Interior Subset -
# Note interior floors & ceilings must
# be inverse of each other
interiorsubset_9 = HBInteriorConstructionSubset(interior_wall=opaqueconstr_83, ceiling=opaqueconstr_87, interior_floor=opaqueconstr_90)  # -> interior_set; plug-in component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
panel_107 = Panel(interiorsubset_9)

# ----
# Exterior Subset
exteriorsubset_9 = HBExteriorConstructionSubset(exterior_wall=opaqueconstr_86, exterior_roof=opaqueconstr_88, exposed_floor=opaqueconstr_89)  # -> exterior_set; plug-in component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
panel_108 = Panel(exteriorsubset_9)
decnstrmat_19 = HBDeconstructMaterial(mat=exteriorsubset_9)  # -> values, attr_names, r_val_si, r_val_ip; plug-in component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
panel_109 = Panel(decnstrmat_19.r_val_si)

merge_80 = Merge(
    Data1=opaquemat_301,
    Data2=opaquemat_309,
    Data3=opaquemat_305,
    Data4=opaquemat_310,
    Data5=opaquemat_315,
    Data6=opaquemat_307)
opaqueconstr_100 = HBOpaqueConstruction(name="Floor_03.01_IntFlr", materials=merge_80)  # -> constr; plug-in component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

# ----
# Interior Subset -
# Note interior floors & ceilings must
# be inverse of each other
interiorsubset_10 = HBInteriorConstructionSubset(interior_wall=opaqueconstr_92, ceiling=opaqueconstr_99, interior_floor=opaqueconstr_100)  # -> interior_set; plug-in component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
panel_110 = Panel(interiorsubset_10)

# ----
# Exterior Subset
exteriorsubset_10 = HBExteriorConstructionSubset(exterior_wall=opaqueconstr_95, exterior_roof=opaqueconstr_96, exposed_floor=opaqueconstr_97)  # -> exterior_set; plug-in component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
panel_111 = Panel(exteriorsubset_10)
decnstrmat_20 = HBDeconstructMaterial(mat=exteriorsubset_10)  # -> values, attr_names, r_val_si, r_val_ip; plug-in component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
panel_112 = Panel(decnstrmat_20.r_val_si)

# ----
# EXPORT TO JSON
panel_113 = Panel("pre_1980::ClimateZone4::Mass")
constructionset_9 = HBConstructionSet(
    name="R5SF_CSet",
    base_constr_set=panel_113,
    exterior_subset=exteriorsubset_9,
    ground_subset=groundsubset_9,
    interior_subset=interiorsubset_9,
    subface_subset=subfacesubset_9)  # -> constr_set; plug-in component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
objtostr_9 = HBObjectToString(hb_obj=constructionset_9)  # -> hb_str; plug-in component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

panel_114 = Panel(objtostr_9)

# ----
# EXPORT TO JSON
panel_115 = Panel("pre_1980::ClimateZone4::Mass")
constructionset_10 = HBConstructionSet(
    name="R5TH_CSet",
    base_constr_set=panel_115,
    exterior_subset=exteriorsubset_10,
    ground_subset=groundsubset_10,
    interior_subset=interiorsubset_10,
    subface_subset=subfacesubset_10)  # -> constr_set; plug-in component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
objtostr_10 = HBObjectToString(hb_obj=constructionset_10)  # -> hb_str; plug-in component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

panel_116 = Panel(objtostr_10)

opaquemat_325 = HBOpaqueMaterial(name="CeramicTile", thickness="0.015", conductivity="1.470", density="1700", spec_heat="1000", roughness="MediumSmooth")  # -> mat; plug-in component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

opaquemat_326 = HBOpaqueMaterial(name="CementMortar", thickness="0.020", conductivity="1.400", density="2000", spec_heat="1000", roughness="Rough")  # -> mat; plug-in component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

opaquemat_327 = HBOpaqueMaterial(name="LtwtConcScreed_2cm", thickness=".020", conductivity=".580", density="400", spec_heat="1000", roughness="Rough")  # -> mat; plug-in component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

opaquematnomass_6 = HBOpaqueMaterialNoMass(name="FictitiousLayer_R0.3", r_value="0.3")  # -> mat; plug-in component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

opaquemat_328 = HBOpaqueMaterial(
    name="InsulationPanel",
    thickness="0.017",
    conductivity="0.045",
    density="30",
    spec_heat="1220",
    roughness="MediumSmooth")  # -> mat; plug-in component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

opaquematnomass_7 = HBOpaqueMaterialNoMass(name="FictitiousLayer_R0.3", r_value="0.3")  # -> mat; plug-in component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

opaquemat_329 = HBOpaqueMaterial(name="LtwtConcScreed_2cm", thickness=".020", conductivity=".580", density="400", spec_heat="1000", roughness="Rough")  # -> mat; plug-in component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

opaquemat_330 = HBOpaqueMaterial(name="CementMortar", thickness="0.020", conductivity="1.400", density="2000", spec_heat="1000", roughness="Rough")  # -> mat; plug-in component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

opaquemat_331 = HBOpaqueMaterial(
    name="Slab_BrickBlkConc_16cm",
    thickness=".160",
    conductivity="0.560",
    density="900",
    spec_heat="1000",
    roughness="Rough")  # -> mat; plug-in component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

opaquemat_332 = HBOpaqueMaterial(name="ExternalPlaster", thickness=".020", conductivity="0.900", density="1800", spec_heat="1000", roughness="Rough")  # -> mat; plug-in component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

opaquemat_333 = HBOpaqueMaterial(
    name="InternalPlaster",
    thickness=".020",
    conductivity="0.700",
    density="1400",
    spec_heat="1000",
    roughness="MediumSmooth")  # -> mat; plug-in component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

opaquemat_334 = HBOpaqueMaterial(name="WoodDoor_Double", thickness="0.045", conductivity="0.10714", density="1600", spec_heat="550", roughness="Smooth")  # -> mat; plug-in component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

opaquemat_335 = HBOpaqueMaterial(name="HollowBrick_12cm", thickness="0.120", conductivity="0.387", density="800", spec_heat="1000", roughness="Rough")  # -> mat; plug-in component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

opaquemat_336 = HBOpaqueMaterial(
    name="Slab_BrickBlkConc_16cm",
    thickness=".160",
    conductivity="0.560",
    density="900",
    spec_heat="1000",
    roughness="Rough")  # -> mat; plug-in component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

opaquemat_337 = HBOpaqueMaterial(name="CementMortar", thickness="0.020", conductivity="1.400", density="2000", spec_heat="1000", roughness="Rough")  # -> mat; plug-in component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

opaquemat_338 = HBOpaqueMaterial(name="SolidBrick", thickness=".382", conductivity="0.720", density="1800", spec_heat="1000", roughness="Rough")  # -> mat; plug-in component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

opaquemat_339 = HBOpaqueMaterial(
    name="InternalPlaster",
    thickness="0.020",
    conductivity="0.700",
    density="1400",
    spec_heat="1000",
    roughness="MediumSmooth")  # -> mat; plug-in component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

opaquemat_340 = HBOpaqueMaterial(name="CeramicTile", thickness="0.015", conductivity="1.470", density="1700", spec_heat="1000", roughness="MediumSmooth")  # -> mat; plug-in component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

opaquemat_341 = HBOpaqueMaterial(name="ExternalPlaster", thickness=".020", conductivity="0.900", density="1800", spec_heat="1000", roughness="Rough")  # -> mat; plug-in component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

opaquemat_342 = HBOpaqueMaterial(
    name="InsulationPanel",
    thickness="0.017",
    conductivity="0.045",
    density="30",
    spec_heat="1220",
    roughness="MediumSmooth")  # -> mat; plug-in component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

opaquemat_343 = HBOpaqueMaterial(name="CementMortar", thickness="0.020", conductivity="1.400", density="2000", spec_heat="1000", roughness="Rough")  # -> mat; plug-in component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

opaquemat_344 = HBOpaqueMaterial(name="LtwtConcScreed_2cm", thickness=".020", conductivity=".580", density="400", spec_heat="1000", roughness="Rough")  # -> mat; plug-in component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

opaquemat_345 = HBOpaqueMaterial(
    name="InternalPlaster",
    thickness="0.020",
    conductivity="0.700",
    density="1400",
    spec_heat="1000",
    roughness="MediumSmooth")  # -> mat; plug-in component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

opaquemat_346 = HBOpaqueMaterial(name="HollowBrick_12cm", thickness="0.120", conductivity="0.387", density="800", spec_heat="1000", roughness="Rough")  # -> mat; plug-in component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

opaquemat_347 = HBOpaqueMaterial(
    name="InternalPlaster",
    thickness="0.020",
    conductivity="0.700",
    density="1400",
    spec_heat="1000",
    roughness="MediumSmooth")  # -> mat; plug-in component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

opaquemat_348 = HBOpaqueMaterial(name="CeramicTile", thickness="0.015", conductivity="1.470", density="1700", spec_heat="1000", roughness="MediumSmooth")  # -> mat; plug-in component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

opaquemat_349 = HBOpaqueMaterial(name="SemiSolidBrick_25cm", thickness="0.250", conductivity="0.400", density="1000", spec_heat="1000", roughness="Rough")  # -> mat; plug-in component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

opaquemat_350 = HBOpaqueMaterial(name="InsulatedCavity", thickness="0.0124", conductivity="0.045", density="30", spec_heat="570", roughness="Rough")  # -> mat; plug-in component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

# ----
# R6SF
opaquemat_351 = HBOpaqueMaterial(name="ExternalPlaster", thickness=".020", conductivity="0.900", density="1800", spec_heat="1000", roughness="Rough")  # -> mat; plug-in component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

opaquemat_352 = HBOpaqueMaterial(
    name="InternalPlaster",
    thickness="0.020",
    conductivity="0.700",
    density="1400",
    spec_heat="1000",
    roughness="MediumSmooth")  # -> mat; plug-in component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

opaquemat_353 = HBOpaqueMaterial(name="CementMortar", thickness="0.020", conductivity="1.400", density="2000", spec_heat="1000", roughness="Rough")  # -> mat; plug-in component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

opaquemat_354 = HBOpaqueMaterial(
    name="Slab_BrickBlkConc_16cm",
    thickness=".160",
    conductivity="0.560",
    density="900",
    spec_heat="1000",
    roughness="Rough")  # -> mat; plug-in component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

opaquemat_355 = HBOpaqueMaterial(name="HollowBrick_8cm", thickness="0.080", conductivity="0.400", density="800", spec_heat="1000", roughness="Rough")  # -> mat; plug-in component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

opaquemat_356 = HBOpaqueMaterial(name="CementMortar", thickness="0.020", conductivity="1.400", density="2000", spec_heat="1000", roughness="Rough")  # -> mat; plug-in component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

opaquemat_357 = HBOpaqueMaterial(
    name="Slab_BrickBlkConc_16cm",
    thickness=".160",
    conductivity="0.560",
    density="900",
    spec_heat="1000",
    roughness="Rough")  # -> mat; plug-in component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

opaquemat_358 = HBOpaqueMaterial(name="CementMortar", thickness="0.020", conductivity="1.400", density="2000", spec_heat="1000", roughness="Rough")  # -> mat; plug-in component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

glassmat_11 = HBGlassMaterial(
    name="Glass_06.01_Interior",
    thickness="0.004",
    transmittance="0.85",
    reflectance="0.075",
    emiss_front="0.84",
    emiss_back="0.84",
    conductivity="0.9")  # -> mat; plug-in component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

opaquemat_359 = HBOpaqueMaterial(name="CementMortar", thickness="0.020", conductivity="1.400", density="2000", spec_heat="1000", roughness="Rough")  # -> mat; plug-in component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

opaquemat_360 = HBOpaqueMaterial(name="CeramicTile", thickness="0.015", conductivity="1.470", density="1700", spec_heat="1000", roughness="MediumSmooth")  # -> mat; plug-in component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

opaquemat_361 = HBOpaqueMaterial(name="LtwtConcScreed_2cm", thickness=".020", conductivity=".580", density="400", spec_heat="1000", roughness="Rough")  # -> mat; plug-in component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

opaquemat_362 = HBOpaqueMaterial(
    name="InsulationPanel",
    thickness="0.0173",
    conductivity="0.045",
    density="30",
    spec_heat="1220",
    roughness="MediumSmooth")  # -> mat; plug-in component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

opaquemat_363 = HBOpaqueMaterial(name="CementMortar", thickness="0.020", conductivity="1.400", density="2000", spec_heat="1000", roughness="Rough")  # -> mat; plug-in component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

opaquemat_364 = HBOpaqueMaterial(name="CeramicTile", thickness="0.015", conductivity="1.470", density="1700", spec_heat="1000", roughness="MediumSmooth")  # -> mat; plug-in component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

opaquemat_365 = HBOpaqueMaterial(name="CementMortar", thickness="0.020", conductivity="1.400", density="2000", spec_heat="1000", roughness="Rough")  # -> mat; plug-in component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

opaquemat_366 = HBOpaqueMaterial(name="LtwtConcScreed_2cm", thickness=".020", conductivity=".580", density="400", spec_heat="1000", roughness="Rough")  # -> mat; plug-in component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

opaquemat_367 = HBOpaqueMaterial(
    name="InternalPlaster",
    thickness="0.020",
    conductivity="0.700",
    density="1400",
    spec_heat="1000",
    roughness="MediumSmooth")  # -> mat; plug-in component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

opaquemat_368 = HBOpaqueMaterial(name="ReinforcedConcrete", thickness="0.040", conductivity="1.910", density="2400", spec_heat="1000", roughness="Rough")  # -> mat; plug-in component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

opaquemat_369 = HBOpaqueMaterial(
    name="Slab_BrickBlkConc_16cm",
    thickness=".160",
    conductivity="0.543",
    density="900",
    spec_heat="1000",
    roughness="Rough")  # -> mat; plug-in component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

opaquemat_370 = HBOpaqueMaterial(name="ExternalPlaster", thickness=".020", conductivity="0.900", density="1800", spec_heat="1000", roughness="Rough")  # -> mat; plug-in component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

opaquemat_371 = HBOpaqueMaterial(
    name="InsulationPanel",
    thickness="0.017",
    conductivity="0.045",
    density="30",
    spec_heat="1220",
    roughness="MediumSmooth")  # -> mat; plug-in component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

opaquematnomass_8 = HBOpaqueMaterialNoMass(name="FictitiousLayer_R0.3", r_value="0.3")  # -> mat; plug-in component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

opaquemat_372 = HBOpaqueMaterial(
    name="Slab_BrickBlkConc_16cm",
    thickness=".160",
    conductivity="0.560",
    density="900",
    spec_heat="1000",
    roughness="Rough")  # -> mat; plug-in component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

opaquemat_373 = HBOpaqueMaterial(name="CementMortar", thickness="0.020", conductivity="1.400", density="2000", spec_heat="1000", roughness="Rough")  # -> mat; plug-in component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

opaquemat_374 = HBOpaqueMaterial(
    name="InternalPlaster",
    thickness=".020",
    conductivity="0.700",
    density="1400",
    spec_heat="1000",
    roughness="MediumSmooth")  # -> mat; plug-in component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

opaquemat_375 = HBOpaqueMaterial(name="HollowBrick_12cm", thickness="0.120", conductivity="0.387", density="800", spec_heat="1000", roughness="Rough")  # -> mat; plug-in component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

opaquemat_376 = HBOpaqueMaterial(
    name="Slab_BrickBlkConc_16cm",
    thickness=".160",
    conductivity="0.560",
    density="900",
    spec_heat="1000",
    roughness="Rough")  # -> mat; plug-in component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

opaquemat_377 = HBOpaqueMaterial(
    name="InternalPlaster",
    thickness="0.020",
    conductivity="0.700",
    density="1400",
    spec_heat="1000",
    roughness="MediumSmooth")  # -> mat; plug-in component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

opaquemat_378 = HBOpaqueMaterial(name="CementMortar", thickness="0.020", conductivity="1.400", density="2000", spec_heat="1000", roughness="Rough")  # -> mat; plug-in component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

opaquemat_379 = HBOpaqueMaterial(name="LtwtConcScreed_2cm", thickness=".020", conductivity=".580", density="400", spec_heat="1000", roughness="Rough")  # -> mat; plug-in component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

opaquemat_380 = HBOpaqueMaterial(
    name="InternalPlaster",
    thickness="0.020",
    conductivity="0.700",
    density="1400",
    spec_heat="1000",
    roughness="MediumSmooth")  # -> mat; plug-in component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

opaquemat_381 = HBOpaqueMaterial(name="HollowBrick_12cm", thickness="0.120", conductivity="0.387", density="800", spec_heat="1000", roughness="Rough")  # -> mat; plug-in component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

opaquemat_382 = HBOpaqueMaterial(
    name="InternalPlaster",
    thickness="0.020",
    conductivity="0.700",
    density="1400",
    spec_heat="1000",
    roughness="MediumSmooth")  # -> mat; plug-in component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

opaquemat_383 = HBOpaqueMaterial(name="CeramicTile", thickness="0.015", conductivity="1.470", density="1700", spec_heat="1000", roughness="MediumSmooth")  # -> mat; plug-in component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

opaquemat_384 = HBOpaqueMaterial(name="CementMortar", thickness="0.020", conductivity="1.400", density="2000", spec_heat="1000", roughness="Rough")  # -> mat; plug-in component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

opaquemat_385 = HBOpaqueMaterial(
    name="Slab_BrickBlkConc_16cm",
    thickness=".160",
    conductivity="0.560",
    density="900",
    spec_heat="1000",
    roughness="Rough")  # -> mat; plug-in component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

opaquemat_386 = HBOpaqueMaterial(name="CementMortar", thickness="0.020", conductivity="1.400", density="2000", spec_heat="1000", roughness="Rough")  # -> mat; plug-in component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

opaquemat_387 = HBOpaqueMaterial(name="CementMortar", thickness="0.020", conductivity="1.400", density="2000", spec_heat="1000", roughness="Rough")  # -> mat; plug-in component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

opaquemat_388 = HBOpaqueMaterial(name="CeramicTile", thickness="0.015", conductivity="1.470", density="1700", spec_heat="1000", roughness="MediumSmooth")  # -> mat; plug-in component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

opaquemat_389 = HBOpaqueMaterial(name="LtwtConcScreed_2cm", thickness=".020", conductivity=".580", density="400", spec_heat="1000", roughness="Rough")  # -> mat; plug-in component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

opaquemat_390 = HBOpaqueMaterial(name="CeramicTile", thickness="0.015", conductivity="1.470", density="1700", spec_heat="1000", roughness="MediumSmooth")  # -> mat; plug-in component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

opaquemat_391 = HBOpaqueMaterial(name="CementMortar", thickness="0.020", conductivity="1.400", density="2000", spec_heat="1000", roughness="Rough")  # -> mat; plug-in component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

glassmat_12 = HBGlassMaterial(
    name="Glass_06.02_Interior",
    thickness="0.004",
    transmittance="0.85",
    reflectance="0.075",
    emiss_front="0.84",
    emiss_back="0.84",
    conductivity="0.9")  # -> mat; plug-in component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

opaquemat_392 = HBOpaqueMaterial(name="LtwtConcScreed_2cm", thickness=".020", conductivity=".580", density="400", spec_heat="1000", roughness="Rough")  # -> mat; plug-in component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

opaquemat_393 = HBOpaqueMaterial(name="WoodDoor_Double", thickness="0.045", conductivity="0.10714", density="1600", spec_heat="550", roughness="Smooth")  # -> mat; plug-in component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

opaquematnomass_9 = HBOpaqueMaterialNoMass(name="FictitiousLayer_R0.3", r_value="0.3")  # -> mat; plug-in component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

opaquemat_394 = HBOpaqueMaterial(
    name="InsulationPanel",
    thickness="0.017",
    conductivity="0.045",
    density="30",
    spec_heat="1220",
    roughness="MediumSmooth")  # -> mat; plug-in component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

opaquematnomass_10 = HBOpaqueMaterialNoMass(name="FictitiousLayer_R0.3", r_value="0.3")  # -> mat; plug-in component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

opaquemat_395 = HBOpaqueMaterial(name="LtwtConcScreed_2cm", thickness=".020", conductivity=".580", density="400", spec_heat="1000", roughness="Rough")  # -> mat; plug-in component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

opaquemat_396 = HBOpaqueMaterial(name="CementMortar", thickness="0.020", conductivity="1.400", density="2000", spec_heat="1000", roughness="Rough")  # -> mat; plug-in component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

opaquemat_397 = HBOpaqueMaterial(
    name="Slab_BrickBlkConc_16cm",
    thickness=".160",
    conductivity="0.560",
    density="900",
    spec_heat="1000",
    roughness="Rough")  # -> mat; plug-in component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

opaquemat_398 = HBOpaqueMaterial(name="ExternalPlaster", thickness=".020", conductivity="0.900", density="1800", spec_heat="1000", roughness="Rough")  # -> mat; plug-in component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

opaquemat_399 = HBOpaqueMaterial(name="CementMortar", thickness="0.020", conductivity="1.400", density="2000", spec_heat="1000", roughness="Rough")  # -> mat; plug-in component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

opaquemat_400 = HBOpaqueMaterial(name="SolidBrick", thickness=".382", conductivity="0.720", density="1800", spec_heat="1000", roughness="Rough")  # -> mat; plug-in component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

opaquemat_401 = HBOpaqueMaterial(name="CeramicTile", thickness="0.015", conductivity="1.470", density="1700", spec_heat="1000", roughness="MediumSmooth")  # -> mat; plug-in component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

opaquemat_402 = HBOpaqueMaterial(name="ExternalPlaster", thickness=".020", conductivity="0.900", density="1800", spec_heat="1000", roughness="Rough")  # -> mat; plug-in component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

opaquemat_403 = HBOpaqueMaterial(
    name="InsulationPanel",
    thickness="0.017",
    conductivity="0.045",
    density="30",
    spec_heat="1220",
    roughness="MediumSmooth")  # -> mat; plug-in component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

opaquemat_404 = HBOpaqueMaterial(name="CementMortar", thickness="0.020", conductivity="1.400", density="2000", spec_heat="1000", roughness="Rough")  # -> mat; plug-in component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

opaquemat_405 = HBOpaqueMaterial(
    name="Slab_BrickBlkConc_16cm",
    thickness=".160",
    conductivity="0.560",
    density="900",
    spec_heat="1000",
    roughness="Rough")  # -> mat; plug-in component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

glassmat_13 = HBGlassMaterial(
    name="Glass_06.01_Interior",
    thickness="0.004",
    transmittance="0.85",
    reflectance="0.075",
    emiss_front="0.84",
    emiss_back="0.84",
    conductivity="0.9")  # -> mat; plug-in component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

opaquemat_406 = HBOpaqueMaterial(name="CeramicTile", thickness="0.015", conductivity="1.470", density="1700", spec_heat="1000", roughness="MediumSmooth")  # -> mat; plug-in component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

opaquemat_407 = HBOpaqueMaterial(name="CementMortar", thickness="0.020", conductivity="1.400", density="2000", spec_heat="1000", roughness="Rough")  # -> mat; plug-in component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

opaquemat_408 = HBOpaqueMaterial(name="LtwtConcScreed_2cm", thickness=".020", conductivity=".580", density="400", spec_heat="1000", roughness="Rough")  # -> mat; plug-in component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

opaquemat_409 = HBOpaqueMaterial(name="ExternalPlaster", thickness=".020", conductivity="0.900", density="1800", spec_heat="1000", roughness="Rough")  # -> mat; plug-in component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

opaquemat_410 = HBOpaqueMaterial(
    name="InsulationPanel",
    thickness="0.017",
    conductivity="0.045",
    density="30",
    spec_heat="1220",
    roughness="MediumSmooth")  # -> mat; plug-in component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

opaquematnomass_11 = HBOpaqueMaterialNoMass(name="FictitiousLayer_R0.3", r_value="0.3")  # -> mat; plug-in component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

opaquemat_411 = HBOpaqueMaterial(name="WoodPlanking", thickness="0.020", conductivity="0.150", density="550", spec_heat="1600", roughness="Rough")  # -> mat; plug-in component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

# ----
# R6TH
opaquemat_412 = HBOpaqueMaterial(name="ExternalPlaster", thickness=".020", conductivity="0.900", density="1800", spec_heat="1000", roughness="Rough")  # -> mat; plug-in component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

opaquemat_413 = HBOpaqueMaterial(name="SemiSolidBrick_25cm", thickness="0.250", conductivity="0.400", density="1000", spec_heat="1000", roughness="Rough")  # -> mat; plug-in component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

opaquemat_414 = HBOpaqueMaterial(name="InsulatedCavity", thickness="0.0124", conductivity="0.045", density="30", spec_heat="570", roughness="Rough")  # -> mat; plug-in component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

opaquemat_415 = HBOpaqueMaterial(
    name="InternalPlaster",
    thickness="0.020",
    conductivity="0.700",
    density="1400",
    spec_heat="1000",
    roughness="MediumSmooth")  # -> mat; plug-in component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

opaquemat_416 = HBOpaqueMaterial(
    name="InsulationPanel",
    thickness="0.035",
    conductivity="0.045",
    density="30",
    spec_heat="1220",
    roughness="MediumSmooth")  # -> mat; plug-in component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

opaquemat_417 = HBOpaqueMaterial(name="CementMortar", thickness="0.020", conductivity="1.400", density="2000", spec_heat="1000", roughness="Rough")  # -> mat; plug-in component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

opaquemat_418 = HBOpaqueMaterial(name="HollowBrick_8cm", thickness="0.080", conductivity="0.400", density="800", spec_heat="1000", roughness="Rough")  # -> mat; plug-in component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

opaquemat_419 = HBOpaqueMaterial(
    name="Slab_BrickBlkConc_16cm",
    thickness=".160",
    conductivity="0.560",
    density="900",
    spec_heat="1000",
    roughness="Rough")  # -> mat; plug-in component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

merge_81 = Merge(Data1=opaquemat_339, Data2=opaquemat_346, Data3=opaquemat_335, Data4=opaquemat_347)
opaqueconstr_101 = HBOpaqueConstruction(name="Wall_06.02Mod_Interior", materials=merge_81)  # -> constr; plug-in component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

merge_82 = Merge(Data1=opaquemat_351, Data2=opaquemat_349, Data3=opaquemat_350, Data4=opaquemat_355, Data5=opaquemat_352)
opaqueconstr_102 = HBOpaqueConstruction(name="Wall_06.02", materials=merge_82)  # -> constr; plug-in component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

merge_83 = Merge(Data1=opaquemat_362, Data2=opaquemat_363, Data3=opaquemat_368, Data4=opaquemat_369, Data5=opaquemat_367)

merge_84 = Merge(
    Data1=opaquemat_340,
    Data2=opaquemat_337,
    Data3=opaquemat_329,
    Data4=opaquemat_328,
    Data5=opaquemat_330,
    Data6=opaquemat_331,
    Data7=opaquemat_332,
    Data8=opaquematnomass_7)
opaqueconstr_103 = HBOpaqueConstruction(name="Floor_06.01_GRroof", materials=merge_84)  # -> constr; plug-in component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

merge_85 = Merge(
    Data1=opaquemat_360,
    Data2=opaquemat_356,
    Data3=opaquemat_361,
    Data4=opaquemat_359,
    Data5=opaquemat_357,
    Data6=opaquemat_345)
opaqueconstr_104 = HBOpaqueConstruction(name="Floor_06.01_IntClg", materials=merge_85)  # -> constr; plug-in component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

merge_86 = Merge(
    Data1=opaquematnomass_6,
    Data2=opaquemat_341,
    Data3=opaquemat_354,
    Data4=opaquemat_353,
    Data5=opaquemat_342,
    Data6=opaquemat_327,
    Data7=opaquemat_326,
    Data8=opaquemat_325)
opaqueconstr_105 = HBOpaqueConstruction(name="Floor_06.01_GRfloor", materials=merge_86)  # -> constr; plug-in component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

# ----
# Ground Subset -
# same as interior floors,
# ground & roof must be inverse.
# 
# Base ground & roof construction
# on exterior floor for same archetype
# Make this same thickness as W1
panel_117 = Panel("Wall_06.02_UGwall")
opaqueconstr_106 = HBOpaqueConstruction(name=panel_117, materials=opaquemat_338)  # -> constr; plug-in component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
groundsubset_11 = HBGroundConstructionSubset(ground_wall=opaqueconstr_106, ground_roof=opaqueconstr_103, ground_floor=opaqueconstr_105)  # -> ground_set; plug-in component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
decnstrmat_21 = HBDeconstructMaterial(mat=groundsubset_11)  # -> values, attr_names, r_val_si, r_val_ip; plug-in component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
panel_118 = Panel(groundsubset_11)
panel_119 = Panel(decnstrmat_21.r_val_si)

merge_87 = Merge(Data1=opaquemat_377, Data2=opaquemat_381, Data3=opaquemat_375, Data4=opaquemat_382)
opaqueconstr_107 = HBOpaqueConstruction(name="Wall_06.02Mod_Interior", materials=merge_87)  # -> constr; plug-in component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

opaqueconstr_108 = HBOpaqueConstruction(name="Roof_06.02", materials=merge_83)  # -> constr; plug-in component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

merge_88 = Merge(
    Data1=opaquemat_333,
    Data2=opaquemat_336,
    Data3=opaquemat_343,
    Data5=opaquemat_344,
    Data6=opaquemat_358,
    Data7=opaquemat_348)
opaqueconstr_109 = HBOpaqueConstruction(name="Floor_06.01_IntFlr", materials=merge_88)  # -> constr; plug-in component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

merge_89 = Merge(
    Data1=opaquematnomass_8,
    Data2=opaquemat_370,
    Data3=opaquemat_372,
    Data4=opaquemat_373,
    Data5=opaquemat_371,
    Data6=opaquemat_366,
    Data7=opaquemat_365,
    Data8=opaquemat_364)
opaqueconstr_110 = HBOpaqueConstruction(name="Floor_06.01", materials=merge_89)  # -> constr; plug-in component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

merge_90 = Merge(Data1=opaquemat_412, Data2=opaquemat_413, Data3=opaquemat_414, Data4=opaquemat_418, Data5=opaquemat_415)
opaqueconstr_111 = HBOpaqueConstruction(name="Wall_06.02", materials=merge_90)  # -> constr; plug-in component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

merge_91 = Merge(
    Data1=opaquemat_388,
    Data2=opaquemat_384,
    Data3=opaquemat_389,
    Data4=opaquemat_387,
    Data5=opaquemat_385,
    Data6=opaquemat_380)
opaqueconstr_112 = HBOpaqueConstruction(name="Floor_06.01_IntClg", materials=merge_91)  # -> constr; plug-in component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

merge_92 = Merge(Data1=opaquemat_411, Data2=opaquemat_416)
opaqueconstr_113 = HBOpaqueConstruction(name="Roof_06.01", materials=merge_92)  # -> constr; plug-in component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

merge_93 = Merge(
    Data1=opaquemat_401,
    Data2=opaquemat_399,
    Data3=opaquemat_395,
    Data4=opaquemat_394,
    Data5=opaquemat_396,
    Data6=opaquemat_397,
    Data7=opaquemat_398,
    Data8=opaquematnomass_10)
opaqueconstr_114 = HBOpaqueConstruction(name="Floor_06.01_GRroof", materials=merge_93)  # -> constr; plug-in component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

merge_94 = Merge(
    Data1=opaquematnomass_9,
    Data2=opaquemat_402,
    Data3=opaquemat_405,
    Data4=opaquemat_404,
    Data5=opaquemat_403,
    Data6=opaquemat_392,
    Data7=opaquemat_391,
    Data8=opaquemat_390)
opaqueconstr_115 = HBOpaqueConstruction(name="Floor_06.01_GRfloor", materials=merge_94)  # -> constr; plug-in component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

# ----
# Ground Subset -
# same as interior floors,
# ground & roof must be inverse.
# 
# Base ground & roof construction
# on exterior floor for same archetype
# Make this same thickness as W1
panel_120 = Panel("Wall_06.02_UGwall")
opaqueconstr_116 = HBOpaqueConstruction(name=panel_120, materials=opaquemat_400)  # -> constr; plug-in component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
groundsubset_12 = HBGroundConstructionSubset(ground_wall=opaqueconstr_116, ground_roof=opaqueconstr_114, ground_floor=opaqueconstr_115)  # -> ground_set; plug-in component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
decnstrmat_22 = HBDeconstructMaterial(mat=groundsubset_12)  # -> values, attr_names, r_val_si, r_val_ip; plug-in component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
panel_121 = Panel(groundsubset_12)
panel_122 = Panel(decnstrmat_22.r_val_si)

# ----
# Interior Subset -
# Note interior floors & ceilings must
# be inverse of each other
interiorsubset_11 = HBInteriorConstructionSubset(interior_wall=opaqueconstr_101, ceiling=opaqueconstr_104, interior_floor=opaqueconstr_109)  # -> interior_set; plug-in component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
panel_123 = Panel(interiorsubset_11)

merge_95 = Merge(
    Data1=opaquemat_374,
    Data2=opaquemat_376,
    Data3=opaquemat_378,
    Data5=opaquemat_379,
    Data6=opaquemat_386,
    Data7=opaquemat_383)
opaqueconstr_117 = HBOpaqueConstruction(name="Floor_06.01_IntFlr", materials=merge_95)  # -> constr; plug-in component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

# ----
# Exterior Subset
exteriorsubset_11 = HBExteriorConstructionSubset(exterior_wall=opaqueconstr_102, exterior_roof=opaqueconstr_108, exposed_floor=opaqueconstr_110)  # -> exterior_set; plug-in component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
panel_124 = Panel(exteriorsubset_11)
decnstrmat_23 = HBDeconstructMaterial(mat=exteriorsubset_11)  # -> values, attr_names, r_val_si, r_val_ip; plug-in component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
panel_125 = Panel(decnstrmat_23.r_val_si)

merge_96 = Merge(
    Data1=opaquematnomass_11,
    Data2=opaquemat_409,
    Data3=opaquemat_419,
    Data4=opaquemat_417,
    Data5=opaquemat_410,
    Data6=opaquemat_408,
    Data7=opaquemat_407,
    Data8=opaquemat_406)
opaqueconstr_118 = HBOpaqueConstruction(name="Floor_06.01", materials=merge_96)  # -> constr; plug-in component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

# ----
# Interior Subset -
# Note interior floors & ceilings must
# be inverse of each other
interiorsubset_12 = HBInteriorConstructionSubset(interior_wall=opaqueconstr_107, ceiling=opaqueconstr_112, interior_floor=opaqueconstr_117)  # -> interior_set; plug-in component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
panel_126 = Panel(interiorsubset_12)

# ----
# Exterior Subset
exteriorsubset_12 = HBExteriorConstructionSubset(exterior_wall=opaqueconstr_111, exterior_roof=opaqueconstr_113, exposed_floor=opaqueconstr_118)  # -> exterior_set; plug-in component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
panel_127 = Panel(exteriorsubset_12)
decnstrmat_24 = HBDeconstructMaterial(mat=exteriorsubset_12)  # -> values, attr_names, r_val_si, r_val_ip; plug-in component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
panel_128 = Panel(decnstrmat_24.r_val_si)

opaquemat_420 = HBOpaqueMaterial(name="CeramicTile", thickness="0.015", conductivity="1.470", density="1700", spec_heat="1000", roughness="MediumSmooth")  # -> mat; plug-in component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

opaquemat_421 = HBOpaqueMaterial(name="CementMortar", thickness="0.020", conductivity="1.400", density="2000", spec_heat="1000", roughness="Rough")  # -> mat; plug-in component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

opaquemat_422 = HBOpaqueMaterial(
    name="Slab_BrickBlkConc_16cm",
    thickness=".160",
    conductivity="0.560",
    density="900",
    spec_heat="1000",
    roughness="Rough")  # -> mat; plug-in component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

opaquemat_423 = HBOpaqueMaterial(
    name="InternalPlaster_Thin",
    thickness="0.010",
    conductivity="0.700",
    density="1400",
    spec_heat="1000",
    roughness="MediumSmooth")  # -> mat; plug-in component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

opaquemat_424 = HBOpaqueMaterial(name="LtwtConcScreed_2cm", thickness=".020", conductivity=".580", density="400", spec_heat="1000", roughness="Rough")  # -> mat; plug-in component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

opaquemat_425 = HBOpaqueMaterial(
    name="InternalPlaster",
    thickness=".020",
    conductivity="0.700",
    density="1400",
    spec_heat="1000",
    roughness="MediumSmooth")  # -> mat; plug-in component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

opaquemat_426 = HBOpaqueMaterial(
    name="Slab_BrickBlkConc_16cm",
    thickness=".160",
    conductivity="0.560",
    density="900",
    spec_heat="1000",
    roughness="Rough")  # -> mat; plug-in component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

opaquemat_427 = HBOpaqueMaterial(name="CementMortar", thickness="0.020", conductivity="1.400", density="2000", spec_heat="1000", roughness="Rough")  # -> mat; plug-in component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

opaquemat_428 = HBOpaqueMaterial(
    name="ConcretePanel_Prefab",
    thickness="0.225",
    conductivity="0.580",
    density="1400",
    spec_heat="1000",
    roughness="Rough")  # -> mat; plug-in component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

opaquemat_429 = HBOpaqueMaterial(
    name="InternalPlaster",
    thickness="0.020",
    conductivity="0.700",
    density="1400",
    spec_heat="1000",
    roughness="MediumSmooth")  # -> mat; plug-in component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

opaquemat_430 = HBOpaqueMaterial(
    name="InternalPlaster_Thin",
    thickness="0.010",
    conductivity="0.700",
    density="1400",
    spec_heat="1000",
    roughness="MediumSmooth")  # -> mat; plug-in component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

opaquemat_431 = HBOpaqueMaterial(name="FiberglassInsulation", thickness="0.044", conductivity="0.040", density="30", spec_heat="670", roughness="Rough")  # -> mat; plug-in component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

opaquematnomass_12 = HBOpaqueMaterialNoMass(name="FictitiousLayer_R0.3", r_value="0.3")  # -> mat; plug-in component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

opaquemat_432 = HBOpaqueMaterial(name="LtwtConcScreed_2cm", thickness=".020", conductivity=".580", density="400", spec_heat="1000", roughness="Rough")  # -> mat; plug-in component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

opaquemat_433 = HBOpaqueMaterial(name="CementMortar", thickness="0.020", conductivity="1.400", density="2000", spec_heat="1000", roughness="Rough")  # -> mat; plug-in component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

opaquemat_434 = HBOpaqueMaterial(
    name="InternalPlaster_Thin",
    thickness="0.010",
    conductivity="0.700",
    density="1400",
    spec_heat="1000",
    roughness="MediumSmooth")  # -> mat; plug-in component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

opaquemat_435 = HBOpaqueMaterial(name="CeramicTile", thickness="0.015", conductivity="1.470", density="1700", spec_heat="1000", roughness="MediumSmooth")  # -> mat; plug-in component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

opaquemat_436 = HBOpaqueMaterial(
    name="ConcretePanel_Prefab",
    thickness="0.225",
    conductivity="0.580",
    density="1400",
    spec_heat="1000",
    roughness="Rough")  # -> mat; plug-in component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

opaquemat_437 = HBOpaqueMaterial(name="CementMortar", thickness="0.020", conductivity="1.400", density="2000", spec_heat="1000", roughness="Rough")  # -> mat; plug-in component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

opaquemat_438 = HBOpaqueMaterial(name="CementMortar", thickness="0.020", conductivity="1.400", density="2000", spec_heat="1000", roughness="Rough")  # -> mat; plug-in component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

opaquemat_439 = HBOpaqueMaterial(
    name="Slab_BrickBlkConc_16cm",
    thickness=".160",
    conductivity="0.560",
    density="900",
    spec_heat="1000",
    roughness="Rough")  # -> mat; plug-in component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
opaquemat_440 = HBOpaqueMaterial(name="CeramicTile", thickness="0.015", conductivity="1.470", density="1700", spec_heat="1000", roughness="MediumSmooth")  # -> mat; plug-in component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

opaquemat_441 = HBOpaqueMaterial(name="LtwtConcScreed_2cm", thickness=".020", conductivity=".580", density="400", spec_heat="1000", roughness="Rough")  # -> mat; plug-in component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

opaquemat_442 = HBOpaqueMaterial(name="LtwtConcScreed_2cm", thickness=".020", conductivity=".580", density="400", spec_heat="1000", roughness="Rough")  # -> mat; plug-in component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

opaquemat_443 = HBOpaqueMaterial(name="InsulationPanel", thickness="0.037", conductivity="0.045", density="30", spec_heat="1220", roughness="Rough")  # -> mat; plug-in component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

opaquemat_444 = HBOpaqueMaterial(name="CementMortar", thickness="0.020", conductivity="1.400", density="2000", spec_heat="1000", roughness="Rough")  # -> mat; plug-in component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

opaquemat_445 = HBOpaqueMaterial(name="CementMortar", thickness="0.020", conductivity="1.400", density="2000", spec_heat="1000", roughness="Rough")  # -> mat; plug-in component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

opaquematnomass_13 = HBOpaqueMaterialNoMass(name="FictitiousLayer_R0.3", r_value="0.3")  # -> mat; plug-in component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

opaquemat_446 = HBOpaqueMaterial(
    name="InternalPlaster",
    thickness="0.020",
    conductivity="0.700",
    density="1400",
    spec_heat="1000",
    roughness="MediumSmooth")  # -> mat; plug-in component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

opaquemat_447 = HBOpaqueMaterial(name="LtwtConcScreed_2cm", thickness=".020", conductivity=".580", density="400", spec_heat="1000", roughness="Rough")  # -> mat; plug-in component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

opaquemat_448 = HBOpaqueMaterial(name="CeramicTile", thickness="0.015", conductivity="1.470", density="1700", spec_heat="1000", roughness="MediumSmooth")  # -> mat; plug-in component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

# ----
# R7TH
opaquemat_449 = HBOpaqueMaterial(name="ExternalPlaster", thickness=".020", conductivity="0.900", density="1800", spec_heat="1000", roughness="Rough")  # -> mat; plug-in component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

opaquemat_450 = HBOpaqueMaterial(
    name="InsulationPanel",
    thickness="0.0296",
    conductivity="0.045",
    density="30",
    spec_heat="1220",
    roughness="MediumSmooth")  # -> mat; plug-in component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

opaquematnomass_14 = HBOpaqueMaterialNoMass(name="FictitiousLayer_R0.3", r_value="0.3")  # -> mat; plug-in component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

opaquemat_451 = HBOpaqueMaterial(name="LtwtConcScreed_2cm", thickness=".020", conductivity=".580", density="400", spec_heat="1000", roughness="Rough")  # -> mat; plug-in component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

opaquemat_452 = HBOpaqueMaterial(name="CementMortar", thickness="0.020", conductivity="1.400", density="2000", spec_heat="1000", roughness="Rough")  # -> mat; plug-in component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

opaquemat_453 = HBOpaqueMaterial(
    name="Slab_BrickBlkConc_16cm",
    thickness=".160",
    conductivity="0.560",
    density="900",
    spec_heat="1000",
    roughness="Rough")  # -> mat; plug-in component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

opaquemat_454 = HBOpaqueMaterial(name="ExternalPlaster", thickness=".020", conductivity="0.900", density="1800", spec_heat="1000", roughness="Rough")  # -> mat; plug-in component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

opaquemat_455 = HBOpaqueMaterial(name="CementMortar", thickness="0.020", conductivity="1.400", density="2000", spec_heat="1000", roughness="Rough")  # -> mat; plug-in component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

opaquemat_456 = HBOpaqueMaterial(name="SolidBrick", thickness=".299", conductivity="0.720", density="2000", spec_heat="1000", roughness="Rough")  # -> mat; plug-in component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

opaquemat_457 = HBOpaqueMaterial(name="CeramicTile", thickness="0.015", conductivity="1.470", density="1700", spec_heat="1000", roughness="MediumSmooth")  # -> mat; plug-in component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

opaquemat_458 = HBOpaqueMaterial(name="ExternalPlaster", thickness=".020", conductivity="0.900", density="1800", spec_heat="1000", roughness="Rough")  # -> mat; plug-in component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

opaquemat_459 = HBOpaqueMaterial(
    name="InsulationPanel",
    thickness="0.0296",
    conductivity="0.045",
    density="30",
    spec_heat="1220",
    roughness="MediumSmooth")  # -> mat; plug-in component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

glassmat_14 = HBGlassMaterial(
    name="Glass_06.01_Interior",
    thickness="0.004",
    transmittance="0.85",
    reflectance="0.075",
    emiss_front="0.84",
    emiss_back="0.84",
    conductivity="0.9")  # -> mat; plug-in component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

opaquemat_460 = HBOpaqueMaterial(name="ExternalPlaster", thickness=".020", conductivity="0.900", density="1800", spec_heat="1000", roughness="Rough")  # -> mat; plug-in component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

opaquematnomass_15 = HBOpaqueMaterialNoMass(name="FictitiousLayer_R0.3", r_value="0.3")  # -> mat; plug-in component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

opaquemat_461 = HBOpaqueMaterial(name="InsulationPanel", thickness="0.0296", conductivity="0.045", density="30", spec_heat="1220", roughness="Rough")  # -> mat; plug-in component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

opaquemat_462 = HBOpaqueMaterial(name="WoodDoor_Double", thickness="0.045", conductivity="0.10714", density="1600", spec_heat="550", roughness="Smooth")  # -> mat; plug-in component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

opaquemat_463 = HBOpaqueMaterial(
    name="Slab_BrickBlkConc_16cm",
    thickness=".160",
    conductivity="0.560",
    density="900",
    spec_heat="1000",
    roughness="Rough")  # -> mat; plug-in component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

opaquemat_464 = HBOpaqueMaterial(name="CementMortar", thickness="0.020", conductivity="1.400", density="2000", spec_heat="1000", roughness="Rough")  # -> mat; plug-in component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

opaquemat_465 = HBOpaqueMaterial(
    name="Slab_BrickBlkConc_16cm",
    thickness=".160",
    conductivity="0.560",
    density="900",
    spec_heat="1000",
    roughness="Rough")  # -> mat; plug-in component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

opaquemat_466 = HBOpaqueMaterial(name="CementMortar", thickness="0.020", conductivity="1.400", density="2000", spec_heat="1000", roughness="Rough")  # -> mat; plug-in component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

glassmat_15 = HBGlassMaterial(
    name="Glass_06.01_Interior",
    thickness="0.004",
    transmittance="0.85",
    reflectance="0.075",
    emiss_front="0.84",
    emiss_back="0.84",
    conductivity="0.9")  # -> mat; plug-in component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

opaquemat_467 = HBOpaqueMaterial(
    name="InternalPlaster_Thin",
    thickness="0.010",
    conductivity="0.700",
    density="1400",
    spec_heat="1000",
    roughness="MediumSmooth")  # -> mat; plug-in component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

opaquemat_468 = HBOpaqueMaterial(name="FiberglassInsulation", thickness="0.044", conductivity="0.040", density="30", spec_heat="670", roughness="Rough")  # -> mat; plug-in component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

opaquematnomass_16 = HBOpaqueMaterialNoMass(name="FictitiousLayer_R0.3", r_value="0.3")  # -> mat; plug-in component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

opaquemat_469 = HBOpaqueMaterial(name="LtwtConcScreed_2cm", thickness=".020", conductivity=".580", density="400", spec_heat="1000", roughness="Rough")  # -> mat; plug-in component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

opaquemat_470 = HBOpaqueMaterial(
    name="ConcretePanel_Prefab",
    thickness="0.225",
    conductivity="0.580",
    density="1400",
    spec_heat="1000",
    roughness="Rough")  # -> mat; plug-in component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

opaquemat_471 = HBOpaqueMaterial(
    name="Slab_BrickBlkConc_16cm",
    thickness=".160",
    conductivity="0.560",
    density="900",
    spec_heat="1000",
    roughness="Rough")  # -> mat; plug-in component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

opaquemat_472 = HBOpaqueMaterial(name="CeramicTile", thickness="0.015", conductivity="1.470", density="1700", spec_heat="1000", roughness="MediumSmooth")  # -> mat; plug-in component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

opaquemat_473 = HBOpaqueMaterial(name="InsulationPanel", thickness="0.037", conductivity="0.045", density="30", spec_heat="1220", roughness="Rough")  # -> mat; plug-in component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

opaquemat_474 = HBOpaqueMaterial(name="CementMortar", thickness="0.020", conductivity="1.400", density="2000", spec_heat="1000", roughness="Rough")  # -> mat; plug-in component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

opaquemat_475 = HBOpaqueMaterial(name="CementMortar", thickness="0.020", conductivity="1.400", density="2000", spec_heat="1000", roughness="Rough")  # -> mat; plug-in component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

opaquemat_476 = HBOpaqueMaterial(
    name="InternalPlaster",
    thickness="0.020",
    conductivity="0.700",
    density="1400",
    spec_heat="1000",
    roughness="MediumSmooth")  # -> mat; plug-in component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

opaquemat_477 = HBOpaqueMaterial(name="LtwtConcScreed_2cm", thickness=".020", conductivity=".580", density="400", spec_heat="1000", roughness="Rough")  # -> mat; plug-in component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

# ----
# R7SF
opaquemat_478 = HBOpaqueMaterial(name="ExternalPlaster", thickness=".020", conductivity="0.900", density="1800", spec_heat="1000", roughness="Rough")  # -> mat; plug-in component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

opaquemat_479 = HBOpaqueMaterial(name="ExternalPlaster", thickness=".020", conductivity="0.900", density="1800", spec_heat="1000", roughness="Rough")  # -> mat; plug-in component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

opaquemat_480 = HBOpaqueMaterial(name="InsulationPanel", thickness="0.0296", conductivity="0.045", density="30", spec_heat="1220", roughness="Rough")  # -> mat; plug-in component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

opaquematnomass_17 = HBOpaqueMaterialNoMass(name="FictitiousLayer_R0.3", r_value="0.3")  # -> mat; plug-in component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

glassmat_16 = HBGlassMaterial(
    name="Glass_07.01_Interior",
    thickness="0.006",
    transmittance="0.755",
    reflectance="0.07",
    emiss_front="0.84",
    emiss_back="0.84",
    conductivity=".9")  # -> mat; plug-in component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

opaquemat_481 = HBOpaqueMaterial(
    name="Slab_BrickBlkConc_16cm",
    thickness=".160",
    conductivity="0.560",
    density="900",
    spec_heat="1000",
    roughness="Rough")  # -> mat; plug-in component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

opaquemat_482 = HBOpaqueMaterial(name="CementMortar", thickness="0.020", conductivity="1.400", density="2000", spec_heat="1000", roughness="Rough")  # -> mat; plug-in component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

opaquemat_483 = HBOpaqueMaterial(name="CeramicTile", thickness="0.015", conductivity="1.470", density="1700", spec_heat="1000", roughness="MediumSmooth")  # -> mat; plug-in component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

opaquemat_484 = HBOpaqueMaterial(name="CementMortar", thickness="0.020", conductivity="1.400", density="2000", spec_heat="1000", roughness="Rough")  # -> mat; plug-in component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

opaquemat_485 = HBOpaqueMaterial(name="LtwtConcScreed_2cm", thickness=".020", conductivity=".580", density="400", spec_heat="1000", roughness="Rough")  # -> mat; plug-in component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

opaquemat_486 = HBOpaqueMaterial(name="CeramicTile", thickness="0.015", conductivity="1.470", density="1700", spec_heat="1000", roughness="MediumSmooth")  # -> mat; plug-in component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

opaquemat_487 = HBOpaqueMaterial(name="CementMortar", thickness="0.020", conductivity="1.400", density="2000", spec_heat="1000", roughness="Rough")  # -> mat; plug-in component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

opaquemat_488 = HBOpaqueMaterial(
    name="Slab_BrickBlkConc_16cm",
    thickness=".160",
    conductivity="0.560",
    density="900",
    spec_heat="1000",
    roughness="Rough")  # -> mat; plug-in component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

opaquemat_489 = HBOpaqueMaterial(name="LtwtConcScreed_2cm", thickness=".020", conductivity=".580", density="400", spec_heat="1000", roughness="Rough")  # -> mat; plug-in component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

opaquemat_490 = HBOpaqueMaterial(name="CementMortar", thickness="0.020", conductivity="1.400", density="2000", spec_heat="1000", roughness="Rough")  # -> mat; plug-in component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

opaquemat_491 = HBOpaqueMaterial(
    name="InternalPlaster",
    thickness=".020",
    conductivity="0.700",
    density="1400",
    spec_heat="1000",
    roughness="MediumSmooth")  # -> mat; plug-in component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

opaquemat_492 = HBOpaqueMaterial(
    name="Slab_BrickBlkConc_16cm",
    thickness=".160",
    conductivity="0.560",
    density="900",
    spec_heat="1000",
    roughness="Rough")  # -> mat; plug-in component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

opaquemat_493 = HBOpaqueMaterial(
    name="InternalPlaster_Thin",
    thickness="0.010",
    conductivity="0.700",
    density="1400",
    spec_heat="1000",
    roughness="MediumSmooth")  # -> mat; plug-in component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

opaquemat_494 = HBOpaqueMaterial(name="ExternalPlaster", thickness=".020", conductivity="0.900", density="1800", spec_heat="1000", roughness="Rough")  # -> mat; plug-in component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

opaquemat_495 = HBOpaqueMaterial(name="SolidBrick", thickness=".299", conductivity="0.720", density="1800", spec_heat="1000", roughness="Rough")  # -> mat; plug-in component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

opaquemat_496 = HBOpaqueMaterial(
    name="InsulationPanel",
    thickness="0.0296",
    conductivity="0.045",
    density="30",
    spec_heat="1220",
    roughness="MediumSmooth")  # -> mat; plug-in component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

opaquematnomass_18 = HBOpaqueMaterialNoMass(name="FictitiousLayer_R0.3", r_value="0.3")  # -> mat; plug-in component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

opaquematnomass_19 = HBOpaqueMaterialNoMass(name="FictitiousLayer_R0.3", r_value="0.3")  # -> mat; plug-in component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

opaquemat_497 = HBOpaqueMaterial(
    name="ConcretePanel_Prefab",
    thickness="0.225",
    conductivity="0.580",
    density="1400",
    spec_heat="1000",
    roughness="Rough")  # -> mat; plug-in component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

opaquemat_498 = HBOpaqueMaterial(
    name="InternalPlaster",
    thickness="0.020",
    conductivity="0.700",
    density="1400",
    spec_heat="1000",
    roughness="MediumSmooth")  # -> mat; plug-in component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

opaquemat_499 = HBOpaqueMaterial(name="CementMortar", thickness="0.020", conductivity="1.400", density="2000", spec_heat="1000", roughness="Rough")  # -> mat; plug-in component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

opaquemat_500 = HBOpaqueMaterial(
    name="InternalPlaster_Thin",
    thickness="0.010",
    conductivity="0.700",
    density="1400",
    spec_heat="1000",
    roughness="MediumSmooth")  # -> mat; plug-in component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

opaquemat_501 = HBOpaqueMaterial(
    name="InsulationPanel",
    thickness="0.0296",
    conductivity="0.045",
    density="30",
    spec_heat="1220",
    roughness="MediumSmooth")  # -> mat; plug-in component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

opaquemat_502 = HBOpaqueMaterial(
    name="Slab_BrickBlkConc_16cm",
    thickness=".160",
    conductivity="0.560",
    density="900",
    spec_heat="1000",
    roughness="Rough")  # -> mat; plug-in component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

opaquemat_503 = HBOpaqueMaterial(name="CementMortar", thickness="0.020", conductivity="1.400", density="2000", spec_heat="1000", roughness="Rough")  # -> mat; plug-in component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

opaquemat_504 = HBOpaqueMaterial(name="CementMortar", thickness="0.020", conductivity="1.400", density="2000", spec_heat="1000", roughness="Rough")  # -> mat; plug-in component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

opaquemat_505 = HBOpaqueMaterial(name="LtwtConcScreed_2cm", thickness=".020", conductivity=".580", density="400", spec_heat="1000", roughness="Rough")  # -> mat; plug-in component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

opaquemat_506 = HBOpaqueMaterial(name="CementMortar", thickness="0.020", conductivity="1.400", density="2000", spec_heat="1000", roughness="Rough")  # -> mat; plug-in component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

opaquemat_507 = HBOpaqueMaterial(
    name="Slab_BrickBlkConc_16cm",
    thickness=".160",
    conductivity="0.560",
    density="900",
    spec_heat="1000",
    roughness="Rough")  # -> mat; plug-in component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

opaquemat_508 = HBOpaqueMaterial(name="ExternalPlaster", thickness=".020", conductivity="0.900", density="1800", spec_heat="1000", roughness="Rough")  # -> mat; plug-in component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

opaquemat_509 = HBOpaqueMaterial(name="LtwtConcScreed_2cm", thickness=".020", conductivity=".580", density="400", spec_heat="1000", roughness="Rough")  # -> mat; plug-in component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

opaquemat_510 = HBOpaqueMaterial(name="CementMortar", thickness="0.020", conductivity="1.400", density="2000", spec_heat="1000", roughness="Rough")  # -> mat; plug-in component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

opaquemat_511 = HBOpaqueMaterial(name="CeramicTile", thickness="0.015", conductivity="1.470", density="1700", spec_heat="1000", roughness="MediumSmooth")  # -> mat; plug-in component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

opaquemat_512 = HBOpaqueMaterial(name="CeramicTile", thickness="0.015", conductivity="1.470", density="1700", spec_heat="1000", roughness="MediumSmooth")  # -> mat; plug-in component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

merge_97 = Merge(Data1=opaquemat_423, Data2=opaquemat_428, Data3=opaquemat_434)
opaqueconstr_119 = HBOpaqueConstruction(name="Wall_06.05_Interior", materials=merge_97)  # -> constr; plug-in component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

merge_98 = Merge(Data1=opaquemat_449, Data2=opaquemat_436, Data3=opaquemat_431, Data4=opaquemat_430)
opaqueconstr_120 = HBOpaqueConstruction(name="Wall_07.03", materials=merge_98)  # -> constr; plug-in component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

merge_99 = Merge(
    Data1=opaquematnomass_12,
    Data2=opaquemat_432,
    Data3=opaquemat_443,
    Data4=opaquemat_444,
    Data5=opaquemat_439,
    Data6=opaquemat_446)
opaqueconstr_121 = HBOpaqueConstruction(name="Ceiling_07.01", materials=merge_99)  # -> constr; plug-in component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

merge_100 = Merge(
    Data1=opaquemat_420,
    Data2=opaquemat_421,
    Data3=opaquemat_424,
    Data4=opaquemat_427,
    Data5=opaquemat_422,
    Data6=opaquemat_429)
opaqueconstr_122 = HBOpaqueConstruction(name="Floor_07.01_IntClg", materials=merge_100)  # -> constr; plug-in component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

merge_101 = Merge(
    Data1=opaquemat_457,
    Data2=opaquemat_455,
    Data3=opaquemat_451,
    Data4=opaquemat_450,
    Data5=opaquemat_452,
    Data6=opaquemat_453,
    Data7=opaquemat_454,
    Data8=opaquematnomass_14)
opaqueconstr_123 = HBOpaqueConstruction(name="Floor_07.01_GRroof", materials=merge_101)  # -> constr; plug-in component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

merge_102 = Merge(
    Data1=opaquematnomass_13,
    Data2=opaquemat_458,
    Data3=opaquemat_463,
    Data4=opaquemat_464,
    Data5=opaquemat_459,
    Data6=opaquemat_442,
    Data7=opaquemat_438,
    Data8=opaquemat_435)
opaqueconstr_124 = HBOpaqueConstruction(name="Floor_07.01_GRfloor", materials=merge_102)  # -> constr; plug-in component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

# ----
# Ground Subset -
# same as interior floors,
# ground & roof must be inverse.
# 
# Base ground & roof construction
# on exterior floor for same archetype
# Make this same thickness as W1
panel_129 = Panel("Wall_07.03_UGwall")
opaqueconstr_125 = HBOpaqueConstruction(name=panel_129, materials=opaquemat_456)  # -> constr; plug-in component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
groundsubset_13 = HBGroundConstructionSubset(ground_wall=opaqueconstr_125, ground_roof=opaqueconstr_123, ground_floor=opaqueconstr_124)  # -> ground_set; plug-in component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
decnstrmat_25 = HBDeconstructMaterial(mat=groundsubset_13)  # -> values, attr_names, r_val_si, r_val_ip; plug-in component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
panel_130 = Panel(groundsubset_13)
panel_131 = Panel(decnstrmat_25.r_val_si)

merge_103 = Merge(
    Data1=opaquemat_425,
    Data2=opaquemat_426,
    Data3=opaquemat_433,
    Data4=opaquemat_441,
    Data5=opaquemat_437,
    Data6=opaquemat_448)
opaqueconstr_126 = HBOpaqueConstruction(name="Floor_07.01_IntFlr", materials=merge_103)  # -> constr; plug-in component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

merge_104 = Merge(Data1=opaquemat_478, Data2=opaquemat_470, Data3=opaquemat_468, Data4=opaquemat_467)
opaqueconstr_127 = HBOpaqueConstruction(name="Wall_07.03", materials=merge_104)  # -> constr; plug-in component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

merge_105 = Merge(
    Data1=opaquematnomass_15,
    Data2=opaquemat_460,
    Data3=opaquemat_465,
    Data4=opaquemat_466,
    Data5=opaquemat_461,
    Data6=opaquemat_447,
    Data7=opaquemat_445,
    Data8=opaquemat_440)
opaqueconstr_128 = HBOpaqueConstruction(name="Floor_07.01", materials=merge_105)  # -> constr; plug-in component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

merge_106 = Merge(
    Data1=opaquematnomass_16,
    Data2=opaquemat_469,
    Data3=opaquemat_473,
    Data4=opaquemat_474,
    Data5=opaquemat_471,
    Data6=opaquemat_476)
opaqueconstr_129 = HBOpaqueConstruction(name="Ceiling_07.01", materials=merge_106)  # -> constr; plug-in component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

merge_107 = Merge(Data1=opaquemat_500, Data2=opaquemat_497, Data3=opaquemat_493)
opaqueconstr_130 = HBOpaqueConstruction(name="Wall_07.03_Interior", materials=merge_107)  # -> constr; plug-in component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

# ----
# Interior Subset -
# Note interior floors & ceilings must
# be inverse of each other
interiorsubset_13 = HBInteriorConstructionSubset(interior_wall=opaqueconstr_119, ceiling=opaqueconstr_122, interior_floor=opaqueconstr_126)  # -> interior_set; plug-in component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
panel_132 = Panel(interiorsubset_13)

# ----
# Exterior Subset
exteriorsubset_13 = HBExteriorConstructionSubset(exterior_wall=opaqueconstr_120, exterior_roof=opaqueconstr_121, exposed_floor=opaqueconstr_128)  # -> exterior_set; plug-in component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
panel_133 = Panel(exteriorsubset_13)
decnstrmat_26 = HBDeconstructMaterial(mat=exteriorsubset_13)  # -> values, attr_names, r_val_si, r_val_ip; plug-in component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
panel_134 = Panel(decnstrmat_26.r_val_si)

merge_108 = Merge(
    Data1=opaquemat_486,
    Data2=opaquemat_487,
    Data3=opaquemat_489,
    Data4=opaquemat_490,
    Data5=opaquemat_488,
    Data6=opaquemat_498)
opaqueconstr_131 = HBOpaqueConstruction(name="Floor_07.01_IntClg", materials=merge_108)  # -> constr; plug-in component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

merge_109 = Merge(
    Data1=opaquemat_512,
    Data2=opaquemat_510,
    Data3=opaquemat_505,
    Data4=opaquemat_501,
    Data5=opaquemat_506,
    Data6=opaquemat_507,
    Data7=opaquemat_508,
    Data8=opaquematnomass_18)
opaqueconstr_132 = HBOpaqueConstruction(name="Floor_07.01_GRroof", materials=merge_109)  # -> constr; plug-in component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

merge_110 = Merge(
    Data1=opaquematnomass_19,
    Data2=opaquemat_494,
    Data3=opaquemat_502,
    Data4=opaquemat_503,
    Data5=opaquemat_496,
    Data6=opaquemat_485,
    Data7=opaquemat_484,
    Data8=opaquemat_483)
opaqueconstr_133 = HBOpaqueConstruction(name="Floor_07.01_GRfloor", materials=merge_110)  # -> constr; plug-in component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

# ----
# Ground Subset -
# same as interior floors,
# ground & roof must be inverse.
# 
# Base ground & roof construction
# on exterior floor for same archetype
# Make this same thickness as W1
panel_135 = Panel("Wall_07.03_UGwall")
opaqueconstr_134 = HBOpaqueConstruction(name=panel_135, materials=opaquemat_495)  # -> constr; plug-in component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
groundsubset_14 = HBGroundConstructionSubset(ground_wall=opaqueconstr_134, ground_roof=opaqueconstr_132, ground_floor=opaqueconstr_133)  # -> ground_set; plug-in component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
decnstrmat_27 = HBDeconstructMaterial(mat=groundsubset_14)  # -> values, attr_names, r_val_si, r_val_ip; plug-in component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
panel_136 = Panel(groundsubset_14)
panel_137 = Panel(decnstrmat_27.r_val_si)

merge_111 = Merge(
    Data1=opaquematnomass_17,
    Data2=opaquemat_479,
    Data3=opaquemat_481,
    Data4=opaquemat_482,
    Data5=opaquemat_480,
    Data6=opaquemat_477,
    Data7=opaquemat_475,
    Data8=opaquemat_472)
opaqueconstr_135 = HBOpaqueConstruction(name="Floor_07.01", materials=merge_111)  # -> constr; plug-in component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

merge_112 = Merge(
    Data1=opaquemat_491,
    Data2=opaquemat_492,
    Data3=opaquemat_499,
    Data4=opaquemat_509,
    Data5=opaquemat_504,
    Data6=opaquemat_511)
opaqueconstr_136 = HBOpaqueConstruction(name="Floor_07.01_IntFlr", materials=merge_112)  # -> constr; plug-in component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

# ----
# Exterior Subset
exteriorsubset_14 = HBExteriorConstructionSubset(exterior_wall=opaqueconstr_127, exterior_roof=opaqueconstr_129, exposed_floor=opaqueconstr_135)  # -> exterior_set; plug-in component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
panel_138 = Panel(exteriorsubset_14)
decnstrmat_28 = HBDeconstructMaterial(mat=exteriorsubset_14)  # -> values, attr_names, r_val_si, r_val_ip; plug-in component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
panel_139 = Panel(decnstrmat_28.r_val_si)

# ----
# Interior Subset -
# Note interior floors & ceilings must
# be inverse of each other
interiorsubset_14 = HBInteriorConstructionSubset(interior_wall=opaqueconstr_130, ceiling=opaqueconstr_131, interior_floor=opaqueconstr_136)  # -> interior_set; plug-in component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
panel_140 = Panel(interiorsubset_14)

opaquemat_513 = HBOpaqueMaterial(name="CeramicTile", thickness="0.015", conductivity="1.470", density="1700", spec_heat="1000", roughness="MediumSmooth")  # -> mat; plug-in component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

opaquemat_514 = HBOpaqueMaterial(name="CementMortar_Thick", thickness="0.030", conductivity="1.400", density="2000", spec_heat="1000", roughness="Rough")  # -> mat; plug-in component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

opaquemat_515 = HBOpaqueMaterial(name="CeramicTile", thickness="0.015", conductivity="1.470", density="1700", spec_heat="1000", roughness="MediumSmooth")  # -> mat; plug-in component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

opaquemat_516 = HBOpaqueMaterial(
    name="InternalPlaster",
    thickness="0.020",
    conductivity="0.700",
    density="1400",
    spec_heat="1000",
    roughness="MediumSmooth")  # -> mat; plug-in component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

opaquemat_517 = HBOpaqueMaterial(name="CementMortar", thickness="0.020", conductivity="1.400", density="2000", spec_heat="1000", roughness="Rough")  # -> mat; plug-in component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

opaquemat_518 = HBOpaqueMaterial(
    name="Slab_BrickBlkConc_16cm",
    thickness=".160",
    conductivity="0.560",
    density="900",
    spec_heat="1000",
    roughness="Rough")  # -> mat; plug-in component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

opaquemat_519 = HBOpaqueMaterial(name="ClayBrickBlocks", thickness="0.250", conductivity="0.400", density="1000", spec_heat="1000", roughness="Rough")  # -> mat; plug-in component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

opaquematnomass_20 = HBOpaqueMaterialNoMass(name="FictitiousLayer_R0.3", r_value="0.3")  # -> mat; plug-in component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

opaquemat_520 = HBOpaqueMaterial(name="Concrete_Reg", thickness="0.100", conductivity="1.160", density="2000", spec_heat="1000", roughness="Rough")  # -> mat; plug-in component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

opaquemat_521 = HBOpaqueMaterial(
    name="InternalPlaster",
    thickness="0.020",
    conductivity="0.700",
    density="1400",
    spec_heat="1000",
    roughness="MediumSmooth")  # -> mat; plug-in component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

opaquemat_522 = HBOpaqueMaterial(name="ClayBrickBlocks", thickness="0.250", conductivity="0.400", density="1000", spec_heat="1000", roughness="Rough")  # -> mat; plug-in component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

opaquemat_523 = HBOpaqueMaterial(
    name="InternalPlaster",
    thickness="0.020",
    conductivity="0.700",
    density="1400",
    spec_heat="1000",
    roughness="MediumSmooth")  # -> mat; plug-in component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

opaquemat_524 = HBOpaqueMaterial(name="LtwtConcScreed_2cm", thickness=".020", conductivity=".580", density="400", spec_heat="1000", roughness="Rough")  # -> mat; plug-in component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

opaquemat_525 = HBOpaqueMaterial(name="CementMortar", thickness="0.020", conductivity="1.400", density="2000", spec_heat="1000", roughness="Rough")  # -> mat; plug-in component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

opaquemat_526 = HBOpaqueMaterial(
    name="InternalPlaster",
    thickness=".020",
    conductivity="0.700",
    density="1400",
    spec_heat="1000",
    roughness="MediumSmooth")  # -> mat; plug-in component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

opaquemat_527 = HBOpaqueMaterial(
    name="Slab_BrickBlkConc_16cm",
    thickness=".160",
    conductivity="0.560",
    density="900",
    spec_heat="1000",
    roughness="Rough")  # -> mat; plug-in component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

opaquemat_528 = HBOpaqueMaterial(name="LtwtConcScreed_2cm", thickness=".020", conductivity=".580", density="400", spec_heat="1000", roughness="Rough")  # -> mat; plug-in component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

opaquemat_529 = HBOpaqueMaterial(
    name="InsulationPanel",
    thickness="0.114",
    conductivity="0.045",
    density="30",
    spec_heat="1220",
    roughness="MediumSmooth")  # -> mat; plug-in component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

opaquemat_530 = HBOpaqueMaterial(name="GravelRiverStone", thickness=".147", conductivity="1.200", density="1700", spec_heat="1000", roughness="VeryRough")  # -> mat; plug-in component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

# ----
# R8TH
opaquemat_531 = HBOpaqueMaterial(name="ExternalPlaster", thickness=".020", conductivity="0.900", density="1800", spec_heat="1000", roughness="Rough")  # -> mat; plug-in component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

opaquemat_532 = HBOpaqueMaterial(
    name="InternalPlaster",
    thickness="0.020",
    conductivity="0.700",
    density="1400",
    spec_heat="1000",
    roughness="MediumSmooth")  # -> mat; plug-in component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

opaquemat_533 = HBOpaqueMaterial(
    name="InsulationPanel",
    thickness="0.0944",
    conductivity="0.045",
    density="30",
    spec_heat="1220",
    roughness="MediumSmooth")  # -> mat; plug-in component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

opaquemat_534 = HBOpaqueMaterial(
    name="InsulationPanel",
    thickness="0.122",
    conductivity="0.045",
    density="30",
    spec_heat="1220",
    roughness="MediumSmooth")  # -> mat; plug-in component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

opaquemat_535 = HBOpaqueMaterial(name="CementMortar", thickness="0.020", conductivity="1.400", density="2000", spec_heat="1000", roughness="Rough")  # -> mat; plug-in component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

opaquemat_536 = HBOpaqueMaterial(
    name="Slab_BrickBlkConc_16cm",
    thickness=".160",
    conductivity="0.560",
    density="900",
    spec_heat="1000",
    roughness="Rough")  # -> mat; plug-in component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

glassmat_17 = HBGlassMaterial(
    name="Glass_07.02_Interior",
    thickness="0.006",
    transmittance="0.755",
    reflectance="0.07",
    emiss_front="0.84",
    emiss_back="0.84",
    conductivity=".9")  # -> mat; plug-in component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

opaquemat_537 = HBOpaqueMaterial(name="CementMortar", thickness="0.020", conductivity="1.400", density="2000", spec_heat="1000", roughness="Rough")  # -> mat; plug-in component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

opaquemat_538 = HBOpaqueMaterial(
    name="InternalPlaster",
    thickness="0.020",
    conductivity="0.700",
    density="1400",
    spec_heat="1000",
    roughness="MediumSmooth")  # -> mat; plug-in component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

opaquemat_539 = HBOpaqueMaterial(name="WoodDoor_Double", thickness="0.045", conductivity="0.10714", density="1600", spec_heat="550", roughness="Smooth")  # -> mat; plug-in component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

opaquemat_540 = HBOpaqueMaterial(name="CementMortar", thickness="0.020", conductivity="1.400", density="2000", spec_heat="1000", roughness="Rough")  # -> mat; plug-in component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

opaquemat_541 = HBOpaqueMaterial(name="LtwtConcScreed_2cm", thickness=".020", conductivity=".580", density="400", spec_heat="1000", roughness="Rough")  # -> mat; plug-in component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

opaquemat_542 = HBOpaqueMaterial(name="CeramicTile", thickness="0.015", conductivity="1.470", density="1700", spec_heat="1000", roughness="MediumSmooth")  # -> mat; plug-in component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

opaquemat_543 = HBOpaqueMaterial(name="SolidBrick", thickness=".384", conductivity="0.720", density="1800", spec_heat="1000", roughness="Rough")  # -> mat; plug-in component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

opaquemat_544 = HBOpaqueMaterial(name="CeramicTile", thickness="0.015", conductivity="1.470", density="1700", spec_heat="1000", roughness="MediumSmooth")  # -> mat; plug-in component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

opaquemat_545 = HBOpaqueMaterial(name="CementMortar_Thick", thickness="0.030", conductivity="1.400", density="2000", spec_heat="1000", roughness="Rough")  # -> mat; plug-in component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

opaquemat_546 = HBOpaqueMaterial(
    name="InsulationPanel",
    thickness="0.114",
    conductivity="0.045",
    density="30",
    spec_heat="1220",
    roughness="MediumSmooth")  # -> mat; plug-in component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

opaquemat_547 = HBOpaqueMaterial(name="Concrete_Reg", thickness="0.100", conductivity="1.160", density="2000", spec_heat="1000", roughness="Rough")  # -> mat; plug-in component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

opaquemat_548 = HBOpaqueMaterial(name="Concrete_Reg", thickness="0.100", conductivity="1.160", density="2000", spec_heat="1000", roughness="Rough")  # -> mat; plug-in component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

opaquemat_549 = HBOpaqueMaterial(
    name="InsulationPanel",
    thickness="0.114",
    conductivity="0.045",
    density="30",
    spec_heat="1220",
    roughness="MediumSmooth")  # -> mat; plug-in component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

opaquemat_550 = HBOpaqueMaterial(name="GravelRiverStone", thickness=".147", conductivity="1.200", density="1700", spec_heat="1000", roughness="VeryRough")  # -> mat; plug-in component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

opaquemat_551 = HBOpaqueMaterial(name="GravelRiverStone", thickness=".147", conductivity="1.200", density="1700", spec_heat="1000", roughness="VeryRough")  # -> mat; plug-in component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

opaquemat_552 = HBOpaqueMaterial(name="CeramicTile", thickness="0.015", conductivity="1.470", density="1700", spec_heat="1000", roughness="MediumSmooth")  # -> mat; plug-in component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

opaquemat_553 = HBOpaqueMaterial(name="CementMortar_Thick", thickness="0.030", conductivity="1.400", density="2000", spec_heat="1000", roughness="Rough")  # -> mat; plug-in component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

opaquemat_554 = HBOpaqueMaterial(name="CeramicTile", thickness="0.015", conductivity="1.470", density="1700", spec_heat="1000", roughness="MediumSmooth")  # -> mat; plug-in component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

opaquemat_555 = HBOpaqueMaterial(name="CementMortar", thickness="0.020", conductivity="1.400", density="2000", spec_heat="1000", roughness="Rough")  # -> mat; plug-in component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

opaquemat_556 = HBOpaqueMaterial(
    name="Slab_BrickBlkConc_16cm",
    thickness=".160",
    conductivity="0.560",
    density="900",
    spec_heat="1000",
    roughness="Rough")  # -> mat; plug-in component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

opaquemat_557 = HBOpaqueMaterial(name="ClayBrickBlocks", thickness="0.250", conductivity="0.400", density="1000", spec_heat="1000", roughness="Rough")  # -> mat; plug-in component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

opaquemat_558 = HBOpaqueMaterial(
    name="Slab_BrickBlkConc_16cm",
    thickness=".160",
    conductivity="0.560",
    density="900",
    spec_heat="1000",
    roughness="Rough")  # -> mat; plug-in component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

opaquemat_559 = HBOpaqueMaterial(
    name="InternalPlaster",
    thickness="0.020",
    conductivity="0.700",
    density="1400",
    spec_heat="1000",
    roughness="MediumSmooth")  # -> mat; plug-in component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

opaquemat_560 = HBOpaqueMaterial(
    name="InternalPlaster",
    thickness="0.020",
    conductivity="0.700",
    density="1400",
    spec_heat="1000",
    roughness="MediumSmooth")  # -> mat; plug-in component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

opaquemat_561 = HBOpaqueMaterial(name="LtwtConcScreed_2cm", thickness=".020", conductivity=".580", density="400", spec_heat="1000", roughness="Rough")  # -> mat; plug-in component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

opaquemat_562 = HBOpaqueMaterial(name="CementMortar", thickness="0.020", conductivity="1.400", density="2000", spec_heat="1000", roughness="Rough")  # -> mat; plug-in component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

opaquemat_563 = HBOpaqueMaterial(
    name="InternalPlaster",
    thickness=".020",
    conductivity="0.700",
    density="1400",
    spec_heat="1000",
    roughness="MediumSmooth")  # -> mat; plug-in component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

opaquemat_564 = HBOpaqueMaterial(
    name="InternalPlaster",
    thickness="0.020",
    conductivity="0.700",
    density="1400",
    spec_heat="1000",
    roughness="MediumSmooth")  # -> mat; plug-in component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

opaquemat_565 = HBOpaqueMaterial(name="CeramicTile", thickness="0.015", conductivity="1.470", density="1700", spec_heat="1000", roughness="MediumSmooth")  # -> mat; plug-in component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

glassmat_18 = HBGlassMaterial(
    name="Glass_07.01_Interior",
    thickness="0.006",
    transmittance="0.755",
    reflectance="0.07",
    emiss_front="0.84",
    emiss_back="0.84",
    conductivity=".9")  # -> mat; plug-in component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

opaquemat_566 = HBOpaqueMaterial(name="CementMortar", thickness="0.020", conductivity="1.400", density="2000", spec_heat="1000", roughness="Rough")  # -> mat; plug-in component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

opaquemat_567 = HBOpaqueMaterial(name="CementMortar_Thick", thickness="0.030", conductivity="1.400", density="2000", spec_heat="1000", roughness="Rough")  # -> mat; plug-in component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

opaquemat_568 = HBOpaqueMaterial(name="WoodDoor_Double", thickness="0.045", conductivity="0.10714", density="1600", spec_heat="550", roughness="Smooth")  # -> mat; plug-in component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

opaquemat_569 = HBOpaqueMaterial(name="CementMortar", thickness="0.020", conductivity="1.400", density="2000", spec_heat="1000", roughness="Rough")  # -> mat; plug-in component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

opaquemat_570 = HBOpaqueMaterial(name="LtwtConcScreed_2cm", thickness=".020", conductivity=".580", density="400", spec_heat="1000", roughness="Rough")  # -> mat; plug-in component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

opaquemat_571 = HBOpaqueMaterial(name="CeramicTile", thickness="0.015", conductivity="1.470", density="1700", spec_heat="1000", roughness="MediumSmooth")  # -> mat; plug-in component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

opaquemat_572 = HBOpaqueMaterial(name="Concrete_Reg", thickness="0.100", conductivity="1.160", density="2000", spec_heat="1000", roughness="Rough")  # -> mat; plug-in component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

opaquemat_573 = HBOpaqueMaterial(
    name="InsulationPanel",
    thickness="0.114",
    conductivity="0.045",
    density="30",
    spec_heat="1220",
    roughness="MediumSmooth")  # -> mat; plug-in component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

opaquemat_574 = HBOpaqueMaterial(name="GravelRiverStone", thickness=".147", conductivity="1.200", density="1700", spec_heat="1000", roughness="VeryRough")  # -> mat; plug-in component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

opaquemat_575 = HBOpaqueMaterial(name="SolidBrick", thickness=".384", conductivity="0.720", density="1800", spec_heat="1000", roughness="Rough")  # -> mat; plug-in component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

opaquemat_576 = HBOpaqueMaterial(name="CeramicTile", thickness="0.015", conductivity="1.470", density="1700", spec_heat="1000", roughness="MediumSmooth")  # -> mat; plug-in component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

opaquemat_577 = HBOpaqueMaterial(
    name="InternalPlaster",
    thickness="0.020",
    conductivity="0.700",
    density="1400",
    spec_heat="1000",
    roughness="MediumSmooth")  # -> mat; plug-in component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

opaquemat_578 = HBOpaqueMaterial(name="ClayBrickBlocks", thickness="0.250", conductivity="0.400", density="1000", spec_heat="1000", roughness="Rough")  # -> mat; plug-in component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

opaquemat_579 = HBOpaqueMaterial(name="CementMortar_Thick", thickness="0.030", conductivity="1.400", density="2000", spec_heat="1000", roughness="Rough")  # -> mat; plug-in component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

opaquematnomass_21 = HBOpaqueMaterialNoMass(name="FictitiousLayer_R0.3", r_value="0.3")  # -> mat; plug-in component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

opaquemat_580 = HBOpaqueMaterial(name="LtwtConcScreed_2cm", thickness=".020", conductivity=".580", density="400", spec_heat="1000", roughness="Rough")  # -> mat; plug-in component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

opaquemat_581 = HBOpaqueMaterial(
    name="InsulationPanel",
    thickness="0.114",
    conductivity="0.045",
    density="30",
    spec_heat="1220",
    roughness="MediumSmooth")  # -> mat; plug-in component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

# ----
# R8SF
opaquemat_582 = HBOpaqueMaterial(name="ExternalPlaster", thickness=".020", conductivity="0.900", density="1800", spec_heat="1000", roughness="Rough")  # -> mat; plug-in component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

opaquemat_583 = HBOpaqueMaterial(
    name="InsulationPanel",
    thickness="0.0944",
    conductivity="0.045",
    density="30",
    spec_heat="1220",
    roughness="MediumSmooth")  # -> mat; plug-in component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

opaquemat_584 = HBOpaqueMaterial(
    name="InsulationPanel",
    thickness="0.122",
    conductivity="0.045",
    density="30",
    spec_heat="1220",
    roughness="MediumSmooth")  # -> mat; plug-in component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

opaquemat_585 = HBOpaqueMaterial(name="CementMortar", thickness="0.020", conductivity="1.400", density="2000", spec_heat="1000", roughness="Rough")  # -> mat; plug-in component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

opaquemat_586 = HBOpaqueMaterial(
    name="Slab_BrickBlkConc_16cm",
    thickness=".160",
    conductivity="0.560",
    density="900",
    spec_heat="1000",
    roughness="Rough")  # -> mat; plug-in component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

opaquemat_587 = HBOpaqueMaterial(
    name="InternalPlaster",
    thickness="0.020",
    conductivity="0.700",
    density="1400",
    spec_heat="1000",
    roughness="MediumSmooth")  # -> mat; plug-in component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

opaquemat_588 = HBOpaqueMaterial(name="Concrete_Reg", thickness="0.100", conductivity="1.160", density="2000", spec_heat="1000", roughness="Rough")  # -> mat; plug-in component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

opaquemat_589 = HBOpaqueMaterial(name="Concrete_Reg", thickness="0.100", conductivity="1.160", density="2000", spec_heat="1000", roughness="Rough")  # -> mat; plug-in component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

opaquemat_590 = HBOpaqueMaterial(
    name="InsulationPanel",
    thickness="0.114",
    conductivity="0.045",
    density="30",
    spec_heat="1220",
    roughness="MediumSmooth")  # -> mat; plug-in component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

opaquemat_591 = HBOpaqueMaterial(name="GravelRiverStone", thickness=".147", conductivity="1.200", density="1700", spec_heat="1000", roughness="VeryRough")  # -> mat; plug-in component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

opaquemat_592 = HBOpaqueMaterial(name="GravelRiverStone", thickness=".147", conductivity="1.200", density="1700", spec_heat="1000", roughness="VeryRough")  # -> mat; plug-in component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

opaquemat_593 = HBOpaqueMaterial(name="CeramicTile", thickness="0.015", conductivity="1.470", density="1700", spec_heat="1000", roughness="MediumSmooth")  # -> mat; plug-in component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

opaquemat_594 = HBOpaqueMaterial(name="CementMortar_Thick", thickness="0.030", conductivity="1.400", density="2000", spec_heat="1000", roughness="Rough")  # -> mat; plug-in component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

merge_113 = Merge(Data1=opaquemat_521, Data2=opaquemat_522, Data3=opaquemat_523)
opaqueconstr_137 = HBOpaqueConstruction(name="Wall_08.01_Interior", materials=merge_113)  # -> constr; plug-in component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

merge_114 = Merge(Data1=opaquemat_531, Data2=opaquemat_533, Data3=opaquemat_519, Data4=opaquemat_516)
opaqueconstr_138 = HBOpaqueConstruction(name="Wall_08.01", materials=merge_114)  # -> constr; plug-in component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

merge_115 = Merge(Data1=opaquemat_551, Data2=opaquemat_548, Data3=opaquemat_546, Data4=opaquemat_545, Data5=opaquemat_544)
opaqueconstr_139 = HBOpaqueConstruction(name="Floor_08.02_GRfloor", materials=merge_115)  # -> constr; plug-in component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

merge_116 = Merge(Data1=opaquemat_552, Data2=opaquemat_553, Data3=opaquemat_549, Data4=opaquemat_547, Data5=opaquemat_550)
opaqueconstr_140 = HBOpaqueConstruction(name="Floor_08.01_GRroof", materials=merge_116)  # -> constr; plug-in component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

# ----
# Ground Subset -
# same as interior floors,
# ground & roof must be inverse.
# 
# Base ground & roof construction
# on exterior floor for same archetype
# Make this same thickness as W1
panel_141 = Panel("Wall_08.01_UGwall")
opaqueconstr_141 = HBOpaqueConstruction(name=panel_141, materials=opaquemat_543)  # -> constr; plug-in component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
groundsubset_15 = HBGroundConstructionSubset(ground_wall=opaqueconstr_141, ground_roof=opaqueconstr_140, ground_floor=opaqueconstr_139)  # -> ground_set; plug-in component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
decnstrmat_29 = HBDeconstructMaterial(mat=groundsubset_15)  # -> values, attr_names, r_val_si, r_val_ip; plug-in component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
panel_142 = Panel(groundsubset_15)
panel_143 = Panel(decnstrmat_29.r_val_si)

merge_117 = Merge(
    Data1=opaquematnomass_20,
    Data2=opaquemat_528,
    Data3=opaquemat_534,
    Data4=opaquemat_535,
    Data5=opaquemat_536,
    Data6=opaquemat_538)
opaqueconstr_142 = HBOpaqueConstruction(name="Ceiling_08.01", materials=merge_117)  # -> constr; plug-in component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

merge_118 = Merge(Data1=opaquemat_530, Data2=opaquemat_520, Data3=opaquemat_529, Data4=opaquemat_514, Data5=opaquemat_513)
opaqueconstr_143 = HBOpaqueConstruction(name="Floor_08.02", materials=merge_118)  # -> constr; plug-in component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

merge_119 = Merge(
    Data1=opaquemat_515,
    Data2=opaquemat_517,
    Data3=opaquemat_524,
    Data4=opaquemat_525,
    Data5=opaquemat_518,
    Data6=opaquemat_532)
opaqueconstr_144 = HBOpaqueConstruction(name="Floor_08.01_IntClg", materials=merge_119)  # -> constr; plug-in component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

merge_120 = Merge(
    Data1=opaquemat_526,
    Data2=opaquemat_527,
    Data3=opaquemat_537,
    Data4=opaquemat_541,
    Data5=opaquemat_540,
    Data6=opaquemat_542)
opaqueconstr_145 = HBOpaqueConstruction(name="Floor_08.01_IntFlr", materials=merge_120)  # -> constr; plug-in component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

merge_121 = Merge(Data1=opaquemat_559, Data2=opaquemat_557, Data3=opaquemat_560)
opaqueconstr_146 = HBOpaqueConstruction(name="Wall_08.01_Interior", materials=merge_121)  # -> constr; plug-in component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

merge_122 = Merge(Data1=opaquemat_592, Data2=opaquemat_589, Data3=opaquemat_581, Data4=opaquemat_579, Data5=opaquemat_576)
opaqueconstr_147 = HBOpaqueConstruction(name="Floor_08.02_GRfloor", materials=merge_122)  # -> constr; plug-in component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

merge_123 = Merge(Data1=opaquemat_593, Data2=opaquemat_594, Data3=opaquemat_590, Data4=opaquemat_588, Data5=opaquemat_591)
opaqueconstr_148 = HBOpaqueConstruction(name="Floor_08.01_GRroof", materials=merge_123)  # -> constr; plug-in component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

# ----
# Ground Subset -
# same as interior floors,
# ground & roof must be inverse.
# 
# Base ground & roof construction
# on exterior floor for same archetype
# Make this same thickness as W1
panel_144 = Panel("Wall_08.01_UGwall")
opaqueconstr_149 = HBOpaqueConstruction(name=panel_144, materials=opaquemat_575)  # -> constr; plug-in component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
groundsubset_16 = HBGroundConstructionSubset(ground_wall=opaqueconstr_149, ground_roof=opaqueconstr_148, ground_floor=opaqueconstr_147)  # -> ground_set; plug-in component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
decnstrmat_30 = HBDeconstructMaterial(mat=groundsubset_16)  # -> values, attr_names, r_val_si, r_val_ip; plug-in component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
panel_145 = Panel(groundsubset_16)
panel_146 = Panel(decnstrmat_30.r_val_si)

merge_124 = Merge(Data1=opaquemat_582, Data2=opaquemat_583, Data3=opaquemat_578, Data4=opaquemat_577)
opaqueconstr_150 = HBOpaqueConstruction(name="Wall_08.01", materials=merge_124)  # -> constr; plug-in component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

merge_125 = Merge(Data1=opaquemat_574, Data2=opaquemat_572, Data3=opaquemat_573, Data4=opaquemat_567, Data5=opaquemat_565)
opaqueconstr_151 = HBOpaqueConstruction(name="Floor_08.02", materials=merge_125)  # -> constr; plug-in component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

merge_126 = Merge(
    Data1=opaquematnomass_21,
    Data2=opaquemat_580,
    Data3=opaquemat_584,
    Data4=opaquemat_585,
    Data5=opaquemat_586,
    Data6=opaquemat_587)
opaqueconstr_152 = HBOpaqueConstruction(name="Ceiling_08.01", materials=merge_126)  # -> constr; plug-in component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

merge_127 = Merge(
    Data1=opaquemat_554,
    Data2=opaquemat_555,
    Data3=opaquemat_561,
    Data4=opaquemat_562,
    Data5=opaquemat_556,
    Data6=opaquemat_564)
opaqueconstr_153 = HBOpaqueConstruction(name="Floor_08.01_IntClg", materials=merge_127)  # -> constr; plug-in component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

# ----
# Exterior Subset
exteriorsubset_15 = HBExteriorConstructionSubset(exterior_wall=opaqueconstr_138, exterior_roof=opaqueconstr_142, exposed_floor=opaqueconstr_143)  # -> exterior_set; plug-in component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
panel_147 = Panel(exteriorsubset_15)
decnstrmat_31 = HBDeconstructMaterial(mat=exteriorsubset_15)  # -> values, attr_names, r_val_si, r_val_ip; plug-in component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
panel_148 = Panel(decnstrmat_31.r_val_si)

# ----
# Interior Subset -
# Note interior floors & ceilings must
# be inverse of each other
interiorsubset_15 = HBInteriorConstructionSubset(interior_wall=opaqueconstr_137, ceiling=opaqueconstr_144, interior_floor=opaqueconstr_145)  # -> interior_set; plug-in component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
panel_149 = Panel(interiorsubset_15)

merge_128 = Merge(
    Data1=opaquemat_563,
    Data2=opaquemat_558,
    Data3=opaquemat_566,
    Data4=opaquemat_570,
    Data5=opaquemat_569,
    Data6=opaquemat_571)
opaqueconstr_154 = HBOpaqueConstruction(name="Floor_08.01_IntFlr", materials=merge_128)  # -> constr; plug-in component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

# ----
# Interior Subset -
# Note interior floors & ceilings must
# be inverse of each other
interiorsubset_16 = HBInteriorConstructionSubset(interior_wall=opaqueconstr_146, ceiling=opaqueconstr_153, interior_floor=opaqueconstr_154)  # -> interior_set; plug-in component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
panel_150 = Panel(interiorsubset_16)

# ----
# Exterior Subset
exteriorsubset_16 = HBExteriorConstructionSubset(exterior_wall=opaqueconstr_150, exterior_roof=opaqueconstr_152, exposed_floor=opaqueconstr_151)  # -> exterior_set; plug-in component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
panel_151 = Panel(exteriorsubset_16)
decnstrmat_32 = HBDeconstructMaterial(mat=exteriorsubset_16)  # -> values, attr_names, r_val_si, r_val_ip; plug-in component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
panel_152 = Panel(decnstrmat_32.r_val_si)

# ----
# Subface Subset
panel_153 = Panel(".0065")
gapmat = HBWindowGapMaterial(thickness=panel_153)  # -> mat; plug-in component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
panel_154 = Panel(gapmat)
opaqueconstr_155 = HBOpaqueConstruction(name="Door_06.02", materials=opaquemat_334)  # -> constr; plug-in component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
decnstrconstr_21 = HBDeconstructConstruction(constr=opaqueconstr_155)  # -> materials, layers, r_val_si, r_val_ip, u_fac_si, u_fac_ip, shgc, t_sol, t_vis; plug-in component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
panel_155 = Panel([decnstrconstr_21.r_val_si, decnstrconstr_21.u_fac_si, decnstrconstr_21.shgc])

glassmat_19 = HBGlassMaterial(
    name="Glass_06.01_Exterior",
    thickness="0.004",
    transmittance="0.83",
    reflectance="0.12",
    emiss_front="0.84",
    emiss_back="0.45",
    conductivity="0.9")  # -> mat; plug-in component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

windowconstr_11 = HBWindowConstruction(name="Wimndow_06.01", materials=[glassmat_19, gapmat, glassmat_11])  # -> constr; plug-in component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
decnstrconstr_22 = HBDeconstructConstruction(constr=windowconstr_11)  # -> materials, layers, r_val_si, r_val_ip, u_fac_si, u_fac_ip, shgc, t_sol, t_vis; plug-in component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
subfacesubset_11 = HBSubfaceSubset(
    window=windowconstr_11,
    skylight=windowconstr_11,
    operable=windowconstr_11,
    exterior_door=opaqueconstr_155,
    glass_door=windowconstr_11)  # -> subface_set; plug-in component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
panel_156 = Panel([decnstrconstr_22.r_val_si, decnstrconstr_22.u_fac_si, decnstrconstr_22.shgc])
panel_157 = Panel(subfacesubset_11)

# ----
# EXPORT TO JSON
panel_158 = Panel("pre_1980::ClimateZone4::Mass")
constructionset_11 = HBConstructionSet(
    name="R6SF_CSet",
    base_constr_set=panel_158,
    exterior_subset=exteriorsubset_11,
    ground_subset=groundsubset_11,
    interior_subset=interiorsubset_11,
    subface_subset=subfacesubset_11)  # -> constr_set; plug-in component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
objtostr_11 = HBObjectToString(hb_obj=constructionset_11)  # -> hb_str; plug-in component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

panel_159 = Panel(objtostr_11)

# ----
# Subface Subset
panel_160 = Panel(".0065")
gapmat_2 = HBWindowGapMaterial(thickness=panel_160)  # -> mat; plug-in component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
panel_161 = Panel(gapmat_2)
opaqueconstr_156 = HBOpaqueConstruction(name="Door_06.02", materials=opaquemat_393)  # -> constr; plug-in component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
decnstrconstr_23 = HBDeconstructConstruction(constr=opaqueconstr_156)  # -> materials, layers, r_val_si, r_val_ip, u_fac_si, u_fac_ip, shgc, t_sol, t_vis; plug-in component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
panel_162 = Panel([decnstrconstr_23.r_val_si, decnstrconstr_23.u_fac_si, decnstrconstr_23.shgc])

glassmat_20 = HBGlassMaterial(
    name="Glass_06.01_Exterior",
    thickness="0.004",
    transmittance="0.83",
    reflectance="0.12",
    emiss_front="0.84",
    emiss_back="0.45",
    conductivity="0.9")  # -> mat; plug-in component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

windowconstr_12 = HBWindowConstruction(name="Wimndow_06.01", materials=[glassmat_20, gapmat_2, glassmat_13])  # -> constr; plug-in component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
decnstrconstr_24 = HBDeconstructConstruction(constr=windowconstr_12)  # -> materials, layers, r_val_si, r_val_ip, u_fac_si, u_fac_ip, shgc, t_sol, t_vis; plug-in component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
subfacesubset_12 = HBSubfaceSubset(
    window=windowconstr_12,
    skylight=windowconstr_12,
    operable=windowconstr_12,
    exterior_door=opaqueconstr_156,
    glass_door=windowconstr_12)  # -> subface_set; plug-in component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
panel_163 = Panel([decnstrconstr_24.r_val_si, decnstrconstr_24.u_fac_si, decnstrconstr_24.shgc])
panel_164 = Panel(subfacesubset_12)

# ----
# EXPORT TO JSON
panel_165 = Panel("pre_1980::ClimateZone4::Mass")
constructionset_12 = HBConstructionSet(
    name="R6TH_CSet",
    base_constr_set=panel_165,
    exterior_subset=exteriorsubset_12,
    ground_subset=groundsubset_12,
    interior_subset=interiorsubset_12,
    subface_subset=subfacesubset_12)  # -> constr_set; plug-in component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
objtostr_12 = HBObjectToString(hb_obj=constructionset_12)  # -> hb_str; plug-in component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

panel_166 = Panel(objtostr_12)

# ----
# Subface Subset
panel_167 = Panel(".0065")
gapmat_3 = HBWindowGapMaterial(thickness=panel_167)  # -> mat; plug-in component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
panel_168 = Panel(gapmat_3)
opaqueconstr_157 = HBOpaqueConstruction(name="Door_06.02", materials=opaquemat_462)  # -> constr; plug-in component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
decnstrconstr_25 = HBDeconstructConstruction(constr=opaqueconstr_157)  # -> materials, layers, r_val_si, r_val_ip, u_fac_si, u_fac_ip, shgc, t_sol, t_vis; plug-in component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
panel_169 = Panel([decnstrconstr_25.r_val_si, decnstrconstr_25.u_fac_si, decnstrconstr_25.shgc])

glassmat_21 = HBGlassMaterial(
    name="Glass_06.01_Exterior",
    thickness="0.004",
    transmittance="0.83",
    reflectance="0.12",
    emiss_front="0.84",
    emiss_back="0.45",
    conductivity="0.9")  # -> mat; plug-in component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

windowconstr_13 = HBWindowConstruction(name="Wimndow_06.01", materials=[glassmat_21, gapmat_3, glassmat_14])  # -> constr; plug-in component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
decnstrconstr_26 = HBDeconstructConstruction(constr=windowconstr_13)  # -> materials, layers, r_val_si, r_val_ip, u_fac_si, u_fac_ip, shgc, t_sol, t_vis; plug-in component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
subfacesubset_13 = HBSubfaceSubset(
    window=windowconstr_13,
    skylight=windowconstr_13,
    operable=windowconstr_13,
    exterior_door=opaqueconstr_157,
    glass_door=windowconstr_13)  # -> subface_set; plug-in component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
panel_170 = Panel(subfacesubset_13)
panel_171 = Panel([decnstrconstr_26.r_val_si, decnstrconstr_26.u_fac_si, decnstrconstr_26.shgc])

# ----
# EXPORT TO JSON
panel_172 = Panel("pre_1980::ClimateZone4::Mass")
constructionset_13 = HBConstructionSet(
    name="R7TH_CSet",
    base_constr_set=panel_172,
    exterior_subset=exteriorsubset_13,
    ground_subset=groundsubset_13,
    interior_subset=interiorsubset_13,
    subface_subset=subfacesubset_13)  # -> constr_set; plug-in component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
objtostr_13 = HBObjectToString(hb_obj=constructionset_13)  # -> hb_str; plug-in component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

panel_173 = Panel(objtostr_13)

# ----
# Subface Subset
panel_174 = Panel(".0065")
gapmat_4 = HBWindowGapMaterial(thickness=panel_174)  # -> mat; plug-in component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
panel_175 = Panel(gapmat_4)

glassmat_22 = HBGlassMaterial(
    name="Glass_06.01_Exterior",
    thickness="0.004",
    transmittance="0.83",
    reflectance="0.12",
    emiss_front="0.84",
    emiss_back="0.45",
    conductivity="0.9")  # -> mat; plug-in component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

windowconstr_14 = HBWindowConstruction(name="Wimndow_06.01", materials=[glassmat_22, gapmat_4, glassmat_15])  # -> constr; plug-in component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
decnstrconstr_27 = HBDeconstructConstruction(constr=windowconstr_14)  # -> materials, layers, r_val_si, r_val_ip, u_fac_si, u_fac_ip, shgc, t_sol, t_vis; plug-in component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
subfacesubset_14 = HBSubfaceSubset(window=windowconstr_14, skylight=windowconstr_14, operable=windowconstr_14, glass_door=windowconstr_14)  # -> subface_set; plug-in component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
panel_176 = Panel(subfacesubset_14)
panel_177 = Panel([decnstrconstr_27.r_val_si, decnstrconstr_27.u_fac_si, decnstrconstr_27.shgc])

# ----
# EXPORT TO JSON
panel_178 = Panel("pre_1980::ClimateZone4::Mass")
constructionset_14 = HBConstructionSet(
    name="R7SF_CSet",
    base_constr_set=panel_178,
    exterior_subset=exteriorsubset_14,
    ground_subset=groundsubset_14,
    interior_subset=interiorsubset_14,
    subface_subset=subfacesubset_14)  # -> constr_set; plug-in component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
objtostr_14 = HBObjectToString(hb_obj=constructionset_14)  # -> hb_str; plug-in component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

panel_179 = Panel(objtostr_14)

# ----
# Subface Subset
panel_180 = Panel(""".20
.80""")
panel_181 = Panel("""Air
Argon""")
gapmat_5 = HBWindowGapMaterial(thickness=".0127", gas_types=panel_181, gas_ratios=panel_180)  # -> mat; plug-in component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
panel_182 = Panel(gapmat_5)
opaqueconstr_158 = HBOpaqueConstruction(name="Door_06.02", materials=opaquemat_539)  # -> constr; plug-in component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
decnstrconstr_28 = HBDeconstructConstruction(constr=opaqueconstr_158)  # -> materials, layers, r_val_si, r_val_ip, u_fac_si, u_fac_ip, shgc, t_sol, t_vis; plug-in component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
panel_183 = Panel([decnstrconstr_28.r_val_si, decnstrconstr_28.u_fac_si, decnstrconstr_28.shgc])

glassmat_23 = HBGlassMaterial(
    name="Glass_07.02_Exterior",
    thickness="0.006",
    transmittance="0.755",
    reflectance="0.21",
    emiss_front="0.84",
    emiss_back="0.465",
    conductivity=".9")  # -> mat; plug-in component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

windowconstr_15 = HBWindowConstruction(name="Window_07.02", materials=[glassmat_23, gapmat_5, glassmat_17])  # -> constr; plug-in component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
decnstrconstr_29 = HBDeconstructConstruction(constr=windowconstr_15)  # -> materials, layers, r_val_si, r_val_ip, u_fac_si, u_fac_ip, shgc, t_sol, t_vis; plug-in component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
subfacesubset_15 = HBSubfaceSubset(
    window=windowconstr_15,
    skylight=windowconstr_15,
    operable=windowconstr_15,
    exterior_door=opaqueconstr_158,
    glass_door=windowconstr_15)  # -> subface_set; plug-in component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
panel_184 = Panel(subfacesubset_15)
panel_185 = Panel([decnstrconstr_29.r_val_si, decnstrconstr_29.u_fac_si, decnstrconstr_29.shgc])

# ----
# EXPORT TO JSON
panel_186 = Panel("pre_1980::ClimateZone4::Mass")
constructionset_15 = HBConstructionSet(
    name="R8TH_CSet",
    base_constr_set=panel_186,
    exterior_subset=exteriorsubset_15,
    ground_subset=groundsubset_15,
    interior_subset=interiorsubset_15,
    subface_subset=subfacesubset_15)  # -> constr_set; plug-in component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
objtostr_15 = HBObjectToString(hb_obj=constructionset_15)  # -> hb_str; plug-in component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

panel_187 = Panel(objtostr_15)

# ----
# Subface Subset
panel_188 = Panel(""".20
.80""")
panel_189 = Panel("""Air
Argon""")
gapmat_6 = HBWindowGapMaterial(thickness=".0127", gas_types=panel_189, gas_ratios=panel_188)  # -> mat; plug-in component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
panel_190 = Panel(gapmat_6)
opaqueconstr_159 = HBOpaqueConstruction(name="Door_06.02", materials=opaquemat_568)  # -> constr; plug-in component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
decnstrconstr_30 = HBDeconstructConstruction(constr=opaqueconstr_159)  # -> materials, layers, r_val_si, r_val_ip, u_fac_si, u_fac_ip, shgc, t_sol, t_vis; plug-in component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
panel_191 = Panel([decnstrconstr_30.r_val_si, decnstrconstr_30.u_fac_si, decnstrconstr_30.shgc])

glassmat_24 = HBGlassMaterial(
    name="Glass_07.02_Exterior",
    thickness="0.006",
    transmittance="0.755",
    reflectance="0.21",
    emiss_front="0.84",
    emiss_back="0.465",
    conductivity=".9")  # -> mat; plug-in component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

windowconstr_16 = HBWindowConstruction(name="Window_07.02", materials=[glassmat_24, gapmat_6, glassmat_18])  # -> constr; plug-in component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
decnstrconstr_31 = HBDeconstructConstruction(constr=windowconstr_16)  # -> materials, layers, r_val_si, r_val_ip, u_fac_si, u_fac_ip, shgc, t_sol, t_vis; plug-in component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
subfacesubset_16 = HBSubfaceSubset(
    window=windowconstr_16,
    skylight=windowconstr_16,
    operable=windowconstr_16,
    exterior_door=opaqueconstr_159,
    glass_door=windowconstr_16)  # -> subface_set; plug-in component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
panel_192 = Panel(subfacesubset_16)
panel_193 = Panel([decnstrconstr_31.r_val_si, decnstrconstr_31.u_fac_si, decnstrconstr_31.shgc])

# ----
# EXPORT TO JSON
panel_194 = Panel("pre_1980::ClimateZone4::Mass")
constructionset_16 = HBConstructionSet(
    name="R8SF_CSet",
    base_constr_set=panel_194,
    exterior_subset=exteriorsubset_16,
    ground_subset=groundsubset_16,
    interior_subset=interiorsubset_16,
    subface_subset=subfacesubset_16)  # -> constr_set; plug-in component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
objtostr_16 = HBObjectToString(hb_obj=constructionset_16)  # -> hb_str; plug-in component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

panel_195 = Panel(objtostr_16)
