# Grasshopper definition 03_Digital Building Library_nZEB_ABMF archetypes.gh (Grasshopper 1.0.8)

opaquemat = HBOpaqueMaterial(name="FloorInsul_MW", thickness=".120", conductivity="0.034", density="80", spec_heat="1030", roughness="Rough")  # -> mat; plug-in component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

opaquemat_2 = HBOpaqueMaterial(name="GypsumBoard", thickness=".0125", conductivity="0.160", density="772", spec_heat="1090", roughness="MediumSmooth")  # -> mat; plug-in component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

opaquemat_3 = HBOpaqueMaterial(name="WallInsul_MW_Int", thickness=".100", conductivity="0.033", density="70", spec_heat="1030", roughness="Rough")  # -> mat; plug-in component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

opaquemat_4 = HBOpaqueMaterial(name="FloorInsul_MW", thickness=".120", conductivity="0.034", density="80", spec_heat="1030", roughness="Rough")  # -> mat; plug-in component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

opaquemat_5 = HBOpaqueMaterial(name="FloorInsul_MW", thickness=".120", conductivity="0.034", density="80", spec_heat="1030", roughness="Rough")  # -> mat; plug-in component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

opaquemat_6 = HBOpaqueMaterial(name="RoofInsul_MW_spray", thickness=".193", conductivity="0.046", density="10", spec_heat="837", roughness="VeryRough")  # -> mat; plug-in component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

opaquemat_7 = HBOpaqueMaterial(name="WallInsul_MW_Int", thickness=".100", conductivity="0.033", density="70", spec_heat="1030", roughness="Rough")  # -> mat; plug-in component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

opaquemat_8 = HBOpaqueMaterial(name="GypsumBoard", thickness=".0125", conductivity="0.160", density="772", spec_heat="1090", roughness="MediumSmooth")  # -> mat; plug-in component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

opaquemat_9 = HBOpaqueMaterial(name="RoofInsul_MW_spray", thickness=".187", conductivity="0.046", density="10", spec_heat="837", roughness="VeryRough")  # -> mat; plug-in component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

opaquemat_10 = HBOpaqueMaterial(name="FloorInsul_MW", thickness=".120", conductivity="0.034", density="80", spec_heat="1030", roughness="Rough")  # -> mat; plug-in component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

opaquemat_11 = HBOpaqueMaterial(
    name="InternalPlaster",
    thickness="0.020",
    conductivity="0.700",
    density="1400",
    spec_heat="1000",
    roughness="MediumSmooth")  # -> mat; plug-in component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

opaquemat_12 = HBOpaqueMaterial(name="SolidBrick", thickness="0.460", conductivity="0.720", density="1800", spec_heat="1000", roughness="Rough")  # -> mat; plug-in component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

opaquemat_13 = HBOpaqueMaterial(
    name="InternalPlaster",
    thickness="0.020",
    conductivity="0.700",
    density="1400",
    spec_heat="1000",
    roughness="MediumSmooth")  # -> mat; plug-in component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

opaquemat_14 = HBOpaqueMaterial(
    name="InternalPlaster",
    thickness="0.020",
    conductivity="0.700",
    density="1400",
    spec_heat="1000",
    roughness="MediumSmooth")  # -> mat; plug-in component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

opaquemat_15 = HBOpaqueMaterial(name="CeramicTile", thickness="0.015", conductivity="1.470", density="1700", spec_heat="1000", roughness="MediumSmooth")  # -> mat; plug-in component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

opaquemat_16 = HBOpaqueMaterial(name="CementMortar", thickness="0.020", conductivity="1.400", density="2000", spec_heat="1000", roughness="Rough")  # -> mat; plug-in component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

opaquemat_17 = HBOpaqueMaterial(
    name="InternalPlaster",
    thickness="0.020",
    conductivity="0.700",
    density="1400",
    spec_heat="1000",
    roughness="MediumSmooth")  # -> mat; plug-in component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

opaquemat_18 = HBOpaqueMaterial(name="SolidBrick", thickness="0.233", conductivity="0.720", density="1800", spec_heat="1000", roughness="Rough")  # -> mat; plug-in component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

opaquemat_19 = HBOpaqueMaterial(name="ExternalPlaster", thickness=".020", conductivity="0.900", density="1800", spec_heat="1000", roughness="Rough")  # -> mat; plug-in component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

opaquematnomass = HBOpaqueMaterialNoMass(name="FictitiousLayer_R0.3", r_value="0.3")  # -> mat; plug-in component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

opaquemat_20 = HBOpaqueMaterial(name="SolidBrick", thickness="0.233", conductivity="0.720", density="1800", spec_heat="1000", roughness="Rough")  # -> mat; plug-in component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

opaquemat_21 = HBOpaqueMaterial(name="CeramicTile", thickness="0.015", conductivity="1.470", density="1700", spec_heat="1000", roughness="MediumSmooth")  # -> mat; plug-in component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

opaquemat_22 = HBOpaqueMaterial(name="CementMortar", thickness="0.020", conductivity="1.400", density="2000", spec_heat="1000", roughness="Rough")  # -> mat; plug-in component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

opaquematnomass_2 = HBOpaqueMaterialNoMass(name="FictitiousLayer_R0.3", r_value="0.3")  # -> mat; plug-in component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

opaquemat_23 = HBOpaqueMaterial(name="CeramicTile", thickness="0.015", conductivity="1.470", density="1700", spec_heat="1000", roughness="MediumSmooth")  # -> mat; plug-in component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

opaquemat_24 = HBOpaqueMaterial(name="SolidBrick", thickness="0.233", conductivity="0.720", density="1800", spec_heat="1000", roughness="Rough")  # -> mat; plug-in component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

opaquemat_25 = HBOpaqueMaterial(name="SolidBrick", thickness=".600", conductivity="0.720", density="1800", spec_heat="1000", roughness="Rough")  # -> mat; plug-in component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

opaquemat_26 = HBOpaqueMaterial(name="CementMortar", thickness="0.020", conductivity="1.400", density="2000", spec_heat="1000", roughness="Rough")  # -> mat; plug-in component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

opaquemat_27 = HBOpaqueMaterial(name="ExternalPlaster", thickness=".020", conductivity="0.900", density="1800", spec_heat="1000", roughness="Rough")  # -> mat; plug-in component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

opaquemat_28 = HBOpaqueMaterial(name="SolidBrick", thickness="0.233", conductivity="0.720", density="1800", spec_heat="1000", roughness="Rough")  # -> mat; plug-in component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

opaquemat_29 = HBOpaqueMaterial(name="CementMortar", thickness="0.020", conductivity="1.400", density="2000", spec_heat="1000", roughness="Rough")  # -> mat; plug-in component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

opaquemat_30 = HBOpaqueMaterial(name="CeramicTile", thickness="0.015", conductivity="1.470", density="1700", spec_heat="1000", roughness="MediumSmooth")  # -> mat; plug-in component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

opaquematnomass_3 = HBOpaqueMaterialNoMass(name="FictitiousLayer_R0.3", r_value="0.3")  # -> mat; plug-in component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

opaquemat_31 = HBOpaqueMaterial(name="CeramicTile", thickness="0.015", conductivity="1.470", density="1700", spec_heat="1000", roughness="MediumSmooth")  # -> mat; plug-in component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

opaquemat_32 = HBOpaqueMaterial(name="CementMortar", thickness="0.020", conductivity="1.400", density="2000", spec_heat="1000", roughness="Rough")  # -> mat; plug-in component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

opaquemat_33 = HBOpaqueMaterial(name="SolidBrick", thickness="0.233", conductivity="0.720", density="1800", spec_heat="1000", roughness="Rough")  # -> mat; plug-in component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

opaquemat_34 = HBOpaqueMaterial(name="ExternalPlaster", thickness=".020", conductivity="0.900", density="1800", spec_heat="1000", roughness="Rough")  # -> mat; plug-in component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

opaquemat_35 = HBOpaqueMaterial(name="LtwtConcScreed", thickness=".020", conductivity=".580", density="400", spec_heat="1000", roughness="Rough")  # -> mat; plug-in component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

opaquemat_36 = HBOpaqueMaterial(name="WoodDecking", thickness="0.010", conductivity="0.180", density="710", spec_heat="2400", roughness="MediumRough")  # -> mat; plug-in component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

opaquemat_37 = HBOpaqueMaterial(
    name="InternalPlaster",
    thickness="0.020",
    conductivity="0.700",
    density="1400",
    spec_heat="1000",
    roughness="MediumSmooth")  # -> mat; plug-in component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

opaquematnomass_4 = HBOpaqueMaterialNoMass(name="FictitiousLayer_R0.3", r_value="0.3")  # -> mat; plug-in component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

opaquemat_38 = HBOpaqueMaterial(
    name="InternalPlaster",
    thickness="0.020",
    conductivity="0.700",
    density="1400",
    spec_heat="1000",
    roughness="MediumSmooth")  # -> mat; plug-in component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

opaquemat_39 = HBOpaqueMaterial(
    name="InternalPlaster",
    thickness="0.020",
    conductivity="0.700",
    density="1400",
    spec_heat="1000",
    roughness="MediumSmooth")  # -> mat; plug-in component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

opaquemat_40 = HBOpaqueMaterial(name="CeramicTile", thickness="0.015", conductivity="1.470", density="1700", spec_heat="1000", roughness="MediumSmooth")  # -> mat; plug-in component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

opaquemat_41 = HBOpaqueMaterial(name="Brick&Stone", thickness="0.560", conductivity="0.900", density="2000", spec_heat="1000", roughness="VeryRough")  # -> mat; plug-in component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

opaquemat_42 = HBOpaqueMaterial(name="CementMortar", thickness="0.020", conductivity="1.400", density="2000", spec_heat="1000", roughness="Rough")  # -> mat; plug-in component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

opaquemat_43 = HBOpaqueMaterial(
    name="InternalPlaster",
    thickness="0.020",
    conductivity="0.700",
    density="1400",
    spec_heat="1000",
    roughness="MediumSmooth")  # -> mat; plug-in component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

opaquemat_44 = HBOpaqueMaterial(name="SolidBrick", thickness="0.233", conductivity="0.720", density="1800", spec_heat="1000", roughness="Rough")  # -> mat; plug-in component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

opaquemat_45 = HBOpaqueMaterial(name="ExternalPlaster", thickness=".020", conductivity="0.900", density="1800", spec_heat="1000", roughness="Rough")  # -> mat; plug-in component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

opaquematnomass_5 = HBOpaqueMaterialNoMass(name="FictitiousLayer_R0.3", r_value="0.3")  # -> mat; plug-in component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

opaquemat_46 = HBOpaqueMaterial(
    name="InternalPlaster",
    thickness="0.020",
    conductivity="0.700",
    density="1400",
    spec_heat="1000",
    roughness="MediumSmooth")  # -> mat; plug-in component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

opaquemat_47 = HBOpaqueMaterial(name="SolidBrick", thickness="0.233", conductivity="0.720", density="1800", spec_heat="1000", roughness="Rough")  # -> mat; plug-in component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

opaquemat_48 = HBOpaqueMaterial(name="CeramicTile", thickness="0.015", conductivity="1.470", density="1700", spec_heat="1000", roughness="MediumSmooth")  # -> mat; plug-in component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

opaquemat_49 = HBOpaqueMaterial(name="CementMortar", thickness="0.020", conductivity="1.400", density="2000", spec_heat="1000", roughness="Rough")  # -> mat; plug-in component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

opaquemat_50 = HBOpaqueMaterial(name="Brick&Stone", thickness="0.560", conductivity="0.900", density="2000", spec_heat="1000", roughness="VeryRough")  # -> mat; plug-in component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

opaquematnomass_6 = HBOpaqueMaterialNoMass(name="FictitiousLayer_R0.3", r_value="0.3")  # -> mat; plug-in component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

opaquemat_51 = HBOpaqueMaterial(name="SolidBrick", thickness="0.233", conductivity="0.720", density="1800", spec_heat="1000", roughness="Rough")  # -> mat; plug-in component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

opaquemat_52 = HBOpaqueMaterial(name="ExternalPlaster", thickness=".020", conductivity="0.900", density="1800", spec_heat="1000", roughness="Rough")  # -> mat; plug-in component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

opaquemat_53 = HBOpaqueMaterial(name="CeramicTile", thickness="0.015", conductivity="1.470", density="1700", spec_heat="1000", roughness="MediumSmooth")  # -> mat; plug-in component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

opaquemat_54 = HBOpaqueMaterial(name="SolidBrick", thickness=".600", conductivity="0.720", density="1800", spec_heat="1000", roughness="Rough")  # -> mat; plug-in component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

opaquemat_55 = HBOpaqueMaterial(name="CeramicTile", thickness="0.015", conductivity="1.470", density="1700", spec_heat="1000", roughness="MediumSmooth")  # -> mat; plug-in component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

opaquemat_56 = HBOpaqueMaterial(name="CementMortar", thickness="0.020", conductivity="1.400", density="2000", spec_heat="1000", roughness="Rough")  # -> mat; plug-in component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

opaquemat_57 = HBOpaqueMaterial(name="ExternalPlaster", thickness=".020", conductivity="0.900", density="1800", spec_heat="1000", roughness="Rough")  # -> mat; plug-in component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

opaquemat_58 = HBOpaqueMaterial(name="SolidBrick", thickness="0.233", conductivity="0.720", density="1800", spec_heat="1000", roughness="Rough")  # -> mat; plug-in component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

opaquemat_59 = HBOpaqueMaterial(name="CementMortar", thickness="0.020", conductivity="1.400", density="2000", spec_heat="1000", roughness="Rough")  # -> mat; plug-in component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

# ----
# R1AB
opaquemat_60 = HBOpaqueMaterial(name="ExternalPlaster", thickness=".020", conductivity="0.900", density="1800", spec_heat="1000", roughness="Rough")  # -> mat; plug-in component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

opaquemat_61 = HBOpaqueMaterial(name="SolidBrick", thickness="0.233", conductivity="0.720", density="1800", spec_heat="1000", roughness="Rough")  # -> mat; plug-in component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

opaquematnomass_7 = HBOpaqueMaterialNoMass(name="FictitiousLayer_R0.3", r_value="0.3")  # -> mat; plug-in component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

opaquemat_62 = HBOpaqueMaterial(name="CementMortar", thickness="0.020", conductivity="1.400", density="2000", spec_heat="1000", roughness="Rough")  # -> mat; plug-in component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

opaquematnomass_8 = HBOpaqueMaterialNoMass(name="FictitiousLayer_R0.3", r_value="0.3")  # -> mat; plug-in component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

opaquemat_63 = HBOpaqueMaterial(name="SolidBrick", thickness=".130", conductivity="0.720", density="1800", spec_heat="1000", roughness="Rough")  # -> mat; plug-in component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

opaquemat_64 = HBOpaqueMaterial(name="CeramicTile", thickness="0.015", conductivity="1.470", density="1700", spec_heat="1000", roughness="MediumSmooth")  # -> mat; plug-in component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

opaquemat_65 = HBOpaqueMaterial(
    name="InternalPlaster",
    thickness="0.020",
    conductivity="0.700",
    density="1400",
    spec_heat="1000",
    roughness="MediumSmooth")  # -> mat; plug-in component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

opaquemat_66 = HBOpaqueMaterial(name="CementMortar", thickness=".020", conductivity="1.400", density="2000", spec_heat="1000", roughness="Rough")  # -> mat; plug-in component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

# ----
# R1MF
opaquemat_67 = HBOpaqueMaterial(name="ExternalPlaster", thickness=".020", conductivity="0.900", density="1800", spec_heat="1000", roughness="Rough")  # -> mat; plug-in component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

opaquemat_68 = HBOpaqueMaterial(name="Brick&Stone", thickness="0.560", conductivity="0.900", density="2000", spec_heat="1000", roughness="VeryRough")  # -> mat; plug-in component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

opaquemat_69 = HBOpaqueMaterial(
    name="InternalPlaster",
    thickness="0.020",
    conductivity="0.700",
    density="1400",
    spec_heat="1000",
    roughness="MediumSmooth")  # -> mat; plug-in component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

# ----
# Hard code window
# U 1.40, g 0.35, VT 0.55
panel = Panel("0.55")
windowmat = HBWindowMaterial(name="U 1.40 Dbl LoE", u_factor="1.40", shgc="0.35", t_vis=panel)  # -> mat; plug-in component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
windowconstr = HBWindowConstruction(name="U 1.40 Dbl LoE", materials=windowmat)  # -> constr; plug-in component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
decnstrconstr = HBDeconstructConstruction(constr=windowconstr)  # -> materials, layers, r_val_si, r_val_ip, u_fac_si, u_fac_ip, shgc, t_sol, t_vis; plug-in component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
panel_2 = Panel([decnstrconstr.r_val_si, decnstrconstr.u_fac_si, decnstrconstr.shgc, decnstrconstr.t_sol, decnstrconstr.t_vis])
subfacesubset = HBSubfaceSubset(window=windowconstr, skylight=windowconstr, operable=windowconstr, glass_door=windowconstr)  # -> subface_set; plug-in component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

# ----
# Hard code window
# U 1.40, g 0.35, VT 0.55
panel_3 = Panel("0.55")
windowmat_2 = HBWindowMaterial(name="U 1.40 Dbl LoE", u_factor="1.40", shgc="0.35", t_vis=panel_3)  # -> mat; plug-in component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
windowconstr_2 = HBWindowConstruction(name="U 1.40 Dbl LoE", materials=windowmat_2)  # -> constr; plug-in component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
decnstrconstr_2 = HBDeconstructConstruction(constr=windowconstr_2)  # -> materials, layers, r_val_si, r_val_ip, u_fac_si, u_fac_ip, shgc, t_sol, t_vis; plug-in component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
panel_4 = Panel([decnstrconstr_2.r_val_si, decnstrconstr_2.u_fac_si, decnstrconstr_2.shgc, decnstrconstr_2.t_sol, decnstrconstr_2.t_vis])
subfacesubset_2 = HBSubfaceSubset(window=windowconstr_2, skylight=windowconstr_2, operable=windowconstr_2, glass_door=windowconstr_2)  # -> subface_set; plug-in component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

merge = Merge(Data1=opaquemat_15, Data2=opaquemat_16, Data3=opaquemat_18, Data4=opaquemat_17)
opaqueconstr = HBOpaqueConstruction(name="Floor_01.01_IntClg", materials=merge)  # -> constr; plug-in component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

merge_2 = Merge(Data1=opaquemat_11, Data2=opaquemat_12, Data3=opaquemat_13)
opaqueconstr_2 = HBOpaqueConstruction(name="Wall_01.07_Interior", materials=merge_2)  # -> constr; plug-in component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

merge_3 = Merge(Data1=opaquematnomass_2, Data2=opaquemat, Data3=opaquemat_27, Data4=opaquemat_28, Data5=opaquemat_29, Data6=opaquemat_30)
opaqueconstr_3 = HBOpaqueConstruction(name="Floor_01.01_GRfloor", materials=merge_3)  # -> constr; plug-in component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

merge_4 = Merge(Data1=opaquemat_14, Data2=opaquemat_20, Data3=opaquemat_22, Data4=opaquemat_21)
opaqueconstr_4 = HBOpaqueConstruction(name="Floor_01.01_IntFlr", materials=merge_4)  # -> constr; plug-in component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

merge_5 = Merge(Data1=opaquemat_23, Data2=opaquemat_26, Data3=opaquemat_24, Data4=opaquemat_19, Data5=opaquemat, Data6=opaquematnomass)
opaqueconstr_5 = HBOpaqueConstruction(name="Floor_01.01_GRroof", materials=merge_5)  # -> constr; plug-in component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

# ----
# Ground Subset -
# same as interior floors,
# ground & roof must be inverse.
# 
# Base ground & roof construction
# on exterior floor for same archetype
# Make this same thickness as W1
panel_5 = Panel("Wall_01.04_UGwall")
opaqueconstr_6 = HBOpaqueConstruction(name=panel_5, materials=opaquemat_25)  # -> constr; plug-in component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
groundsubset = HBGroundConstructionSubset(ground_wall=opaqueconstr_6, ground_roof=opaqueconstr_5, ground_floor=opaqueconstr_3)  # -> ground_set; plug-in component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
decnstrmat = HBDeconstructMaterial(mat=groundsubset)  # -> values, attr_names, r_val_si, r_val_ip; plug-in component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
panel_6 = Panel(groundsubset)
panel_7 = Panel(decnstrmat.r_val_si)

merge_6 = Merge(Data1=opaquemat_40, Data2=opaquemat_42, Data3=opaquemat_44, Data4=opaquemat_43)
opaqueconstr_7 = HBOpaqueConstruction(name="Floor_01.01_IntClg", materials=merge_6)  # -> constr; plug-in component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

merge_7 = Merge(Data1=opaquemat_37, Data2=opaquemat_41, Data3=opaquemat_39)
opaqueconstr_8 = HBOpaqueConstruction(name="Wall_01.04_Interior", materials=merge_7)  # -> constr; plug-in component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

merge_8 = Merge(
    Data1=opaquematnomass_6,
    Data2=opaquemat_4,
    Data3=opaquemat_57,
    Data4=opaquemat_61,
    Data5=opaquemat_62,
    Data6=opaquemat_64)
opaqueconstr_9 = HBOpaqueConstruction(name="Floor_01.01_GRfloor", materials=merge_8)  # -> constr; plug-in component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

merge_9 = Merge(Data1=opaquematnomass_3, Data2=opaquemat_6, Data3=opaquemat_35, Data4=opaquemat_36)
opaqueconstr_10 = HBOpaqueConstruction(name="Ceiling_01.02", materials=merge_9)  # -> constr; plug-in component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

merge_10 = Merge(Data1=opaquemat_38, Data2=opaquemat_47, Data3=opaquemat_49, Data4=opaquemat_48)
opaqueconstr_11 = HBOpaqueConstruction(name="Floor_01.01_IntFlr", materials=merge_10)  # -> constr; plug-in component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

merge_11 = Merge(
    Data1=opaquematnomass_4,
    Data2=opaquemat_5,
    Data3=opaquemat_34,
    Data4=opaquemat_33,
    Data5=opaquemat_32,
    Data6=opaquemat_31)
opaqueconstr_12 = HBOpaqueConstruction(name="Floor_01.01", materials=merge_11)  # -> constr; plug-in component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

merge_12 = Merge(
    Data1=opaquemat_53,
    Data2=opaquemat_56,
    Data3=opaquemat_51,
    Data4=opaquemat_45,
    Data5=opaquemat_4,
    Data6=opaquematnomass_5)
opaqueconstr_13 = HBOpaqueConstruction(name="Floor_01.01_GRroof", materials=merge_12)  # -> constr; plug-in component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

# ----
# Ground Subset -
# same as interior floors,
# ground & roof must be inverse.
# 
# Base ground & roof construction
# on exterior floor for same archetype
# Make this same thickness as W1
panel_8 = Panel("Wall_01.04_UGwall")
opaqueconstr_14 = HBOpaqueConstruction(name=panel_8, materials=opaquemat_54)  # -> constr; plug-in component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
groundsubset_2 = HBGroundConstructionSubset(ground_wall=opaqueconstr_14, ground_roof=opaqueconstr_13, ground_floor=opaqueconstr_9)  # -> ground_set; plug-in component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
decnstrmat_2 = HBDeconstructMaterial(mat=groundsubset_2)  # -> values, attr_names, r_val_si, r_val_ip; plug-in component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
panel_9 = Panel(groundsubset_2)
panel_10 = Panel(decnstrmat_2.r_val_si)

merge_13 = Merge(Data1=opaquemat_60, Data2=opaquemat_50, Data3=opaquemat_46, Data4=opaquemat_3, Data5=opaquemat_2)
opaqueconstr_15 = HBOpaqueConstruction(name="Wall_01.04", materials=merge_13)  # -> constr; plug-in component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

merge_14 = Merge(Data1=opaquematnomass_8, Data2=opaquemat_9, Data3=opaquemat_66, Data4=opaquemat_63, Data5=opaquemat_65)
opaqueconstr_16 = HBOpaqueConstruction(name="Ceiling_01.01", materials=merge_14)  # -> constr; plug-in component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

merge_15 = Merge(
    Data1=opaquematnomass_7,
    Data2=opaquemat_10,
    Data3=opaquemat_52,
    Data4=opaquemat_58,
    Data5=opaquemat_59,
    Data6=opaquemat_55)
opaqueconstr_17 = HBOpaqueConstruction(name="Floor_01.01", materials=merge_15)  # -> constr; plug-in component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

merge_16 = Merge(Data1=opaquemat_67, Data2=opaquemat_68, Data3=opaquemat_69, Data4=opaquemat_7, Data5=opaquemat_8)
opaqueconstr_18 = HBOpaqueConstruction(name="Wall_01.04", materials=merge_16)  # -> constr; plug-in component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

# ----
# Interior Subset -
# Note interior floors & ceilings must
# be inverse of each other
interiorsubset = HBInteriorConstructionSubset(interior_wall=opaqueconstr_2, ceiling=opaqueconstr, interior_floor=opaqueconstr_4)  # -> interior_set; plug-in component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
panel_11 = Panel(interiorsubset)

# ----
# Exterior Subset
exteriorsubset = HBExteriorConstructionSubset(exterior_wall=opaqueconstr_15, exterior_roof=opaqueconstr_10, exposed_floor=opaqueconstr_12)  # -> exterior_set; plug-in component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
panel_12 = Panel(exteriorsubset)
decnstrmat_3 = HBDeconstructMaterial(mat=exteriorsubset)  # -> values, attr_names, r_val_si, r_val_ip; plug-in component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
panel_13 = Panel(decnstrmat_3.r_val_si)

# ----
# Exterior Subset
exteriorsubset_2 = HBExteriorConstructionSubset(exterior_wall=opaqueconstr_18, exterior_roof=opaqueconstr_16, exposed_floor=opaqueconstr_17)  # -> exterior_set; plug-in component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
panel_14 = Panel(exteriorsubset_2)
decnstrmat_4 = HBDeconstructMaterial(mat=exteriorsubset_2)  # -> values, attr_names, r_val_si, r_val_ip; plug-in component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
panel_15 = Panel(decnstrmat_4.r_val_si)

# ----
# Interior Subset -
# Note interior floors & ceilings must
# be inverse of each other
interiorsubset_2 = HBInteriorConstructionSubset(interior_wall=opaqueconstr_8, ceiling=opaqueconstr_7, interior_floor=opaqueconstr_11)  # -> interior_set; plug-in component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
panel_16 = Panel(interiorsubset_2)

# ----
# EXPORT TO JSON
panel_17 = Panel("pre_1980::ClimateZone4::Mass")
constructionset = HBConstructionSet(
    name="R1AB_g0.35WinHC",
    base_constr_set=panel_17,
    exterior_subset=exteriorsubset,
    ground_subset=groundsubset,
    interior_subset=interiorsubset,
    subface_subset=subfacesubset)  # -> constr_set; plug-in component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
objtostr = HBObjectToString(hb_obj=constructionset)  # -> hb_str; plug-in component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
panel_18 = Panel(objtostr)

# ----
# EXPORT TO JSON
panel_19 = Panel("pre_1980::ClimateZone4::Mass")
constructionset_2 = HBConstructionSet(
    name="R1MF_g0.35WinHC",
    base_constr_set=panel_19,
    exterior_subset=exteriorsubset_2,
    ground_subset=groundsubset_2,
    interior_subset=interiorsubset_2,
    subface_subset=subfacesubset_2)  # -> constr_set; plug-in component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
objtostr_2 = HBObjectToString(hb_obj=constructionset_2)  # -> hb_str; plug-in component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
panel_20 = Panel(objtostr_2)

opaquemat_70 = HBOpaqueMaterial(name="FloorInsul_MW", thickness=".120", conductivity="0.034", density="80", spec_heat="1030", roughness="Rough")  # -> mat; plug-in component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

opaquemat_71 = HBOpaqueMaterial(name="RoofInsul_MW_spray", thickness=".192", conductivity="0.046", density="10", spec_heat="837", roughness="VeryRough")  # -> mat; plug-in component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

opaquemat_72 = HBOpaqueMaterial(name="FloorInsul_MW", thickness=".120", conductivity="0.034", density="80", spec_heat="1030", roughness="Rough")  # -> mat; plug-in component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

opaquemat_73 = HBOpaqueMaterial(name="GypsumBoard", thickness=".0125", conductivity="0.160", density="772", spec_heat="1090", roughness="MediumSmooth")  # -> mat; plug-in component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

opaquemat_74 = HBOpaqueMaterial(name="WallInsul_MW_Int", thickness=".120", conductivity="0.033", density="70", spec_heat="1030", roughness="Rough")  # -> mat; plug-in component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

opaquemat_75 = HBOpaqueMaterial(name="WallInsul_MW_Int", thickness=".100", conductivity="0.033", density="70", spec_heat="1030", roughness="Rough")  # -> mat; plug-in component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

opaquemat_76 = HBOpaqueMaterial(name="FloorInsul_MW", thickness=".120", conductivity="0.034", density="80", spec_heat="1030", roughness="Rough")  # -> mat; plug-in component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

opaquemat_77 = HBOpaqueMaterial(name="GypsumBoard", thickness=".0125", conductivity="0.160", density="772", spec_heat="1090", roughness="MediumSmooth")  # -> mat; plug-in component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

opaquemat_78 = HBOpaqueMaterial(name="RoofInsul_MW_spray", thickness=".193", conductivity="0.046", density="10", spec_heat="837", roughness="VeryRough")  # -> mat; plug-in component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

opaquemat_79 = HBOpaqueMaterial(name="FloorInsul_MW", thickness=".120", conductivity="0.034", density="80", spec_heat="1030", roughness="Rough")  # -> mat; plug-in component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

opaquemat_80 = HBOpaqueMaterial(name="SolidBrick", thickness="0.460", conductivity="0.720", density="1800", spec_heat="1000", roughness="Rough")  # -> mat; plug-in component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

opaquemat_81 = HBOpaqueMaterial(
    name="InternalPlaster",
    thickness="0.020",
    conductivity="0.700",
    density="1400",
    spec_heat="1000",
    roughness="MediumSmooth")  # -> mat; plug-in component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

opaquemat_82 = HBOpaqueMaterial(
    name="InternalPlaster",
    thickness="0.020",
    conductivity="0.700",
    density="1400",
    spec_heat="1000",
    roughness="MediumSmooth")  # -> mat; plug-in component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

opaquemat_83 = HBOpaqueMaterial(name="CeramicTile", thickness="0.015", conductivity="1.470", density="1700", spec_heat="1000", roughness="MediumSmooth")  # -> mat; plug-in component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

opaquemat_84 = HBOpaqueMaterial(
    name="InternalPlaster",
    thickness="0.020",
    conductivity="0.700",
    density="1400",
    spec_heat="1000",
    roughness="MediumSmooth")  # -> mat; plug-in component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

opaquemat_85 = HBOpaqueMaterial(name="CementMortar", thickness="0.020", conductivity="1.400", density="2000", spec_heat="1000", roughness="Rough")  # -> mat; plug-in component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

opaquemat_86 = HBOpaqueMaterial(name="CementMortar", thickness="0.020", conductivity="1.400", density="2000", spec_heat="1000", roughness="Rough")  # -> mat; plug-in component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

opaquemat_87 = HBOpaqueMaterial(
    name="InternalPlaster",
    thickness="0.020",
    conductivity="0.700",
    density="1400",
    spec_heat="1000",
    roughness="MediumSmooth")  # -> mat; plug-in component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

opaquemat_88 = HBOpaqueMaterial(name="SolidBrick", thickness="0.161", conductivity="0.720", density="1800", spec_heat="1000", roughness="Rough")  # -> mat; plug-in component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

opaquemat_89 = HBOpaqueMaterial(name="CeramicTile", thickness="0.015", conductivity="1.470", density="1700", spec_heat="1000", roughness="MediumSmooth")  # -> mat; plug-in component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

opaquemat_90 = HBOpaqueMaterial(name="SolidBrick", thickness="0.161", conductivity="0.720", density="1800", spec_heat="1000", roughness="Rough")  # -> mat; plug-in component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

opaquemat_91 = HBOpaqueMaterial(name="CeramicTile", thickness="0.015", conductivity="1.470", density="1700", spec_heat="1000", roughness="MediumSmooth")  # -> mat; plug-in component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

opaquemat_92 = HBOpaqueMaterial(name="CementMortar", thickness="0.020", conductivity="1.400", density="2000", spec_heat="1000", roughness="Rough")  # -> mat; plug-in component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

opaquemat_93 = HBOpaqueMaterial(name="ExternalPlaster", thickness=".020", conductivity="0.900", density="1800", spec_heat="1000", roughness="Rough")  # -> mat; plug-in component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

opaquematnomass_9 = HBOpaqueMaterialNoMass(name="FictitiousLayer_R0.3", r_value="0.3")  # -> mat; plug-in component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

opaquemat_94 = HBOpaqueMaterial(name="SolidBrick", thickness="0.161", conductivity="0.720", density="1800", spec_heat="1000", roughness="Rough")  # -> mat; plug-in component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

opaquemat_95 = HBOpaqueMaterial(name="SolidBrick", thickness=".370", conductivity="0.720", density="1800", spec_heat="1000", roughness="Rough")  # -> mat; plug-in component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

opaquemat_96 = HBOpaqueMaterial(name="CementMortar", thickness="0.020", conductivity="1.400", density="2000", spec_heat="1000", roughness="Rough")  # -> mat; plug-in component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

opaquemat_97 = HBOpaqueMaterial(name="CeramicTile", thickness="0.015", conductivity="1.470", density="1700", spec_heat="1000", roughness="MediumSmooth")  # -> mat; plug-in component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

opaquemat_98 = HBOpaqueMaterial(name="SolidBrick", thickness="0.161", conductivity="0.720", density="1800", spec_heat="1000", roughness="Rough")  # -> mat; plug-in component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

opaquematnomass_10 = HBOpaqueMaterialNoMass(name="FictitiousLayer_R0.3", r_value="0.3")  # -> mat; plug-in component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

opaquemat_99 = HBOpaqueMaterial(name="ExternalPlaster", thickness=".020", conductivity="0.900", density="1800", spec_heat="1000", roughness="Rough")  # -> mat; plug-in component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

opaquematnomass_11 = HBOpaqueMaterialNoMass(name="FictitiousLayer_R0.3", r_value="0.3")  # -> mat; plug-in component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

opaquemat_100 = HBOpaqueMaterial(name="CeramicTile", thickness="0.015", conductivity="1.470", density="1700", spec_heat="1000", roughness="MediumSmooth")  # -> mat; plug-in component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

opaquemat_101 = HBOpaqueMaterial(name="CementMortar", thickness="0.020", conductivity="1.400", density="2000", spec_heat="1000", roughness="Rough")  # -> mat; plug-in component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

opaquemat_102 = HBOpaqueMaterial(name="SolidBrick", thickness="0.161", conductivity="0.720", density="1800", spec_heat="1000", roughness="Rough")  # -> mat; plug-in component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

opaquemat_103 = HBOpaqueMaterial(
    name="InternalPlaster",
    thickness="0.020",
    conductivity="0.700",
    density="1400",
    spec_heat="1000",
    roughness="MediumSmooth")  # -> mat; plug-in component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

opaquemat_104 = HBOpaqueMaterial(name="ExternalPlaster", thickness=".020", conductivity="0.900", density="1800", spec_heat="1000", roughness="Rough")  # -> mat; plug-in component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

opaquemat_105 = HBOpaqueMaterial(name="SolidBrick", thickness="0.330", conductivity="0.720", density="1800", spec_heat="1000", roughness="Rough")  # -> mat; plug-in component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

opaquematnomass_12 = HBOpaqueMaterialNoMass(name="FictitiousLayer_R0.3", r_value="0.3")  # -> mat; plug-in component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

# ----
# Exterior Wall Insulation & Plaster
# Interior Wall Insulation & GypBd
panel_21 = Panel("ExternalPlaster")
# Floor Insulation
# Roof Insulation - Spray
# R2AB
opaquemat_106 = HBOpaqueMaterial(name=panel_21, thickness=".020", conductivity="0.900", density="1800", spec_heat="1000", roughness="Rough")  # -> mat; plug-in component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

opaquemat_107 = HBOpaqueMaterial(name="SolidBrick", thickness="0.077", conductivity="0.720", density="1800", spec_heat="1000", roughness="Rough")  # -> mat; plug-in component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

opaquemat_108 = HBOpaqueMaterial(
    name="InternalPlaster_Thin",
    thickness="0.010",
    conductivity="0.700",
    density="1400",
    spec_heat="1000",
    roughness="MediumSmooth")  # -> mat; plug-in component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

opaquemat_109 = HBOpaqueMaterial(
    name="InternalPlaster",
    thickness="0.020",
    conductivity="0.700",
    density="1400",
    spec_heat="1000",
    roughness="MediumSmooth")  # -> mat; plug-in component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

opaquemat_110 = HBOpaqueMaterial(name="SolidBrick", thickness="0.340", conductivity="0.720", density="1800", spec_heat="1000", roughness="Rough")  # -> mat; plug-in component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

opaquemat_111 = HBOpaqueMaterial(
    name="InternalPlaster",
    thickness="0.020",
    conductivity="0.700",
    density="1400",
    spec_heat="1000",
    roughness="MediumSmooth")  # -> mat; plug-in component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

opaquemat_112 = HBOpaqueMaterial(
    name="InternalPlaster",
    thickness="0.020",
    conductivity="0.700",
    density="1400",
    spec_heat="1000",
    roughness="MediumSmooth")  # -> mat; plug-in component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

opaquemat_113 = HBOpaqueMaterial(name="CementMortar", thickness="0.020", conductivity="1.400", density="2000", spec_heat="1000", roughness="Rough")  # -> mat; plug-in component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

opaquemat_114 = HBOpaqueMaterial(name="CeramicTile", thickness="0.015", conductivity="1.470", density="1700", spec_heat="1000", roughness="MediumSmooth")  # -> mat; plug-in component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

opaquemat_115 = HBOpaqueMaterial(name="CementMortar", thickness="0.020", conductivity="1.400", density="2000", spec_heat="1000", roughness="Rough")  # -> mat; plug-in component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

opaquemat_116 = HBOpaqueMaterial(
    name="InternalPlaster",
    thickness="0.020",
    conductivity="0.700",
    density="1400",
    spec_heat="1000",
    roughness="MediumSmooth")  # -> mat; plug-in component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

opaquemat_117 = HBOpaqueMaterial(name="SolidBrick", thickness="0.161", conductivity="0.720", density="1800", spec_heat="1000", roughness="Rough")  # -> mat; plug-in component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

opaquemat_118 = HBOpaqueMaterial(name="CeramicTile", thickness="0.015", conductivity="1.470", density="1700", spec_heat="1000", roughness="MediumSmooth")  # -> mat; plug-in component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

opaquemat_119 = HBOpaqueMaterial(name="SolidBrick", thickness="0.161", conductivity="0.720", density="1800", spec_heat="1000", roughness="Rough")  # -> mat; plug-in component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

opaquemat_120 = HBOpaqueMaterial(name="CeramicTile", thickness="0.015", conductivity="1.470", density="1700", spec_heat="1000", roughness="MediumSmooth")  # -> mat; plug-in component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

opaquemat_121 = HBOpaqueMaterial(name="CementMortar", thickness="0.020", conductivity="1.400", density="2000", spec_heat="1000", roughness="Rough")  # -> mat; plug-in component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

opaquemat_122 = HBOpaqueMaterial(name="ExternalPlaster", thickness=".020", conductivity="0.900", density="1800", spec_heat="1000", roughness="Rough")  # -> mat; plug-in component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

opaquematnomass_13 = HBOpaqueMaterialNoMass(name="FictitiousLayer_R0.3", r_value="0.3")  # -> mat; plug-in component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

opaquemat_123 = HBOpaqueMaterial(name="SolidBrick", thickness="0.161", conductivity="0.720", density="1800", spec_heat="1000", roughness="Rough")  # -> mat; plug-in component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

opaquemat_124 = HBOpaqueMaterial(name="SolidBrick", thickness=".600", conductivity="0.720", density="1800", spec_heat="1000", roughness="Rough")  # -> mat; plug-in component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

opaquemat_125 = HBOpaqueMaterial(name="CeramicTile", thickness="0.015", conductivity="1.470", density="1700", spec_heat="1000", roughness="MediumSmooth")  # -> mat; plug-in component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

opaquemat_126 = HBOpaqueMaterial(name="CementMortar", thickness="0.020", conductivity="1.400", density="2000", spec_heat="1000", roughness="Rough")  # -> mat; plug-in component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

# ----
# R2MF
opaquemat_127 = HBOpaqueMaterial(name="ExternalPlaster", thickness=".020", conductivity="0.900", density="1800", spec_heat="1000", roughness="Rough")  # -> mat; plug-in component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

opaquemat_128 = HBOpaqueMaterial(name="Brick&Stone", thickness="0.560", conductivity="0.900", density="2000", spec_heat="1000", roughness="VeryRough")  # -> mat; plug-in component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

opaquemat_129 = HBOpaqueMaterial(name="SolidBrick", thickness="0.161", conductivity="0.720", density="1800", spec_heat="1000", roughness="Rough")  # -> mat; plug-in component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

opaquemat_130 = HBOpaqueMaterial(name="CementMortar", thickness="0.020", conductivity="1.400", density="2000", spec_heat="1000", roughness="Rough")  # -> mat; plug-in component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

opaquemat_131 = HBOpaqueMaterial(
    name="InternalPlaster",
    thickness="0.020",
    conductivity="0.700",
    density="1400",
    spec_heat="1000",
    roughness="MediumSmooth")  # -> mat; plug-in component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

opaquemat_132 = HBOpaqueMaterial(name="ExternalPlaster", thickness=".020", conductivity="0.900", density="1800", spec_heat="1000", roughness="Rough")  # -> mat; plug-in component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

opaquemat_133 = HBOpaqueMaterial(name="CeramicTile", thickness="0.015", conductivity="1.470", density="1700", spec_heat="1000", roughness="MediumSmooth")  # -> mat; plug-in component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

opaquemat_134 = HBOpaqueMaterial(name="SolidBrick", thickness="0.161", conductivity="0.720", density="1800", spec_heat="1000", roughness="Rough")  # -> mat; plug-in component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

opaquematnomass_14 = HBOpaqueMaterialNoMass(name="FictitiousLayer_R0.3", r_value="0.3")  # -> mat; plug-in component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

opaquemat_135 = HBOpaqueMaterial(name="ExternalPlaster", thickness=".020", conductivity="0.900", density="1800", spec_heat="1000", roughness="Rough")  # -> mat; plug-in component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

opaquematnomass_15 = HBOpaqueMaterialNoMass(name="FictitiousLayer_R0.3", r_value="0.3")  # -> mat; plug-in component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

opaquematnomass_16 = HBOpaqueMaterialNoMass(name="FictitiousLayer_R0.3", r_value="0.3")  # -> mat; plug-in component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

opaquemat_136 = HBOpaqueMaterial(name="LtwtConcScreed", thickness=".020", conductivity=".580", density="400", spec_heat="1000", roughness="Rough")  # -> mat; plug-in component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

opaquemat_137 = HBOpaqueMaterial(name="WoodDecking", thickness="0.010", conductivity="0.180", density="710", spec_heat="2400", roughness="MediumRough")  # -> mat; plug-in component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

# ----
# Hard code window
# U 1.40, g 0.35, VT 0.55
panel_22 = Panel("0.55")
windowmat_3 = HBWindowMaterial(name="U 1.40 Dbl LoE", u_factor="1.40", shgc="0.35", t_vis=panel_22)  # -> mat; plug-in component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
windowconstr_3 = HBWindowConstruction(name="U 1.40 Dbl LoE", materials=windowmat_3)  # -> constr; plug-in component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
decnstrconstr_3 = HBDeconstructConstruction(constr=windowconstr_3)  # -> materials, layers, r_val_si, r_val_ip, u_fac_si, u_fac_ip, shgc, t_sol, t_vis; plug-in component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
panel_23 = Panel([decnstrconstr_3.r_val_si, decnstrconstr_3.u_fac_si, decnstrconstr_3.shgc, decnstrconstr_3.t_sol, decnstrconstr_3.t_vis])
subfacesubset_3 = HBSubfaceSubset(window=windowconstr_3, skylight=windowconstr_3, operable=windowconstr_3, glass_door=windowconstr_3)  # -> subface_set; plug-in component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

# ----
# Hard code window
# U 1.40, g 0.35, VT 0.55
panel_24 = Panel("0.55")
windowmat_4 = HBWindowMaterial(name="U 1.40 Dbl LoE", u_factor="1.40", shgc="0.35", t_vis=panel_24)  # -> mat; plug-in component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
windowconstr_4 = HBWindowConstruction(name="U 1.40 Dbl LoE", materials=windowmat_4)  # -> constr; plug-in component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
decnstrconstr_4 = HBDeconstructConstruction(constr=windowconstr_4)  # -> materials, layers, r_val_si, r_val_ip, u_fac_si, u_fac_ip, shgc, t_sol, t_vis; plug-in component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
panel_25 = Panel([decnstrconstr_4.r_val_si, decnstrconstr_4.u_fac_si, decnstrconstr_4.shgc, decnstrconstr_4.t_sol, decnstrconstr_4.t_vis])
subfacesubset_4 = HBSubfaceSubset(window=windowconstr_4, skylight=windowconstr_4, operable=windowconstr_4, glass_door=windowconstr_4)  # -> subface_set; plug-in component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

merge_17 = Merge(Data1=opaquemat_83, Data2=opaquemat_86, Data3=opaquemat_88, Data4=opaquemat_87)
opaqueconstr_19 = HBOpaqueConstruction(name="Floor_01.03_IntClg", materials=merge_17)  # -> constr; plug-in component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

merge_18 = Merge(Data1=opaquemat_81, Data2=opaquemat_80, Data3=opaquemat_82)
opaqueconstr_20 = HBOpaqueConstruction(name="Wall_01.07_Interior", materials=merge_18)  # -> constr; plug-in component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

merge_19 = Merge(
    Data1=opaquematnomass_10,
    Data2=opaquemat_70,
    Data3=opaquemat_99,
    Data4=opaquemat_98,
    Data5=opaquemat_96,
    Data6=opaquemat_97)
opaqueconstr_21 = HBOpaqueConstruction(name="Floor_01.03_GRfloor", materials=merge_19)  # -> constr; plug-in component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

merge_20 = Merge(Data1=opaquemat_84, Data2=opaquemat_90, Data3=opaquemat_92, Data4=opaquemat_91)
opaqueconstr_22 = HBOpaqueConstruction(name="Floor_01.03_IntFlr", materials=merge_20)  # -> constr; plug-in component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

merge_21 = Merge(
    Data1=opaquemat_89,
    Data2=opaquemat_85,
    Data3=opaquemat_94,
    Data4=opaquemat_93,
    Data5=opaquemat_70,
    Data6=opaquematnomass_9)
opaqueconstr_23 = HBOpaqueConstruction(name="Floor_01.03_GRroof", materials=merge_21)  # -> constr; plug-in component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

# ----
# Ground Subset -
# same as interior floors,
# ground & roof must be inverse.
# 
# Base ground & roof construction
# on exterior floor for same archetype
# Make this same thickness as W1
panel_26 = Panel("Wall_01.06_UGwall")
opaqueconstr_24 = HBOpaqueConstruction(name=panel_26, materials=opaquemat_95)  # -> constr; plug-in component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
groundsubset_3 = HBGroundConstructionSubset(ground_wall=opaqueconstr_24, ground_roof=opaqueconstr_23, ground_floor=opaqueconstr_21)  # -> ground_set; plug-in component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
decnstrmat_5 = HBDeconstructMaterial(mat=groundsubset_3)  # -> values, attr_names, r_val_si, r_val_ip; plug-in component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
panel_27 = Panel(groundsubset_3)
panel_28 = Panel(decnstrmat_5.r_val_si)

merge_22 = Merge(Data1=opaquemat_114, Data2=opaquemat_115, Data3=opaquemat_117, Data4=opaquemat_116)
opaqueconstr_25 = HBOpaqueConstruction(name="Floor_01.03_IntClg", materials=merge_22)  # -> constr; plug-in component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

merge_23 = Merge(Data1=opaquematnomass_11, Data2=opaquemat_71, Data3=opaquemat_107, Data4=opaquemat_108)
opaqueconstr_26 = HBOpaqueConstruction(name="Ceiling_01.04", materials=merge_23)  # -> constr; plug-in component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

merge_24 = Merge(
    Data1=opaquematnomass_12,
    Data2=opaquemat_72,
    Data3=opaquemat_104,
    Data4=opaquemat_102,
    Data5=opaquemat_101,
    Data6=opaquemat_100)
opaqueconstr_27 = HBOpaqueConstruction(name="Floor_01.03", materials=merge_24)  # -> constr; plug-in component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

merge_25 = Merge(Data1=opaquemat_109, Data2=opaquemat_110, Data3=opaquemat_111)
opaqueconstr_28 = HBOpaqueConstruction(name="Wall_01.06_Interior", materials=merge_25)  # -> constr; plug-in component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

merge_26 = Merge(Data1=opaquemat_106, Data2=opaquemat_105, Data3=opaquemat_103, Data4=opaquemat_74, Data5=opaquemat_73)
opaqueconstr_29 = HBOpaqueConstruction(name="Wall_01.06", materials=merge_26)  # -> constr; plug-in component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

merge_27 = Merge(
    Data1=opaquematnomass_15,
    Data2=opaquemat_76,
    Data3=opaquemat_135,
    Data4=opaquemat_134,
    Data5=opaquemat_130,
    Data6=opaquemat_133)
opaqueconstr_30 = HBOpaqueConstruction(name="Floor_01.03_GRfloor", materials=merge_27)  # -> constr; plug-in component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

merge_28 = Merge(Data1=opaquemat_112, Data2=opaquemat_119, Data3=opaquemat_121, Data4=opaquemat_120)
opaqueconstr_31 = HBOpaqueConstruction(name="Floor_01.03_IntFlr", materials=merge_28)  # -> constr; plug-in component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

merge_29 = Merge(
    Data1=opaquemat_118,
    Data2=opaquemat_113,
    Data3=opaquemat_123,
    Data4=opaquemat_122,
    Data5=opaquemat_76,
    Data6=opaquematnomass_13)
opaqueconstr_32 = HBOpaqueConstruction(name="Floor_01.03_GRroof", materials=merge_29)  # -> constr; plug-in component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

# ----
# Ground Subset -
# same as interior floors,
# ground & roof must be inverse.
# 
# Base ground & roof construction
# on exterior floor for same archetype
# Make this same thickness as W1
panel_29 = Panel("Wall_01.04_UGwall")
opaqueconstr_33 = HBOpaqueConstruction(name=panel_29, materials=opaquemat_124)  # -> constr; plug-in component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
groundsubset_4 = HBGroundConstructionSubset(ground_wall=opaqueconstr_33, ground_roof=opaqueconstr_32, ground_floor=opaqueconstr_30)  # -> ground_set; plug-in component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
decnstrmat_6 = HBDeconstructMaterial(mat=groundsubset_4)  # -> values, attr_names, r_val_si, r_val_ip; plug-in component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
panel_30 = Panel(groundsubset_4)
panel_31 = Panel(decnstrmat_6.r_val_si)

merge_30 = Merge(
    Data1=opaquematnomass_14,
    Data2=opaquemat_79,
    Data3=opaquemat_132,
    Data4=opaquemat_129,
    Data5=opaquemat_126,
    Data6=opaquemat_125)
opaqueconstr_34 = HBOpaqueConstruction(name="Floor_01.03", materials=merge_30)  # -> constr; plug-in component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

merge_31 = Merge(Data1=opaquematnomass_16, Data2=opaquemat_78, Data3=opaquemat_136, Data4=opaquemat_137)
opaqueconstr_35 = HBOpaqueConstruction(name="Ceiling_01.02", materials=merge_31)  # -> constr; plug-in component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

merge_32 = Merge(Data1=opaquemat_127, Data2=opaquemat_128, Data3=opaquemat_131, Data4=opaquemat_75, Data5=opaquemat_77)
opaqueconstr_36 = HBOpaqueConstruction(name="Wall_01.04", materials=merge_32)  # -> constr; plug-in component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

# ----
# AB & MF
# Library date Apr 2, 2023
# nZEB retrofit as per Decreto Ministeriale
# Hard code windows U1.40, g0.35, VLT0.55
r2mf_g0_35winhc = Data("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")
r2ab_g0_35winhc = Data("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")
r3ab_g0_35winhc = Data("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")
r3mf_g0_35winhc = Data("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")
r4ab_g0_35winhc = Data("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")
r4mf_g0_35winhc = Data("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")
r5ab_g0_35winhc = Data("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")
r5mf_g0_35winhc = Data("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")
r6ab_g0_35winhc = Data("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")
r6mf_g0_35winhc = Data("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")
r7ab_g0_35winhc = Data("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")
r7mf_g0_35winhc = Data("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")
r8ab_g0_35winhc = Data("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")

# ----
# Interior Subset -
# Note interior floors & ceilings must
# be inverse of each other
interiorsubset_3 = HBInteriorConstructionSubset(interior_wall=opaqueconstr_20, ceiling=opaqueconstr_19, interior_floor=opaqueconstr_22)  # -> interior_set; plug-in component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
panel_32 = Panel(interiorsubset_3)

# ----
# Exterior Subset
exteriorsubset_3 = HBExteriorConstructionSubset(exterior_wall=opaqueconstr_29, exterior_roof=opaqueconstr_26, exposed_floor=opaqueconstr_27)  # -> exterior_set; plug-in component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
panel_33 = Panel(exteriorsubset_3)
decnstrmat_7 = HBDeconstructMaterial(mat=exteriorsubset_3)  # -> values, attr_names, r_val_si, r_val_ip; plug-in component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
panel_34 = Panel(decnstrmat_7.r_val_si)

# ----
# Interior Subset -
# Note interior floors & ceilings must
# be inverse of each other
interiorsubset_4 = HBInteriorConstructionSubset(interior_wall=opaqueconstr_28, ceiling=opaqueconstr_25, interior_floor=opaqueconstr_31)  # -> interior_set; plug-in component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
panel_35 = Panel(interiorsubset_4)

# ----
# Exterior Subset
exteriorsubset_4 = HBExteriorConstructionSubset(exterior_wall=opaqueconstr_36, exterior_roof=opaqueconstr_35, exposed_floor=opaqueconstr_34)  # -> exterior_set; plug-in component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
panel_36 = Panel(exteriorsubset_4)
decnstrmat_8 = HBDeconstructMaterial(mat=exteriorsubset_4)  # -> values, attr_names, r_val_si, r_val_ip; plug-in component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
panel_37 = Panel(decnstrmat_8.r_val_si)

# ----
# EXPORT TO JSON
panel_38 = Panel("pre_1980::ClimateZone4::Mass")
constructionset_3 = HBConstructionSet(
    name="R2AB_g0.35WinHC",
    base_constr_set=panel_38,
    exterior_subset=exteriorsubset_3,
    ground_subset=groundsubset_3,
    interior_subset=interiorsubset_3,
    subface_subset=subfacesubset_3)  # -> constr_set; plug-in component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
objtostr_3 = HBObjectToString(hb_obj=constructionset_3)  # -> hb_str; plug-in component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

panel_39 = Panel(objtostr_3)

# ----
# EXPORT TO JSON
panel_40 = Panel("pre_1980::ClimateZone4::Mass")
constructionset_4 = HBConstructionSet(
    name="R2MF_g0.35WinHC",
    base_constr_set=panel_40,
    exterior_subset=exteriorsubset_4,
    ground_subset=groundsubset_4,
    interior_subset=interiorsubset_4,
    subface_subset=subfacesubset_4)  # -> constr_set; plug-in component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
objtostr_4 = HBObjectToString(hb_obj=constructionset_4)  # -> hb_str; plug-in component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

panel_41 = Panel(objtostr_4)

opaquemat_138 = HBOpaqueMaterial(name="FloorInsul_MW", thickness=".120", conductivity="0.034", density="80", spec_heat="1030", roughness="Rough")  # -> mat; plug-in component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

opaquemat_139 = HBOpaqueMaterial(name="GypsumBoard", thickness=".0125", conductivity="0.160", density="772", spec_heat="1090", roughness="MediumSmooth")  # -> mat; plug-in component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

opaquemat_140 = HBOpaqueMaterial(name="WallInsul_MW_Int", thickness=".120", conductivity="0.033", density="70", spec_heat="1030", roughness="Rough")  # -> mat; plug-in component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

opaquemat_141 = HBOpaqueMaterial(name="FloorInsul_MW", thickness=".120", conductivity="0.034", density="80", spec_heat="1030", roughness="Rough")  # -> mat; plug-in component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

opaquemat_142 = HBOpaqueMaterial(name="RoofInsul_MW_spray", thickness=".191", conductivity="0.046", density="10", spec_heat="837", roughness="VeryRough")  # -> mat; plug-in component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

opaquemat_143 = HBOpaqueMaterial(name="GypsumBoard", thickness=".0125", conductivity="0.160", density="772", spec_heat="1090", roughness="MediumSmooth")  # -> mat; plug-in component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

opaquemat_144 = HBOpaqueMaterial(name="WallInsul_MW_Int", thickness=".120", conductivity="0.033", density="70", spec_heat="1030", roughness="Rough")  # -> mat; plug-in component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

opaquemat_145 = HBOpaqueMaterial(name="RoofInsul_MW_spray", thickness=".192", conductivity="0.046", density="10", spec_heat="837", roughness="VeryRough")  # -> mat; plug-in component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

opaquemat_146 = HBOpaqueMaterial(name="FloorInsul_MW", thickness=".120", conductivity="0.034", density="80", spec_heat="1030", roughness="Rough")  # -> mat; plug-in component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

opaquemat_147 = HBOpaqueMaterial(name="FloorInsul_MW", thickness=".120", conductivity="0.034", density="80", spec_heat="1030", roughness="Rough")  # -> mat; plug-in component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

opaquemat_148 = HBOpaqueMaterial(
    name="InternalPlaster",
    thickness="0.020",
    conductivity="0.700",
    density="1400",
    spec_heat="1000",
    roughness="MediumSmooth")  # -> mat; plug-in component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

opaquemat_149 = HBOpaqueMaterial(name="SolidBrick", thickness="0.210", conductivity="0.720", density="1800", spec_heat="1000", roughness="Rough")  # -> mat; plug-in component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

opaquemat_150 = HBOpaqueMaterial(
    name="InternalPlaster",
    thickness="0.020",
    conductivity="0.700",
    density="1400",
    spec_heat="1000",
    roughness="MediumSmooth")  # -> mat; plug-in component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

opaquemat_151 = HBOpaqueMaterial(name="BrickSlabs", thickness=".060", conductivity="0.240", density="900", spec_heat="1000", roughness="Rough")  # -> mat; plug-in component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

opaquemat_152 = HBOpaqueMaterial(
    name="InternalPlaster",
    thickness="0.020",
    conductivity="0.700",
    density="1400",
    spec_heat="1000",
    roughness="MediumSmooth")  # -> mat; plug-in component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

opaquemat_153 = HBOpaqueMaterial(name="CeramicTile", thickness="0.015", conductivity="1.470", density="1700", spec_heat="1000", roughness="MediumSmooth")  # -> mat; plug-in component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

opaquemat_154 = HBOpaqueMaterial(name="CementMortar", thickness="0.020", conductivity="1.400", density="2000", spec_heat="1000", roughness="Rough")  # -> mat; plug-in component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

opaquemat_155 = HBOpaqueMaterial(
    name="InternalPlaster",
    thickness="0.020",
    conductivity="0.700",
    density="1400",
    spec_heat="1000",
    roughness="MediumSmooth")  # -> mat; plug-in component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

opaquemat_156 = HBOpaqueMaterial(name="BrickSlabs", thickness=".060", conductivity="0.240", density="900", spec_heat="1000", roughness="Rough")  # -> mat; plug-in component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

opaquemat_157 = HBOpaqueMaterial(name="ExternalPlaster", thickness=".015", conductivity="0.900", density="1800", spec_heat="1000", roughness="Rough")  # -> mat; plug-in component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

opaquematnomass_17 = HBOpaqueMaterialNoMass(name="FictitiousLayer_R0.3", r_value="0.3")  # -> mat; plug-in component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

opaquematnomass_18 = HBOpaqueMaterialNoMass(name="FictitiousLayer_R0.3", r_value="0.3")  # -> mat; plug-in component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

opaquemat_158 = HBOpaqueMaterial(name="CeramicTile", thickness="0.015", conductivity="1.470", density="1700", spec_heat="1000", roughness="MediumSmooth")  # -> mat; plug-in component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

opaquemat_159 = HBOpaqueMaterial(name="BrickSlabs", thickness=".060", conductivity="0.240", density="900", spec_heat="1000", roughness="Rough")  # -> mat; plug-in component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

opaquemat_160 = HBOpaqueMaterial(name="CementMortar", thickness="0.020", conductivity="1.400", density="2000", spec_heat="1000", roughness="Rough")  # -> mat; plug-in component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

opaquemat_161 = HBOpaqueMaterial(name="ExternalPlaster", thickness=".015", conductivity="0.900", density="1800", spec_heat="1000", roughness="Rough")  # -> mat; plug-in component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

opaquemat_162 = HBOpaqueMaterial(name="CementMortar", thickness="0.020", conductivity="1.400", density="2000", spec_heat="1000", roughness="Rough")  # -> mat; plug-in component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

opaquemat_163 = HBOpaqueMaterial(name="BrickSlabs", thickness=".060", conductivity="0.240", density="900", spec_heat="1000", roughness="Rough")  # -> mat; plug-in component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

opaquemat_164 = HBOpaqueMaterial(name="CeramicTile", thickness="0.015", conductivity="1.470", density="1700", spec_heat="1000", roughness="MediumSmooth")  # -> mat; plug-in component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

opaquemat_165 = HBOpaqueMaterial(name="CeramicTile", thickness="0.015", conductivity="1.470", density="1700", spec_heat="1000", roughness="MediumSmooth")  # -> mat; plug-in component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

opaquemat_166 = HBOpaqueMaterial(name="CementMortar", thickness="0.020", conductivity="1.400", density="2000", spec_heat="1000", roughness="Rough")  # -> mat; plug-in component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

opaquemat_167 = HBOpaqueMaterial(name="SolidBrick", thickness=".515", conductivity="0.720", density="1800", spec_heat="1000", roughness="Rough")  # -> mat; plug-in component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

opaquemat_168 = HBOpaqueMaterial(name="InternalPlaster", thickness=".020", conductivity="0.700", density="1400", spec_heat="1000", roughness="Rough")  # -> mat; plug-in component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

opaquemat_169 = HBOpaqueMaterial(
    name="InternalPlaster",
    thickness="0.020",
    conductivity="0.700",
    density="1400",
    spec_heat="1000",
    roughness="MediumSmooth")  # -> mat; plug-in component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

opaquemat_170 = HBOpaqueMaterial(name="ClayBrickBlocks", thickness="0.250", conductivity="0.400", density="1000", spec_heat="1000", roughness="Rough")  # -> mat; plug-in component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

opaquemat_171 = HBOpaqueMaterial(
    name="InternalPlaster",
    thickness="0.020",
    conductivity="0.700",
    density="1400",
    spec_heat="1000",
    roughness="MediumSmooth")  # -> mat; plug-in component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

opaquemat_172 = HBOpaqueMaterial(name="CeramicTile", thickness="0.015", conductivity="1.470", density="1700", spec_heat="1000", roughness="MediumSmooth")  # -> mat; plug-in component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

opaquemat_173 = HBOpaqueMaterial(name="CementMortar", thickness="0.020", conductivity="1.400", density="2000", spec_heat="1000", roughness="Rough")  # -> mat; plug-in component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

opaquemat_174 = HBOpaqueMaterial(
    name="ReinforcedConcrete_Poured",
    thickness="0.190",
    conductivity="1.910",
    density="2400",
    spec_heat="1000",
    roughness="Rough")  # -> mat; plug-in component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

opaquematnomass_19 = HBOpaqueMaterialNoMass(name="FictitiousLayer_R0.3", r_value="0.3")  # -> mat; plug-in component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

opaquemat_175 = HBOpaqueMaterial(name="CeramicTile", thickness="0.015", conductivity="1.470", density="1700", spec_heat="1000", roughness="MediumSmooth")  # -> mat; plug-in component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

opaquemat_176 = HBOpaqueMaterial(
    name="BrickSlabs_ModConductivity",
    thickness=".060",
    conductivity="0.600",
    density="900",
    spec_heat="1000",
    roughness="Rough")  # -> mat; plug-in component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

opaquemat_177 = HBOpaqueMaterial(name="CementMortar", thickness="0.020", conductivity="1.400", density="2000", spec_heat="1000", roughness="Rough")  # -> mat; plug-in component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

opaquemat_178 = HBOpaqueMaterial(name="CementMortar", thickness="0.020", conductivity="1.400", density="2000", spec_heat="1000", roughness="Rough")  # -> mat; plug-in component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

opaquemat_179 = HBOpaqueMaterial(
    name="InternalPlaster",
    thickness="0.020",
    conductivity="0.700",
    density="1400",
    spec_heat="1000",
    roughness="MediumSmooth")  # -> mat; plug-in component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

opaquemat_180 = HBOpaqueMaterial(name="LtwtConcScreed_6cm", thickness=".060", conductivity=".580", density="900", spec_heat="1000", roughness="Rough")  # -> mat; plug-in component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

opaquemat_181 = HBOpaqueMaterial(name="CeramicTile", thickness="0.015", conductivity="1.470", density="1700", spec_heat="1000", roughness="MediumSmooth")  # -> mat; plug-in component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

opaquemat_182 = HBOpaqueMaterial(name="LtwtConcScreed_6cm", thickness=".060", conductivity=".580", density="900", spec_heat="1000", roughness="Rough")  # -> mat; plug-in component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

opaquemat_183 = HBOpaqueMaterial(name="CementMortar", thickness="0.020", conductivity="1.400", density="2000", spec_heat="1000", roughness="Rough")  # -> mat; plug-in component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

opaquemat_184 = HBOpaqueMaterial(name="BrickSlabs", thickness=".060", conductivity="0.240", density="900", spec_heat="1000", roughness="Rough")  # -> mat; plug-in component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

opaquemat_185 = HBOpaqueMaterial(name="ExternalPlaster", thickness=".015", conductivity="0.900", density="1800", spec_heat="1000", roughness="Rough")  # -> mat; plug-in component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

opaquematnomass_20 = HBOpaqueMaterialNoMass(name="FictitiousLayer_R0.3", r_value="0.3")  # -> mat; plug-in component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

opaquematnomass_21 = HBOpaqueMaterialNoMass(name="FictitiousLayer_R0.3", r_value="0.3")  # -> mat; plug-in component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

opaquemat_186 = HBOpaqueMaterial(
    name="InternalPlaster",
    thickness="0.020",
    conductivity="0.700",
    density="1400",
    spec_heat="1000",
    roughness="MediumSmooth")  # -> mat; plug-in component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

opaquemat_187 = HBOpaqueMaterial(name="CeramicTile", thickness="0.015", conductivity="1.470", density="1700", spec_heat="1000", roughness="MediumSmooth")  # -> mat; plug-in component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

opaquemat_188 = HBOpaqueMaterial(
    name="ReinforcedConcrete_Poured",
    thickness="0.190",
    conductivity="1.910",
    density="2400",
    spec_heat="1000",
    roughness="Rough")  # -> mat; plug-in component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

opaquemat_189 = HBOpaqueMaterial(name="LtwtConcScreed_6cm", thickness=".060", conductivity=".580", density="900", spec_heat="1000", roughness="Rough")  # -> mat; plug-in component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

opaquemat_190 = HBOpaqueMaterial(name="CementMortar", thickness="0.020", conductivity="1.400", density="2000", spec_heat="1000", roughness="Rough")  # -> mat; plug-in component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

opaquemat_191 = HBOpaqueMaterial(name="InternalPlaster", thickness=".020", conductivity="0.700", density="1400", spec_heat="1000", roughness="Rough")  # -> mat; plug-in component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

opaquemat_192 = HBOpaqueMaterial(
    name="ReinforcedConcrete_Poured",
    thickness="0.190",
    conductivity="1.910",
    density="2400",
    spec_heat="1000",
    roughness="Rough")  # -> mat; plug-in component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

opaquemat_193 = HBOpaqueMaterial(name="SolidBrick", thickness="0.475", conductivity="0.720", density="1800", spec_heat="1000", roughness="Rough")  # -> mat; plug-in component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

# ----
# R3AB
opaquemat_194 = HBOpaqueMaterial(name="ExternalPlaster", thickness=".020", conductivity="0.900", density="1800", spec_heat="1000", roughness="Rough")  # -> mat; plug-in component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

opaquemat_195 = HBOpaqueMaterial(name="ExternalPlaster", thickness=".020", conductivity="0.900", density="1800", spec_heat="1000", roughness="Rough")  # -> mat; plug-in component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

opaquemat_196 = HBOpaqueMaterial(
    name="InternalPlaster",
    thickness="0.020",
    conductivity="0.700",
    density="1400",
    spec_heat="1000",
    roughness="MediumSmooth")  # -> mat; plug-in component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

opaquematnomass_22 = HBOpaqueMaterialNoMass(name="FictitiousLayer_R0.3", r_value="0.3")  # -> mat; plug-in component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

# ----
# R3MF
opaquemat_197 = HBOpaqueMaterial(name="ExternalPlaster", thickness=".020", conductivity="0.900", density="1800", spec_heat="1000", roughness="Rough")  # -> mat; plug-in component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

opaquemat_198 = HBOpaqueMaterial(
    name="ReinforcedConcrete_Poured",
    thickness="0.175",
    conductivity="1.910",
    density="2400",
    spec_heat="1000",
    roughness="Rough")  # -> mat; plug-in component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

opaquemat_199 = HBOpaqueMaterial(name="SolidBrick", thickness="0.330", conductivity="0.720", density="1800", spec_heat="1000", roughness="Rough")  # -> mat; plug-in component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

opaquemat_200 = HBOpaqueMaterial(
    name="InternalPlaster",
    thickness="0.020",
    conductivity="0.700",
    density="1400",
    spec_heat="1000",
    roughness="MediumSmooth")  # -> mat; plug-in component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

opaquemat_201 = HBOpaqueMaterial(name="CeramicTile", thickness="0.015", conductivity="1.470", density="1700", spec_heat="1000", roughness="MediumSmooth")  # -> mat; plug-in component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

opaquemat_202 = HBOpaqueMaterial(name="LtwtConcScreed_6cm", thickness=".060", conductivity=".580", density="900", spec_heat="1000", roughness="Rough")  # -> mat; plug-in component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

opaquemat_203 = HBOpaqueMaterial(name="CementMortar", thickness="0.020", conductivity="1.400", density="2000", spec_heat="1000", roughness="Rough")  # -> mat; plug-in component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

opaquemat_204 = HBOpaqueMaterial(name="CeramicTile", thickness="0.015", conductivity="1.470", density="1700", spec_heat="1000", roughness="MediumSmooth")  # -> mat; plug-in component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

opaquemat_205 = HBOpaqueMaterial(name="LtwtConcScreed_6cm", thickness=".060", conductivity=".580", density="900", spec_heat="1000", roughness="Rough")  # -> mat; plug-in component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

opaquemat_206 = HBOpaqueMaterial(
    name="ReinforcedConcrete_Poured",
    thickness="0.190",
    conductivity="1.910",
    density="2400",
    spec_heat="1000",
    roughness="Rough")  # -> mat; plug-in component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

opaquemat_207 = HBOpaqueMaterial(name="ExternalPlaster", thickness=".020", conductivity="0.900", density="1800", spec_heat="1000", roughness="Rough")  # -> mat; plug-in component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

opaquemat_208 = HBOpaqueMaterial(name="CementMortar", thickness="0.020", conductivity="1.400", density="2000", spec_heat="1000", roughness="Rough")  # -> mat; plug-in component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

opaquemat_209 = HBOpaqueMaterial(
    name="ReinforcedConcrete_Poured",
    thickness="0.190",
    conductivity="1.910",
    density="2400",
    spec_heat="1000",
    roughness="Rough")  # -> mat; plug-in component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

opaquemat_210 = HBOpaqueMaterial(name="ExternalPlaster", thickness=".020", conductivity="0.900", density="1800", spec_heat="1000", roughness="Rough")  # -> mat; plug-in component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

opaquematnomass_23 = HBOpaqueMaterialNoMass(name="FictitiousLayer_R0.3", r_value="0.3")  # -> mat; plug-in component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

opaquematnomass_24 = HBOpaqueMaterialNoMass(name="FictitiousLayer_R0.3", r_value="0.3")  # -> mat; plug-in component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

opaquemat_211 = HBOpaqueMaterial(name="SolidBrick", thickness=".370", conductivity="0.720", density="1800", spec_heat="1000", roughness="Rough")  # -> mat; plug-in component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

# ----
# Hard code window
# U 1.40, g 0.35, VT 0.55
panel_42 = Panel("0.55")
windowmat_5 = HBWindowMaterial(name="U 1.40 Dbl LoE", u_factor="1.40", shgc="0.35", t_vis=panel_42)  # -> mat; plug-in component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
windowconstr_5 = HBWindowConstruction(name="U 1.40 Dbl LoE", materials=windowmat_5)  # -> constr; plug-in component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
decnstrconstr_5 = HBDeconstructConstruction(constr=windowconstr_5)  # -> materials, layers, r_val_si, r_val_ip, u_fac_si, u_fac_ip, shgc, t_sol, t_vis; plug-in component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
panel_43 = Panel([decnstrconstr_5.r_val_si, decnstrconstr_5.u_fac_si, decnstrconstr_5.shgc, decnstrconstr_5.t_sol, decnstrconstr_5.t_vis])
subfacesubset_5 = HBSubfaceSubset(window=windowconstr_5, skylight=windowconstr_5, operable=windowconstr_5, glass_door=windowconstr_5)  # -> subface_set; plug-in component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

# ----
# Hard code window
# U 1.40, g 0.35, VT 0.55
panel_44 = Panel("0.55")
windowmat_6 = HBWindowMaterial(name="U 1.40 Dbl LoE", u_factor="1.40", shgc="0.35", t_vis=panel_44)  # -> mat; plug-in component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
windowconstr_6 = HBWindowConstruction(name="U 1.40 Dbl LoE", materials=windowmat_6)  # -> constr; plug-in component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
decnstrconstr_6 = HBDeconstructConstruction(constr=windowconstr_6)  # -> materials, layers, r_val_si, r_val_ip, u_fac_si, u_fac_ip, shgc, t_sol, t_vis; plug-in component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
panel_45 = Panel([decnstrconstr_6.r_val_si, decnstrconstr_6.u_fac_si, decnstrconstr_6.shgc, decnstrconstr_6.t_sol, decnstrconstr_6.t_vis])
subfacesubset_6 = HBSubfaceSubset(window=windowconstr_6, skylight=windowconstr_6, operable=windowconstr_6, glass_door=windowconstr_6)  # -> subface_set; plug-in component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

merge_33 = Merge(Data1=opaquemat_153, Data2=opaquemat_154, Data3=opaquemat_151, Data4=opaquemat_155)
opaqueconstr_37 = HBOpaqueConstruction(name="Floor_02.02_IntClg", materials=merge_33)  # -> constr; plug-in component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

merge_34 = Merge(Data1=opaquemat_148, Data2=opaquemat_149, Data3=opaquemat_150)
opaqueconstr_38 = HBOpaqueConstruction(name="Wall_01.05_Interior", materials=merge_34)  # -> constr; plug-in component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

merge_35 = Merge(
    Data1=opaquematnomass_17,
    Data2=opaquemat_138,
    Data3=opaquemat_161,
    Data4=opaquemat_163,
    Data5=opaquemat_166,
    Data6=opaquemat_164)
opaqueconstr_39 = HBOpaqueConstruction(name="Floor_02.02_GRfloor", materials=merge_35)  # -> constr; plug-in component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

merge_36 = Merge(Data1=opaquemat_152, Data2=opaquemat_156, Data3=opaquemat_160, Data4=opaquemat_158)
opaqueconstr_40 = HBOpaqueConstruction(name="Floor_02.02_IntFlr", materials=merge_36)  # -> constr; plug-in component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

merge_37 = Merge(
    Data1=opaquemat_165,
    Data2=opaquemat_162,
    Data3=opaquemat_159,
    Data4=opaquemat_157,
    Data5=opaquemat_138,
    Data6=opaquematnomass_18)
opaqueconstr_41 = HBOpaqueConstruction(name="Floor_02.02_GRroof", materials=merge_37)  # -> constr; plug-in component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

# ----
# Ground Subset -
# same as interior floors,
# ground & roof must be inverse.
# 
# Base ground & roof construction
# on exterior floor for same archetype
# Make this same thickness as W1
panel_46 = Panel("Wall_01.07_UGwall")
opaqueconstr_42 = HBOpaqueConstruction(name=panel_46, materials=opaquemat_167)  # -> constr; plug-in component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
groundsubset_5 = HBGroundConstructionSubset(ground_wall=opaqueconstr_42, ground_roof=opaqueconstr_41, ground_floor=opaqueconstr_39)  # -> ground_set; plug-in component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
decnstrmat_9 = HBDeconstructMaterial(mat=groundsubset_5)  # -> values, attr_names, r_val_si, r_val_ip; plug-in component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
panel_47 = Panel(groundsubset_5)
panel_48 = Panel(decnstrmat_9.r_val_si)

merge_38 = Merge(Data1=opaquemat_172, Data2=opaquemat_173, Data3=opaquemat_180, Data4=opaquemat_174, Data5=opaquemat_168)
opaqueconstr_43 = HBOpaqueConstruction(name="Floor_02.03_IntClg", materials=merge_38)  # -> constr; plug-in component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

merge_39 = Merge(Data1=opaquemat_169, Data2=opaquemat_170, Data3=opaquemat_171)
opaqueconstr_44 = HBOpaqueConstruction(name="Wall_03.01_Interior", materials=merge_39)  # -> constr; plug-in component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

merge_40 = Merge(Data1=opaquemat_191, Data2=opaquemat_188, Data3=opaquemat_182, Data4=opaquemat_183, Data5=opaquemat_181)
opaqueconstr_45 = HBOpaqueConstruction(name="Floor_02.03_IntFlr", materials=merge_40)  # -> constr; plug-in component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

merge_41 = Merge(
    Data1=opaquematnomass_23,
    Data2=opaquemat_147,
    Data3=opaquemat_210,
    Data4=opaquemat_206,
    Data5=opaquemat_202,
    Data6=opaquemat_203,
    Data7=opaquemat_201)
opaqueconstr_46 = HBOpaqueConstruction(name="Floor_02.03_GRfloor", materials=merge_41)  # -> constr; plug-in component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

merge_42 = Merge(Data1=opaquematnomass_19, Data2=opaquemat_142, Data3=opaquemat_177, Data4=opaquemat_176, Data5=opaquemat_179)
opaqueconstr_47 = HBOpaqueConstruction(name="Ceiling_02.02", materials=merge_42)  # -> constr; plug-in component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

merge_43 = Merge(
    Data1=opaquemat_204,
    Data2=opaquemat_208,
    Data3=opaquemat_205,
    Data4=opaquemat_209,
    Data5=opaquemat_207,
    Data6=opaquemat_147,
    Data7=opaquematnomass_24)
opaqueconstr_48 = HBOpaqueConstruction(name="Floor_02.02_GRroof", materials=merge_43)  # -> constr; plug-in component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

merge_44 = Merge(
    Data1=opaquematnomass_21,
    Data2=opaquemat_141,
    Data3=opaquemat_185,
    Data4=opaquemat_184,
    Data5=opaquemat_178,
    Data6=opaquemat_175)
opaqueconstr_49 = HBOpaqueConstruction(name="Floor_02.02", materials=merge_44)  # -> constr; plug-in component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

merge_45 = Merge(Data1=opaquematnomass_20, Data2=opaquemat_145, Data3=opaquemat_198, Data4=opaquemat_196)
opaqueconstr_50 = HBOpaqueConstruction(name="Ceiling_02.03", materials=merge_45)  # -> constr; plug-in component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

# ----
# Ground Subset -
# same as interior floors,
# ground & roof must be inverse.
# 
# Base ground & roof construction
# on exterior floor for same archetype
# Make this same thickness as W1
panel_49 = Panel("Wall_01.06_UGwall")
opaqueconstr_51 = HBOpaqueConstruction(name=panel_49, materials=opaquemat_211)  # -> constr; plug-in component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
groundsubset_6 = HBGroundConstructionSubset(ground_wall=opaqueconstr_51, ground_roof=opaqueconstr_48, ground_floor=opaqueconstr_46)  # -> ground_set; plug-in component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
decnstrmat_10 = HBDeconstructMaterial(mat=groundsubset_6)  # -> values, attr_names, r_val_si, r_val_ip; plug-in component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
panel_50 = Panel(groundsubset_6)
panel_51 = Panel(decnstrmat_10.r_val_si)

merge_46 = Merge(
    Data1=opaquematnomass_22,
    Data2=opaquemat_146,
    Data3=opaquemat_195,
    Data4=opaquemat_192,
    Data5=opaquemat_189,
    Data6=opaquemat_190,
    Data7=opaquemat_187)
opaqueconstr_52 = HBOpaqueConstruction(name="Floor_02.03", materials=merge_46)  # -> constr; plug-in component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

merge_47 = Merge(Data1=opaquemat_194, Data2=opaquemat_193, Data3=opaquemat_186, Data4=opaquemat_140, Data5=opaquemat_139)
opaqueconstr_53 = HBOpaqueConstruction(name="Wall_01.07", materials=merge_47)  # -> constr; plug-in component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

merge_48 = Merge(Data1=opaquemat_197, Data2=opaquemat_199, Data3=opaquemat_200, Data4=opaquemat_144, Data5=opaquemat_143)
opaqueconstr_54 = HBOpaqueConstruction(name="Wall_01.06", materials=merge_48)  # -> constr; plug-in component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

# ----
# Interior Subset -
# Note interior floors & ceilings must
# be inverse of each other
interiorsubset_5 = HBInteriorConstructionSubset(interior_wall=opaqueconstr_38, ceiling=opaqueconstr_37, interior_floor=opaqueconstr_40)  # -> interior_set; plug-in component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
panel_52 = Panel(interiorsubset_5)

r8mf_cset = Data("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")

# ----
# Interior Subset -
# Note interior floors & ceilings must
# be inverse of each other
interiorsubset_6 = HBInteriorConstructionSubset(interior_wall=opaqueconstr_44, ceiling=opaqueconstr_43, interior_floor=opaqueconstr_45)  # -> interior_set; plug-in component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
panel_53 = Panel(interiorsubset_6)

# ----
# Exterior Subset
exteriorsubset_5 = HBExteriorConstructionSubset(exterior_wall=opaqueconstr_53, exterior_roof=opaqueconstr_47, exposed_floor=opaqueconstr_49)  # -> exterior_set; plug-in component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
panel_54 = Panel(exteriorsubset_5)
decnstrmat_11 = HBDeconstructMaterial(mat=exteriorsubset_5)  # -> values, attr_names, r_val_si, r_val_ip; plug-in component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
panel_55 = Panel(decnstrmat_11.r_val_si)

# ----
# Exterior Subset
exteriorsubset_6 = HBExteriorConstructionSubset(exterior_wall=opaqueconstr_54, exterior_roof=opaqueconstr_50, exposed_floor=opaqueconstr_52)  # -> exterior_set; plug-in component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
panel_56 = Panel(exteriorsubset_6)
decnstrmat_12 = HBDeconstructMaterial(mat=exteriorsubset_6)  # -> values, attr_names, r_val_si, r_val_ip; plug-in component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
panel_57 = Panel(decnstrmat_12.r_val_si)

# ----
# EXPORT TO JSON
panel_58 = Panel("pre_1980::ClimateZone4::Mass")
constructionset_5 = HBConstructionSet(
    name="R3AB_g0.35WinHC",
    base_constr_set=panel_58,
    exterior_subset=exteriorsubset_5,
    ground_subset=groundsubset_5,
    interior_subset=interiorsubset_5,
    subface_subset=subfacesubset_5)  # -> constr_set; plug-in component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
objtostr_5 = HBObjectToString(hb_obj=constructionset_5)  # -> hb_str; plug-in component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

panel_59 = Panel(objtostr_5)

# ----
# EXPORT TO JSON
panel_60 = Panel("pre_1980::ClimateZone4::Mass")
constructionset_6 = HBConstructionSet(
    name="R3MF_g0.35WinHC",
    base_constr_set=panel_60,
    exterior_subset=exteriorsubset_6,
    ground_subset=groundsubset_6,
    interior_subset=interiorsubset_6,
    subface_subset=subfacesubset_6)  # -> constr_set; plug-in component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
objtostr_6 = HBObjectToString(hb_obj=constructionset_6)  # -> hb_str; plug-in component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

panel_61 = Panel(objtostr_6)

opaquemat_212 = HBOpaqueMaterial(name="FloorInsul_MW", thickness=".120", conductivity="0.034", density="80", spec_heat="1030", roughness="Rough")  # -> mat; plug-in component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

opaquemat_213 = HBOpaqueMaterial(name="ExternalPlaster", thickness=".020", conductivity="0.900", density="1800", spec_heat="1000", roughness="Rough")  # -> mat; plug-in component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

opaquemat_214 = HBOpaqueMaterial(name="WallInsul_MW_Ext", thickness=".120", conductivity="0.034", density="80", spec_heat="1030", roughness="Rough")  # -> mat; plug-in component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

opaquemat_215 = HBOpaqueMaterial(name="RoofInsul_MW_spray", thickness=".182", conductivity="0.046", density="10", spec_heat="837", roughness="VeryRough")  # -> mat; plug-in component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

opaquemat_216 = HBOpaqueMaterial(name="FloorInsul_MW", thickness=".120", conductivity="0.034", density="80", spec_heat="1030", roughness="Rough")  # -> mat; plug-in component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

opaquemat_217 = HBOpaqueMaterial(name="FloorInsul_MW", thickness=".120", conductivity="0.034", density="80", spec_heat="1030", roughness="Rough")  # -> mat; plug-in component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

opaquemat_218 = HBOpaqueMaterial(name="FloorInsul_MW", thickness=".120", conductivity="0.034", density="80", spec_heat="1030", roughness="Rough")  # -> mat; plug-in component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

opaquemat_219 = HBOpaqueMaterial(name="ExternalPlaster", thickness=".020", conductivity="0.900", density="1800", spec_heat="1000", roughness="Rough")  # -> mat; plug-in component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

opaquemat_220 = HBOpaqueMaterial(name="WallInsul_MW_Ext", thickness=".120", conductivity="0.034", density="80", spec_heat="1030", roughness="Rough")  # -> mat; plug-in component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

opaquemat_221 = HBOpaqueMaterial(name="RoofInsul_MW_spray", thickness=".182", conductivity="0.046", density="10", spec_heat="837", roughness="VeryRough")  # -> mat; plug-in component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

# ----
# R4MF
opaquemat_222 = HBOpaqueMaterial(name="ExternalPlaster", thickness=".020", conductivity="0.900", density="1800", spec_heat="1000", roughness="Rough")  # -> mat; plug-in component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

opaquemat_223 = HBOpaqueMaterial(
    name="InternalPlaster",
    thickness="0.020",
    conductivity="0.700",
    density="1400",
    spec_heat="1000",
    roughness="MediumSmooth")  # -> mat; plug-in component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

opaquemat_224 = HBOpaqueMaterial(name="SolidBrick", thickness="0.330", conductivity="0.720", density="1800", spec_heat="1000", roughness="Rough")  # -> mat; plug-in component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

opaquematnomass_25 = HBOpaqueMaterialNoMass(name="FictitiousLayer_R0.3", r_value="0.3")  # -> mat; plug-in component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

opaquemat_225 = HBOpaqueMaterial(name="LtwtConcScreed_2cm", thickness=".020", conductivity=".580", density="400", spec_heat="1000", roughness="Rough")  # -> mat; plug-in component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

opaquemat_226 = HBOpaqueMaterial(name="SolidBrick", thickness=".370", conductivity="0.720", density="1800", spec_heat="1000", roughness="Rough")  # -> mat; plug-in component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

opaquemat_227 = HBOpaqueMaterial(
    name="Slab_BrickBlkConc_24cm",
    thickness=".240",
    conductivity="0.715",
    density="900",
    spec_heat="1000",
    roughness="Rough")  # -> mat; plug-in component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

opaquemat_228 = HBOpaqueMaterial(name="CementMortar", thickness="0.020", conductivity="1.400", density="2000", spec_heat="1000", roughness="Rough")  # -> mat; plug-in component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

opaquematnomass_26 = HBOpaqueMaterialNoMass(name="FictitiousLayer_R0.3", r_value="0.3")  # -> mat; plug-in component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

opaquemat_229 = HBOpaqueMaterial(name="ExternalPlaster", thickness=".020", conductivity="0.900", density="1800", spec_heat="1000", roughness="Rough")  # -> mat; plug-in component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

opaquemat_230 = HBOpaqueMaterial(name="LtwtConcScreed_6.5cm", thickness=".065", conductivity=".580", density="900", spec_heat="1000", roughness="Rough")  # -> mat; plug-in component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

opaquemat_231 = HBOpaqueMaterial(name="CeramicTile", thickness="0.015", conductivity="1.470", density="1700", spec_heat="1000", roughness="MediumSmooth")  # -> mat; plug-in component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

opaquemat_232 = HBOpaqueMaterial(
    name="Slab_BrickBlkConc_16cm",
    thickness=".160",
    conductivity="0.560",
    density="900",
    spec_heat="1000",
    roughness="Rough")  # -> mat; plug-in component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

opaquemat_233 = HBOpaqueMaterial(name="CementMortar", thickness="0.020", conductivity="1.400", density="2000", spec_heat="1000", roughness="Rough")  # -> mat; plug-in component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

opaquemat_234 = HBOpaqueMaterial(
    name="InternalPlaster_Thin",
    thickness="0.010",
    conductivity="0.700",
    density="1400",
    spec_heat="1000",
    roughness="MediumSmooth")  # -> mat; plug-in component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

opaquemat_235 = HBOpaqueMaterial(name="CementMortar", thickness="0.020", conductivity="1.400", density="2000", spec_heat="1000", roughness="Rough")  # -> mat; plug-in component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

opaquematnomass_27 = HBOpaqueMaterialNoMass(name="FictitiousLayer_R0.3", r_value="0.3")  # -> mat; plug-in component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

opaquematnomass_28 = HBOpaqueMaterialNoMass(name="FictitiousLayer_R0.3", r_value="0.3")  # -> mat; plug-in component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

opaquemat_236 = HBOpaqueMaterial(
    name="Slab_BrickBlkConc_24cm",
    thickness=".240",
    conductivity="0.715",
    density="900",
    spec_heat="1000",
    roughness="Rough")  # -> mat; plug-in component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

opaquemat_237 = HBOpaqueMaterial(name="CeramicTile", thickness="0.015", conductivity="1.470", density="1700", spec_heat="1000", roughness="MediumSmooth")  # -> mat; plug-in component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

opaquemat_238 = HBOpaqueMaterial(name="CementMortar", thickness="0.020", conductivity="1.400", density="2000", spec_heat="1000", roughness="Rough")  # -> mat; plug-in component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

opaquemat_239 = HBOpaqueMaterial(name="CementMortar", thickness="0.020", conductivity="1.400", density="2000", spec_heat="1000", roughness="Rough")  # -> mat; plug-in component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

opaquemat_240 = HBOpaqueMaterial(name="LtwtConcScreed_6.5cm", thickness=".065", conductivity=".580", density="900", spec_heat="1000", roughness="Rough")  # -> mat; plug-in component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

opaquemat_241 = HBOpaqueMaterial(name="ExternalPlaster", thickness=".020", conductivity="0.900", density="1800", spec_heat="1000", roughness="Rough")  # -> mat; plug-in component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

opaquemat_242 = HBOpaqueMaterial(name="LtwtConcScreed_6.5cm", thickness=".065", conductivity=".580", density="900", spec_heat="1000", roughness="Rough")  # -> mat; plug-in component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

opaquemat_243 = HBOpaqueMaterial(name="ExternalPlaster", thickness=".020", conductivity="0.900", density="1800", spec_heat="1000", roughness="Rough")  # -> mat; plug-in component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

opaquemat_244 = HBOpaqueMaterial(name="SolidBrick", thickness="0.210", conductivity="0.720", density="1800", spec_heat="1000", roughness="Rough")  # -> mat; plug-in component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

opaquemat_245 = HBOpaqueMaterial(
    name="InternalPlaster",
    thickness="0.020",
    conductivity="0.700",
    density="1400",
    spec_heat="1000",
    roughness="MediumSmooth")  # -> mat; plug-in component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
opaquemat_246 = HBOpaqueMaterial(name="CementMortar", thickness="0.020", conductivity="1.400", density="2000", spec_heat="1000", roughness="Rough")  # -> mat; plug-in component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

opaquemat_247 = HBOpaqueMaterial(name="CementMortar", thickness="0.020", conductivity="1.400", density="2000", spec_heat="1000", roughness="Rough")  # -> mat; plug-in component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

opaquemat_248 = HBOpaqueMaterial(
    name="InternalPlaster",
    thickness="0.020",
    conductivity="0.700",
    density="1400",
    spec_heat="1000",
    roughness="MediumSmooth")  # -> mat; plug-in component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

opaquemat_249 = HBOpaqueMaterial(name="CeramicTile", thickness="0.015", conductivity="1.470", density="1700", spec_heat="1000", roughness="MediumSmooth")  # -> mat; plug-in component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

opaquemat_250 = HBOpaqueMaterial(
    name="Slab_BrickBlkConc_24cm",
    thickness=".240",
    conductivity="0.715",
    density="900",
    spec_heat="1000",
    roughness="Rough")  # -> mat; plug-in component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

opaquemat_251 = HBOpaqueMaterial(name="CementMortar", thickness="0.020", conductivity="1.400", density="2000", spec_heat="1000", roughness="Rough")  # -> mat; plug-in component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

opaquemat_252 = HBOpaqueMaterial(name="CeramicTile", thickness="0.015", conductivity="1.470", density="1700", spec_heat="1000", roughness="MediumSmooth")  # -> mat; plug-in component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

opaquemat_253 = HBOpaqueMaterial(
    name="InternalPlaster",
    thickness="0.020",
    conductivity="0.700",
    density="1400",
    spec_heat="1000",
    roughness="MediumSmooth")  # -> mat; plug-in component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

opaquemat_254 = HBOpaqueMaterial(name="LtwtConcScreed_6.5cm", thickness=".065", conductivity=".580", density="900", spec_heat="1000", roughness="Rough")  # -> mat; plug-in component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

opaquemat_255 = HBOpaqueMaterial(name="CementMortar", thickness="0.020", conductivity="1.400", density="2000", spec_heat="1000", roughness="Rough")  # -> mat; plug-in component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

opaquemat_256 = HBOpaqueMaterial(
    name="Slab_BrickBlkConc_24cm",
    thickness=".240",
    conductivity="0.715",
    density="900",
    spec_heat="1000",
    roughness="Rough")  # -> mat; plug-in component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

opaquemat_257 = HBOpaqueMaterial(
    name="InternalPlaster",
    thickness="0.020",
    conductivity="0.700",
    density="1400",
    spec_heat="1000",
    roughness="MediumSmooth")  # -> mat; plug-in component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

opaquemat_258 = HBOpaqueMaterial(
    name="Slab_BrickBlkConc_24cm",
    thickness=".240",
    conductivity="0.715",
    density="900",
    spec_heat="1000",
    roughness="Rough")  # -> mat; plug-in component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

opaquemat_259 = HBOpaqueMaterial(name="LtwtConcScreed_6.5cm", thickness=".065", conductivity=".580", density="900", spec_heat="1000", roughness="Rough")  # -> mat; plug-in component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

opaquemat_260 = HBOpaqueMaterial(name="CementMortar", thickness="0.020", conductivity="1.400", density="2000", spec_heat="1000", roughness="Rough")  # -> mat; plug-in component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

opaquemat_261 = HBOpaqueMaterial(name="CeramicTile", thickness="0.015", conductivity="1.470", density="1700", spec_heat="1000", roughness="MediumSmooth")  # -> mat; plug-in component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

opaquemat_262 = HBOpaqueMaterial(name="CementMortar", thickness="0.020", conductivity="1.400", density="2000", spec_heat="1000", roughness="Rough")  # -> mat; plug-in component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

opaquemat_263 = HBOpaqueMaterial(name="SolidBrick", thickness=".300", conductivity="0.720", density="1800", spec_heat="1000", roughness="Rough")  # -> mat; plug-in component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

opaquemat_264 = HBOpaqueMaterial(
    name="Slab_BrickBlkConc_24cm",
    thickness=".240",
    conductivity="0.715",
    density="900",
    spec_heat="1000",
    roughness="Rough")  # -> mat; plug-in component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

opaquematnomass_29 = HBOpaqueMaterialNoMass(name="FictitiousLayer_R0.3", r_value="0.3")  # -> mat; plug-in component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

opaquemat_265 = HBOpaqueMaterial(name="ExternalPlaster", thickness=".020", conductivity="0.900", density="1800", spec_heat="1000", roughness="Rough")  # -> mat; plug-in component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

opaquemat_266 = HBOpaqueMaterial(name="LtwtConcScreed_6.5cm", thickness=".065", conductivity=".580", density="900", spec_heat="1000", roughness="Rough")  # -> mat; plug-in component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

opaquemat_267 = HBOpaqueMaterial(name="CeramicTile", thickness="0.015", conductivity="1.470", density="1700", spec_heat="1000", roughness="MediumSmooth")  # -> mat; plug-in component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

opaquemat_268 = HBOpaqueMaterial(name="CementMortar", thickness="0.020", conductivity="1.400", density="2000", spec_heat="1000", roughness="Rough")  # -> mat; plug-in component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

opaquemat_269 = HBOpaqueMaterial(name="CementMortar", thickness="0.020", conductivity="1.400", density="2000", spec_heat="1000", roughness="Rough")  # -> mat; plug-in component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

opaquemat_270 = HBOpaqueMaterial(name="LtwtConcScreed_6.5cm", thickness=".065", conductivity=".580", density="900", spec_heat="1000", roughness="Rough")  # -> mat; plug-in component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

opaquematnomass_30 = HBOpaqueMaterialNoMass(name="FictitiousLayer_R0.3", r_value="0.3")  # -> mat; plug-in component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

opaquemat_271 = HBOpaqueMaterial(name="Concrete_Prefab", thickness="0.140", conductivity="0.500", density="2400", spec_heat="1000", roughness="Rough")  # -> mat; plug-in component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

opaquemat_272 = HBOpaqueMaterial(
    name="InternalPlaster",
    thickness="0.020",
    conductivity="0.700",
    density="1400",
    spec_heat="1000",
    roughness="MediumSmooth")  # -> mat; plug-in component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

opaquemat_273 = HBOpaqueMaterial(name="CementMortar", thickness="0.020", conductivity="1.400", density="2000", spec_heat="1000", roughness="Rough")  # -> mat; plug-in component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

opaquemat_274 = HBOpaqueMaterial(
    name="InternalPlaster",
    thickness="0.020",
    conductivity="0.700",
    density="1400",
    spec_heat="1000",
    roughness="MediumSmooth")  # -> mat; plug-in component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

opaquemat_275 = HBOpaqueMaterial(name="CeramicTile", thickness="0.015", conductivity="1.470", density="1700", spec_heat="1000", roughness="MediumSmooth")  # -> mat; plug-in component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

opaquemat_276 = HBOpaqueMaterial(
    name="Slab_BrickBlkConc_24cm",
    thickness=".240",
    conductivity="0.715",
    density="900",
    spec_heat="1000",
    roughness="Rough")  # -> mat; plug-in component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

opaquemat_277 = HBOpaqueMaterial(name="ExternalPlaster", thickness=".020", conductivity="0.900", density="1800", spec_heat="1000", roughness="Rough")  # -> mat; plug-in component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

# ----
# Hard code window
# U 1.40, g 0.35, VT 0.55
panel_62 = Panel("0.55")
windowmat_7 = HBWindowMaterial(name="U 1.40 Dbl LoE", u_factor="1.40", shgc="0.35", t_vis=panel_62)  # -> mat; plug-in component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
windowconstr_7 = HBWindowConstruction(name="U 1.40 Dbl LoE", materials=windowmat_7)  # -> constr; plug-in component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
decnstrconstr_7 = HBDeconstructConstruction(constr=windowconstr_7)  # -> materials, layers, r_val_si, r_val_ip, u_fac_si, u_fac_ip, shgc, t_sol, t_vis; plug-in component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
panel_63 = Panel([decnstrconstr_7.r_val_si, decnstrconstr_7.u_fac_si, decnstrconstr_7.shgc, decnstrconstr_7.t_sol, decnstrconstr_7.t_vis])
subfacesubset_7 = HBSubfaceSubset(window=windowconstr_7, skylight=windowconstr_7, operable=windowconstr_7, glass_door=windowconstr_7)  # -> subface_set; plug-in component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

opaquemat_278 = HBOpaqueMaterial(name="CementMortar", thickness="0.020", conductivity="1.400", density="2000", spec_heat="1000", roughness="Rough")  # -> mat; plug-in component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

opaquemat_279 = HBOpaqueMaterial(
    name="InternalPlaster",
    thickness="0.020",
    conductivity="0.700",
    density="1400",
    spec_heat="1000",
    roughness="MediumSmooth")  # -> mat; plug-in component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

opaquemat_280 = HBOpaqueMaterial(name="CementMortar", thickness="0.020", conductivity="1.400", density="2000", spec_heat="1000", roughness="Rough")  # -> mat; plug-in component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

# ----
# Ground Subset -
# same as interior floors,
# ground & roof must be inverse.
# 
# Base ground & roof construction
# on exterior floor for same archetype
opaquemat_281 = HBOpaqueMaterial(name="CeramicTile", thickness="0.015", conductivity="1.470", density="1700", spec_heat="1000", roughness="MediumSmooth")  # -> mat; plug-in component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

opaquemat_282 = HBOpaqueMaterial(
    name="InternalPlaster",
    thickness="0.020",
    conductivity="0.700",
    density="1400",
    spec_heat="1000",
    roughness="MediumSmooth")  # -> mat; plug-in component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

opaquemat_283 = HBOpaqueMaterial(name="LtwtConcScreed_6.5cm", thickness=".065", conductivity=".580", density="900", spec_heat="1000", roughness="Rough")  # -> mat; plug-in component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

opaquemat_284 = HBOpaqueMaterial(name="CementMortar", thickness="0.020", conductivity="1.400", density="2000", spec_heat="1000", roughness="Rough")  # -> mat; plug-in component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

opaquemat_285 = HBOpaqueMaterial(
    name="Slab_BrickBlkConc_24cm",
    thickness=".240",
    conductivity="0.715",
    density="900",
    spec_heat="1000",
    roughness="Rough")  # -> mat; plug-in component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

opaquemat_286 = HBOpaqueMaterial(
    name="Slab_BrickBlkConc_24cm",
    thickness=".240",
    conductivity="0.715",
    density="900",
    spec_heat="1000",
    roughness="Rough")  # -> mat; plug-in component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

opaquemat_287 = HBOpaqueMaterial(name="LtwtConcScreed_6.5cm", thickness=".065", conductivity=".580", density="900", spec_heat="1000", roughness="Rough")  # -> mat; plug-in component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

opaquemat_288 = HBOpaqueMaterial(name="CementMortar", thickness="0.020", conductivity="1.400", density="2000", spec_heat="1000", roughness="Rough")  # -> mat; plug-in component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

opaquemat_289 = HBOpaqueMaterial(name="CeramicTile", thickness="0.015", conductivity="1.470", density="1700", spec_heat="1000", roughness="MediumSmooth")  # -> mat; plug-in component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

opaquemat_290 = HBOpaqueMaterial(name="CementMortar", thickness="0.020", conductivity="1.400", density="2000", spec_heat="1000", roughness="Rough")  # -> mat; plug-in component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

opaquemat_291 = HBOpaqueMaterial(
    name="InternalPlaster_XThin",
    thickness="0.0045",
    conductivity="0.700",
    density="1400",
    spec_heat="1000",
    roughness="MediumSmooth")  # -> mat; plug-in component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

opaquematnomass_31 = HBOpaqueMaterialNoMass(name="FictitiousLayer_R0.3", r_value="0.3")  # -> mat; plug-in component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

opaquemat_292 = HBOpaqueMaterial(name="HollowBrick_8cm", thickness="0.080", conductivity="0.400", density="800", spec_heat="1000", roughness="Rough")  # -> mat; plug-in component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

opaquemat_293 = HBOpaqueMaterial(name="HollowBrick_12cm", thickness="0.120", conductivity="0.387", density="800", spec_heat="1000", roughness="Rough")  # -> mat; plug-in component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

opaquemat_294 = HBOpaqueMaterial(name="LtwtConcScreed_2cm", thickness=".020", conductivity=".580", density="400", spec_heat="1000", roughness="Rough")  # -> mat; plug-in component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

opaquematnomass_32 = HBOpaqueMaterialNoMass(name="CavityWallGap_R0.18", r_value="0.18")  # -> mat; plug-in component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

# ----
# R4AB
opaquemat_295 = HBOpaqueMaterial(
    name="ExternalPlaster_XThin",
    thickness=".0045",
    conductivity="0.900",
    density="1800",
    spec_heat="1000",
    roughness="Rough")  # -> mat; plug-in component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

opaquemat_296 = HBOpaqueMaterial(name="CementMortar", thickness="0.020", conductivity="1.400", density="2000", spec_heat="1000", roughness="Rough")  # -> mat; plug-in component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

opaquemat_297 = HBOpaqueMaterial(
    name="Slab_BrickBlkConc_16cm",
    thickness=".160",
    conductivity="0.560",
    density="900",
    spec_heat="1000",
    roughness="Rough")  # -> mat; plug-in component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

# ----
# Hard code window
# U 1.40, g 0.35, VT 0.55
panel_64 = Panel("0.55")
windowmat_8 = HBWindowMaterial(name="U 1.40 Dbl LoE", u_factor="1.40", shgc="0.35", t_vis=panel_64)  # -> mat; plug-in component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
windowconstr_8 = HBWindowConstruction(name="U 1.40 Dbl LoE", materials=windowmat_8)  # -> constr; plug-in component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
decnstrconstr_8 = HBDeconstructConstruction(constr=windowconstr_8)  # -> materials, layers, r_val_si, r_val_ip, u_fac_si, u_fac_ip, shgc, t_sol, t_vis; plug-in component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
panel_65 = Panel([decnstrconstr_8.r_val_si, decnstrconstr_8.u_fac_si, decnstrconstr_8.shgc, decnstrconstr_8.t_sol, decnstrconstr_8.t_vis])
subfacesubset_8 = HBSubfaceSubset(window=windowconstr_8, skylight=windowconstr_8, operable=windowconstr_8, glass_door=windowconstr_8)  # -> subface_set; plug-in component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

opaquemat_298 = HBOpaqueMaterial(
    name="InternalPlaster_Thin",
    thickness="0.010",
    conductivity="0.700",
    density="1400",
    spec_heat="1000",
    roughness="MediumSmooth")  # -> mat; plug-in component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

opaquematnomass_33 = HBOpaqueMaterialNoMass(name="FictitiousLayer_R0.3", r_value="0.3")  # -> mat; plug-in component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

opaquemat_299 = HBOpaqueMaterial(name="CeramicTile", thickness="0.015", conductivity="1.470", density="1700", spec_heat="1000", roughness="MediumSmooth")  # -> mat; plug-in component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

opaquemat_300 = HBOpaqueMaterial(
    name="Slab_BrickBlkConc_24cm",
    thickness=".240",
    conductivity="0.715",
    density="900",
    spec_heat="1000",
    roughness="Rough")  # -> mat; plug-in component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

opaquemat_301 = HBOpaqueMaterial(name="CementMortar", thickness="0.020", conductivity="1.400", density="2000", spec_heat="1000", roughness="Rough")  # -> mat; plug-in component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

opaquemat_302 = HBOpaqueMaterial(name="CementMortar", thickness="0.020", conductivity="1.400", density="2000", spec_heat="1000", roughness="Rough")  # -> mat; plug-in component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

opaquemat_303 = HBOpaqueMaterial(name="LtwtConcScreed_6.5cm", thickness=".065", conductivity=".580", density="900", spec_heat="1000", roughness="Rough")  # -> mat; plug-in component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

opaquemat_304 = HBOpaqueMaterial(name="ExternalPlaster", thickness=".020", conductivity="0.900", density="1800", spec_heat="1000", roughness="Rough")  # -> mat; plug-in component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

merge_49 = Merge(Data1=opaquemat_213, Data2=opaquemat_214, Data3=opaquemat_222, Data4=opaquemat_224, Data5=opaquemat_223)
opaqueconstr_55 = HBOpaqueConstruction(name="Wall_01.06", materials=merge_49)  # -> constr; plug-in component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

merge_50 = Merge(Data1=opaquemat_245, Data2=opaquemat_244, Data3=opaquemat_248)
opaqueconstr_56 = HBOpaqueConstruction(name="Wall_01.05_Interior", materials=merge_50)  # -> constr; plug-in component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

merge_51 = Merge(
    Data1=opaquematnomass_25,
    Data2=opaquemat_215,
    Data3=opaquemat_225,
    Data4=opaquemat_228,
    Data5=opaquemat_232,
    Data6=opaquemat_234)
opaqueconstr_57 = HBOpaqueConstruction(name="Ceiling_03.01", materials=merge_51)  # -> constr; plug-in component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

merge_52 = Merge(Data1=opaquemat_272, Data2=opaquemat_271, Data3=opaquemat_274)
opaqueconstr_58 = HBOpaqueConstruction(name="Wall_04.03_Interior", materials=merge_52)  # -> constr; plug-in component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

merge_53 = Merge(
    Data1=opaquemat_252,
    Data2=opaquemat_247,
    Data3=opaquemat_254,
    Data4=opaquemat_255,
    Data5=opaquemat_256,
    Data6=opaquemat_243,
    Data7=opaquemat_216,
    Data8=opaquematnomass_28)
opaqueconstr_59 = HBOpaqueConstruction(name="Floor_03.01_GRroof", materials=merge_53)  # -> constr; plug-in component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

merge_54 = Merge(
    Data1=opaquemat_249,
    Data2=opaquemat_251,
    Data3=opaquemat_242,
    Data4=opaquemat_246,
    Data5=opaquemat_250,
    Data6=opaquemat_253)
opaqueconstr_60 = HBOpaqueConstruction(name="Floor_03.01_IntClg", materials=merge_54)  # -> constr; plug-in component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

merge_55 = Merge(
    Data1=opaquematnomass_26,
    Data2=opaquemat_216,
    Data3=opaquemat_229,
    Data4=opaquemat_227,
    Data5=opaquemat_235,
    Data6=opaquemat_230,
    Data7=opaquemat_233,
    Data8=opaquemat_231)
opaqueconstr_61 = HBOpaqueConstruction(name="Floor_03.01_GRfloor", materials=merge_55)  # -> constr; plug-in component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

# ----
# Ground Subset -
# same as interior floors,
# ground & roof must be inverse.
# 
# Base ground & roof construction
# on exterior floor for same archetype
# Make this same thickness as W1
panel_66 = Panel("Wall_01.06_UGwall")
opaqueconstr_62 = HBOpaqueConstruction(name=panel_66, materials=opaquemat_226)  # -> constr; plug-in component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
groundsubset_7 = HBGroundConstructionSubset(ground_wall=opaqueconstr_62, ground_roof=opaqueconstr_59, ground_floor=opaqueconstr_61)  # -> ground_set; plug-in component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
decnstrmat_13 = HBDeconstructMaterial(mat=groundsubset_7)  # -> values, attr_names, r_val_si, r_val_ip; plug-in component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
panel_67 = Panel(groundsubset_7)
panel_68 = Panel(decnstrmat_13.r_val_si)

merge_56 = Merge(
    Data1=opaquemat_281,
    Data2=opaquemat_280,
    Data3=opaquemat_283,
    Data4=opaquemat_284,
    Data5=opaquemat_285,
    Data6=opaquemat_277,
    Data7=opaquemat_217,
    Data8=opaquematnomass_30)
opaqueconstr_63 = HBOpaqueConstruction(name="Floor_03.01_GRroof", materials=merge_56)  # -> constr; plug-in component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

merge_57 = Merge(
    Data1=opaquemat_275,
    Data2=opaquemat_278,
    Data3=opaquemat_270,
    Data4=opaquemat_273,
    Data5=opaquemat_276,
    Data6=opaquemat_279)
opaqueconstr_64 = HBOpaqueConstruction(name="Floor_03.01_IntClg", materials=merge_57)  # -> constr; plug-in component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

merge_58 = Merge(
    Data1=opaquemat_219,
    Data2=opaquemat_220,
    Data3=opaquemat_295,
    Data4=opaquemat_293,
    Data5=opaquematnomass_32,
    Data6=opaquemat_292,
    Data7=opaquemat_291)
opaqueconstr_65 = HBOpaqueConstruction(name="Wall_03.01", materials=merge_58)  # -> constr; plug-in component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

merge_59 = Merge(
    Data1=opaquematnomass_29,
    Data2=opaquemat_217,
    Data3=opaquemat_265,
    Data4=opaquemat_264,
    Data5=opaquemat_269,
    Data6=opaquemat_266,
    Data7=opaquemat_268,
    Data8=opaquemat_267)
opaqueconstr_66 = HBOpaqueConstruction(name="Floor_03.01_GRfloor", materials=merge_59)  # -> constr; plug-in component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

# ----
# Make this same thickness as W1
panel_69 = Panel("Wall_03.01_UGwall")
opaqueconstr_67 = HBOpaqueConstruction(name=panel_69, materials=opaquemat_263)  # -> constr; plug-in component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
groundsubset_8 = HBGroundConstructionSubset(ground_wall=opaqueconstr_67, ground_roof=opaqueconstr_63, ground_floor=opaqueconstr_66)  # -> ground_set; plug-in component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
decnstrmat_14 = HBDeconstructMaterial(mat=groundsubset_8)  # -> values, attr_names, r_val_si, r_val_ip; plug-in component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
panel_70 = Panel(groundsubset_8)
panel_71 = Panel(decnstrmat_14.r_val_si)

merge_60 = Merge(
    Data1=opaquematnomass_31,
    Data2=opaquemat_221,
    Data3=opaquemat_294,
    Data4=opaquemat_296,
    Data5=opaquemat_297,
    Data6=opaquemat_298)
opaqueconstr_68 = HBOpaqueConstruction(name="Ceiling_03.01", materials=merge_60)  # -> constr; plug-in component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

merge_61 = Merge(
    Data1=opaquematnomass_27,
    Data2=opaquemat_212,
    Data3=opaquemat_241,
    Data4=opaquemat_236,
    Data5=opaquemat_239,
    Data6=opaquemat_240,
    Data7=opaquemat_238,
    Data8=opaquemat_237)
opaqueconstr_69 = HBOpaqueConstruction(name="Floor_03.01", materials=merge_61)  # -> constr; plug-in component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

merge_62 = Merge(
    Data1=opaquemat_257,
    Data2=opaquemat_258,
    Data3=opaquemat_260,
    Data4=opaquemat_259,
    Data5=opaquemat_262,
    Data6=opaquemat_261)
opaqueconstr_70 = HBOpaqueConstruction(name="Floor_03.01_IntFlr", materials=merge_62)  # -> constr; plug-in component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

merge_63 = Merge(
    Data1=opaquemat_282,
    Data2=opaquemat_286,
    Data3=opaquemat_288,
    Data4=opaquemat_287,
    Data5=opaquemat_290,
    Data6=opaquemat_289)
opaqueconstr_71 = HBOpaqueConstruction(name="Floor_03.01_IntFlr", materials=merge_63)  # -> constr; plug-in component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

# ----
# Exterior Subset
exteriorsubset_7 = HBExteriorConstructionSubset(exterior_wall=opaqueconstr_55, exterior_roof=opaqueconstr_57, exposed_floor=opaqueconstr_69)  # -> exterior_set; plug-in component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
panel_72 = Panel(exteriorsubset_7)
decnstrmat_15 = HBDeconstructMaterial(mat=exteriorsubset_7)  # -> values, attr_names, r_val_si, r_val_ip; plug-in component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
panel_73 = Panel(decnstrmat_15.r_val_si)

merge_64 = Merge(
    Data1=opaquematnomass_33,
    Data2=opaquemat_218,
    Data3=opaquemat_304,
    Data4=opaquemat_300,
    Data5=opaquemat_301,
    Data6=opaquemat_303,
    Data7=opaquemat_302,
    Data8=opaquemat_299)
opaqueconstr_72 = HBOpaqueConstruction(name="Floor_03.01", materials=merge_64)  # -> constr; plug-in component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

# ----
# Interior Subset -
# Note interior floors & ceilings must
# be inverse of each other
interiorsubset_7 = HBInteriorConstructionSubset(interior_wall=opaqueconstr_56, ceiling=opaqueconstr_60, interior_floor=opaqueconstr_70)  # -> interior_set; plug-in component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
panel_74 = Panel(interiorsubset_7)

# ----
# Interior Subset -
# Note interior floors & ceilings must
# be inverse of each other
interiorsubset_8 = HBInteriorConstructionSubset(interior_wall=opaqueconstr_58, ceiling=opaqueconstr_64, interior_floor=opaqueconstr_71)  # -> interior_set; plug-in component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
panel_75 = Panel(interiorsubset_8)

# ----
# Exterior Subset
exteriorsubset_8 = HBExteriorConstructionSubset(exterior_wall=opaqueconstr_65, exterior_roof=opaqueconstr_68, exposed_floor=opaqueconstr_72)  # -> exterior_set; plug-in component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
panel_76 = Panel(exteriorsubset_8)
decnstrmat_16 = HBDeconstructMaterial(mat=exteriorsubset_8)  # -> values, attr_names, r_val_si, r_val_ip; plug-in component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
panel_77 = Panel(decnstrmat_16.r_val_si)

# ----
# EXPORT TO JSON
panel_78 = Panel("pre_1980::ClimateZone4::Mass")
constructionset_7 = HBConstructionSet(
    name="R4MF_g0.35WinHC",
    base_constr_set=panel_78,
    exterior_subset=exteriorsubset_7,
    ground_subset=groundsubset_7,
    interior_subset=interiorsubset_7,
    subface_subset=subfacesubset_7)  # -> constr_set; plug-in component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
objtostr_7 = HBObjectToString(hb_obj=constructionset_7)  # -> hb_str; plug-in component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

panel_79 = Panel(objtostr_7)

# ----
# EXPORT TO JSON
panel_80 = Panel("pre_1980::ClimateZone4::Mass")
constructionset_8 = HBConstructionSet(
    name="R4AB_g0.35WinHC",
    base_constr_set=panel_80,
    exterior_subset=exteriorsubset_8,
    ground_subset=groundsubset_8,
    interior_subset=interiorsubset_8,
    subface_subset=subfacesubset_8)  # -> constr_set; plug-in component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
objtostr_8 = HBObjectToString(hb_obj=constructionset_8)  # -> hb_str; plug-in component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

panel_81 = Panel(objtostr_8)

opaquemat_305 = HBOpaqueMaterial(name="ExternalPlaster", thickness=".020", conductivity="0.900", density="1800", spec_heat="1000", roughness="Rough")  # -> mat; plug-in component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

opaquemat_306 = HBOpaqueMaterial(name="WallInsul_MW_Ext", thickness=".120", conductivity="0.034", density="80", spec_heat="1030", roughness="Rough")  # -> mat; plug-in component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

opaquemat_307 = HBOpaqueMaterial(name="FloorInsul_MW", thickness=".120", conductivity="0.034", density="80", spec_heat="1030", roughness="Rough")  # -> mat; plug-in component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

opaquemat_308 = HBOpaqueMaterial(name="FloorInsul_MW", thickness=".120", conductivity="0.034", density="80", spec_heat="1030", roughness="Rough")  # -> mat; plug-in component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

opaquemat_309 = HBOpaqueMaterial(name="FloorInsul_MW", thickness=".120", conductivity="0.034", density="80", spec_heat="1030", roughness="Rough")  # -> mat; plug-in component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

opaquemat_310 = HBOpaqueMaterial(name="RoofInsul_MW_spray", thickness=".182", conductivity="0.046", density="10", spec_heat="837", roughness="VeryRough")  # -> mat; plug-in component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

opaquemat_311 = HBOpaqueMaterial(name="FloorInsul_MW", thickness=".120", conductivity="0.034", density="80", spec_heat="1030", roughness="Rough")  # -> mat; plug-in component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

opaquemat_312 = HBOpaqueMaterial(name="RoofInsul_MW_spray", thickness=".182", conductivity="0.046", density="10", spec_heat="837", roughness="VeryRough")  # -> mat; plug-in component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

opaquemat_313 = HBOpaqueMaterial(name="ExternalPlaster", thickness=".020", conductivity="0.900", density="1800", spec_heat="1000", roughness="Rough")  # -> mat; plug-in component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

opaquemat_314 = HBOpaqueMaterial(name="WallInsul_MW_Ext", thickness=".100", conductivity="0.034", density="80", spec_heat="1030", roughness="Rough")  # -> mat; plug-in component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

opaquemat_315 = HBOpaqueMaterial(name="ClayBrickBlocks", thickness="0.250", conductivity="0.400", density="1000", spec_heat="1000", roughness="Rough")  # -> mat; plug-in component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

opaquemat_316 = HBOpaqueMaterial(
    name="InternalPlaster",
    thickness="0.010",
    conductivity="0.700",
    density="1400",
    spec_heat="1000",
    roughness="MediumSmooth")  # -> mat; plug-in component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

opaquemat_317 = HBOpaqueMaterial(
    name="InternalPlaster",
    thickness="0.010",
    conductivity="0.700",
    density="1400",
    spec_heat="1000",
    roughness="MediumSmooth")  # -> mat; plug-in component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

opaquemat_318 = HBOpaqueMaterial(name="CeramicTile", thickness="0.015", conductivity="1.470", density="1700", spec_heat="1000", roughness="MediumSmooth")  # -> mat; plug-in component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

opaquemat_319 = HBOpaqueMaterial(name="CementMortar", thickness="0.020", conductivity="1.400", density="2000", spec_heat="1000", roughness="Rough")  # -> mat; plug-in component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

opaquemat_320 = HBOpaqueMaterial(name="LtwtConcScreed_6.5cm", thickness=".065", conductivity=".580", density="900", spec_heat="1000", roughness="Rough")  # -> mat; plug-in component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

opaquemat_321 = HBOpaqueMaterial(name="CementMortar", thickness="0.020", conductivity="1.400", density="2000", spec_heat="1000", roughness="Rough")  # -> mat; plug-in component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

opaquemat_322 = HBOpaqueMaterial(
    name="Slab_BrickBlkConc_24cm",
    thickness=".240",
    conductivity="0.715",
    density="900",
    spec_heat="1000",
    roughness="Rough")  # -> mat; plug-in component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

opaquemat_323 = HBOpaqueMaterial(name="CementMortar", thickness="0.020", conductivity="1.400", density="2000", spec_heat="1000", roughness="Rough")  # -> mat; plug-in component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

opaquemat_324 = HBOpaqueMaterial(name="LtwtConcScreed_6.5cm", thickness=".065", conductivity=".580", density="900", spec_heat="1000", roughness="Rough")  # -> mat; plug-in component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

opaquemat_325 = HBOpaqueMaterial(name="CeramicTile", thickness="0.015", conductivity="1.470", density="1700", spec_heat="1000", roughness="MediumSmooth")  # -> mat; plug-in component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

opaquemat_326 = HBOpaqueMaterial(
    name="InternalPlaster",
    thickness="0.020",
    conductivity="0.700",
    density="1400",
    spec_heat="1000",
    roughness="MediumSmooth")  # -> mat; plug-in component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

opaquemat_327 = HBOpaqueMaterial(
    name="Slab_BrickBlkConc_24cm",
    thickness=".240",
    conductivity="0.715",
    density="900",
    spec_heat="1000",
    roughness="Rough")  # -> mat; plug-in component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

opaquemat_328 = HBOpaqueMaterial(name="CeramicTile", thickness="0.015", conductivity="1.470", density="1700", spec_heat="1000", roughness="MediumSmooth")  # -> mat; plug-in component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

opaquemat_329 = HBOpaqueMaterial(
    name="InternalPlaster",
    thickness="0.020",
    conductivity="0.700",
    density="1400",
    spec_heat="1000",
    roughness="MediumSmooth")  # -> mat; plug-in component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

opaquemat_330 = HBOpaqueMaterial(name="CementMortar", thickness="0.020", conductivity="1.400", density="2000", spec_heat="1000", roughness="Rough")  # -> mat; plug-in component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

opaquemat_331 = HBOpaqueMaterial(name="CementMortar", thickness="0.020", conductivity="1.400", density="2000", spec_heat="1000", roughness="Rough")  # -> mat; plug-in component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

opaquemat_332 = HBOpaqueMaterial(name="LtwtConcScreed_6.5cm", thickness=".065", conductivity=".580", density="900", spec_heat="1000", roughness="Rough")  # -> mat; plug-in component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

opaquemat_333 = HBOpaqueMaterial(
    name="Slab_BrickBlkConc_24cm",
    thickness=".240",
    conductivity="0.715",
    density="900",
    spec_heat="1000",
    roughness="Rough")  # -> mat; plug-in component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

opaquematnomass_34 = HBOpaqueMaterialNoMass(name="FictitiousLayer_R0.3", r_value="0.3")  # -> mat; plug-in component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

opaquemat_334 = HBOpaqueMaterial(name="CementMortar", thickness="0.020", conductivity="1.400", density="2000", spec_heat="1000", roughness="Rough")  # -> mat; plug-in component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

opaquemat_335 = HBOpaqueMaterial(name="ExternalPlaster", thickness=".020", conductivity="0.900", density="1800", spec_heat="1000", roughness="Rough")  # -> mat; plug-in component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

opaquemat_336 = HBOpaqueMaterial(name="LtwtConcScreed_6.5cm", thickness=".065", conductivity=".580", density="900", spec_heat="1000", roughness="Rough")  # -> mat; plug-in component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

opaquemat_337 = HBOpaqueMaterial(
    name="Slab_BrickBlkConc_24cm",
    thickness=".240",
    conductivity="0.715",
    density="900",
    spec_heat="1000",
    roughness="Rough")  # -> mat; plug-in component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

opaquemat_338 = HBOpaqueMaterial(name="CementMortar", thickness="0.020", conductivity="1.400", density="2000", spec_heat="1000", roughness="Rough")  # -> mat; plug-in component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

opaquematnomass_35 = HBOpaqueMaterialNoMass(name="FictitiousLayer_R0.3", r_value="0.3")  # -> mat; plug-in component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

opaquemat_339 = HBOpaqueMaterial(name="CementMortar", thickness="0.020", conductivity="1.400", density="2000", spec_heat="1000", roughness="Rough")  # -> mat; plug-in component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

opaquemat_340 = HBOpaqueMaterial(name="ExternalPlaster", thickness=".020", conductivity="0.900", density="1800", spec_heat="1000", roughness="Rough")  # -> mat; plug-in component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

opaquemat_341 = HBOpaqueMaterial(
    name="InternalPlaster_XThin",
    thickness="0.0045",
    conductivity="0.700",
    density="1400",
    spec_heat="1000",
    roughness="MediumSmooth")  # -> mat; plug-in component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

opaquematnomass_36 = HBOpaqueMaterialNoMass(name="FictitiousLayer_R0.3", r_value="0.3")  # -> mat; plug-in component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

opaquemat_342 = HBOpaqueMaterial(name="CeramicTile", thickness="0.015", conductivity="1.470", density="1700", spec_heat="1000", roughness="MediumSmooth")  # -> mat; plug-in component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

opaquemat_343 = HBOpaqueMaterial(name="SolidBrick", thickness=".300", conductivity="0.720", density="1800", spec_heat="1000", roughness="Rough")  # -> mat; plug-in component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

opaquemat_344 = HBOpaqueMaterial(name="LtwtConcScreed_6.5cm", thickness=".065", conductivity=".580", density="900", spec_heat="1000", roughness="Rough")  # -> mat; plug-in component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

opaquemat_345 = HBOpaqueMaterial(name="CementMortar", thickness="0.020", conductivity="1.400", density="2000", spec_heat="1000", roughness="Rough")  # -> mat; plug-in component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

opaquemat_346 = HBOpaqueMaterial(name="HollowBrick_8cm", thickness="0.080", conductivity="0.400", density="800", spec_heat="1000", roughness="Rough")  # -> mat; plug-in component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

# ----
# R5MF
opaquemat_347 = HBOpaqueMaterial(
    name="ExternalPlaster_XThin",
    thickness=".0045",
    conductivity="0.900",
    density="1800",
    spec_heat="1000",
    roughness="Rough")  # -> mat; plug-in component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

opaquemat_348 = HBOpaqueMaterial(
    name="Slab_BrickBlkConc_16cm",
    thickness=".160",
    conductivity="0.560",
    density="900",
    spec_heat="1000",
    roughness="Rough")  # -> mat; plug-in component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

opaquematnomass_37 = HBOpaqueMaterialNoMass(name="FictitiousLayer_R0.3", r_value="0.3")  # -> mat; plug-in component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

opaquemat_349 = HBOpaqueMaterial(
    name="Slab_BrickBlkConc_24cm",
    thickness=".240",
    conductivity="0.715",
    density="900",
    spec_heat="1000",
    roughness="Rough")  # -> mat; plug-in component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

opaquemat_350 = HBOpaqueMaterial(name="HollowBrick_12cm", thickness="0.120", conductivity="0.387", density="800", spec_heat="1000", roughness="Rough")  # -> mat; plug-in component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

opaquemat_351 = HBOpaqueMaterial(
    name="InternalPlaster_Thin",
    thickness="0.010",
    conductivity="0.700",
    density="1400",
    spec_heat="1000",
    roughness="MediumSmooth")  # -> mat; plug-in component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

opaquemat_352 = HBOpaqueMaterial(name="CeramicTile", thickness="0.015", conductivity="1.470", density="1700", spec_heat="1000", roughness="MediumSmooth")  # -> mat; plug-in component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

opaquemat_353 = HBOpaqueMaterial(name="CementMortar", thickness="0.020", conductivity="1.400", density="2000", spec_heat="1000", roughness="Rough")  # -> mat; plug-in component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

opaquemat_354 = HBOpaqueMaterial(name="ExternalPlaster", thickness=".020", conductivity="0.900", density="1800", spec_heat="1000", roughness="Rough")  # -> mat; plug-in component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

opaquematnomass_38 = HBOpaqueMaterialNoMass(name="CavityWallGap_R0.18", r_value="0.18")  # -> mat; plug-in component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

opaquemat_355 = HBOpaqueMaterial(name="LtwtConcScreed_2cm", thickness=".020", conductivity=".580", density="400", spec_heat="1000", roughness="Rough")  # -> mat; plug-in component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

opaquemat_356 = HBOpaqueMaterial(name="CementMortar", thickness="0.020", conductivity="1.400", density="2000", spec_heat="1000", roughness="Rough")  # -> mat; plug-in component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

# ----
# Hard code window
# U 1.40, g 0.35, VT 0.55
panel_82 = Panel("0.55")
windowmat_9 = HBWindowMaterial(name="U 1.40 Dbl LoE", u_factor="1.40", shgc="0.35", t_vis=panel_82)  # -> mat; plug-in component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
windowconstr_9 = HBWindowConstruction(name="U 1.40 Dbl LoE", materials=windowmat_9)  # -> constr; plug-in component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
decnstrconstr_9 = HBDeconstructConstruction(constr=windowconstr_9)  # -> materials, layers, r_val_si, r_val_ip, u_fac_si, u_fac_ip, shgc, t_sol, t_vis; plug-in component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
panel_83 = Panel([decnstrconstr_9.r_val_si, decnstrconstr_9.u_fac_si, decnstrconstr_9.shgc, decnstrconstr_9.t_sol, decnstrconstr_9.t_vis])
subfacesubset_9 = HBSubfaceSubset(window=windowconstr_9, skylight=windowconstr_9, operable=windowconstr_9, glass_door=windowconstr_9)  # -> subface_set; plug-in component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

opaquemat_357 = HBOpaqueMaterial(name="LtwtConcScreed_2cm", thickness=".020", conductivity=".580", density="400", spec_heat="1000", roughness="Rough")  # -> mat; plug-in component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

opaquemat_358 = HBOpaqueMaterial(name="CeramicTile", thickness="0.015", conductivity="1.470", density="1700", spec_heat="1000", roughness="MediumSmooth")  # -> mat; plug-in component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

opaquemat_359 = HBOpaqueMaterial(name="ClayBrickBlocks", thickness="0.300", conductivity="0.337", density="1000", spec_heat="1000", roughness="Rough")  # -> mat; plug-in component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

opaquemat_360 = HBOpaqueMaterial(
    name="InternalPlaster",
    thickness="0.020",
    conductivity="0.700",
    density="1400",
    spec_heat="1000",
    roughness="MediumSmooth")  # -> mat; plug-in component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

opaquemat_361 = HBOpaqueMaterial(name="CementMortar", thickness="0.020", conductivity="1.400", density="2000", spec_heat="1000", roughness="Rough")  # -> mat; plug-in component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

opaquemat_362 = HBOpaqueMaterial(
    name="InternalPlaster",
    thickness="0.020",
    conductivity="0.700",
    density="1400",
    spec_heat="1000",
    roughness="MediumSmooth")  # -> mat; plug-in component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

opaquemat_363 = HBOpaqueMaterial(name="CementMortar", thickness="0.020", conductivity="1.400", density="2000", spec_heat="1000", roughness="Rough")  # -> mat; plug-in component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

opaquemat_364 = HBOpaqueMaterial(name="CeramicTile", thickness="0.015", conductivity="1.470", density="1700", spec_heat="1000", roughness="MediumSmooth")  # -> mat; plug-in component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

opaquemat_365 = HBOpaqueMaterial(
    name="Slab_BrickBlkConc_16cm",
    thickness=".160",
    conductivity="0.560",
    density="900",
    spec_heat="1000",
    roughness="Rough")  # -> mat; plug-in component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

opaquemat_366 = HBOpaqueMaterial(name="CementMortar", thickness="0.020", conductivity="1.400", density="2000", spec_heat="1000", roughness="Rough")  # -> mat; plug-in component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

opaquemat_367 = HBOpaqueMaterial(
    name="InternalPlaster",
    thickness="0.020",
    conductivity="0.700",
    density="1400",
    spec_heat="1000",
    roughness="MediumSmooth")  # -> mat; plug-in component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

opaquemat_368 = HBOpaqueMaterial(name="LtwtConcScreed_2cm", thickness=".020", conductivity=".580", density="400", spec_heat="1000", roughness="Rough")  # -> mat; plug-in component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

opaquemat_369 = HBOpaqueMaterial(name="LtwtConcScreed_2cm", thickness=".020", conductivity=".580", density="400", spec_heat="1000", roughness="Rough")  # -> mat; plug-in component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

opaquemat_370 = HBOpaqueMaterial(
    name="Slab_BrickBlkConc_16cm",
    thickness=".160",
    conductivity="0.560",
    density="900",
    spec_heat="1000",
    roughness="Rough")  # -> mat; plug-in component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

opaquemat_371 = HBOpaqueMaterial(
    name="Slab_BrickBlkConc_16cm",
    thickness=".160",
    conductivity="0.560",
    density="900",
    spec_heat="1000",
    roughness="Rough")  # -> mat; plug-in component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

opaquemat_372 = HBOpaqueMaterial(name="CementMortar", thickness="0.020", conductivity="1.400", density="2000", spec_heat="1000", roughness="Rough")  # -> mat; plug-in component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

opaquemat_373 = HBOpaqueMaterial(
    name="InternalPlaster",
    thickness="0.020",
    conductivity="0.700",
    density="1400",
    spec_heat="1000",
    roughness="MediumSmooth")  # -> mat; plug-in component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

opaquemat_374 = HBOpaqueMaterial(name="LtwtConcScreed_2cm", thickness=".020", conductivity=".580", density="400", spec_heat="1000", roughness="Rough")  # -> mat; plug-in component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

opaquemat_375 = HBOpaqueMaterial(name="CementMortar", thickness="0.020", conductivity="1.400", density="2000", spec_heat="1000", roughness="Rough")  # -> mat; plug-in component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

opaquemat_376 = HBOpaqueMaterial(name="ExternalPlaster", thickness=".020", conductivity="0.900", density="1800", spec_heat="1000", roughness="Rough")  # -> mat; plug-in component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

opaquemat_377 = HBOpaqueMaterial(
    name="Slab_BrickBlkConc_16cm",
    thickness=".160",
    conductivity="0.560",
    density="900",
    spec_heat="1000",
    roughness="Rough")  # -> mat; plug-in component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

opaquemat_378 = HBOpaqueMaterial(name="CementMortar", thickness="0.020", conductivity="1.400", density="2000", spec_heat="1000", roughness="Rough")  # -> mat; plug-in component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

opaquemat_379 = HBOpaqueMaterial(name="CementMortar", thickness="0.020", conductivity="1.400", density="2000", spec_heat="1000", roughness="Rough")  # -> mat; plug-in component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

opaquemat_380 = HBOpaqueMaterial(name="CeramicTile", thickness="0.015", conductivity="1.470", density="1700", spec_heat="1000", roughness="MediumSmooth")  # -> mat; plug-in component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

opaquemat_381 = HBOpaqueMaterial(name="ExternalPlaster", thickness=".020", conductivity="0.900", density="1800", spec_heat="1000", roughness="Rough")  # -> mat; plug-in component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

opaquemat_382 = HBOpaqueMaterial(name="CeramicTile", thickness="0.015", conductivity="1.470", density="1700", spec_heat="1000", roughness="MediumSmooth")  # -> mat; plug-in component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

opaquemat_383 = HBOpaqueMaterial(name="SolidBrick", thickness=".300", conductivity="0.720", density="1800", spec_heat="1000", roughness="Rough")  # -> mat; plug-in component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

opaquemat_384 = HBOpaqueMaterial(name="CementMortar", thickness="0.020", conductivity="1.400", density="2000", spec_heat="1000", roughness="Rough")  # -> mat; plug-in component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

opaquemat_385 = HBOpaqueMaterial(
    name="InternalPlaster",
    thickness="0.020",
    conductivity="0.700",
    density="1400",
    spec_heat="1000",
    roughness="MediumSmooth")  # -> mat; plug-in component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

opaquematnomass_39 = HBOpaqueMaterialNoMass(name="FictitiousLayer_R0.3", r_value="0.3")  # -> mat; plug-in component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

opaquemat_386 = HBOpaqueMaterial(name="HollowBrick_8cm", thickness="0.080", conductivity="0.400", density="800", spec_heat="1000", roughness="Rough")  # -> mat; plug-in component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

opaquemat_387 = HBOpaqueMaterial(name="HollowBrick_12cm", thickness="0.120", conductivity="0.387", density="800", spec_heat="1000", roughness="Rough")  # -> mat; plug-in component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

opaquemat_388 = HBOpaqueMaterial(name="LtwtConcScreed_2cm", thickness=".020", conductivity=".580", density="400", spec_heat="1000", roughness="Rough")  # -> mat; plug-in component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

opaquematnomass_40 = HBOpaqueMaterialNoMass(name="CavityWallGap_R0.18", r_value="0.18")  # -> mat; plug-in component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

opaquemat_389 = HBOpaqueMaterial(name="CementMortar", thickness="0.020", conductivity="1.400", density="2000", spec_heat="1000", roughness="Rough")  # -> mat; plug-in component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

opaquemat_390 = HBOpaqueMaterial(
    name="Slab_BrickBlkConc_16cm",
    thickness=".160",
    conductivity="0.560",
    density="900",
    spec_heat="1000",
    roughness="Rough")  # -> mat; plug-in component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

opaquemat_391 = HBOpaqueMaterial(
    name="InternalPlaster_Thin",
    thickness="0.010",
    conductivity="0.700",
    density="1400",
    spec_heat="1000",
    roughness="MediumSmooth")  # -> mat; plug-in component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

# ----
# R5AB
opaquemat_392 = HBOpaqueMaterial(name="ExternalPlaster", thickness=".020", conductivity="0.900", density="1800", spec_heat="1000", roughness="Rough")  # -> mat; plug-in component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

opaquemat_393 = HBOpaqueMaterial(name="CeramicTile", thickness="0.015", conductivity="1.470", density="1700", spec_heat="1000", roughness="MediumSmooth")  # -> mat; plug-in component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

opaquemat_394 = HBOpaqueMaterial(
    name="Slab_BrickBlkConc_16cm",
    thickness=".160",
    conductivity="0.560",
    density="900",
    spec_heat="1000",
    roughness="Rough")  # -> mat; plug-in component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

opaquemat_395 = HBOpaqueMaterial(name="CementMortar", thickness="0.020", conductivity="1.400", density="2000", spec_heat="1000", roughness="Rough")  # -> mat; plug-in component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

opaquemat_396 = HBOpaqueMaterial(name="CementMortar", thickness="0.020", conductivity="1.400", density="2000", spec_heat="1000", roughness="Rough")  # -> mat; plug-in component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

opaquemat_397 = HBOpaqueMaterial(name="LtwtConcScreed_2cm", thickness=".020", conductivity=".580", density="400", spec_heat="1000", roughness="Rough")  # -> mat; plug-in component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

opaquemat_398 = HBOpaqueMaterial(name="ExternalPlaster", thickness=".020", conductivity="0.900", density="1800", spec_heat="1000", roughness="Rough")  # -> mat; plug-in component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

# ----
# Hard code window
# U 1.40, g 0.35, VT 0.55
panel_84 = Panel("0.55")
windowmat_10 = HBWindowMaterial(name="U 1.40 Dbl LoE", u_factor="1.40", shgc="0.35", t_vis=panel_84)  # -> mat; plug-in component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
windowconstr_10 = HBWindowConstruction(name="U 1.40 Dbl LoE", materials=windowmat_10)  # -> constr; plug-in component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
decnstrconstr_10 = HBDeconstructConstruction(constr=windowconstr_10)  # -> materials, layers, r_val_si, r_val_ip, u_fac_si, u_fac_ip, shgc, t_sol, t_vis; plug-in component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
panel_85 = Panel([decnstrconstr_10.r_val_si, decnstrconstr_10.u_fac_si, decnstrconstr_10.shgc, decnstrconstr_10.t_sol, decnstrconstr_10.t_vis])
subfacesubset_10 = HBSubfaceSubset(window=windowconstr_10, skylight=windowconstr_10, operable=windowconstr_10, glass_door=windowconstr_10)  # -> subface_set; plug-in component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

# ----
# Interior Subset -
# Note interior floors & ceilings must
# be inverse of each other
merge_65 = Merge(Data1=opaquemat_316, Data2=opaquemat_315, Data3=opaquemat_317)
merge_66 = Merge(
    Data1=opaquemat_318,
    Data2=opaquemat_319,
    Data3=opaquemat_320,
    Data4=opaquemat_321,
    Data5=opaquemat_322,
    Data6=opaquemat_326)
opaqueconstr_73 = HBOpaqueConstruction(name="Wall_04.01_Interior", materials=merge_65)  # -> constr; plug-in component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
merge_67 = Merge(
    Data1=opaquemat_329,
    Data2=opaquemat_327,
    Data3=opaquemat_323,
    Data4=opaquemat_324,
    Data5=opaquemat_330,
    Data6=opaquemat_328)
opaqueconstr_74 = HBOpaqueConstruction(name="Floor_03.01_IntClg", materials=merge_66)  # -> constr; plug-in component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
opaqueconstr_75 = HBOpaqueConstruction(name="Floor_03.01_IntFlr", materials=merge_67)  # -> constr; plug-in component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
interiorsubset_9 = HBInteriorConstructionSubset(interior_wall=opaqueconstr_73, ceiling=opaqueconstr_74, interior_floor=opaqueconstr_75)  # -> interior_set; plug-in component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
panel_86 = Panel(interiorsubset_9)

# ----
# Ground Subset -
# same as interior floors,
# ground & roof must be inverse.
# 
# Base ground & roof construction
# on exterior floor for same archetype
# Make this same thickness as W1
panel_87 = Panel("Wall_03.01_UGwall")
opaqueconstr_76 = HBOpaqueConstruction(name=panel_87, materials=opaquemat_343)  # -> constr; plug-in component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
merge_68 = Merge(
    Data1=opaquemat_325,
    Data2=opaquemat_331,
    Data3=opaquemat_332,
    Data4=opaquemat_334,
    Data5=opaquemat_333,
    Data6=opaquemat_335,
    Data7=opaquemat_307,
    Data8=opaquematnomass_34)
merge_69 = Merge(
    Data1=opaquematnomass_35,
    Data2=opaquemat_307,
    Data3=opaquemat_340,
    Data4=opaquemat_337,
    Data5=opaquemat_338,
    Data6=opaquemat_336,
    Data7=opaquemat_339,
    Data8=opaquemat_342)
opaqueconstr_77 = HBOpaqueConstruction(name="Floor_03.01_GRroof", materials=merge_68)  # -> constr; plug-in component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
opaqueconstr_78 = HBOpaqueConstruction(name="Floor_03.01_GRfloor", materials=merge_69)  # -> constr; plug-in component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
groundsubset_9 = HBGroundConstructionSubset(ground_wall=opaqueconstr_76, ground_roof=opaqueconstr_77, ground_floor=opaqueconstr_78)  # -> ground_set; plug-in component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
decnstrmat_17 = HBDeconstructMaterial(mat=groundsubset_9)  # -> values, attr_names, r_val_si, r_val_ip; plug-in component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
panel_88 = Panel(groundsubset_9)
panel_89 = Panel(decnstrmat_17.r_val_si)

merge_70 = Merge(
    Data1=opaquemat_305,
    Data2=opaquemat_306,
    Data3=opaquemat_347,
    Data4=opaquemat_350,
    Data5=opaquematnomass_38,
    Data6=opaquemat_346,
    Data7=opaquemat_341)
opaqueconstr_79 = HBOpaqueConstruction(name="Wall_03.01", materials=merge_70)  # -> constr; plug-in component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

merge_71 = Merge(
    Data1=opaquematnomass_36,
    Data2=opaquemat_310,
    Data3=opaquemat_355,
    Data4=opaquemat_353,
    Data5=opaquemat_348,
    Data6=opaquemat_351)
opaqueconstr_80 = HBOpaqueConstruction(name="Ceiling_03.01", materials=merge_71)  # -> constr; plug-in component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

merge_72 = Merge(Data1=opaquemat_360, Data2=opaquemat_359, Data3=opaquemat_362)
opaqueconstr_81 = HBOpaqueConstruction(name="Wall_04.02_Interior", materials=merge_72)  # -> constr; plug-in component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

merge_73 = Merge(
    Data1=opaquemat_364,
    Data2=opaquemat_366,
    Data3=opaquemat_357,
    Data4=opaquemat_361,
    Data5=opaquemat_365,
    Data6=opaquemat_367)
opaqueconstr_82 = HBOpaqueConstruction(name="Floor_03.01_IntClg", materials=merge_73)  # -> constr; plug-in component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

# ----
# Exterior Subset
merge_74 = Merge(
    Data1=opaquematnomass_37,
    Data2=opaquemat_308,
    Data3=opaquemat_354,
    Data4=opaquemat_349,
    Data5=opaquemat_356,
    Data6=opaquemat_344,
    Data7=opaquemat_345,
    Data8=opaquemat_352)
opaqueconstr_83 = HBOpaqueConstruction(name="Floor_03.01", materials=merge_74)  # -> constr; plug-in component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
exteriorsubset_9 = HBExteriorConstructionSubset(exterior_wall=opaqueconstr_79, exterior_roof=opaqueconstr_80, exposed_floor=opaqueconstr_83)  # -> exterior_set; plug-in component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
panel_90 = Panel(exteriorsubset_9)
decnstrmat_18 = HBDeconstructMaterial(mat=exteriorsubset_9)  # -> values, attr_names, r_val_si, r_val_ip; plug-in component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
panel_91 = Panel(decnstrmat_18.r_val_si)

merge_75 = Merge(
    Data1=opaquemat_358,
    Data2=opaquemat_363,
    Data3=opaquemat_368,
    Data4=opaquemat_375,
    Data5=opaquemat_370,
    Data6=opaquemat_376,
    Data7=opaquemat_309)
opaqueconstr_84 = HBOpaqueConstruction(name="Floor_03.01_GRroof", materials=merge_75)  # -> constr; plug-in component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

merge_76 = Merge(
    Data1=opaquemat_313,
    Data2=opaquemat_314,
    Data3=opaquemat_392,
    Data4=opaquemat_387,
    Data5=opaquematnomass_40,
    Data6=opaquemat_386,
    Data7=opaquemat_385)
opaqueconstr_85 = HBOpaqueConstruction(name="Wall_03.02", materials=merge_76)  # -> constr; plug-in component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

merge_77 = Merge(
    Data1=opaquematnomass_39,
    Data2=opaquemat_312,
    Data3=opaquemat_388,
    Data4=opaquemat_389,
    Data5=opaquemat_390,
    Data6=opaquemat_391)
opaqueconstr_86 = HBOpaqueConstruction(name="Ceiling_03.01", materials=merge_77)  # -> constr; plug-in component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

merge_78 = Merge(
    Data1=opaquemat_309,
    Data2=opaquemat_381,
    Data3=opaquemat_371,
    Data4=opaquemat_372,
    Data5=opaquemat_369,
    Data6=opaquemat_378,
    Data7=opaquemat_382)
opaqueconstr_87 = HBOpaqueConstruction(name="Floor_03.01_GRfloor", materials=merge_78)  # -> constr; plug-in component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

# ----
# Ground Subset -
# same as interior floors,
# ground & roof must be inverse.
# 
# Base ground & roof construction
# on exterior floor for same archetype
# Make this same thickness as W1
panel_92 = Panel("Wall_03.02_UGwall")
opaqueconstr_88 = HBOpaqueConstruction(name=panel_92, materials=opaquemat_383)  # -> constr; plug-in component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
groundsubset_10 = HBGroundConstructionSubset(ground_wall=opaqueconstr_88, ground_roof=opaqueconstr_84, ground_floor=opaqueconstr_87)  # -> ground_set; plug-in component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
decnstrmat_19 = HBDeconstructMaterial(mat=groundsubset_10)  # -> values, attr_names, r_val_si, r_val_ip; plug-in component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
panel_93 = Panel(groundsubset_10)
panel_94 = Panel(decnstrmat_19.r_val_si)

merge_79 = Merge(
    Data1=opaquemat_373,
    Data2=opaquemat_377,
    Data3=opaquemat_379,
    Data4=opaquemat_374,
    Data5=opaquemat_384,
    Data6=opaquemat_380)
opaqueconstr_89 = HBOpaqueConstruction(name="Floor_03.01_IntFlr", materials=merge_79)  # -> constr; plug-in component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

merge_80 = Merge(
    Data1=opaquemat_311,
    Data2=opaquemat_398,
    Data3=opaquemat_394,
    Data4=opaquemat_396,
    Data5=opaquemat_397,
    Data6=opaquemat_395,
    Data7=opaquemat_393)
opaqueconstr_90 = HBOpaqueConstruction(name="Floor_03.01", materials=merge_80)  # -> constr; plug-in component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

# ----
# Interior Subset -
# Note interior floors & ceilings must
# be inverse of each other
interiorsubset_10 = HBInteriorConstructionSubset(interior_wall=opaqueconstr_81, ceiling=opaqueconstr_82, interior_floor=opaqueconstr_89)  # -> interior_set; plug-in component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
panel_95 = Panel(interiorsubset_10)

# ----
# Exterior Subset
exteriorsubset_10 = HBExteriorConstructionSubset(exterior_wall=opaqueconstr_85, exterior_roof=opaqueconstr_86, exposed_floor=opaqueconstr_90)  # -> exterior_set; plug-in component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
panel_96 = Panel(exteriorsubset_10)
decnstrmat_20 = HBDeconstructMaterial(mat=exteriorsubset_10)  # -> values, attr_names, r_val_si, r_val_ip; plug-in component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
panel_97 = Panel(decnstrmat_20.r_val_si)

# ----
# EXPORT TO JSON
panel_98 = Panel("pre_1980::ClimateZone4::Mass")
constructionset_9 = HBConstructionSet(
    name="R5MF_g0.35WinHC",
    base_constr_set=panel_98,
    exterior_subset=exteriorsubset_9,
    ground_subset=groundsubset_9,
    interior_subset=interiorsubset_9,
    subface_subset=subfacesubset_9)  # -> constr_set; plug-in component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
objtostr_9 = HBObjectToString(hb_obj=constructionset_9)  # -> hb_str; plug-in component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

panel_99 = Panel(objtostr_9)

# ----
# EXPORT TO JSON
panel_100 = Panel("pre_1980::ClimateZone4::Mass")
constructionset_10 = HBConstructionSet(
    name="R5AB_g0.35WinHC",
    base_constr_set=panel_100,
    exterior_subset=exteriorsubset_10,
    ground_subset=groundsubset_10,
    interior_subset=interiorsubset_10,
    subface_subset=subfacesubset_10)  # -> constr_set; plug-in component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
objtostr_10 = HBObjectToString(hb_obj=constructionset_10)  # -> hb_str; plug-in component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

panel_101 = Panel(objtostr_10)

opaquemat_399 = HBOpaqueMaterial(name="RoofInsul_MW_spray", thickness=".162", conductivity="0.046", density="10", spec_heat="837", roughness="VeryRough")  # -> mat; plug-in component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

opaquemat_400 = HBOpaqueMaterial(name="FloorInsul_MW", thickness=".120", conductivity="0.034", density="80", spec_heat="1030", roughness="Rough")  # -> mat; plug-in component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

opaquemat_401 = HBOpaqueMaterial(name="ExternalPlaster", thickness=".020", conductivity="0.900", density="1800", spec_heat="1000", roughness="Rough")  # -> mat; plug-in component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

opaquemat_402 = HBOpaqueMaterial(name="FloorInsul_MW", thickness=".120", conductivity="0.034", density="80", spec_heat="1030", roughness="Rough")  # -> mat; plug-in component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

opaquemat_403 = HBOpaqueMaterial(name="WallInsul_MW_Ext", thickness=".100", conductivity="0.034", density="80", spec_heat="1030", roughness="Rough")  # -> mat; plug-in component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

opaquemat_404 = HBOpaqueMaterial(name="RoofInsul_MW_spray", thickness=".162", conductivity="0.046", density="10", spec_heat="837", roughness="VeryRough")  # -> mat; plug-in component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

opaquemat_405 = HBOpaqueMaterial(name="FloorInsul_MW", thickness=".100", conductivity="0.034", density="80", spec_heat="1030", roughness="Rough")  # -> mat; plug-in component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

opaquemat_406 = HBOpaqueMaterial(name="ExternalPlaster", thickness=".020", conductivity="0.900", density="1800", spec_heat="1000", roughness="Rough")  # -> mat; plug-in component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

opaquemat_407 = HBOpaqueMaterial(name="WallInsul_MW_Ext", thickness=".100", conductivity="0.034", density="80", spec_heat="1030", roughness="Rough")  # -> mat; plug-in component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

opaquemat_408 = HBOpaqueMaterial(name="FloorInsul_MW", thickness=".100", conductivity="0.034", density="80", spec_heat="1030", roughness="Rough")  # -> mat; plug-in component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

opaquemat_409 = HBOpaqueMaterial(name="CeramicTile", thickness="0.015", conductivity="1.470", density="1700", spec_heat="1000", roughness="MediumSmooth")  # -> mat; plug-in component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

opaquemat_410 = HBOpaqueMaterial(name="CementMortar", thickness="0.020", conductivity="1.400", density="2000", spec_heat="1000", roughness="Rough")  # -> mat; plug-in component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

opaquemat_411 = HBOpaqueMaterial(name="HollowBrick_8cm", thickness="0.080", conductivity="0.400", density="800", spec_heat="1000", roughness="Rough")  # -> mat; plug-in component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

opaquemat_412 = HBOpaqueMaterial(name="LtwtConcScreed_2cm", thickness=".020", conductivity=".580", density="400", spec_heat="1000", roughness="Rough")  # -> mat; plug-in component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

opaquematnomass_41 = HBOpaqueMaterialNoMass(name="FictitiousLayer_R0.3", r_value="0.3")  # -> mat; plug-in component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

opaquemat_413 = HBOpaqueMaterial(
    name="InsulationPanel",
    thickness="0.0185",
    conductivity="0.045",
    density="30",
    spec_heat="1220",
    roughness="MediumSmooth")  # -> mat; plug-in component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

opaquemat_414 = HBOpaqueMaterial(
    name="InternalPlaster",
    thickness="0.020",
    conductivity="0.700",
    density="1400",
    spec_heat="1000",
    roughness="MediumSmooth")  # -> mat; plug-in component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

opaquemat_415 = HBOpaqueMaterial(name="InsulatedCavity", thickness="0.009", conductivity="0.045", density="30", spec_heat="570", roughness="Rough")  # -> mat; plug-in component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

opaquemat_416 = HBOpaqueMaterial(name="CementMortar", thickness="0.020", conductivity="1.400", density="2000", spec_heat="1000", roughness="Rough")  # -> mat; plug-in component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

opaquemat_417 = HBOpaqueMaterial(
    name="Slab_BrickBlkConc_16cm",
    thickness=".160",
    conductivity="0.560",
    density="900",
    spec_heat="1000",
    roughness="Rough")  # -> mat; plug-in component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

opaquemat_418 = HBOpaqueMaterial(name="CeramicTile", thickness="0.015", conductivity="1.470", density="1700", spec_heat="1000", roughness="MediumSmooth")  # -> mat; plug-in component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

opaquemat_419 = HBOpaqueMaterial(name="SemiSolidBrick_25cm", thickness="0.250", conductivity="0.400", density="1000", spec_heat="1000", roughness="Rough")  # -> mat; plug-in component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

opaquemat_420 = HBOpaqueMaterial(name="LtwtConcScreed_2cm", thickness=".020", conductivity=".580", density="400", spec_heat="1000", roughness="Rough")  # -> mat; plug-in component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

opaquemat_421 = HBOpaqueMaterial(
    name="InternalPlaster",
    thickness="0.020",
    conductivity="0.700",
    density="1400",
    spec_heat="1000",
    roughness="MediumSmooth")  # -> mat; plug-in component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

opaquemat_422 = HBOpaqueMaterial(
    name="InternalPlaster",
    thickness=".020",
    conductivity="0.700",
    density="1400",
    spec_heat="1000",
    roughness="MediumSmooth")  # -> mat; plug-in component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

opaquemat_423 = HBOpaqueMaterial(name="CementMortar", thickness="0.020", conductivity="1.400", density="2000", spec_heat="1000", roughness="Rough")  # -> mat; plug-in component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

opaquemat_424 = HBOpaqueMaterial(name="ExternalPlaster", thickness=".020", conductivity="0.900", density="1800", spec_heat="1000", roughness="Rough")  # -> mat; plug-in component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

opaquemat_425 = HBOpaqueMaterial(
    name="Slab_BrickBlkConc_16cm",
    thickness=".160",
    conductivity="0.560",
    density="900",
    spec_heat="1000",
    roughness="Rough")  # -> mat; plug-in component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

opaquemat_426 = HBOpaqueMaterial(name="LtwtConcScreed_2cm", thickness=".020", conductivity=".580", density="400", spec_heat="1000", roughness="Rough")  # -> mat; plug-in component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

opaquemat_427 = HBOpaqueMaterial(
    name="InsulationPanel",
    thickness="0.011",
    conductivity="0.045",
    density="30",
    spec_heat="1220",
    roughness="MediumSmooth")  # -> mat; plug-in component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

opaquemat_428 = HBOpaqueMaterial(name="CementMortar", thickness="0.020", conductivity="1.400", density="2000", spec_heat="1000", roughness="Rough")  # -> mat; plug-in component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

opaquemat_429 = HBOpaqueMaterial(name="LtwtConcScreed_2cm", thickness=".020", conductivity=".580", density="400", spec_heat="1000", roughness="Rough")  # -> mat; plug-in component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

opaquemat_430 = HBOpaqueMaterial(
    name="InternalPlaster",
    thickness="0.020",
    conductivity="0.700",
    density="1400",
    spec_heat="1000",
    roughness="MediumSmooth")  # -> mat; plug-in component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

opaquemat_431 = HBOpaqueMaterial(
    name="InternalPlaster_Thin",
    thickness="0.010",
    conductivity="0.700",
    density="1400",
    spec_heat="1000",
    roughness="MediumSmooth")  # -> mat; plug-in component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

opaquemat_432 = HBOpaqueMaterial(name="ClayBrickBlocks", thickness="0.250", conductivity="0.400", density="1000", spec_heat="1000", roughness="Rough")  # -> mat; plug-in component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

opaquemat_433 = HBOpaqueMaterial(name="CeramicTile", thickness="0.015", conductivity="1.470", density="1700", spec_heat="1000", roughness="MediumSmooth")  # -> mat; plug-in component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

# ----
# R6MF
opaquemat_434 = HBOpaqueMaterial(name="ExternalPlaster", thickness=".020", conductivity="0.900", density="1800", spec_heat="1000", roughness="Rough")  # -> mat; plug-in component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

opaquemat_435 = HBOpaqueMaterial(name="SolidBrick", thickness=".379", conductivity="0.720", density="1800", spec_heat="1000", roughness="Rough")  # -> mat; plug-in component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

opaquemat_436 = HBOpaqueMaterial(
    name="Slab_BrickBlkConc_16cm",
    thickness=".160",
    conductivity="0.560",
    density="900",
    spec_heat="1000",
    roughness="Rough")  # -> mat; plug-in component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

opaquemat_437 = HBOpaqueMaterial(name="CementMortar", thickness="0.020", conductivity="1.400", density="2000", spec_heat="1000", roughness="Rough")  # -> mat; plug-in component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

opaquemat_438 = HBOpaqueMaterial(
    name="InternalPlaster_Thin",
    thickness="0.010",
    conductivity="0.700",
    density="1400",
    spec_heat="1000",
    roughness="MediumSmooth")  # -> mat; plug-in component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

opaquemat_439 = HBOpaqueMaterial(name="ExternalPlaster", thickness=".020", conductivity="0.900", density="1800", spec_heat="1000", roughness="Rough")  # -> mat; plug-in component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

opaquemat_440 = HBOpaqueMaterial(
    name="InsulationPanel",
    thickness="0.011",
    conductivity="0.045",
    density="30",
    spec_heat="1220",
    roughness="MediumSmooth")  # -> mat; plug-in component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

opaquemat_441 = HBOpaqueMaterial(name="CementMortar", thickness="0.020", conductivity="1.400", density="2000", spec_heat="1000", roughness="Rough")  # -> mat; plug-in component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

opaquemat_442 = HBOpaqueMaterial(
    name="Slab_BrickBlkConc_16cm",
    thickness=".160",
    conductivity="0.560",
    density="900",
    spec_heat="1000",
    roughness="Rough")  # -> mat; plug-in component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

opaquemat_443 = HBOpaqueMaterial(name="CementMortar", thickness="0.020", conductivity="1.400", density="2000", spec_heat="1000", roughness="Rough")  # -> mat; plug-in component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

opaquemat_444 = HBOpaqueMaterial(name="CementMortar", thickness="0.020", conductivity="1.400", density="2000", spec_heat="1000", roughness="Rough")  # -> mat; plug-in component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

opaquemat_445 = HBOpaqueMaterial(name="CeramicTile", thickness="0.015", conductivity="1.470", density="1700", spec_heat="1000", roughness="MediumSmooth")  # -> mat; plug-in component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

opaquemat_446 = HBOpaqueMaterial(name="LtwtConcScreed_2cm", thickness=".020", conductivity=".580", density="400", spec_heat="1000", roughness="Rough")  # -> mat; plug-in component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

opaquemat_447 = HBOpaqueMaterial(
    name="InsulationPanel",
    thickness="0.011",
    conductivity="0.045",
    density="30",
    spec_heat="1220",
    roughness="MediumSmooth")  # -> mat; plug-in component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

opaquemat_448 = HBOpaqueMaterial(
    name="Slab_BrickBlkConc_16cm",
    thickness=".160",
    conductivity="0.560",
    density="900",
    spec_heat="1000",
    roughness="Rough")  # -> mat; plug-in component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

opaquemat_449 = HBOpaqueMaterial(name="CementMortar", thickness="0.020", conductivity="1.400", density="2000", spec_heat="1000", roughness="Rough")  # -> mat; plug-in component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

opaquemat_450 = HBOpaqueMaterial(name="LtwtConcScreed_2cm", thickness=".020", conductivity=".580", density="400", spec_heat="1000", roughness="Rough")  # -> mat; plug-in component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

opaquemat_451 = HBOpaqueMaterial(name="CementMortar", thickness="0.020", conductivity="1.400", density="2000", spec_heat="1000", roughness="Rough")  # -> mat; plug-in component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

opaquemat_452 = HBOpaqueMaterial(
    name="Slab_BrickBlkConc_16cm",
    thickness=".160",
    conductivity="0.560",
    density="900",
    spec_heat="1000",
    roughness="Rough")  # -> mat; plug-in component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

opaquemat_453 = HBOpaqueMaterial(name="ExternalPlaster", thickness=".020", conductivity="0.900", density="1800", spec_heat="1000", roughness="Rough")  # -> mat; plug-in component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

opaquemat_454 = HBOpaqueMaterial(name="CementMortar", thickness="0.020", conductivity="1.400", density="2000", spec_heat="1000", roughness="Rough")  # -> mat; plug-in component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

opaquemat_455 = HBOpaqueMaterial(name="CeramicTile", thickness="0.015", conductivity="1.470", density="1700", spec_heat="1000", roughness="MediumSmooth")  # -> mat; plug-in component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

# ----
# Hard code window
# U 1.40, g 0.35, VT 0.55
panel_102 = Panel("0.55")
windowmat_11 = HBWindowMaterial(name="U 1.40 Dbl LoE", u_factor="1.40", shgc="0.35", t_vis=panel_102)  # -> mat; plug-in component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
windowconstr_11 = HBWindowConstruction(name="U 1.40 Dbl LoE", materials=windowmat_11)  # -> constr; plug-in component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
decnstrconstr_11 = HBDeconstructConstruction(constr=windowconstr_11)  # -> materials, layers, r_val_si, r_val_ip, u_fac_si, u_fac_ip, shgc, t_sol, t_vis; plug-in component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
panel_103 = Panel([decnstrconstr_11.r_val_si, decnstrconstr_11.u_fac_si, decnstrconstr_11.shgc, decnstrconstr_11.t_sol, decnstrconstr_11.t_vis])
subfacesubset_11 = HBSubfaceSubset(window=windowconstr_11, skylight=windowconstr_11, operable=windowconstr_11, glass_door=windowconstr_11)  # -> subface_set; plug-in component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

# ----
# R6AB
opaquemat_456 = HBOpaqueMaterial(name="ExternalPlaster", thickness=".020", conductivity="0.900", density="1800", spec_heat="1000", roughness="Rough")  # -> mat; plug-in component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

opaquemat_457 = HBOpaqueMaterial(
    name="InternalPlaster",
    thickness="0.020",
    conductivity="0.700",
    density="1400",
    spec_heat="1000",
    roughness="MediumSmooth")  # -> mat; plug-in component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

opaquemat_458 = HBOpaqueMaterial(name="CeramicTile", thickness="0.015", conductivity="1.470", density="1700", spec_heat="1000", roughness="MediumSmooth")  # -> mat; plug-in component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

opaquemat_459 = HBOpaqueMaterial(name="CementMortar", thickness="0.020", conductivity="1.400", density="2000", spec_heat="1000", roughness="Rough")  # -> mat; plug-in component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

opaquemat_460 = HBOpaqueMaterial(name="LtwtConcScreed_2cm", thickness=".020", conductivity=".580", density="400", spec_heat="1000", roughness="Rough")  # -> mat; plug-in component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

opaquemat_461 = HBOpaqueMaterial(
    name="InsulationPanel",
    thickness="0.0185",
    conductivity="0.045",
    density="30",
    spec_heat="1220",
    roughness="MediumSmooth")  # -> mat; plug-in component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

opaquemat_462 = HBOpaqueMaterial(name="CementMortar", thickness="0.020", conductivity="1.400", density="2000", spec_heat="1000", roughness="Rough")  # -> mat; plug-in component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

opaquemat_463 = HBOpaqueMaterial(
    name="InternalPlaster",
    thickness=".020",
    conductivity="0.700",
    density="1400",
    spec_heat="1000",
    roughness="MediumSmooth")  # -> mat; plug-in component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

opaquematnomass_42 = HBOpaqueMaterialNoMass(name="FictitiousLayer_R0.3", r_value="0.3")  # -> mat; plug-in component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

opaquemat_464 = HBOpaqueMaterial(
    name="Slab_BrickBlkConc_16cm",
    thickness=".160",
    conductivity="0.560",
    density="900",
    spec_heat="1000",
    roughness="Rough")  # -> mat; plug-in component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

opaquemat_465 = HBOpaqueMaterial(name="HollowBrick_8cm", thickness="0.080", conductivity="0.400", density="800", spec_heat="1000", roughness="Rough")  # -> mat; plug-in component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

opaquemat_466 = HBOpaqueMaterial(
    name="Slab_BrickBlkConc_16cm",
    thickness=".160",
    conductivity="0.560",
    density="900",
    spec_heat="1000",
    roughness="Rough")  # -> mat; plug-in component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

opaquemat_467 = HBOpaqueMaterial(name="LtwtConcScreed_2cm", thickness=".020", conductivity=".580", density="400", spec_heat="1000", roughness="Rough")  # -> mat; plug-in component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

opaquematnomass_43 = HBOpaqueMaterialNoMass(name="FictitiousLayer_R0.3", r_value="0.3")  # -> mat; plug-in component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

opaquemat_468 = HBOpaqueMaterial(name="CementMortar", thickness="0.020", conductivity="1.400", density="2000", spec_heat="1000", roughness="Rough")  # -> mat; plug-in component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

opaquemat_469 = HBOpaqueMaterial(name="LtwtConcScreed_2cm", thickness=".020", conductivity=".580", density="400", spec_heat="1000", roughness="Rough")  # -> mat; plug-in component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

opaquemat_470 = HBOpaqueMaterial(name="SemiSolidBrick_25cm", thickness="0.250", conductivity="0.400", density="1000", spec_heat="1000", roughness="Rough")  # -> mat; plug-in component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

opaquemat_471 = HBOpaqueMaterial(
    name="InternalPlaster",
    thickness="0.020",
    conductivity="0.700",
    density="1400",
    spec_heat="1000",
    roughness="MediumSmooth")  # -> mat; plug-in component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

opaquemat_472 = HBOpaqueMaterial(name="ExternalPlaster", thickness=".020", conductivity="0.900", density="1800", spec_heat="1000", roughness="Rough")  # -> mat; plug-in component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

opaquemat_473 = HBOpaqueMaterial(
    name="InsulationPanel",
    thickness="0.017",
    conductivity="0.045",
    density="30",
    spec_heat="1220",
    roughness="MediumSmooth")  # -> mat; plug-in component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

opaquemat_474 = HBOpaqueMaterial(
    name="InternalPlaster",
    thickness="0.020",
    conductivity="0.700",
    density="1400",
    spec_heat="1000",
    roughness="MediumSmooth")  # -> mat; plug-in component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

opaquemat_475 = HBOpaqueMaterial(
    name="InternalPlaster_Thin",
    thickness="0.010",
    conductivity="0.700",
    density="1400",
    spec_heat="1000",
    roughness="MediumSmooth")  # -> mat; plug-in component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

opaquemat_476 = HBOpaqueMaterial(
    name="ConcretePanel_Prefab",
    thickness="0.160",
    conductivity="0.580",
    density="1400",
    spec_heat="1000",
    roughness="Rough")  # -> mat; plug-in component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

opaquemat_477 = HBOpaqueMaterial(name="CeramicTile", thickness="0.015", conductivity="1.470", density="1700", spec_heat="1000", roughness="MediumSmooth")  # -> mat; plug-in component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

opaquemat_478 = HBOpaqueMaterial(name="InsulatedCavity", thickness="0.0124", conductivity="0.045", density="30", spec_heat="570", roughness="Rough")  # -> mat; plug-in component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

opaquemat_479 = HBOpaqueMaterial(
    name="InternalPlaster_Thin",
    thickness="0.010",
    conductivity="0.700",
    density="1400",
    spec_heat="1000",
    roughness="MediumSmooth")  # -> mat; plug-in component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

opaquemat_480 = HBOpaqueMaterial(name="CeramicTile", thickness="0.015", conductivity="1.470", density="1700", spec_heat="1000", roughness="MediumSmooth")  # -> mat; plug-in component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

opaquemat_481 = HBOpaqueMaterial(
    name="Slab_BrickBlkConc_16cm",
    thickness=".160",
    conductivity="0.560",
    density="900",
    spec_heat="1000",
    roughness="Rough")  # -> mat; plug-in component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

opaquemat_482 = HBOpaqueMaterial(name="CementMortar", thickness="0.020", conductivity="1.400", density="2000", spec_heat="1000", roughness="Rough")  # -> mat; plug-in component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

opaquemat_483 = HBOpaqueMaterial(name="CementMortar", thickness="0.020", conductivity="1.400", density="2000", spec_heat="1000", roughness="Rough")  # -> mat; plug-in component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

opaquemat_484 = HBOpaqueMaterial(name="CementMortar", thickness="0.020", conductivity="1.400", density="2000", spec_heat="1000", roughness="Rough")  # -> mat; plug-in component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

opaquemat_485 = HBOpaqueMaterial(
    name="Slab_BrickBlkConc_16cm",
    thickness=".160",
    conductivity="0.560",
    density="900",
    spec_heat="1000",
    roughness="Rough")  # -> mat; plug-in component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

opaquemat_486 = HBOpaqueMaterial(name="CementMortar", thickness="0.020", conductivity="1.400", density="2000", spec_heat="1000", roughness="Rough")  # -> mat; plug-in component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

opaquemat_487 = HBOpaqueMaterial(name="LtwtConcScreed_2cm", thickness=".020", conductivity=".580", density="400", spec_heat="1000", roughness="Rough")  # -> mat; plug-in component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

opaquemat_488 = HBOpaqueMaterial(name="CementMortar", thickness="0.020", conductivity="1.400", density="2000", spec_heat="1000", roughness="Rough")  # -> mat; plug-in component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

opaquematnomass_44 = HBOpaqueMaterialNoMass(name="FictitiousLayer_R0.3", r_value="0.3")  # -> mat; plug-in component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

opaquemat_489 = HBOpaqueMaterial(name="CeramicTile", thickness="0.015", conductivity="1.470", density="1700", spec_heat="1000", roughness="MediumSmooth")  # -> mat; plug-in component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

opaquemat_490 = HBOpaqueMaterial(name="LtwtConcScreed_2cm", thickness=".020", conductivity=".580", density="400", spec_heat="1000", roughness="Rough")  # -> mat; plug-in component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

opaquemat_491 = HBOpaqueMaterial(
    name="InsulationPanel",
    thickness="0.017",
    conductivity="0.045",
    density="30",
    spec_heat="1220",
    roughness="MediumSmooth")  # -> mat; plug-in component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

opaquematnomass_45 = HBOpaqueMaterialNoMass(name="FictitiousLayer_R0.3", r_value="0.3")  # -> mat; plug-in component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

opaquemat_492 = HBOpaqueMaterial(name="LtwtConcScreed_2cm", thickness=".020", conductivity=".580", density="400", spec_heat="1000", roughness="Rough")  # -> mat; plug-in component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

opaquemat_493 = HBOpaqueMaterial(name="CementMortar", thickness="0.020", conductivity="1.400", density="2000", spec_heat="1000", roughness="Rough")  # -> mat; plug-in component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

opaquemat_494 = HBOpaqueMaterial(
    name="Slab_BrickBlkConc_16cm",
    thickness=".160",
    conductivity="0.560",
    density="900",
    spec_heat="1000",
    roughness="Rough")  # -> mat; plug-in component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

opaquemat_495 = HBOpaqueMaterial(name="ExternalPlaster", thickness=".020", conductivity="0.900", density="1800", spec_heat="1000", roughness="Rough")  # -> mat; plug-in component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

opaquemat_496 = HBOpaqueMaterial(name="CementMortar", thickness="0.020", conductivity="1.400", density="2000", spec_heat="1000", roughness="Rough")  # -> mat; plug-in component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

opaquemat_497 = HBOpaqueMaterial(name="SolidBrick", thickness=".382", conductivity="0.720", density="1800", spec_heat="1000", roughness="Rough")  # -> mat; plug-in component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

opaquemat_498 = HBOpaqueMaterial(name="CeramicTile", thickness="0.015", conductivity="1.470", density="1700", spec_heat="1000", roughness="MediumSmooth")  # -> mat; plug-in component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

opaquemat_499 = HBOpaqueMaterial(name="ExternalPlaster", thickness=".020", conductivity="0.900", density="1800", spec_heat="1000", roughness="Rough")  # -> mat; plug-in component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

opaquemat_500 = HBOpaqueMaterial(
    name="InsulationPanel",
    thickness="0.017",
    conductivity="0.045",
    density="30",
    spec_heat="1220",
    roughness="MediumSmooth")  # -> mat; plug-in component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

opaquemat_501 = HBOpaqueMaterial(
    name="Slab_BrickBlkConc_16cm",
    thickness=".160",
    conductivity="0.560",
    density="900",
    spec_heat="1000",
    roughness="Rough")  # -> mat; plug-in component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

opaquemat_502 = HBOpaqueMaterial(name="CementMortar", thickness="0.020", conductivity="1.400", density="2000", spec_heat="1000", roughness="Rough")  # -> mat; plug-in component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

# ----
# Hard code window
# U 1.40, g 0.35, VT 0.55
panel_104 = Panel("0.55")
windowmat_12 = HBWindowMaterial(name="U 1.40 Dbl LoE", u_factor="1.40", shgc="0.35", t_vis=panel_104)  # -> mat; plug-in component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
windowconstr_12 = HBWindowConstruction(name="U 1.40 Dbl LoE", materials=windowmat_12)  # -> constr; plug-in component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
decnstrconstr_12 = HBDeconstructConstruction(constr=windowconstr_12)  # -> materials, layers, r_val_si, r_val_ip, u_fac_si, u_fac_ip, shgc, t_sol, t_vis; plug-in component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
panel_105 = Panel([decnstrconstr_12.r_val_si, decnstrconstr_12.u_fac_si, decnstrconstr_12.shgc, decnstrconstr_12.t_sol, decnstrconstr_12.t_vis])
subfacesubset_12 = HBSubfaceSubset(window=windowconstr_12, skylight=windowconstr_12, operable=windowconstr_12, glass_door=windowconstr_12)  # -> subface_set; plug-in component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

merge_81 = Merge(Data1=opaquemat_431, Data2=opaquemat_432, Data3=opaquemat_438)
opaqueconstr_91 = HBOpaqueConstruction(name="Wall_06.03_Interior", materials=merge_81)  # -> constr; plug-in component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

merge_82 = Merge(
    Data1=opaquemat_401,
    Data2=opaquemat_403,
    Data3=opaquemat_434,
    Data4=opaquemat_419,
    Data5=opaquemat_415,
    Data6=opaquemat_411,
    Data7=opaquemat_414)
opaqueconstr_92 = HBOpaqueConstruction(name="Wall_06.03", materials=merge_82)  # -> constr; plug-in component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

merge_83 = Merge(
    Data1=opaquematnomass_41,
    Data2=opaquemat_399,
    Data3=opaquemat_420,
    Data4=opaquemat_413,
    Data5=opaquemat_416,
    Data6=opaquemat_417,
    Data7=opaquemat_421)
opaqueconstr_93 = HBOpaqueConstruction(name="Ceiling_06.01", materials=merge_83)  # -> constr; plug-in component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

merge_84 = Merge(
    Data1=opaquemat_445,
    Data2=opaquemat_441,
    Data3=opaquemat_446,
    Data4=opaquemat_444,
    Data5=opaquemat_442,
    Data6=opaquemat_430)
opaqueconstr_94 = HBOpaqueConstruction(name="Floor_06.01b_IntClg", materials=merge_84)  # -> constr; plug-in component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

merge_85 = Merge(
    Data1=opaquemat_455,
    Data2=opaquemat_454,
    Data3=opaquemat_450,
    Data4=opaquemat_447,
    Data5=opaquemat_451,
    Data6=opaquemat_452,
    Data7=opaquemat_453,
    Data8=opaquemat_402)
opaqueconstr_95 = HBOpaqueConstruction(name="Floor_06.01b_GRroof", materials=merge_85)  # -> constr; plug-in component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

merge_86 = Merge(
    Data1=opaquemat_402,
    Data2=opaquemat_439,
    Data3=opaquemat_448,
    Data4=opaquemat_449,
    Data5=opaquemat_440,
    Data6=opaquemat_426,
    Data7=opaquemat_423,
    Data8=opaquemat_418)
opaqueconstr_96 = HBOpaqueConstruction(name="Floor_06.01b_GRfloor", materials=merge_86)  # -> constr; plug-in component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

# ----
# Ground Subset -
# same as interior floors,
# ground & roof must be inverse.
# 
# Base ground & roof construction
# on exterior floor for same archetype
# Make this same thickness as W1
panel_106 = Panel("Wall_06.03_UGwall")
opaqueconstr_97 = HBOpaqueConstruction(name=panel_106, materials=opaquemat_435)  # -> constr; plug-in component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
groundsubset_11 = HBGroundConstructionSubset(ground_wall=opaqueconstr_97, ground_roof=opaqueconstr_95, ground_floor=opaqueconstr_96)  # -> ground_set; plug-in component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
decnstrmat_21 = HBDeconstructMaterial(mat=groundsubset_11)  # -> values, attr_names, r_val_si, r_val_ip; plug-in component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
panel_107 = Panel(groundsubset_11)
panel_108 = Panel(decnstrmat_21.r_val_si)

merge_87 = Merge(Data1=opaquemat_475, Data2=opaquemat_476, Data3=opaquemat_479)
opaqueconstr_98 = HBOpaqueConstruction(name="Wall_06.05_Interior", materials=merge_87)  # -> constr; plug-in component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

merge_88 = Merge(
    Data1=opaquemat_406,
    Data2=opaquemat_407,
    Data3=opaquemat_456,
    Data4=opaquemat_470,
    Data5=opaquemat_478,
    Data6=opaquemat_465,
    Data7=opaquemat_457)
opaqueconstr_99 = HBOpaqueConstruction(name="Wall_06.02", materials=merge_88)  # -> constr; plug-in component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

merge_89 = Merge(
    Data1=opaquemat_400,
    Data2=opaquemat_424,
    Data3=opaquemat_436,
    Data4=opaquemat_437,
    Data5=opaquemat_427,
    Data6=opaquemat_412,
    Data7=opaquemat_410,
    Data8=opaquemat_409)
opaqueconstr_100 = HBOpaqueConstruction(name="Floor_06.01b", materials=merge_89)  # -> constr; plug-in component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

merge_90 = Merge(
    Data1=opaquemat_422,
    Data2=opaquemat_425,
    Data3=opaquemat_428,
    Data4=opaquemat_429,
    Data5=opaquemat_443,
    Data6=opaquemat_433)
opaqueconstr_101 = HBOpaqueConstruction(name="Floor_06.01b_IntFlr", materials=merge_90)  # -> constr; plug-in component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

merge_91 = Merge(
    Data1=opaquematnomass_42,
    Data2=opaquemat_404,
    Data3=opaquemat_467,
    Data4=opaquemat_461,
    Data5=opaquemat_462,
    Data6=opaquemat_466,
    Data7=opaquemat_471)
opaqueconstr_102 = HBOpaqueConstruction(name="Ceiling_06.01", materials=merge_91)  # -> constr; plug-in component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

merge_92 = Merge(
    Data1=opaquemat_489,
    Data2=opaquemat_483,
    Data3=opaquemat_490,
    Data4=opaquemat_488,
    Data5=opaquemat_485,
    Data6=opaquemat_474)
opaqueconstr_103 = HBOpaqueConstruction(name="Floor_06.01_IntClg", materials=merge_92)  # -> constr; plug-in component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

merge_93 = Merge(
    Data1=opaquemat_498,
    Data2=opaquemat_496,
    Data3=opaquemat_492,
    Data4=opaquemat_491,
    Data5=opaquemat_493,
    Data6=opaquemat_494,
    Data7=opaquemat_495,
    Data8=opaquemat_405,
    Data9=opaquematnomass_45)
opaqueconstr_104 = HBOpaqueConstruction(name="Floor_06.01_GRroof", materials=merge_93)  # -> constr; plug-in component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

merge_94 = Merge(
    Data1=opaquematnomass_44,
    Data2=opaquemat_405,
    Data3=opaquemat_499,
    Data4=opaquemat_501,
    Data5=opaquemat_502,
    Data6=opaquemat_500,
    Data7=opaquemat_487,
    Data8=opaquemat_484,
    Data9=opaquemat_480)
opaqueconstr_105 = HBOpaqueConstruction(name="Floor_06.01_GRfloor", materials=merge_94)  # -> constr; plug-in component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

# ----
# Ground Subset -
# same as interior floors,
# ground & roof must be inverse.
# 
# Base ground & roof construction
# on exterior floor for same archetype
# Make this same thickness as W1
panel_109 = Panel("Wall_06.02_UGwall")
opaqueconstr_106 = HBOpaqueConstruction(name=panel_109, materials=opaquemat_497)  # -> constr; plug-in component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
groundsubset_12 = HBGroundConstructionSubset(ground_wall=opaqueconstr_106, ground_roof=opaqueconstr_104, ground_floor=opaqueconstr_105)  # -> ground_set; plug-in component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