# Grasshopper definition 04_Digital Building Library_nZEB_THSF archetypes.gh (Grasshopper 1.0.8)

opaquemat = HBOpaqueMaterial(name="GypsumBoard", thickness=".0125", conductivity="0.160", density="772", spec_heat="1090", roughness="MediumSmooth")  # -> mat; plug-in component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

opaquemat_2 = HBOpaqueMaterial(name="WallInsul_MW_Int", thickness=".120", conductivity="0.033", density="70", spec_heat="1030", roughness="Rough")  # -> mat; plug-in component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

opaquemat_3 = HBOpaqueMaterial(
    name="RoofInsul_MW_ExtSheets",
    thickness=".160",
    conductivity="0.036",
    density="140",
    spec_heat="1030",
    roughness="Rough")  # -> mat; plug-in component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

opaquemat_4 = HBOpaqueMaterial(name="FloorInsul_MW", thickness=".120", conductivity="0.034", density="80", spec_heat="1030", roughness="Rough")  # -> mat; plug-in component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

opaquemat_5 = HBOpaqueMaterial(name="GypsumBoard", thickness=".0125", conductivity="0.160", density="772", spec_heat="1090", roughness="MediumSmooth")  # -> mat; plug-in component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

opaquemat_6 = HBOpaqueMaterial(name="WallInsul_MW_Int", thickness=".120", conductivity="0.033", density="70", spec_heat="1030", roughness="Rough")  # -> mat; plug-in component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

opaquemat_7 = HBOpaqueMaterial(name="FloorInsul_MW", thickness=".120", conductivity="0.034", density="80", spec_heat="1030", roughness="Rough")  # -> mat; plug-in component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

opaquemat_8 = HBOpaqueMaterial(
    name="RoofInsul_MW_ExtSheets",
    thickness=".160",
    conductivity="0.036",
    density="140",
    spec_heat="1030",
    roughness="Rough")  # -> mat; plug-in component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

opaquemat_9 = HBOpaqueMaterial(name="Brick&Stone", thickness="0.360", conductivity="0.900", density="2000", spec_heat="1000", roughness="Rough")  # -> mat; plug-in component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

opaquemat_10 = HBOpaqueMaterial(
    name="InternalPlaster",
    thickness="0.020",
    conductivity="0.700",
    density="1400",
    spec_heat="1000",
    roughness="MediumSmooth")  # -> mat; plug-in component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

opaquemat_11 = HBOpaqueMaterial(
    name="InternalPlaster",
    thickness="0.020",
    conductivity="0.700",
    density="1400",
    spec_heat="1000",
    roughness="MediumSmooth")  # -> mat; plug-in component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

opaquemat_12 = HBOpaqueMaterial(name="CeramicTile", thickness="0.015", conductivity="1.470", density="1700", spec_heat="1000", roughness="MediumSmooth")  # -> mat; plug-in component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

opaquemat_13 = HBOpaqueMaterial(
    name="InternalPlaster",
    thickness="0.020",
    conductivity="0.700",
    density="1400",
    spec_heat="1000",
    roughness="MediumSmooth")  # -> mat; plug-in component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

opaquemat_14 = HBOpaqueMaterial(name="CementMortar", thickness="0.020", conductivity="1.400", density="2000", spec_heat="1000", roughness="Rough")  # -> mat; plug-in component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

opaquemat_15 = HBOpaqueMaterial(
    name="InternalPlaster",
    thickness="0.020",
    conductivity="0.700",
    density="1400",
    spec_heat="1000",
    roughness="MediumSmooth")  # -> mat; plug-in component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

opaquemat_16 = HBOpaqueMaterial(name="SolidBrick", thickness="0.233", conductivity="0.720", density="1800", spec_heat="1000", roughness="Rough")  # -> mat; plug-in component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

opaquemat_17 = HBOpaqueMaterial(name="SolidBrick", thickness="0.233", conductivity="0.720", density="1800", spec_heat="1000", roughness="Rough")  # -> mat; plug-in component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

opaquemat_18 = HBOpaqueMaterial(name="CeramicTile", thickness="0.015", conductivity="1.470", density="1700", spec_heat="1000", roughness="MediumSmooth")  # -> mat; plug-in component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

opaquemat_19 = HBOpaqueMaterial(
    name="InternalPlaster",
    thickness="0.020",
    conductivity="0.700",
    density="1400",
    spec_heat="1000",
    roughness="MediumSmooth")  # -> mat; plug-in component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

opaquemat_20 = HBOpaqueMaterial(name="Brick&Stone", thickness="0.360", conductivity="0.900", density="2000", spec_heat="1000", roughness="Rough")  # -> mat; plug-in component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

opaquemat_21 = HBOpaqueMaterial(name="CementMortar", thickness="0.020", conductivity="1.400", density="2000", spec_heat="1000", roughness="Rough")  # -> mat; plug-in component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

opaquemat_22 = HBOpaqueMaterial(
    name="InternalPlaster",
    thickness="0.020",
    conductivity="0.700",
    density="1400",
    spec_heat="1000",
    roughness="MediumSmooth")  # -> mat; plug-in component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

opaquemat_23 = HBOpaqueMaterial(
    name="InternalPlaster",
    thickness="0.020",
    conductivity="0.700",
    density="1400",
    spec_heat="1000",
    roughness="MediumSmooth")  # -> mat; plug-in component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

opaquemat_24 = HBOpaqueMaterial(name="CeramicTile", thickness="0.015", conductivity="1.470", density="1700", spec_heat="1000", roughness="MediumSmooth")  # -> mat; plug-in component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

opaquemat_25 = HBOpaqueMaterial(name="CementMortar", thickness="0.020", conductivity="1.400", density="2000", spec_heat="1000", roughness="Rough")  # -> mat; plug-in component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

opaquemat_26 = HBOpaqueMaterial(
    name="InternalPlaster",
    thickness="0.020",
    conductivity="0.700",
    density="1400",
    spec_heat="1000",
    roughness="MediumSmooth")  # -> mat; plug-in component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

opaquemat_27 = HBOpaqueMaterial(name="SolidBrick", thickness=".400", conductivity="0.720", density="1800", spec_heat="1000", roughness="Rough")  # -> mat; plug-in component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

opaquemat_28 = HBOpaqueMaterial(name="SolidBrick", thickness="0.233", conductivity="0.720", density="1800", spec_heat="1000", roughness="Rough")  # -> mat; plug-in component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

opaquemat_29 = HBOpaqueMaterial(name="CeramicTile", thickness="0.015", conductivity="1.470", density="1700", spec_heat="1000", roughness="MediumSmooth")  # -> mat; plug-in component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

opaquemat_30 = HBOpaqueMaterial(name="CementMortar_Thick", thickness="0.030", conductivity="1.400", density="2000", spec_heat="1000", roughness="Rough")  # -> mat; plug-in component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

opaquemat_31 = HBOpaqueMaterial(name="SolidBrick", thickness="0.233", conductivity="0.720", density="1800", spec_heat="1000", roughness="Rough")  # -> mat; plug-in component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

opaquemat_32 = HBOpaqueMaterial(name="CeramicTile", thickness="0.015", conductivity="1.470", density="1700", spec_heat="1000", roughness="MediumSmooth")  # -> mat; plug-in component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

opaquemat_33 = HBOpaqueMaterial(name="Concrete_Reg", thickness="0.100", conductivity="1.160", density="2000", spec_heat="1000", roughness="Rough")  # -> mat; plug-in component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

opaquemat_34 = HBOpaqueMaterial(name="CementMortar", thickness="0.020", conductivity="1.400", density="2000", spec_heat="1000", roughness="Rough")  # -> mat; plug-in component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

opaquemat_35 = HBOpaqueMaterial(name="GravelRiverStone", thickness=".147", conductivity="1.200", density="1700", spec_heat="1000", roughness="VeryRough")  # -> mat; plug-in component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

opaquemat_36 = HBOpaqueMaterial(name="ExternalPlaster", thickness=".020", conductivity="0.900", density="1800", spec_heat="1000", roughness="Rough")  # -> mat; plug-in component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

opaquemat_37 = HBOpaqueMaterial(name="CeramicTile", thickness="0.015", conductivity="1.470", density="1700", spec_heat="1000", roughness="MediumSmooth")  # -> mat; plug-in component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

opaquemat_38 = HBOpaqueMaterial(name="ExternalPlaster", thickness=".020", conductivity="0.900", density="1800", spec_heat="1000", roughness="Rough")  # -> mat; plug-in component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

opaquemat_39 = HBOpaqueMaterial(name="CementMortar", thickness="0.020", conductivity="1.400", density="2000", spec_heat="1000", roughness="Rough")  # -> mat; plug-in component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

opaquemat_40 = HBOpaqueMaterial(name="SolidBrick", thickness="0.233", conductivity="0.720", density="1800", spec_heat="1000", roughness="Rough")  # -> mat; plug-in component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

opaquemat_41 = HBOpaqueMaterial(name="CeramicTile", thickness="0.015", conductivity="1.470", density="1700", spec_heat="1000", roughness="MediumSmooth")  # -> mat; plug-in component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

opaquemat_42 = HBOpaqueMaterial(name="SolidBrick", thickness="0.233", conductivity="0.720", density="1800", spec_heat="1000", roughness="Rough")  # -> mat; plug-in component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

opaquemat_43 = HBOpaqueMaterial(name="CementMortar", thickness="0.020", conductivity="1.400", density="2000", spec_heat="1000", roughness="Rough")  # -> mat; plug-in component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

opaquemat_44 = HBOpaqueMaterial(name="ExternalPlaster", thickness=".020", conductivity="0.900", density="1800", spec_heat="1000", roughness="Rough")  # -> mat; plug-in component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

opaquemat_45 = HBOpaqueMaterial(name="WoodPlanking", thickness="0.063", conductivity="0.150", density="550", spec_heat="1600", roughness="Rough")  # -> mat; plug-in component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

opaquemat_46 = HBOpaqueMaterial(name="SolidBrick", thickness="0.233", conductivity="0.720", density="1800", spec_heat="1000", roughness="Rough")  # -> mat; plug-in component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

opaquemat_47 = HBOpaqueMaterial(name="CeramicTile", thickness="0.015", conductivity="1.470", density="1700", spec_heat="1000", roughness="MediumSmooth")  # -> mat; plug-in component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

opaquemat_48 = HBOpaqueMaterial(name="CementMortar", thickness="0.020", conductivity="1.400", density="2000", spec_heat="1000", roughness="Rough")  # -> mat; plug-in component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

opaquemat_49 = HBOpaqueMaterial(name="SolidBrick", thickness=".400", conductivity="0.720", density="1800", spec_heat="1000", roughness="Rough")  # -> mat; plug-in component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

opaquemat_50 = HBOpaqueMaterial(name="CementMortar_Thick", thickness="0.030", conductivity="1.400", density="2000", spec_heat="1000", roughness="Rough")  # -> mat; plug-in component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

opaquemat_51 = HBOpaqueMaterial(name="Concrete_Reg", thickness="0.100", conductivity="1.160", density="2000", spec_heat="1000", roughness="Rough")  # -> mat; plug-in component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

opaquemat_52 = HBOpaqueMaterial(name="Brick&Stone", thickness="0.360", conductivity="0.900", density="2000", spec_heat="1000", roughness="VeryRough")  # -> mat; plug-in component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

opaquemat_53 = HBOpaqueMaterial(name="CeramicTile", thickness="0.015", conductivity="1.470", density="1700", spec_heat="1000", roughness="MediumSmooth")  # -> mat; plug-in component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

opaquemat_54 = HBOpaqueMaterial(
    name="InternalPlaster",
    thickness="0.020",
    conductivity="0.700",
    density="1400",
    spec_heat="1000",
    roughness="MediumSmooth")  # -> mat; plug-in component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

opaquemat_55 = HBOpaqueMaterial(name="GravelRiverStone", thickness=".147", conductivity="1.200", density="1700", spec_heat="1000", roughness="VeryRough")  # -> mat; plug-in component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

# ----
# R1TH
opaquemat_56 = HBOpaqueMaterial(name="ExternalPlaster", thickness=".020", conductivity="0.900", density="1800", spec_heat="1000", roughness="Rough")  # -> mat; plug-in component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

# ----
# R1SF
opaquemat_57 = HBOpaqueMaterial(name="ExternalPlaster", thickness=".020", conductivity="0.900", density="1800", spec_heat="1000", roughness="Rough")  # -> mat; plug-in component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

opaquemat_58 = HBOpaqueMaterial(
    name="InternalPlaster",
    thickness="0.020",
    conductivity="0.700",
    density="1400",
    spec_heat="1000",
    roughness="MediumSmooth")  # -> mat; plug-in component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

opaquemat_59 = HBOpaqueMaterial(name="Brick&Stone", thickness="0.360", conductivity="0.900", density="2000", spec_heat="1000", roughness="VeryRough")  # -> mat; plug-in component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

opaquemat_60 = HBOpaqueMaterial(name="CeramicTile", thickness="0.015", conductivity="1.470", density="1700", spec_heat="1000", roughness="MediumSmooth")  # -> mat; plug-in component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

opaquemat_61 = HBOpaqueMaterial(name="WoodPlanking", thickness="0.063", conductivity="0.150", density="550", spec_heat="1600", roughness="Rough")  # -> mat; plug-in component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

opaquemat_62 = HBOpaqueMaterial(name="Concrete_Reg", thickness="0.100", conductivity="1.160", density="2000", spec_heat="1000", roughness="Rough")  # -> mat; plug-in component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

opaquemat_63 = HBOpaqueMaterial(name="CementMortar_Thick", thickness="0.030", conductivity="1.400", density="2000", spec_heat="1000", roughness="Rough")  # -> mat; plug-in component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

opaquemat_64 = HBOpaqueMaterial(name="GravelRiverStone", thickness=".147", conductivity="1.200", density="1700", spec_heat="1000", roughness="VeryRough")  # -> mat; plug-in component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

# ----
# Hard code window
# U 1.40, g 0.35, VT 0.55
panel = Panel("0.55")
windowmat = HBWindowMaterial(name="U 1.40 Dbl LoE", u_factor="1.40", shgc="0.35", t_vis=panel)  # -> mat; plug-in component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
windowconstr = HBWindowConstruction(name="U 1.40 Dbl LoE", materials=windowmat)  # -> constr; plug-in component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
decnstrconstr = HBDeconstructConstruction(constr=windowconstr)  # -> materials, layers, r_val_si, r_val_ip, u_fac_si, u_fac_ip, shgc, t_sol, t_vis; plug-in component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
panel_2 = Panel([decnstrconstr.r_val_si, decnstrconstr.u_fac_si, decnstrconstr.shgc, decnstrconstr.t_sol, decnstrconstr.t_vis])
subfacesubset = HBSubfaceSubset(window=windowconstr, skylight=windowconstr, operable=windowconstr, glass_door=windowconstr)  # -> subface_set; plug-in component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

# ----
# Hard code window
# U 1.40, g 0.35, VT 0.55
panel_3 = Panel("0.55")
windowmat_2 = HBWindowMaterial(name="U 1.40 Dbl LoE", u_factor="1.40", shgc="0.35", t_vis=panel_3)  # -> mat; plug-in component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
windowconstr_2 = HBWindowConstruction(name="U 1.40 Dbl LoE", materials=windowmat_2)  # -> constr; plug-in component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
decnstrconstr_2 = HBDeconstructConstruction(constr=windowconstr_2)  # -> materials, layers, r_val_si, r_val_ip, u_fac_si, u_fac_ip, shgc, t_sol, t_vis; plug-in component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
panel_4 = Panel([decnstrconstr_2.r_val_si, decnstrconstr_2.u_fac_si, decnstrconstr_2.shgc, decnstrconstr_2.t_sol, decnstrconstr_2.t_vis])
subfacesubset_2 = HBSubfaceSubset(window=windowconstr_2, skylight=windowconstr_2, operable=windowconstr_2, glass_door=windowconstr_2)  # -> subface_set; plug-in component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

merge = Merge(Data1=opaquemat_12, Data2=opaquemat_14, Data3=opaquemat_16, Data4=opaquemat_15)
opaqueconstr = HBOpaqueConstruction(name="Floor_01.01_IntClg", materials=merge)  # -> constr; plug-in component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

merge_2 = Merge(Data1=opaquemat_24, Data2=opaquemat_25, Data3=opaquemat_28, Data4=opaquemat_26)
opaqueconstr_2 = HBOpaqueConstruction(name="Floor_01.01_IntClg", materials=merge_2)  # -> constr; plug-in component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

merge_3 = Merge(Data1=opaquemat_10, Data2=opaquemat_9, Data3=opaquemat_11)
opaqueconstr_3 = HBOpaqueConstruction(name="Wall_01.03_Interior", materials=merge_3)  # -> constr; plug-in component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

merge_4 = Merge(Data1=opaquemat_35, Data2=opaquemat_33, Data3=opaquemat_30, Data4=opaquemat_29)
opaqueconstr_4 = HBOpaqueConstruction(name="Floor_01.04_GRfloor", materials=merge_4)  # -> constr; plug-in component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

merge_5 = Merge(Data1=opaquemat_19, Data2=opaquemat_20, Data3=opaquemat_22)
opaqueconstr_5 = HBOpaqueConstruction(name="Wall_01.03_Interior", materials=merge_5)  # -> constr; plug-in component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

merge_6 = Merge(Data1=opaquemat_3, Data2=opaquemat_45)
opaqueconstr_6 = HBOpaqueConstruction(name="Roof_01.01", materials=merge_6)  # -> constr; plug-in component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

merge_7 = Merge(Data1=opaquemat_13, Data2=opaquemat_17, Data3=opaquemat_21, Data4=opaquemat_18)
opaqueconstr_7 = HBOpaqueConstruction(name="Floor_01.01_IntFlr", materials=merge_7)  # -> constr; plug-in component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

merge_8 = Merge(Data1=opaquemat_8, Data2=opaquemat_61)
opaqueconstr_8 = HBOpaqueConstruction(name="Roof_01.01", materials=merge_8)  # -> constr; plug-in component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

merge_9 = Merge(Data1=opaquemat_47, Data2=opaquemat_50, Data3=opaquemat_51, Data4=opaquemat_55)
opaqueconstr_9 = HBOpaqueConstruction(name="Floor_01.04_GRroof", materials=merge_9)  # -> constr; plug-in component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

# ----
# Ground Subset -
# same as interior floors,
# ground & roof must be inverse.
# 
# Base ground & roof construction
# on exterior floor for same archetype
# Make this same thickness as W1
panel_5 = Panel("Wall_01.03_UGwall")
opaqueconstr_10 = HBOpaqueConstruction(name=panel_5, materials=opaquemat_27)  # -> constr; plug-in component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
groundsubset = HBGroundConstructionSubset(ground_wall=opaqueconstr_10, ground_roof=opaqueconstr_9, ground_floor=opaqueconstr_4)  # -> ground_set; plug-in component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
decnstrmat = HBDeconstructMaterial(mat=groundsubset)  # -> values, attr_names, r_val_si, r_val_ip; plug-in component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
panel_6 = Panel(groundsubset)
panel_7 = Panel(decnstrmat.r_val_si)

merge_10 = Merge(Data1=opaquemat_7, Data2=opaquemat_44, Data3=opaquemat_46, Data4=opaquemat_48, Data5=opaquemat_53)
opaqueconstr_11 = HBOpaqueConstruction(name="Floor_01.01_GRfloor", materials=merge_10)  # -> constr; plug-in component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

merge_11 = Merge(Data1=opaquemat_23, Data2=opaquemat_31, Data3=opaquemat_34, Data4=opaquemat_32)
opaqueconstr_12 = HBOpaqueConstruction(name="Floor_01.01_IntFlr", materials=merge_11)  # -> constr; plug-in component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

merge_12 = Merge(Data1=opaquemat_41, Data2=opaquemat_43, Data3=opaquemat_42, Data4=opaquemat_36, Data5=opaquemat_7)
opaqueconstr_13 = HBOpaqueConstruction(name="Floor_01.01_GRroof", materials=merge_12)  # -> constr; plug-in component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

# ----
# Ground Subset -
# same as interior floors,
# ground & roof must be inverse.
# 
# Base ground & roof construction
# on exterior floor for same archetype
# Make this same thickness as W1
panel_8 = Panel("Wall_01.03_UGwall")
opaqueconstr_14 = HBOpaqueConstruction(name=panel_8, materials=opaquemat_49)  # -> constr; plug-in component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
groundsubset_2 = HBGroundConstructionSubset(ground_wall=opaqueconstr_14, ground_roof=opaqueconstr_13, ground_floor=opaqueconstr_11)  # -> ground_set; plug-in component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
decnstrmat_2 = HBDeconstructMaterial(mat=groundsubset_2)  # -> values, attr_names, r_val_si, r_val_ip; plug-in component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
panel_9 = Panel(groundsubset_2)
panel_10 = Panel(decnstrmat_2.r_val_si)

merge_13 = Merge(Data1=opaquemat_56, Data2=opaquemat_52, Data3=opaquemat_54, Data4=opaquemat_2, Data5=opaquemat)
opaqueconstr_15 = HBOpaqueConstruction(name="Wall_01.03", materials=merge_13)  # -> constr; plug-in component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

merge_14 = Merge(Data1=opaquemat_4, Data2=opaquemat_38, Data3=opaquemat_40, Data4=opaquemat_39, Data5=opaquemat_37)
opaqueconstr_16 = HBOpaqueConstruction(name="Floor_01.01", materials=merge_14)  # -> constr; plug-in component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

merge_15 = Merge(Data1=opaquemat_57, Data2=opaquemat_59, Data3=opaquemat_58, Data4=opaquemat_6, Data5=opaquemat_5)
opaqueconstr_17 = HBOpaqueConstruction(name="Wall_01.03", materials=merge_15)  # -> constr; plug-in component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

merge_16 = Merge(Data1=opaquemat_64, Data2=opaquemat_62, Data3=opaquemat_63, Data4=opaquemat_60)
opaqueconstr_18 = HBOpaqueConstruction(name="Floor_01.04", materials=merge_16)  # -> constr; plug-in component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

# ----
# Exterior Subset
exteriorsubset = HBExteriorConstructionSubset(exterior_wall=opaqueconstr_15, exterior_roof=opaqueconstr_6, exposed_floor=opaqueconstr_16)  # -> exterior_set; plug-in component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
panel_11 = Panel(exteriorsubset)
decnstrmat_3 = HBDeconstructMaterial(mat=exteriorsubset)  # -> values, attr_names, r_val_si, r_val_ip; plug-in component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
panel_12 = Panel(decnstrmat_3.r_val_si)

# ----
# TH & SF
# Library Date Apr 2, 2023
# nZEB as per Decreto Ministeriale
# Hard code windows U1.40, g0.35, VLT0.55
r2th_g0_35winhc = Data("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")
r2sf_g0_35winhc = Data("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")
r3sf_g0_35winhc = Data("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")
r3th_g0_35winhc = Data("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")
r4sf_g0_35winhc = Data("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")
r4th_g0_35winhc = Data("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")
r5sf_g0_35winhc = Data("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")
r5th_g0_35winhc = Data("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")
r6sf_g0_35winhc = Data("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")
r6th_g0_35winhc = Data("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")
r7sf_g0_35winhc = Data("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")
r7th_g0_35winhc = Data("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")
r8sf_g0_35winhc = Data("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")
r8th_g0_35winhc = Data("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")

# ----
# Exterior Subset
exteriorsubset_2 = HBExteriorConstructionSubset(exterior_wall=opaqueconstr_17, exterior_roof=opaqueconstr_8, exposed_floor=opaqueconstr_18)  # -> exterior_set; plug-in component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
panel_13 = Panel(exteriorsubset_2)
decnstrmat_4 = HBDeconstructMaterial(mat=exteriorsubset_2)  # -> values, attr_names, r_val_si, r_val_ip; plug-in component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
panel_14 = Panel(decnstrmat_4.r_val_si)

# ----
# Interior Subset -
# Note interior floors & ceilings must
# be inverse of each other
interiorsubset = HBInteriorConstructionSubset(interior_wall=opaqueconstr_3, ceiling=opaqueconstr, interior_floor=opaqueconstr_7)  # -> interior_set; plug-in component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
panel_15 = Panel(interiorsubset)

# ----
# Interior Subset -
# Note interior floors & ceilings must
# be inverse of each other
interiorsubset_2 = HBInteriorConstructionSubset(interior_wall=opaqueconstr_5, ceiling=opaqueconstr_2, interior_floor=opaqueconstr_12)  # -> interior_set; plug-in component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
panel_16 = Panel(interiorsubset_2)

# ----
# EXPORT TO JSON
panel_17 = Panel("pre_1980::ClimateZone4::Mass")
constructionset = HBConstructionSet(
    name="R1SF_g0.35WinHC",
    base_constr_set=panel_17,
    exterior_subset=exteriorsubset_2,
    ground_subset=groundsubset,
    interior_subset=interiorsubset,
    subface_subset=subfacesubset_2)  # -> constr_set; plug-in component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
objtostr = HBObjectToString(hb_obj=constructionset)  # -> hb_str; plug-in component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

# ----
# EXPORT TO JSON
panel_18 = Panel("pre_1980::ClimateZone4::Mass")
constructionset_2 = HBConstructionSet(
    name="R1TH_g0.35WinHC",
    base_constr_set=panel_18,
    exterior_subset=exteriorsubset,
    ground_subset=groundsubset_2,
    interior_subset=interiorsubset_2,
    subface_subset=subfacesubset)  # -> constr_set; plug-in component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
objtostr_2 = HBObjectToString(hb_obj=constructionset_2)  # -> hb_str; plug-in component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

opaquemat_65 = HBOpaqueMaterial(name="GypsumBoard", thickness=".0125", conductivity="0.160", density="772", spec_heat="1090", roughness="MediumSmooth")  # -> mat; plug-in component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

opaquemat_66 = HBOpaqueMaterial(name="WallInsul_MW_Int", thickness=".120", conductivity="0.033", density="70", spec_heat="1030", roughness="Rough")  # -> mat; plug-in component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

opaquemat_67 = HBOpaqueMaterial(
    name="RoofInsul_MW_ExtSheets",
    thickness=".160",
    conductivity="0.036",
    density="140",
    spec_heat="1030",
    roughness="Rough")  # -> mat; plug-in component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

opaquemat_68 = HBOpaqueMaterial(name="GypsumBoard", thickness=".0125", conductivity="0.160", density="772", spec_heat="1090", roughness="MediumSmooth")  # -> mat; plug-in component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

opaquemat_69 = HBOpaqueMaterial(name="WallInsul_MW_Int", thickness=".120", conductivity="0.033", density="70", spec_heat="1030", roughness="Rough")  # -> mat; plug-in component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

opaquemat_70 = HBOpaqueMaterial(
    name="RoofInsul_MW_ExtSheets",
    thickness=".160",
    conductivity="0.036",
    density="140",
    spec_heat="1030",
    roughness="Rough")  # -> mat; plug-in component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

opaquemat_71 = HBOpaqueMaterial(
    name="InternalPlaster",
    thickness="0.020",
    conductivity="0.700",
    density="1400",
    spec_heat="1000",
    roughness="MediumSmooth")  # -> mat; plug-in component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

opaquemat_72 = HBOpaqueMaterial(name="Brick&Stone", thickness="0.360", conductivity="0.900", density="2000", spec_heat="1000", roughness="Rough")  # -> mat; plug-in component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

# ----
# R2TH
opaquemat_73 = HBOpaqueMaterial(name="ExternalPlaster", thickness=".020", conductivity="0.900", density="1800", spec_heat="1000", roughness="Rough")  # -> mat; plug-in component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

opaquemat_74 = HBOpaqueMaterial(name="CeramicTile", thickness="0.015", conductivity="1.470", density="1700", spec_heat="1000", roughness="MediumSmooth")  # -> mat; plug-in component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

opaquemat_75 = HBOpaqueMaterial(name="Concrete_Reg", thickness="0.100", conductivity="1.160", density="2000", spec_heat="1000", roughness="Rough")  # -> mat; plug-in component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

opaquemat_76 = HBOpaqueMaterial(name="CementMortar_Thick", thickness="0.030", conductivity="1.400", density="2000", spec_heat="1000", roughness="Rough")  # -> mat; plug-in component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

opaquemat_77 = HBOpaqueMaterial(name="GravelRiverStone", thickness=".147", conductivity="1.200", density="1700", spec_heat="1000", roughness="VeryRough")  # -> mat; plug-in component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

opaquemat_78 = HBOpaqueMaterial(name="Brick&Stone", thickness="0.360", conductivity="0.900", density="2000", spec_heat="1000", roughness="Rough")  # -> mat; plug-in component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

opaquemat_79 = HBOpaqueMaterial(
    name="InternalPlaster",
    thickness="0.020",
    conductivity="0.700",
    density="1400",
    spec_heat="1000",
    roughness="MediumSmooth")  # -> mat; plug-in component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

opaquemat_80 = HBOpaqueMaterial(name="CementMortar", thickness="0.020", conductivity="1.400", density="2000", spec_heat="1000", roughness="Rough")  # -> mat; plug-in component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

opaquemat_81 = HBOpaqueMaterial(
    name="InternalPlaster",
    thickness="0.020",
    conductivity="0.700",
    density="1400",
    spec_heat="1000",
    roughness="MediumSmooth")  # -> mat; plug-in component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

opaquemat_82 = HBOpaqueMaterial(
    name="BrickSlabs_ModConductivity",
    thickness=".060",
    conductivity="0.600",
    density="900",
    spec_heat="1000",
    roughness="Rough")  # -> mat; plug-in component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

opaquemat_83 = HBOpaqueMaterial(
    name="InternalPlaster",
    thickness="0.020",
    conductivity="0.700",
    density="1400",
    spec_heat="1000",
    roughness="MediumSmooth")  # -> mat; plug-in component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

opaquemat_84 = HBOpaqueMaterial(name="CeramicTile", thickness="0.015", conductivity="1.470", density="1700", spec_heat="1000", roughness="MediumSmooth")  # -> mat; plug-in component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

opaquemat_85 = HBOpaqueMaterial(
    name="InternalPlaster",
    thickness="0.020",
    conductivity="0.700",
    density="1400",
    spec_heat="1000",
    roughness="MediumSmooth")  # -> mat; plug-in component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

opaquemat_86 = HBOpaqueMaterial(name="WoodDecking", thickness="0.063", conductivity="0.150", density="550", spec_heat="1600", roughness="Rough")  # -> mat; plug-in component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

opaquemat_87 = HBOpaqueMaterial(name="CeramicTile", thickness="0.015", conductivity="1.470", density="1700", spec_heat="1000", roughness="MediumSmooth")  # -> mat; plug-in component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

opaquemat_88 = HBOpaqueMaterial(name="CementMortar", thickness="0.020", conductivity="1.400", density="2000", spec_heat="1000", roughness="Rough")  # -> mat; plug-in component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

opaquemat_89 = HBOpaqueMaterial(
    name="BrickSlabs_ModConductivity",
    thickness=".060",
    conductivity="0.600",
    density="900",
    spec_heat="1000",
    roughness="Rough")  # -> mat; plug-in component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

opaquemat_90 = HBOpaqueMaterial(name="SolidBrick", thickness=".400", conductivity="0.720", density="1800", spec_heat="1000", roughness="Rough")  # -> mat; plug-in component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

opaquemat_91 = HBOpaqueMaterial(name="CeramicTile", thickness="0.015", conductivity="1.470", density="1700", spec_heat="1000", roughness="MediumSmooth")  # -> mat; plug-in component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

opaquemat_92 = HBOpaqueMaterial(
    name="InternalPlaster",
    thickness="0.020",
    conductivity="0.700",
    density="1400",
    spec_heat="1000",
    roughness="MediumSmooth")  # -> mat; plug-in component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

opaquemat_93 = HBOpaqueMaterial(name="Brick&Stone", thickness="0.360", conductivity="0.900", density="2000", spec_heat="1000", roughness="Rough")  # -> mat; plug-in component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

opaquemat_94 = HBOpaqueMaterial(name="CementMortar_Thick", thickness="0.030", conductivity="1.400", density="2000", spec_heat="1000", roughness="Rough")  # -> mat; plug-in component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

opaquemat_95 = HBOpaqueMaterial(name="CementMortar", thickness="0.020", conductivity="1.400", density="2000", spec_heat="1000", roughness="Rough")  # -> mat; plug-in component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

opaquemat_96 = HBOpaqueMaterial(
    name="BrickSlabs_ModConductivity",
    thickness=".060",
    conductivity="0.600",
    density="900",
    spec_heat="1000",
    roughness="Rough")  # -> mat; plug-in component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

opaquemat_97 = HBOpaqueMaterial(
    name="InternalPlaster",
    thickness="0.020",
    conductivity="0.700",
    density="1400",
    spec_heat="1000",
    roughness="MediumSmooth")  # -> mat; plug-in component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

opaquemat_98 = HBOpaqueMaterial(
    name="InternalPlaster",
    thickness="0.020",
    conductivity="0.700",
    density="1400",
    spec_heat="1000",
    roughness="MediumSmooth")  # -> mat; plug-in component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

opaquemat_99 = HBOpaqueMaterial(name="Concrete_Reg", thickness="0.100", conductivity="1.160", density="2000", spec_heat="1000", roughness="Rough")  # -> mat; plug-in component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

opaquemat_100 = HBOpaqueMaterial(
    name="InternalPlaster",
    thickness="0.020",
    conductivity="0.700",
    density="1400",
    spec_heat="1000",
    roughness="MediumSmooth")  # -> mat; plug-in component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

opaquemat_101 = HBOpaqueMaterial(name="CeramicTile", thickness="0.015", conductivity="1.470", density="1700", spec_heat="1000", roughness="MediumSmooth")  # -> mat; plug-in component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

opaquemat_102 = HBOpaqueMaterial(name="CeramicTile", thickness="0.015", conductivity="1.470", density="1700", spec_heat="1000", roughness="MediumSmooth")  # -> mat; plug-in component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

opaquemat_103 = HBOpaqueMaterial(name="GravelRiverStone", thickness=".147", conductivity="1.200", density="1700", spec_heat="1000", roughness="VeryRough")  # -> mat; plug-in component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

opaquemat_104 = HBOpaqueMaterial(name="CementMortar", thickness="0.020", conductivity="1.400", density="2000", spec_heat="1000", roughness="Rough")  # -> mat; plug-in component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

opaquemat_105 = HBOpaqueMaterial(
    name="BrickSlabs_ModConductivity",
    thickness=".060",
    conductivity="0.600",
    density="900",
    spec_heat="1000",
    roughness="Rough")  # -> mat; plug-in component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

opaquemat_106 = HBOpaqueMaterial(name="SolidBrick", thickness=".400", conductivity="0.720", density="1800", spec_heat="1000", roughness="Rough")  # -> mat; plug-in component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

opaquemat_107 = HBOpaqueMaterial(name="CeramicTile", thickness="0.015", conductivity="1.470", density="1700", spec_heat="1000", roughness="MediumSmooth")  # -> mat; plug-in component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

opaquemat_108 = HBOpaqueMaterial(name="CementMortar_Thick", thickness="0.030", conductivity="1.400", density="2000", spec_heat="1000", roughness="Rough")  # -> mat; plug-in component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

opaquemat_109 = HBOpaqueMaterial(name="Concrete_Reg", thickness="0.100", conductivity="1.160", density="2000", spec_heat="1000", roughness="Rough")  # -> mat; plug-in component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

opaquemat_110 = HBOpaqueMaterial(name="GravelRiverStone", thickness=".147", conductivity="1.200", density="1700", spec_heat="1000", roughness="VeryRough")  # -> mat; plug-in component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

opaquemat_111 = HBOpaqueMaterial(name="CeramicTile", thickness="0.015", conductivity="1.470", density="1700", spec_heat="1000", roughness="MediumSmooth")  # -> mat; plug-in component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

opaquemat_112 = HBOpaqueMaterial(name="CementMortar_Thick", thickness="0.030", conductivity="1.400", density="2000", spec_heat="1000", roughness="Rough")  # -> mat; plug-in component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

opaquemat_113 = HBOpaqueMaterial(name="Concrete_Reg", thickness="0.100", conductivity="1.160", density="2000", spec_heat="1000", roughness="Rough")  # -> mat; plug-in component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

opaquemat_114 = HBOpaqueMaterial(name="GravelRiverStone", thickness=".147", conductivity="1.200", density="1700", spec_heat="1000", roughness="VeryRough")  # -> mat; plug-in component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

opaquemat_115 = HBOpaqueMaterial(name="Brick&Stone", thickness="0.360", conductivity="0.900", density="2000", spec_heat="1000", roughness="VeryRough")  # -> mat; plug-in component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

opaquemat_116 = HBOpaqueMaterial(name="CeramicTile", thickness="0.015", conductivity="1.470", density="1700", spec_heat="1000", roughness="MediumSmooth")  # -> mat; plug-in component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

opaquemat_117 = HBOpaqueMaterial(
    name="InternalPlaster",
    thickness="0.020",
    conductivity="0.700",
    density="1400",
    spec_heat="1000",
    roughness="MediumSmooth")  # -> mat; plug-in component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

opaquemat_118 = HBOpaqueMaterial(name="CementMortar_Thick", thickness="0.030", conductivity="1.400", density="2000", spec_heat="1000", roughness="Rough")  # -> mat; plug-in component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

# ----
# R2SF
opaquemat_119 = HBOpaqueMaterial(name="ExternalPlaster", thickness=".020", conductivity="0.900", density="1800", spec_heat="1000", roughness="Rough")  # -> mat; plug-in component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

opaquemat_120 = HBOpaqueMaterial(name="Concrete_Reg", thickness="0.100", conductivity="1.160", density="2000", spec_heat="1000", roughness="Rough")  # -> mat; plug-in component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

opaquemat_121 = HBOpaqueMaterial(name="GravelRiverStone", thickness=".147", conductivity="1.200", density="1700", spec_heat="1000", roughness="VeryRough")  # -> mat; plug-in component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

opaquemat_122 = HBOpaqueMaterial(name="CeramicTile", thickness="0.015", conductivity="1.470", density="1700", spec_heat="1000", roughness="MediumSmooth")  # -> mat; plug-in component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

opaquemat_123 = HBOpaqueMaterial(name="WoodPlanking", thickness="0.063", conductivity="0.150", density="550", spec_heat="1600", roughness="Rough")  # -> mat; plug-in component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

opaquemat_124 = HBOpaqueMaterial(name="Concrete_Reg", thickness="0.100", conductivity="1.160", density="2000", spec_heat="1000", roughness="Rough")  # -> mat; plug-in component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

opaquemat_125 = HBOpaqueMaterial(name="CementMortar_Thick", thickness="0.030", conductivity="1.400", density="2000", spec_heat="1000", roughness="Rough")  # -> mat; plug-in component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

opaquemat_126 = HBOpaqueMaterial(name="GravelRiverStone", thickness=".147", conductivity="1.200", density="1700", spec_heat="1000", roughness="VeryRough")  # -> mat; plug-in component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

# ----
# Hard code window
# U 1.40, g 0.35, VT 0.55
panel_19 = Panel("0.55")
windowmat_3 = HBWindowMaterial(name="U 1.40 Dbl LoE", u_factor="1.40", shgc="0.35", t_vis=panel_19)  # -> mat; plug-in component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
windowconstr_3 = HBWindowConstruction(name="U 1.40 Dbl LoE", materials=windowmat_3)  # -> constr; plug-in component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
decnstrconstr_3 = HBDeconstructConstruction(constr=windowconstr_3)  # -> materials, layers, r_val_si, r_val_ip, u_fac_si, u_fac_ip, shgc, t_sol, t_vis; plug-in component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
panel_20 = Panel([decnstrconstr_3.r_val_si, decnstrconstr_3.u_fac_si, decnstrconstr_3.shgc, decnstrconstr_3.t_sol, decnstrconstr_3.t_vis])
subfacesubset_3 = HBSubfaceSubset(window=windowconstr_3, skylight=windowconstr_3, operable=windowconstr_3, glass_door=windowconstr_3)  # -> subface_set; plug-in component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

# ----
# Hard code window
# U 1.40, g 0.35, VT 0.55
panel_21 = Panel("0.55")
windowmat_4 = HBWindowMaterial(name="U 1.40 Dbl LoE", u_factor="1.40", shgc="0.35", t_vis=panel_21)  # -> mat; plug-in component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
windowconstr_4 = HBWindowConstruction(name="U 1.40 Dbl LoE", materials=windowmat_4)  # -> constr; plug-in component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
decnstrconstr_4 = HBDeconstructConstruction(constr=windowconstr_4)  # -> materials, layers, r_val_si, r_val_ip, u_fac_si, u_fac_ip, shgc, t_sol, t_vis; plug-in component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
panel_22 = Panel([decnstrconstr_4.r_val_si, decnstrconstr_4.u_fac_si, decnstrconstr_4.shgc, decnstrconstr_4.t_sol, decnstrconstr_4.t_vis])
subfacesubset_4 = HBSubfaceSubset(window=windowconstr_4, skylight=windowconstr_4, operable=windowconstr_4, glass_door=windowconstr_4)  # -> subface_set; plug-in component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

merge_17 = Merge(Data1=opaquemat_67, Data2=opaquemat_86)
opaqueconstr_19 = HBOpaqueConstruction(name="Roof_01.01", materials=merge_17)  # -> constr; plug-in component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

merge_18 = Merge(Data1=opaquemat_84, Data2=opaquemat_80, Data3=opaquemat_82, Data4=opaquemat_85)
opaqueconstr_20 = HBOpaqueConstruction(name="Ceiling_02.02_IntClg", materials=merge_18)  # -> constr; plug-in component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

merge_19 = Merge(Data1=opaquemat_101, Data2=opaquemat_95, Data3=opaquemat_96, Data4=opaquemat_98)
opaqueconstr_21 = HBOpaqueConstruction(name="Ceiling_02.02_IntClg", materials=merge_19)  # -> constr; plug-in component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

merge_20 = Merge(Data1=opaquemat_79, Data2=opaquemat_78, Data3=opaquemat_83)
opaqueconstr_22 = HBOpaqueConstruction(name="Wall_01.07_Interior", materials=merge_20)  # -> constr; plug-in component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

merge_21 = Merge(Data1=opaquemat_103, Data2=opaquemat_99, Data3=opaquemat_94, Data4=opaquemat_91)
opaqueconstr_23 = HBOpaqueConstruction(name="Floor_01.04_GRfloor", materials=merge_21)  # -> constr; plug-in component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

merge_22 = Merge(Data1=opaquemat_81, Data2=opaquemat_89, Data3=opaquemat_88, Data4=opaquemat_87)
opaqueconstr_24 = HBOpaqueConstruction(name="Ceiling_02.02_IntFlr", materials=merge_22)  # -> constr; plug-in component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

merge_23 = Merge(Data1=opaquemat_92, Data2=opaquemat_93, Data3=opaquemat_100)
opaqueconstr_25 = HBOpaqueConstruction(name="Wall_01.03_Interior", materials=merge_23)  # -> constr; plug-in component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

merge_24 = Merge(Data1=opaquemat_73, Data2=opaquemat_72, Data3=opaquemat_71, Data4=opaquemat_66, Data5=opaquemat_65)
opaqueconstr_26 = HBOpaqueConstruction(name="Wall_01.03", materials=merge_24)  # -> constr; plug-in component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

merge_25 = Merge(Data1=opaquemat_110, Data2=opaquemat_109, Data4=opaquemat_108, Data5=opaquemat_107)
opaqueconstr_27 = HBOpaqueConstruction(name="Floor_01.04_GRfloor", materials=merge_25)  # -> constr; plug-in component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

merge_26 = Merge(Data1=opaquemat_70, Data2=opaquemat_123)
opaqueconstr_28 = HBOpaqueConstruction(name="Roof_01.01", materials=merge_26)  # -> constr; plug-in component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

merge_27 = Merge(Data1=opaquemat_77, Data2=opaquemat_75, Data3=opaquemat_76, Data4=opaquemat_74)
opaqueconstr_29 = HBOpaqueConstruction(name="Floor_01.04", materials=merge_27)  # -> constr; plug-in component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

merge_28 = Merge(Data1=opaquemat_111, Data2=opaquemat_112, Data3=opaquemat_113, Data4=opaquemat_114)
opaqueconstr_30 = HBOpaqueConstruction(name="Floor_01.04_GRroof", materials=merge_28)  # -> constr; plug-in component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

# ----
# Ground Subset -
# same as interior floors,
# ground & roof must be inverse.
# 
# Base ground & roof construction
# on exterior floor for same archetype
# Make this same thickness as W1
panel_23 = Panel("Wall_01.03_UGwall")
opaqueconstr_31 = HBOpaqueConstruction(name=panel_23, materials=opaquemat_90)  # -> constr; plug-in component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
groundsubset_3 = HBGroundConstructionSubset(ground_wall=opaqueconstr_31, ground_roof=opaqueconstr_30, ground_floor=opaqueconstr_23)  # -> ground_set; plug-in component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
decnstrmat_5 = HBDeconstructMaterial(mat=groundsubset_3)  # -> values, attr_names, r_val_si, r_val_ip; plug-in component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
panel_24 = Panel(groundsubset_3)
panel_25 = Panel(decnstrmat_5.r_val_si)

merge_29 = Merge(Data1=opaquemat_97, Data2=opaquemat_105, Data3=opaquemat_104, Data4=opaquemat_102)
opaqueconstr_32 = HBOpaqueConstruction(name="Ceiling_02.02_IntFlr", materials=merge_29)  # -> constr; plug-in component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

merge_30 = Merge(Data1=opaquemat_116, Data2=opaquemat_118, Data4=opaquemat_120, Data5=opaquemat_121)
opaqueconstr_33 = HBOpaqueConstruction(name="Floor_01.04_GRroof", materials=merge_30)  # -> constr; plug-in component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

# ----
# Ground Subset -
# same as interior floors,
# ground & roof must be inverse.
# 
# Base ground & roof construction
# on exterior floor for same archetype
# Make this same thickness as W1
panel_26 = Panel("Wall_01.03_UGwall")
opaqueconstr_34 = HBOpaqueConstruction(name=panel_26, materials=opaquemat_106)  # -> constr; plug-in component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
groundsubset_4 = HBGroundConstructionSubset(ground_wall=opaqueconstr_34, ground_roof=opaqueconstr_33, ground_floor=opaqueconstr_27)  # -> ground_set; plug-in component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
decnstrmat_6 = HBDeconstructMaterial(mat=groundsubset_4)  # -> values, attr_names, r_val_si, r_val_ip; plug-in component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
panel_27 = Panel(groundsubset_4)
panel_28 = Panel(decnstrmat_6.r_val_si)

merge_31 = Merge(Data1=opaquemat_119, Data2=opaquemat_115, Data3=opaquemat_117, Data4=opaquemat_69, Data5=opaquemat_68)
opaqueconstr_35 = HBOpaqueConstruction(name="Wall_01.03", materials=merge_31)  # -> constr; plug-in component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

merge_32 = Merge(Data1=opaquemat_126, Data2=opaquemat_124, Data4=opaquemat_125, Data5=opaquemat_122)
opaqueconstr_36 = HBOpaqueConstruction(name="Floor_01.04", materials=merge_32)  # -> constr; plug-in component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

# ----
# Exterior Subset
exteriorsubset_3 = HBExteriorConstructionSubset(exterior_wall=opaqueconstr_26, exterior_roof=opaqueconstr_19, exposed_floor=opaqueconstr_29)  # -> exterior_set; plug-in component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
panel_29 = Panel(exteriorsubset_3)
decnstrmat_7 = HBDeconstructMaterial(mat=exteriorsubset_3)  # -> values, attr_names, r_val_si, r_val_ip; plug-in component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
panel_30 = Panel(decnstrmat_7.r_val_si)

# ----
# Interior Subset -
# Note interior floors & ceilings must
# be inverse of each other
interiorsubset_3 = HBInteriorConstructionSubset(interior_wall=opaqueconstr_22, ceiling=opaqueconstr_20, interior_floor=opaqueconstr_24)  # -> interior_set; plug-in component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
panel_31 = Panel(interiorsubset_3)

# ----
# Interior Subset -
# Note interior floors & ceilings must
# be inverse of each other
interiorsubset_4 = HBInteriorConstructionSubset(interior_wall=opaqueconstr_25, ceiling=opaqueconstr_21, interior_floor=opaqueconstr_32)  # -> interior_set; plug-in component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
panel_32 = Panel(interiorsubset_4)

# ----
# Exterior Subset
exteriorsubset_4 = HBExteriorConstructionSubset(exterior_wall=opaqueconstr_35, exterior_roof=opaqueconstr_28, exposed_floor=opaqueconstr_36)  # -> exterior_set; plug-in component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
panel_33 = Panel(exteriorsubset_4)
decnstrmat_8 = HBDeconstructMaterial(mat=exteriorsubset_4)  # -> values, attr_names, r_val_si, r_val_ip; plug-in component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
panel_34 = Panel(decnstrmat_8.r_val_si)

# ----
# EXPORT TO JSON
panel_35 = Panel("pre_1980::ClimateZone4::Mass")
constructionset_3 = HBConstructionSet(
    name="R2TH_g0.35WinHC",
    base_constr_set=panel_35,
    exterior_subset=exteriorsubset_3,
    ground_subset=groundsubset_3,
    interior_subset=interiorsubset_3,
    subface_subset=subfacesubset_3)  # -> constr_set; plug-in component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
objtostr_3 = HBObjectToString(hb_obj=constructionset_3)  # -> hb_str; plug-in component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

panel_36 = Panel(objtostr_3)

# ----
# EXPORT TO JSON
panel_37 = Panel("pre_1980::ClimateZone4::Mass")
constructionset_4 = HBConstructionSet(
    name="R2SF_g0.35WinHC",
    base_constr_set=panel_37,
    exterior_subset=exteriorsubset_4,
    ground_subset=groundsubset_4,
    interior_subset=interiorsubset_4,
    subface_subset=subfacesubset_4)  # -> constr_set; plug-in component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
objtostr_4 = HBObjectToString(hb_obj=constructionset_4)  # -> hb_str; plug-in component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

panel_38 = Panel(objtostr_4)

opaquemat_127 = HBOpaqueMaterial(name="GypsumBoard", thickness=".0125", conductivity="0.160", density="772", spec_heat="1090", roughness="MediumSmooth")  # -> mat; plug-in component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

opaquemat_128 = HBOpaqueMaterial(name="WallInsul_MW_Int", thickness=".120", conductivity="0.033", density="70", spec_heat="1030", roughness="Rough")  # -> mat; plug-in component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

opaquemat_129 = HBOpaqueMaterial(name="RoofInsul_MW_spray", thickness=".192", conductivity="0.046", density="10", spec_heat="837", roughness="VeryRough")  # -> mat; plug-in component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

opaquemat_130 = HBOpaqueMaterial(name="GypsumBoard", thickness=".0125", conductivity="0.160", density="772", spec_heat="1090", roughness="MediumSmooth")  # -> mat; plug-in component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

opaquemat_131 = HBOpaqueMaterial(name="WallInsul_MW_Int", thickness=".120", conductivity="0.033", density="70", spec_heat="1030", roughness="Rough")  # -> mat; plug-in component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

opaquemat_132 = HBOpaqueMaterial(
    name="RoofInsul_MW_ExtSheets",
    thickness=".160",
    conductivity="0.036",
    density="140",
    spec_heat="1030",
    roughness="Rough")  # -> mat; plug-in component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

opaquemat_133 = HBOpaqueMaterial(
    name="InternalPlaster",
    thickness="0.020",
    conductivity="0.700",
    density="1400",
    spec_heat="1000",
    roughness="MediumSmooth")  # -> mat; plug-in component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

opaquemat_134 = HBOpaqueMaterial(name="SolidBrick", thickness="0.200", conductivity="0.720", density="1800", spec_heat="1000", roughness="Rough")  # -> mat; plug-in component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

opaquemat_135 = HBOpaqueMaterial(
    name="InternalPlaster",
    thickness="0.020",
    conductivity="0.700",
    density="1400",
    spec_heat="1000",
    roughness="MediumSmooth")  # -> mat; plug-in component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

opaquemat_136 = HBOpaqueMaterial(name="CementMortar", thickness="0.020", conductivity="1.400", density="2000", spec_heat="1000", roughness="Rough")  # -> mat; plug-in component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

opaquemat_137 = HBOpaqueMaterial(
    name="InternalPlaster",
    thickness="0.020",
    conductivity="0.700",
    density="1400",
    spec_heat="1000",
    roughness="MediumSmooth")  # -> mat; plug-in component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

opaquemat_138 = HBOpaqueMaterial(
    name="BrickSlabs_ModConductivity",
    thickness=".060",
    conductivity="0.600",
    density="900",
    spec_heat="1000",
    roughness="Rough")  # -> mat; plug-in component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

opaquemat_139 = HBOpaqueMaterial(
    name="InternalPlaster",
    thickness="0.020",
    conductivity="0.700",
    density="1400",
    spec_heat="1000",
    roughness="MediumSmooth")  # -> mat; plug-in component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

opaquemat_140 = HBOpaqueMaterial(name="CeramicTile", thickness="0.015", conductivity="1.470", density="1700", spec_heat="1000", roughness="MediumSmooth")  # -> mat; plug-in component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

opaquemat_141 = HBOpaqueMaterial(name="CeramicTile", thickness="0.015", conductivity="1.470", density="1700", spec_heat="1000", roughness="MediumSmooth")  # -> mat; plug-in component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

opaquemat_142 = HBOpaqueMaterial(name="CementMortar", thickness="0.020", conductivity="1.400", density="2000", spec_heat="1000", roughness="Rough")  # -> mat; plug-in component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

opaquemat_143 = HBOpaqueMaterial(
    name="BrickSlabs_ModConductivity",
    thickness=".060",
    conductivity="0.600",
    density="900",
    spec_heat="1000",
    roughness="Rough")  # -> mat; plug-in component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

opaquemat_144 = HBOpaqueMaterial(name="SolidBrick", thickness=".240", conductivity="0.720", density="1800", spec_heat="1000", roughness="Rough")  # -> mat; plug-in component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

opaquemat_145 = HBOpaqueMaterial(name="CeramicTile", thickness="0.015", conductivity="1.470", density="1700", spec_heat="1000", roughness="MediumSmooth")  # -> mat; plug-in component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

opaquemat_146 = HBOpaqueMaterial(name="CeramicTile", thickness="0.015", conductivity="1.470", density="1700", spec_heat="1000", roughness="MediumSmooth")  # -> mat; plug-in component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

opaquemat_147 = HBOpaqueMaterial(name="CementMortar_Thick", thickness="0.030", conductivity="1.400", density="2000", spec_heat="1000", roughness="Rough")  # -> mat; plug-in component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

opaquemat_148 = HBOpaqueMaterial(name="CementMortar_Thick", thickness="0.030", conductivity="1.400", density="2000", spec_heat="1000", roughness="Rough")  # -> mat; plug-in component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

opaquematnomass = HBOpaqueMaterialNoMass(name="FictitiousLayer_R0.3", r_value="0.3")  # -> mat; plug-in component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

opaquemat_149 = HBOpaqueMaterial(name="Concrete_Reg", thickness="0.100", conductivity="1.160", density="2000", spec_heat="1000", roughness="Rough")  # -> mat; plug-in component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

opaquemat_150 = HBOpaqueMaterial(name="Concrete_Reg", thickness="0.100", conductivity="1.160", density="2000", spec_heat="1000", roughness="Rough")  # -> mat; plug-in component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

opaquemat_151 = HBOpaqueMaterial(name="GravelRiverStone", thickness=".147", conductivity="1.200", density="1700", spec_heat="1000", roughness="VeryRough")  # -> mat; plug-in component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

opaquemat_152 = HBOpaqueMaterial(name="GravelRiverStone", thickness=".147", conductivity="1.200", density="1700", spec_heat="1000", roughness="VeryRough")  # -> mat; plug-in component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

opaquemat_153 = HBOpaqueMaterial(name="CementMortar", thickness="0.020", conductivity="1.400", density="2000", spec_heat="1000", roughness="Rough")  # -> mat; plug-in component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

opaquemat_154 = HBOpaqueMaterial(
    name="BrickSlabs_ModConductivity",
    thickness=".060",
    conductivity="0.600",
    density="900",
    spec_heat="1000",
    roughness="Rough")  # -> mat; plug-in component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

opaquemat_155 = HBOpaqueMaterial(
    name="InternalPlaster",
    thickness="0.020",
    conductivity="0.700",
    density="1400",
    spec_heat="1000",
    roughness="MediumSmooth")  # -> mat; plug-in component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

opaquemat_156 = HBOpaqueMaterial(name="CeramicTile", thickness="0.015", conductivity="1.470", density="1700", spec_heat="1000", roughness="MediumSmooth")  # -> mat; plug-in component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

opaquemat_157 = HBOpaqueMaterial(name="SolidBrick", thickness="0.200", conductivity="0.720", density="1800", spec_heat="1000", roughness="Rough")  # -> mat; plug-in component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

opaquemat_158 = HBOpaqueMaterial(name="CementMortar_Thick", thickness="0.030", conductivity="1.400", density="2000", spec_heat="1000", roughness="Rough")  # -> mat; plug-in component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

opaquemat_159 = HBOpaqueMaterial(name="Concrete_Reg", thickness="0.100", conductivity="1.160", density="2000", spec_heat="1000", roughness="Rough")  # -> mat; plug-in component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

# ----
# R3TH
opaquemat_160 = HBOpaqueMaterial(name="ExternalPlaster", thickness=".020", conductivity="0.900", density="1800", spec_heat="1000", roughness="Rough")  # -> mat; plug-in component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

opaquemat_161 = HBOpaqueMaterial(name="GravelRiverStone", thickness=".147", conductivity="1.200", density="1700", spec_heat="1000", roughness="VeryRough")  # -> mat; plug-in component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

opaquemat_162 = HBOpaqueMaterial(
    name="InternalPlaster",
    thickness="0.020",
    conductivity="0.700",
    density="1400",
    spec_heat="1000",
    roughness="MediumSmooth")  # -> mat; plug-in component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

opaquemat_163 = HBOpaqueMaterial(name="SolidBrick", thickness="0.330", conductivity="0.720", density="1800", spec_heat="1000", roughness="Rough")  # -> mat; plug-in component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

opaquemat_164 = HBOpaqueMaterial(
    name="InternalPlaster",
    thickness="0.020",
    conductivity="0.700",
    density="1400",
    spec_heat="1000",
    roughness="MediumSmooth")  # -> mat; plug-in component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

# ----
# R3SF
opaquemat_165 = HBOpaqueMaterial(name="ExternalPlaster", thickness=".020", conductivity="0.900", density="1800", spec_heat="1000", roughness="Rough")  # -> mat; plug-in component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

opaquemat_166 = HBOpaqueMaterial(name="CeramicTile", thickness="0.015", conductivity="1.470", density="1700", spec_heat="1000", roughness="MediumSmooth")  # -> mat; plug-in component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

opaquemat_167 = HBOpaqueMaterial(name="Concrete_Reg", thickness="0.100", conductivity="1.160", density="2000", spec_heat="1000", roughness="Rough")  # -> mat; plug-in component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

opaquemat_168 = HBOpaqueMaterial(name="CementMortar_Thick", thickness="0.030", conductivity="1.400", density="2000", spec_heat="1000", roughness="Rough")  # -> mat; plug-in component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

opaquemat_169 = HBOpaqueMaterial(name="GravelRiverStone", thickness=".147", conductivity="1.200", density="1700", spec_heat="1000", roughness="VeryRough")  # -> mat; plug-in component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

opaquemat_170 = HBOpaqueMaterial(name="WoodPlanking", thickness="0.063", conductivity="0.150", density="550", spec_heat="1600", roughness="Rough")  # -> mat; plug-in component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

# ----
# Hard code window
# U 1.40, g 0.35, VT 0.55
panel_39 = Panel("0.55")
windowmat_5 = HBWindowMaterial(name="U 1.40 Dbl LoE", u_factor="1.40", shgc="0.35", t_vis=panel_39)  # -> mat; plug-in component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
windowconstr_5 = HBWindowConstruction(name="U 1.40 Dbl LoE", materials=windowmat_5)  # -> constr; plug-in component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
decnstrconstr_5 = HBDeconstructConstruction(constr=windowconstr_5)  # -> materials, layers, r_val_si, r_val_ip, u_fac_si, u_fac_ip, shgc, t_sol, t_vis; plug-in component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
panel_40 = Panel([decnstrconstr_5.r_val_si, decnstrconstr_5.u_fac_si, decnstrconstr_5.shgc, decnstrconstr_5.t_sol, decnstrconstr_5.t_vis])
subfacesubset_5 = HBSubfaceSubset(window=windowconstr_5, skylight=windowconstr_5, operable=windowconstr_5, glass_door=windowconstr_5)  # -> subface_set; plug-in component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

opaquemat_171 = HBOpaqueMaterial(name="SolidBrick", thickness="0.330", conductivity="0.720", density="1800", spec_heat="1000", roughness="Rough")  # -> mat; plug-in component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

opaquemat_172 = HBOpaqueMaterial(
    name="InternalPlaster",
    thickness="0.020",
    conductivity="0.700",
    density="1400",
    spec_heat="1000",
    roughness="MediumSmooth")  # -> mat; plug-in component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

opaquemat_173 = HBOpaqueMaterial(
    name="InternalPlaster",
    thickness="0.020",
    conductivity="0.700",
    density="1400",
    spec_heat="1000",
    roughness="MediumSmooth")  # -> mat; plug-in component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

opaquemat_174 = HBOpaqueMaterial(name="CementMortar", thickness="0.020", conductivity="1.400", density="2000", spec_heat="1000", roughness="Rough")  # -> mat; plug-in component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

opaquemat_175 = HBOpaqueMaterial(
    name="InternalPlaster",
    thickness="0.020",
    conductivity="0.700",
    density="1400",
    spec_heat="1000",
    roughness="MediumSmooth")  # -> mat; plug-in component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

opaquemat_176 = HBOpaqueMaterial(
    name="BrickSlabs_ModConductivity",
    thickness=".060",
    conductivity="0.600",
    density="900",
    spec_heat="1000",
    roughness="Rough")  # -> mat; plug-in component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

opaquemat_177 = HBOpaqueMaterial(
    name="InternalPlaster",
    thickness="0.020",
    conductivity="0.700",
    density="1400",
    spec_heat="1000",
    roughness="MediumSmooth")  # -> mat; plug-in component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

opaquemat_178 = HBOpaqueMaterial(name="CeramicTile", thickness="0.015", conductivity="1.470", density="1700", spec_heat="1000", roughness="MediumSmooth")  # -> mat; plug-in component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

opaquemat_179 = HBOpaqueMaterial(name="CeramicTile", thickness="0.015", conductivity="1.470", density="1700", spec_heat="1000", roughness="MediumSmooth")  # -> mat; plug-in component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

opaquemat_180 = HBOpaqueMaterial(name="CementMortar", thickness="0.020", conductivity="1.400", density="2000", spec_heat="1000", roughness="Rough")  # -> mat; plug-in component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

opaquemat_181 = HBOpaqueMaterial(
    name="BrickSlabs_ModConductivity",
    thickness=".060",
    conductivity="0.600",
    density="900",
    spec_heat="1000",
    roughness="Rough")  # -> mat; plug-in component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

opaquemat_182 = HBOpaqueMaterial(name="SolidBrick", thickness=".370", conductivity="0.720", density="1800", spec_heat="1000", roughness="Rough")  # -> mat; plug-in component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

opaquemat_183 = HBOpaqueMaterial(name="CeramicTile", thickness="0.015", conductivity="1.470", density="1700", spec_heat="1000", roughness="MediumSmooth")  # -> mat; plug-in component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

opaquemat_184 = HBOpaqueMaterial(name="CementMortar_Thick", thickness="0.030", conductivity="1.400", density="2000", spec_heat="1000", roughness="Rough")  # -> mat; plug-in component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

opaquemat_185 = HBOpaqueMaterial(name="Concrete_Reg", thickness="0.100", conductivity="1.160", density="2000", spec_heat="1000", roughness="Rough")  # -> mat; plug-in component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

opaquemat_186 = HBOpaqueMaterial(name="GravelRiverStone", thickness=".147", conductivity="1.200", density="1700", spec_heat="1000", roughness="VeryRough")  # -> mat; plug-in component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

opaquemat_187 = HBOpaqueMaterial(name="CeramicTile", thickness="0.015", conductivity="1.470", density="1700", spec_heat="1000", roughness="MediumSmooth")  # -> mat; plug-in component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

opaquemat_188 = HBOpaqueMaterial(name="CementMortar_Thick", thickness="0.030", conductivity="1.400", density="2000", spec_heat="1000", roughness="Rough")  # -> mat; plug-in component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

# ----
# Hard code window
# U 1.40, g 0.35, VT 0.55
panel_41 = Panel("0.55")
windowmat_6 = HBWindowMaterial(name="U 1.40 Dbl LoE", u_factor="1.40", shgc="0.35", t_vis=panel_41)  # -> mat; plug-in component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
windowconstr_6 = HBWindowConstruction(name="U 1.40 Dbl LoE", materials=windowmat_6)  # -> constr; plug-in component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
decnstrconstr_6 = HBDeconstructConstruction(constr=windowconstr_6)  # -> materials, layers, r_val_si, r_val_ip, u_fac_si, u_fac_ip, shgc, t_sol, t_vis; plug-in component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
panel_42 = Panel([decnstrconstr_6.r_val_si, decnstrconstr_6.u_fac_si, decnstrconstr_6.shgc, decnstrconstr_6.t_sol, decnstrconstr_6.t_vis])
subfacesubset_6 = HBSubfaceSubset(window=windowconstr_6, skylight=windowconstr_6, operable=windowconstr_6, glass_door=windowconstr_6)  # -> subface_set; plug-in component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

opaquemat_189 = HBOpaqueMaterial(name="Concrete_Reg", thickness="0.100", conductivity="1.160", density="2000", spec_heat="1000", roughness="Rough")  # -> mat; plug-in component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

opaquemat_190 = HBOpaqueMaterial(name="GravelRiverStone", thickness=".147", conductivity="1.200", density="1700", spec_heat="1000", roughness="VeryRough")  # -> mat; plug-in component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

merge_33 = Merge(Data1=opaquemat_140, Data2=opaquemat_136, Data3=opaquemat_138, Data4=opaquemat_139)
opaqueconstr_37 = HBOpaqueConstruction(name="Ceiling_02.02_IntClg", materials=merge_33)  # -> constr; plug-in component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

merge_34 = Merge(Data1=opaquemat_133, Data2=opaquemat_134, Data3=opaquemat_135)
opaqueconstr_38 = HBOpaqueConstruction(name="Wall_01.05_Interior", materials=merge_34)  # -> constr; plug-in component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

merge_35 = Merge(Data1=opaquemat_137, Data2=opaquemat_143, Data3=opaquemat_142, Data4=opaquemat_141)
opaqueconstr_39 = HBOpaqueConstruction(name="Ceiling_02.02_IntFlr", materials=merge_35)  # -> constr; plug-in component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

merge_36 = Merge(Data1=opaquemat_151, Data2=opaquemat_150, Data3=opaquemat_147, Data4=opaquemat_145)
opaqueconstr_40 = HBOpaqueConstruction(name="Floor_01.04_GRfloor", materials=merge_36)  # -> constr; plug-in component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

merge_37 = Merge(Data1=opaquemat_132, Data2=opaquemat_170)
opaqueconstr_41 = HBOpaqueConstruction(name="Roof_01.01", materials=merge_37)  # -> constr; plug-in component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

merge_38 = Merge(Data1=opaquemat_156, Data2=opaquemat_158, Data3=opaquemat_159, Data4=opaquemat_161)
opaqueconstr_42 = HBOpaqueConstruction(name="Floor_01.04_GRroof", materials=merge_38)  # -> constr; plug-in component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

# ----
# Ground Subset -
# same as interior floors,
# ground & roof must be inverse.
# 
# Base ground & roof construction
# on exterior floor for same archetype
# Make this same thickness as W1
panel_43 = Panel("Wall_01.05_UGwall")
opaqueconstr_43 = HBOpaqueConstruction(name=panel_43, materials=opaquemat_144)  # -> constr; plug-in component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
groundsubset_5 = HBGroundConstructionSubset(ground_wall=opaqueconstr_43, ground_roof=opaqueconstr_42, ground_floor=opaqueconstr_40)  # -> ground_set; plug-in component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
decnstrmat_9 = HBDeconstructMaterial(mat=groundsubset_5)  # -> values, attr_names, r_val_si, r_val_ip; plug-in component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
panel_44 = Panel(groundsubset_5)
panel_45 = Panel(decnstrmat_9.r_val_si)

merge_39 = Merge(Data1=opaquemat_152, Data2=opaquemat_149, Data3=opaquemat_148, Data4=opaquemat_146)
opaqueconstr_44 = HBOpaqueConstruction(name="Floor_01.04", materials=merge_39)  # -> constr; plug-in component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

merge_40 = Merge(Data1=opaquematnomass, Data2=opaquemat_129, Data3=opaquemat_153, Data4=opaquemat_154, Data5=opaquemat_155)
opaqueconstr_45 = HBOpaqueConstruction(name="Ceiling_02.02", materials=merge_40)  # -> constr; plug-in component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

merge_41 = Merge(Data1=opaquemat_160, Data2=opaquemat_157, Data3=opaquemat_162, Data4=opaquemat_128, Data5=opaquemat_127)
opaqueconstr_46 = HBOpaqueConstruction(name="Wall_01.05", materials=merge_41)  # -> constr; plug-in component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

merge_42 = Merge(Data1=opaquemat_165, Data2=opaquemat_163, Data3=opaquemat_164, Data4=opaquemat_131, Data5=opaquemat_130)
opaqueconstr_47 = HBOpaqueConstruction(name="Wall_01.06", materials=merge_42)  # -> constr; plug-in component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

merge_43 = Merge(Data1=opaquemat_169, Data2=opaquemat_167, Data4=opaquemat_168, Data5=opaquemat_166)
opaqueconstr_48 = HBOpaqueConstruction(name="Floor_01.04", materials=merge_43)  # -> constr; plug-in component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

merge_44 = Merge(Data1=opaquemat_178, Data2=opaquemat_174, Data3=opaquemat_176, Data4=opaquemat_177)
opaqueconstr_49 = HBOpaqueConstruction(name="Ceiling_02.02_IntClg", materials=merge_44)  # -> constr; plug-in component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

merge_45 = Merge(Data1=opaquemat_172, Data2=opaquemat_171, Data3=opaquemat_173)
opaqueconstr_50 = HBOpaqueConstruction(name="Wall_01.06_Interior", materials=merge_45)  # -> constr; plug-in component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

merge_46 = Merge(Data1=opaquemat_186, Data2=opaquemat_185, Data4=opaquemat_184, Data5=opaquemat_183)
opaqueconstr_51 = HBOpaqueConstruction(name="Floor_01.04_GRfloor", materials=merge_46)  # -> constr; plug-in component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

merge_47 = Merge(Data1=opaquemat_175, Data2=opaquemat_181, Data3=opaquemat_180, Data4=opaquemat_179)
opaqueconstr_52 = HBOpaqueConstruction(name="Ceiling_02.02_IntFlr", materials=merge_47)  # -> constr; plug-in component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

merge_48 = Merge(Data1=opaquemat_187, Data2=opaquemat_188, Data4=opaquemat_189, Data5=opaquemat_190)
opaqueconstr_53 = HBOpaqueConstruction(name="Floor_01.04_GRroof", materials=merge_48)  # -> constr; plug-in component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

# ----
# Ground Subset -
# same as interior floors,
# ground & roof must be inverse.
# 
# Base ground & roof construction
# on exterior floor for same archetype
# Make this same thickness as W1
panel_46 = Panel("Wall_01.06_UGwall")
opaqueconstr_54 = HBOpaqueConstruction(name=panel_46, materials=opaquemat_182)  # -> constr; plug-in component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
groundsubset_6 = HBGroundConstructionSubset(ground_wall=opaqueconstr_54, ground_roof=opaqueconstr_53, ground_floor=opaqueconstr_51)  # -> ground_set; plug-in component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
decnstrmat_10 = HBDeconstructMaterial(mat=groundsubset_6)  # -> values, attr_names, r_val_si, r_val_ip; plug-in component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
panel_47 = Panel(groundsubset_6)
panel_48 = Panel(decnstrmat_10.r_val_si)

# ----
# Interior Subset -
# Note interior floors & ceilings must
# be inverse of each other
interiorsubset_5 = HBInteriorConstructionSubset(interior_wall=opaqueconstr_38, ceiling=opaqueconstr_37, interior_floor=opaqueconstr_39)  # -> interior_set; plug-in component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
panel_49 = Panel(interiorsubset_5)

# ----
# Exterior Subset
exteriorsubset_5 = HBExteriorConstructionSubset(exterior_wall=opaqueconstr_46, exterior_roof=opaqueconstr_45, exposed_floor=opaqueconstr_44)  # -> exterior_set; plug-in component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
panel_50 = Panel(exteriorsubset_5)
decnstrmat_11 = HBDeconstructMaterial(mat=exteriorsubset_5)  # -> values, attr_names, r_val_si, r_val_ip; plug-in component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
panel_51 = Panel(decnstrmat_11.r_val_si)

# ----
# Exterior Subset
exteriorsubset_6 = HBExteriorConstructionSubset(exterior_wall=opaqueconstr_47, exterior_roof=opaqueconstr_41, exposed_floor=opaqueconstr_48)  # -> exterior_set; plug-in component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
panel_52 = Panel(exteriorsubset_6)
decnstrmat_12 = HBDeconstructMaterial(mat=exteriorsubset_6)  # -> values, attr_names, r_val_si, r_val_ip; plug-in component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
panel_53 = Panel(decnstrmat_12.r_val_si)

# ----
# Interior Subset -
# Note interior floors & ceilings must
# be inverse of each other
interiorsubset_6 = HBInteriorConstructionSubset(interior_wall=opaqueconstr_50, ceiling=opaqueconstr_49, interior_floor=opaqueconstr_52)  # -> interior_set; plug-in component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
panel_54 = Panel(interiorsubset_6)

# ----
# EXPORT TO JSON
panel_55 = Panel("pre_1980::ClimateZone4::Mass")
constructionset_5 = HBConstructionSet(
    name="R3TH_g0.35WinHC",
    base_constr_set=panel_55,
    exterior_subset=exteriorsubset_5,
    ground_subset=groundsubset_5,
    interior_subset=interiorsubset_5,
    subface_subset=subfacesubset_5)  # -> constr_set; plug-in component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
objtostr_5 = HBObjectToString(hb_obj=constructionset_5)  # -> hb_str; plug-in component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

panel_56 = Panel(objtostr_5)

# ----
# EXPORT TO JSON
panel_57 = Panel("pre_1980::ClimateZone4::Mass")
constructionset_6 = HBConstructionSet(
    name="R3SF_g0.35WinHC",
    base_constr_set=panel_57,
    exterior_subset=exteriorsubset_6,
    ground_subset=groundsubset_6,
    interior_subset=interiorsubset_6,
    subface_subset=subfacesubset_6)  # -> constr_set; plug-in component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
objtostr_6 = HBObjectToString(hb_obj=constructionset_6)  # -> hb_str; plug-in component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

panel_58 = Panel(objtostr_6)

opaquemat_191 = HBOpaqueMaterial(
    name="RoofInsul_MW_ExtSheets",
    thickness=".160",
    conductivity="0.036",
    density="140",
    spec_heat="1030",
    roughness="Rough")  # -> mat; plug-in component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

opaquemat_192 = HBOpaqueMaterial(name="ExternalPlaster", thickness=".020", conductivity="0.900", density="1800", spec_heat="1000", roughness="Rough")  # -> mat; plug-in component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

opaquemat_193 = HBOpaqueMaterial(name="WallInsul_MW_Ext", thickness=".120", conductivity="0.034", density="80", spec_heat="1030", roughness="Rough")  # -> mat; plug-in component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

opaquemat_194 = HBOpaqueMaterial(name="FloorInsul_MW", thickness=".120", conductivity="0.034", density="80", spec_heat="1030", roughness="Rough")  # -> mat; plug-in component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

opaquemat_195 = HBOpaqueMaterial(
    name="RoofInsul_MW_ExtSheets",
    thickness=".160",
    conductivity="0.036",
    density="140",
    spec_heat="1030",
    roughness="Rough")  # -> mat; plug-in component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

opaquemat_196 = HBOpaqueMaterial(name="FloorInsul_MW", thickness=".120", conductivity="0.034", density="80", spec_heat="1030", roughness="Rough")  # -> mat; plug-in component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

opaquemat_197 = HBOpaqueMaterial(name="ExternalPlaster", thickness=".020", conductivity="0.900", density="1800", spec_heat="1000", roughness="Rough")  # -> mat; plug-in component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

opaquemat_198 = HBOpaqueMaterial(name="WallInsul_MW_Ext", thickness=".120", conductivity="0.034", density="80", spec_heat="1030", roughness="Rough")  # -> mat; plug-in component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

opaquemat_199 = HBOpaqueMaterial(name="LtwtConcScreed_6.5cm", thickness=".065", conductivity=".580", density="900", spec_heat="1000", roughness="Rough")  # -> mat; plug-in component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

opaquemat_200 = HBOpaqueMaterial(
    name="InternalPlaster",
    thickness="0.020",
    conductivity="0.700",
    density="1400",
    spec_heat="1000",
    roughness="MediumSmooth")  # -> mat; plug-in component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

opaquemat_201 = HBOpaqueMaterial(name="SolidBrick", thickness="0.330", conductivity="0.720", density="1800", spec_heat="1000", roughness="Rough")  # -> mat; plug-in component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

opaquemat_202 = HBOpaqueMaterial(name="CementMortar", thickness="0.020", conductivity="1.400", density="2000", spec_heat="1000", roughness="Rough")  # -> mat; plug-in component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

opaquemat_203 = HBOpaqueMaterial(
    name="InternalPlaster",
    thickness="0.020",
    conductivity="0.700",
    density="1400",
    spec_heat="1000",
    roughness="MediumSmooth")  # -> mat; plug-in component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

opaquemat_204 = HBOpaqueMaterial(
    name="Slab_BrickBlkConc_24cm",
    thickness=".240",
    conductivity="0.715",
    density="900",
    spec_heat="1000",
    roughness="Rough")  # -> mat; plug-in component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

opaquemat_205 = HBOpaqueMaterial(name="CeramicTile", thickness="0.015", conductivity="1.470", density="1700", spec_heat="1000", roughness="MediumSmooth")  # -> mat; plug-in component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

opaquemat_206 = HBOpaqueMaterial(name="CementMortar", thickness="0.020", conductivity="1.400", density="2000", spec_heat="1000", roughness="Rough")  # -> mat; plug-in component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

opaquemat_207 = HBOpaqueMaterial(
    name="InternalPlaster",
    thickness="0.020",
    conductivity="0.700",
    density="1400",
    spec_heat="1000",
    roughness="MediumSmooth")  # -> mat; plug-in component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

opaquemat_208 = HBOpaqueMaterial(
    name="InternalPlaster",
    thickness="0.020",
    conductivity="0.700",
    density="1400",
    spec_heat="1000",
    roughness="MediumSmooth")  # -> mat; plug-in component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

opaquemat_209 = HBOpaqueMaterial(name="CementMortar", thickness="0.020", conductivity="1.400", density="2000", spec_heat="1000", roughness="Rough")  # -> mat; plug-in component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

opaquemat_210 = HBOpaqueMaterial(
    name="Slab_BrickBlkConc_24cm",
    thickness=".240",
    conductivity="0.715",
    density="900",
    spec_heat="1000",
    roughness="Rough")  # -> mat; plug-in component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

opaquemat_211 = HBOpaqueMaterial(name="LtwtConcScreed_6.5cm", thickness=".065", conductivity=".580", density="900", spec_heat="1000", roughness="Rough")  # -> mat; plug-in component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

opaquemat_212 = HBOpaqueMaterial(name="CementMortar", thickness="0.020", conductivity="1.400", density="2000", spec_heat="1000", roughness="Rough")  # -> mat; plug-in component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

opaquemat_213 = HBOpaqueMaterial(name="CeramicTile", thickness="0.015", conductivity="1.470", density="1700", spec_heat="1000", roughness="MediumSmooth")  # -> mat; plug-in component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

opaquemat_214 = HBOpaqueMaterial(name="CeramicTile", thickness="0.015", conductivity="1.470", density="1700", spec_heat="1000", roughness="MediumSmooth")  # -> mat; plug-in component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

opaquemat_215 = HBOpaqueMaterial(name="Concrete_Reg", thickness="0.100", conductivity="1.160", density="2000", spec_heat="1000", roughness="Rough")  # -> mat; plug-in component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

opaquemat_216 = HBOpaqueMaterial(name="CementMortar_Thick", thickness="0.030", conductivity="1.400", density="2000", spec_heat="1000", roughness="Rough")  # -> mat; plug-in component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

opaquemat_217 = HBOpaqueMaterial(name="CementMortar", thickness="0.020", conductivity="1.400", density="2000", spec_heat="1000", roughness="Rough")  # -> mat; plug-in component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

opaquemat_218 = HBOpaqueMaterial(name="SolidBrick", thickness=".370", conductivity="0.720", density="1800", spec_heat="1000", roughness="Rough")  # -> mat; plug-in component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

opaquemat_219 = HBOpaqueMaterial(
    name="InternalPlaster",
    thickness="0.020",
    conductivity="0.700",
    density="1400",
    spec_heat="1000",
    roughness="MediumSmooth")  # -> mat; plug-in component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

opaquemat_220 = HBOpaqueMaterial(name="CeramicTile", thickness="0.015", conductivity="1.470", density="1700", spec_heat="1000", roughness="MediumSmooth")  # -> mat; plug-in component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

# ----
# R4SF
opaquemat_221 = HBOpaqueMaterial(name="ExternalPlaster", thickness=".020", conductivity="0.900", density="1800", spec_heat="1000", roughness="Rough")  # -> mat; plug-in component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

opaquemat_222 = HBOpaqueMaterial(name="ReinforcedConcrete", thickness="0.040", conductivity="1.910", density="2400", spec_heat="1000", roughness="Rough")  # -> mat; plug-in component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

opaquemat_223 = HBOpaqueMaterial(
    name="Slab_BrickBlkConc_16cm",
    thickness=".160",
    conductivity="0.582",
    density="900",
    spec_heat="1000",
    roughness="Rough")  # -> mat; plug-in component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

opaquemat_224 = HBOpaqueMaterial(name="CementMortar_Thick", thickness="0.030", conductivity="1.400", density="2000", spec_heat="1000", roughness="Rough")  # -> mat; plug-in component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

opaquemat_225 = HBOpaqueMaterial(name="SolidBrick", thickness="0.330", conductivity="0.720", density="1800", spec_heat="1000", roughness="Rough")  # -> mat; plug-in component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

opaquemat_226 = HBOpaqueMaterial(name="GravelRiverStone", thickness=".147", conductivity="1.200", density="1700", spec_heat="1000", roughness="VeryRough")  # -> mat; plug-in component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

opaquemat_227 = HBOpaqueMaterial(name="Concrete_Reg", thickness="0.100", conductivity="1.160", density="2000", spec_heat="1000", roughness="Rough")  # -> mat; plug-in component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

opaquemat_228 = HBOpaqueMaterial(name="GravelRiverStone", thickness=".147", conductivity="1.200", density="1700", spec_heat="1000", roughness="VeryRough")  # -> mat; plug-in component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

# ----
# Hard code window
# U 1.40, g 0.35, VT 0.55
panel_59 = Panel("0.55")
windowmat_7 = HBWindowMaterial(name="U 1.40 Dbl LoE", u_factor="1.40", shgc="0.35", t_vis=panel_59)  # -> mat; plug-in component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
windowconstr_7 = HBWindowConstruction(name="U 1.40 Dbl LoE", materials=windowmat_7)  # -> constr; plug-in component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
decnstrconstr_7 = HBDeconstructConstruction(constr=windowconstr_7)  # -> materials, layers, r_val_si, r_val_ip, u_fac_si, u_fac_ip, shgc, t_sol, t_vis; plug-in component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
panel_60 = Panel([decnstrconstr_7.r_val_si, decnstrconstr_7.u_fac_si, decnstrconstr_7.shgc, decnstrconstr_7.t_sol, decnstrconstr_7.t_vis])
subfacesubset_7 = HBSubfaceSubset(window=windowconstr_7, skylight=windowconstr_7, operable=windowconstr_7, glass_door=windowconstr_7)  # -> subface_set; plug-in component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
opaquemat_229 = HBOpaqueMaterial(name="SolidBrick", thickness=".300", conductivity="0.720", density="1800", spec_heat="1000", roughness="Rough")  # -> mat; plug-in component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

opaquemat_230 = HBOpaqueMaterial(name="CeramicTile", thickness="0.015", conductivity="1.470", density="1700", spec_heat="1000", roughness="MediumSmooth")  # -> mat; plug-in component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

opaquemat_231 = HBOpaqueMaterial(name="CementMortar_Thick", thickness="0.030", conductivity="1.400", density="2000", spec_heat="1000", roughness="Rough")  # -> mat; plug-in component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

opaquemat_232 = HBOpaqueMaterial(
    name="Slab_BrickBlkConc_24cm",
    thickness=".240",
    conductivity="0.715",
    density="900",
    spec_heat="1000",
    roughness="Rough")  # -> mat; plug-in component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

opaquemat_233 = HBOpaqueMaterial(name="Concrete_Reg", thickness="0.100", conductivity="1.160", density="2000", spec_heat="1000", roughness="Rough")  # -> mat; plug-in component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

opaquematnomass_2 = HBOpaqueMaterialNoMass(name="FictitiousLayer_R0.3", r_value="0.3")  # -> mat; plug-in component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

opaquemat_234 = HBOpaqueMaterial(name="ExternalPlaster", thickness=".020", conductivity="0.900", density="1800", spec_heat="1000", roughness="Rough")  # -> mat; plug-in component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

opaquemat_235 = HBOpaqueMaterial(name="LtwtConcScreed_6.5cm", thickness=".065", conductivity=".580", density="900", spec_heat="1000", roughness="Rough")  # -> mat; plug-in component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

opaquemat_236 = HBOpaqueMaterial(name="CeramicTile", thickness="0.015", conductivity="1.470", density="1700", spec_heat="1000", roughness="MediumSmooth")  # -> mat; plug-in component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

opaquemat_237 = HBOpaqueMaterial(name="CementMortar", thickness="0.020", conductivity="1.400", density="2000", spec_heat="1000", roughness="Rough")  # -> mat; plug-in component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

opaquemat_238 = HBOpaqueMaterial(name="GravelRiverStone", thickness=".147", conductivity="1.200", density="1700", spec_heat="1000", roughness="VeryRough")  # -> mat; plug-in component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

opaquemat_239 = HBOpaqueMaterial(name="CementMortar", thickness="0.020", conductivity="1.400", density="2000", spec_heat="1000", roughness="Rough")  # -> mat; plug-in component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

opaquematnomass_3 = HBOpaqueMaterialNoMass(name="FictitiousLayer_R0.3", r_value="0.3")  # -> mat; plug-in component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

opaquemat_240 = HBOpaqueMaterial(name="ExternalPlaster", thickness=".020", conductivity="0.900", density="1800", spec_heat="1000", roughness="Rough")  # -> mat; plug-in component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

opaquemat_241 = HBOpaqueMaterial(
    name="InternalPlaster_XThin",
    thickness="0.0045",
    conductivity="0.700",
    density="1400",
    spec_heat="1000",
    roughness="MediumSmooth")  # -> mat; plug-in component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

opaquemat_242 = HBOpaqueMaterial(name="LtwtConcScreed_6.5cm", thickness=".065", conductivity=".580", density="900", spec_heat="1000", roughness="Rough")  # -> mat; plug-in component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

opaquemat_243 = HBOpaqueMaterial(name="CementMortar", thickness="0.020", conductivity="1.400", density="2000", spec_heat="1000", roughness="Rough")  # -> mat; plug-in component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

opaquemat_244 = HBOpaqueMaterial(name="Concrete_Prefab", thickness="0.140", conductivity="0.500", density="2400", spec_heat="1000", roughness="Rough")  # -> mat; plug-in component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

opaquemat_245 = HBOpaqueMaterial(
    name="InternalPlaster",
    thickness="0.020",
    conductivity="0.700",
    density="1400",
    spec_heat="1000",
    roughness="MediumSmooth")  # -> mat; plug-in component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

opaquemat_246 = HBOpaqueMaterial(name="CementMortar", thickness="0.020", conductivity="1.400", density="2000", spec_heat="1000", roughness="Rough")  # -> mat; plug-in component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

opaquemat_247 = HBOpaqueMaterial(name="CeramicTile", thickness="0.015", conductivity="1.470", density="1700", spec_heat="1000", roughness="MediumSmooth")  # -> mat; plug-in component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

opaquemat_248 = HBOpaqueMaterial(
    name="InternalPlaster",
    thickness="0.020",
    conductivity="0.700",
    density="1400",
    spec_heat="1000",
    roughness="MediumSmooth")  # -> mat; plug-in component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

opaquemat_249 = HBOpaqueMaterial(name="CeramicTile", thickness="0.015", conductivity="1.470", density="1700", spec_heat="1000", roughness="MediumSmooth")  # -> mat; plug-in component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

opaquemat_250 = HBOpaqueMaterial(
    name="Slab_BrickBlkConc_24cm",
    thickness=".240",
    conductivity="0.715",
    density="900",
    spec_heat="1000",
    roughness="Rough")  # -> mat; plug-in component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

opaquemat_251 = HBOpaqueMaterial(name="LtwtConcScreed_6.5cm", thickness=".065", conductivity=".580", density="900", spec_heat="1000", roughness="Rough")  # -> mat; plug-in component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

opaquemat_252 = HBOpaqueMaterial(name="CementMortar", thickness="0.020", conductivity="1.400", density="2000", spec_heat="1000", roughness="Rough")  # -> mat; plug-in component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

opaquemat_253 = HBOpaqueMaterial(name="HollowBrick_8cm", thickness="0.080", conductivity="0.400", density="800", spec_heat="1000", roughness="Rough")  # -> mat; plug-in component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

opaquemat_254 = HBOpaqueMaterial(
    name="Slab_BrickBlkConc_24cm",
    thickness=".240",
    conductivity="0.715",
    density="900",
    spec_heat="1000",
    roughness="Rough")  # -> mat; plug-in component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

opaquemat_255 = HBOpaqueMaterial(name="CementMortar", thickness="0.020", conductivity="1.400", density="2000", spec_heat="1000", roughness="Rough")  # -> mat; plug-in component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

# ----
# R4TH
opaquemat_256 = HBOpaqueMaterial(
    name="ExternalPlaster_XThin",
    thickness=".0045",
    conductivity="0.900",
    density="1800",
    spec_heat="1000",
    roughness="Rough")  # -> mat; plug-in component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

opaquemat_257 = HBOpaqueMaterial(name="HollowBrick_12cm", thickness="0.120", conductivity="0.387", density="800", spec_heat="1000", roughness="Rough")  # -> mat; plug-in component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

opaquemat_258 = HBOpaqueMaterial(
    name="InternalPlaster",
    thickness="0.020",
    conductivity="0.700",
    density="1400",
    spec_heat="1000",
    roughness="MediumSmooth")  # -> mat; plug-in component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

opaquematnomass_4 = HBOpaqueMaterialNoMass(name="CavityWallGap_R0.18", r_value="0.18")  # -> mat; plug-in component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

opaquemat_259 = HBOpaqueMaterial(name="CementMortar", thickness="0.020", conductivity="1.400", density="2000", spec_heat="1000", roughness="Rough")  # -> mat; plug-in component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

opaquemat_260 = HBOpaqueMaterial(
    name="Slab_BrickBlkConc_16cm",
    thickness=".160",
    conductivity="0.582",
    density="900",
    spec_heat="1000",
    roughness="Rough")  # -> mat; plug-in component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

opaquematnomass_5 = HBOpaqueMaterialNoMass(name="FictitiousLayer_R0.3", r_value="0.3")  # -> mat; plug-in component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

opaquemat_261 = HBOpaqueMaterial(
    name="InternalPlaster",
    thickness="0.020",
    conductivity="0.700",
    density="1400",
    spec_heat="1000",
    roughness="MediumSmooth")  # -> mat; plug-in component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

opaquemat_262 = HBOpaqueMaterial(name="ReinforcedConcrete", thickness="0.040", conductivity="1.910", density="2400", spec_heat="1000", roughness="Rough")  # -> mat; plug-in component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

opaquemat_263 = HBOpaqueMaterial(
    name="Slab_BrickBlkConc_24cm",
    thickness=".240",
    conductivity="0.715",
    density="900",
    spec_heat="1000",
    roughness="Rough")  # -> mat; plug-in component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

opaquemat_264 = HBOpaqueMaterial(name="CeramicTile", thickness="0.015", conductivity="1.470", density="1700", spec_heat="1000", roughness="MediumSmooth")  # -> mat; plug-in component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

opaquemat_265 = HBOpaqueMaterial(
    name="Slab_BrickBlkConc_24cm",
    thickness=".240",
    conductivity="0.715",
    density="900",
    spec_heat="1000",
    roughness="Rough")  # -> mat; plug-in component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

opaquemat_266 = HBOpaqueMaterial(name="CementMortar", thickness="0.020", conductivity="1.400", density="2000", spec_heat="1000", roughness="Rough")  # -> mat; plug-in component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

opaquemat_267 = HBOpaqueMaterial(name="LtwtConcScreed_6.5cm", thickness=".065", conductivity=".580", density="900", spec_heat="1000", roughness="Rough")  # -> mat; plug-in component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

opaquemat_268 = HBOpaqueMaterial(name="CementMortar", thickness="0.020", conductivity="1.400", density="2000", spec_heat="1000", roughness="Rough")  # -> mat; plug-in component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

opaquemat_269 = HBOpaqueMaterial(name="LtwtConcScreed_6.5cm", thickness=".065", conductivity=".580", density="900", spec_heat="1000", roughness="Rough")  # -> mat; plug-in component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

opaquemat_270 = HBOpaqueMaterial(name="ExternalPlaster", thickness=".020", conductivity="0.900", density="1800", spec_heat="1000", roughness="Rough")  # -> mat; plug-in component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

opaquemat_271 = HBOpaqueMaterial(name="CementMortar", thickness="0.020", conductivity="1.400", density="2000", spec_heat="1000", roughness="Rough")  # -> mat; plug-in component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

opaquemat_272 = HBOpaqueMaterial(name="CeramicTile", thickness="0.015", conductivity="1.470", density="1700", spec_heat="1000", roughness="MediumSmooth")  # -> mat; plug-in component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

opaquemat_273 = HBOpaqueMaterial(name="CementMortar", thickness="0.020", conductivity="1.400", density="2000", spec_heat="1000", roughness="Rough")  # -> mat; plug-in component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

# ----
# Hard code window
# U 1.40, g 0.35, VT 0.55
panel_61 = Panel("0.55")
windowmat_8 = HBWindowMaterial(name="U 1.40 Dbl LoE", u_factor="1.40", shgc="0.35", t_vis=panel_61)  # -> mat; plug-in component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
windowconstr_8 = HBWindowConstruction(name="U 1.40 Dbl LoE", materials=windowmat_8)  # -> constr; plug-in component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
decnstrconstr_8 = HBDeconstructConstruction(constr=windowconstr_8)  # -> materials, layers, r_val_si, r_val_ip, u_fac_si, u_fac_ip, shgc, t_sol, t_vis; plug-in component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
panel_62 = Panel([decnstrconstr_8.r_val_si, decnstrconstr_8.u_fac_si, decnstrconstr_8.shgc, decnstrconstr_8.t_sol, decnstrconstr_8.t_vis])
subfacesubset_8 = HBSubfaceSubset(window=windowconstr_8, skylight=windowconstr_8, operable=windowconstr_8, glass_door=windowconstr_8)  # -> subface_set; plug-in component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

merge_49 = Merge(Data1=opaquemat_200, Data2=opaquemat_201, Data3=opaquemat_203)
opaqueconstr_55 = HBOpaqueConstruction(name="Wall_01.06_Interior", materials=merge_49)  # -> constr; plug-in component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

merge_50 = Merge(Data1=opaquemat_191, Data2=opaquemat_209, Data3=opaquemat_222, Data4=opaquemat_223)
opaqueconstr_56 = HBOpaqueConstruction(name="Roof_03.01", materials=merge_50)  # -> constr; plug-in component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

merge_51 = Merge(Data1=opaquemat_228, Data2=opaquemat_227, Data3=opaquemat_224, Data4=opaquemat_220)
opaqueconstr_57 = HBOpaqueConstruction(name="Floor_01.04_GRfloor", materials=merge_51)  # -> constr; plug-in component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

merge_52 = Merge(Data1=opaquemat_230, Data2=opaquemat_231, Data3=opaquemat_233, Data4=opaquemat_238)
opaqueconstr_58 = HBOpaqueConstruction(name="Floor_01.04_GRroof", materials=merge_52)  # -> constr; plug-in component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

# ----
# Ground Subset -
# same as interior floors,
# ground & roof must be inverse.
# 
# Base ground & roof construction
# on exterior floor for same archetype
# Make this same thickness as W1
panel_63 = Panel("Wall_01.06_UGwall")
opaqueconstr_59 = HBOpaqueConstruction(name=panel_63, materials=opaquemat_218)  # -> constr; plug-in component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
groundsubset_7 = HBGroundConstructionSubset(ground_wall=opaqueconstr_59, ground_roof=opaqueconstr_58, ground_floor=opaqueconstr_57)  # -> ground_set; plug-in component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
decnstrmat_13 = HBDeconstructMaterial(mat=groundsubset_7)  # -> values, attr_names, r_val_si, r_val_ip; plug-in component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
panel_64 = Panel(groundsubset_7)
panel_65 = Panel(decnstrmat_13.r_val_si)

merge_53 = Merge(Data1=opaquemat_192, Data2=opaquemat_193, Data3=opaquemat_221, Data4=opaquemat_225, Data5=opaquemat_219)
opaqueconstr_60 = HBOpaqueConstruction(name="Wall_01.06", materials=merge_53)  # -> constr; plug-in component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

merge_54 = Merge(Data1=opaquemat_226, Data2=opaquemat_215, Data3=opaquemat_216, Data4=opaquemat_213)
opaqueconstr_61 = HBOpaqueConstruction(name="Floor_01.04", materials=merge_54)  # -> constr; plug-in component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

merge_55 = Merge(Data1=opaquemat_245, Data2=opaquemat_244, Data3=opaquemat_248)
opaqueconstr_62 = HBOpaqueConstruction(name="Wall_04.03_Interior", materials=merge_55)  # -> constr; plug-in component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

merge_56 = Merge(
    Data1=opaquemat_197,
    Data2=opaquemat_198,
    Data3=opaquemat_256,
    Data4=opaquemat_257,
    Data5=opaquematnomass_4,
    Data6=opaquemat_253,
    Data7=opaquemat_241)
opaqueconstr_63 = HBOpaqueConstruction(name="Wall_03.01", materials=merge_56)  # -> constr; plug-in component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

merge_57 = Merge(
    Data1=opaquemat_205,
    Data2=opaquemat_206,
    Data3=opaquemat_199,
    Data4=opaquemat_202,
    Data5=opaquemat_204,
    Data6=opaquemat_207)
opaqueconstr_64 = HBOpaqueConstruction(name="Floor_03.01_IntClg", materials=merge_57)  # -> constr; plug-in component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

merge_58 = Merge(Data1=opaquemat_195, Data2=opaquemat_259, Data3=opaquemat_262, Data4=opaquemat_260)
opaqueconstr_65 = HBOpaqueConstruction(name="Roof_03.01", materials=merge_58)  # -> constr; plug-in component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

merge_59 = Merge(
    Data1=opaquemat_247,
    Data2=opaquemat_243,
    Data3=opaquemat_251,
    Data4=opaquemat_252,
    Data5=opaquemat_254,
    Data6=opaquemat_240,
    Data7=opaquemat_194,
    Data8=opaquematnomass_3)
opaqueconstr_66 = HBOpaqueConstruction(name="Floor_03.01_GRroof", materials=merge_59)  # -> constr; plug-in component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

merge_60 = Merge(
    Data1=opaquemat_249,
    Data2=opaquemat_255,
    Data3=opaquemat_242,
    Data4=opaquemat_246,
    Data5=opaquemat_250,
    Data6=opaquemat_258)
opaqueconstr_67 = HBOpaqueConstruction(name="Floor_03.01_IntClg", materials=merge_60)  # -> constr; plug-in component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

merge_61 = Merge(
    Data1=opaquematnomass_2,
    Data2=opaquemat_194,
    Data3=opaquemat_234,
    Data4=opaquemat_232,
    Data5=opaquemat_239,
    Data6=opaquemat_235,
    Data7=opaquemat_237,
    Data8=opaquemat_236)
opaqueconstr_68 = HBOpaqueConstruction(name="Floor_03.01_GRfloor", materials=merge_61)  # -> constr; plug-in component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

# ----
# Ground Subset -
# same as interior floors,
# ground & roof must be inverse.
# 
# Base ground & roof construction
# on exterior floor for same archetype
# Make this same thickness as W1
panel_66 = Panel("Wall_03.01_UGwall")
opaqueconstr_69 = HBOpaqueConstruction(name=panel_66, materials=opaquemat_229)  # -> constr; plug-in component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
groundsubset_8 = HBGroundConstructionSubset(ground_wall=opaqueconstr_69, ground_roof=opaqueconstr_66, ground_floor=opaqueconstr_68)  # -> ground_set; plug-in component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
decnstrmat_14 = HBDeconstructMaterial(mat=groundsubset_8)  # -> values, attr_names, r_val_si, r_val_ip; plug-in component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
panel_67 = Panel(groundsubset_8)
panel_68 = Panel(decnstrmat_14.r_val_si)

merge_62 = Merge(
    Data1=opaquemat_208,
    Data2=opaquemat_210,
    Data3=opaquemat_212,
    Data4=opaquemat_211,
    Data5=opaquemat_217,
    Data6=opaquemat_214)
opaqueconstr_70 = HBOpaqueConstruction(name="Floor_03.01_IntFlr", materials=merge_62)  # -> constr; plug-in component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

merge_63 = Merge(
    Data1=opaquemat_261,
    Data2=opaquemat_265,
    Data3=opaquemat_271,
    Data4=opaquemat_267,
    Data5=opaquemat_273,
    Data6=opaquemat_272)
opaqueconstr_71 = HBOpaqueConstruction(name="Floor_03.01_IntFlr", materials=merge_63)  # -> constr; plug-in component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

merge_64 = Merge(
    Data1=opaquematnomass_5,
    Data2=opaquemat_196,
    Data3=opaquemat_270,
    Data4=opaquemat_263,
    Data5=opaquemat_268,
    Data6=opaquemat_269,
    Data7=opaquemat_266,
    Data8=opaquemat_264)
opaqueconstr_72 = HBOpaqueConstruction(name="Floor_03.01", materials=merge_64)  # -> constr; plug-in component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

# ----
# Interior Subset -
# Note interior floors & ceilings must
# be inverse of each other
interiorsubset_7 = HBInteriorConstructionSubset(interior_wall=opaqueconstr_55, ceiling=opaqueconstr_64, interior_floor=opaqueconstr_70)  # -> interior_set; plug-in component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
panel_69 = Panel(interiorsubset_7)

# ----
# Exterior Subset
exteriorsubset_7 = HBExteriorConstructionSubset(exterior_wall=opaqueconstr_60, exterior_roof=opaqueconstr_56, exposed_floor=opaqueconstr_61)  # -> exterior_set; plug-in component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
panel_70 = Panel(exteriorsubset_7)
decnstrmat_15 = HBDeconstructMaterial(mat=exteriorsubset_7)  # -> values, attr_names, r_val_si, r_val_ip; plug-in component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
panel_71 = Panel(decnstrmat_15.r_val_si)

# ----
# Interior Subset -
# Note interior floors & ceilings must
# be inverse of each other
interiorsubset_8 = HBInteriorConstructionSubset(interior_wall=opaqueconstr_62, ceiling=opaqueconstr_67, interior_floor=opaqueconstr_71)  # -> interior_set; plug-in component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
panel_72 = Panel(interiorsubset_8)

# ----
# Exterior Subset
exteriorsubset_8 = HBExteriorConstructionSubset(exterior_wall=opaqueconstr_63, exterior_roof=opaqueconstr_65, exposed_floor=opaqueconstr_72)  # -> exterior_set; plug-in component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
panel_73 = Panel(exteriorsubset_8)
decnstrmat_16 = HBDeconstructMaterial(mat=exteriorsubset_8)  # -> values, attr_names, r_val_si, r_val_ip; plug-in component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
panel_74 = Panel(decnstrmat_16.r_val_si)

# ----
# EXPORT TO JSON
panel_75 = Panel("pre_1980::ClimateZone4::Mass")
constructionset_7 = HBConstructionSet(
    name="R4SF_g0.35WinHC",
    base_constr_set=panel_75,
    exterior_subset=exteriorsubset_7,
    ground_subset=groundsubset_7,
    interior_subset=interiorsubset_7,
    subface_subset=subfacesubset_7)  # -> constr_set; plug-in component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
objtostr_7 = HBObjectToString(hb_obj=constructionset_7)  # -> hb_str; plug-in component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

panel_76 = Panel(objtostr_7)

# ----
# EXPORT TO JSON
panel_77 = Panel("pre_1980::ClimateZone4::Mass")
constructionset_8 = HBConstructionSet(
    name="R4TH_g0.35WinHC",
    base_constr_set=panel_77,
    exterior_subset=exteriorsubset_8,
    ground_subset=groundsubset_8,
    interior_subset=interiorsubset_8,
    subface_subset=subfacesubset_8)  # -> constr_set; plug-in component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
objtostr_8 = HBObjectToString(hb_obj=constructionset_8)  # -> hb_str; plug-in component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

panel_78 = Panel(objtostr_8)

opaquemat_274 = HBOpaqueMaterial(name="ExternalPlaster", thickness=".020", conductivity="0.900", density="1800", spec_heat="1000", roughness="Rough")  # -> mat; plug-in component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

opaquemat_275 = HBOpaqueMaterial(name="WallInsul_MW_Ext", thickness=".120", conductivity="0.034", density="80", spec_heat="1030", roughness="Rough")  # -> mat; plug-in component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

opaquemat_276 = HBOpaqueMaterial(
    name="RoofInsul_MW_ExtSheets",
    thickness=".160",
    conductivity="0.036",
    density="140",
    spec_heat="1030",
    roughness="Rough")  # -> mat; plug-in component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

opaquemat_277 = HBOpaqueMaterial(
    name="RoofInsul_MW_ExtSheets",
    thickness=".160",
    conductivity="0.036",
    density="140",
    spec_heat="1030",
    roughness="Rough")  # -> mat; plug-in component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

opaquemat_278 = HBOpaqueMaterial(name="ExternalPlaster", thickness=".020", conductivity="0.900", density="1800", spec_heat="1000", roughness="Rough")  # -> mat; plug-in component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

opaquemat_279 = HBOpaqueMaterial(name="WallInsul_MW_Ext", thickness=".120", conductivity="0.034", density="80", spec_heat="1030", roughness="Rough")  # -> mat; plug-in component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

opaquemat_280 = HBOpaqueMaterial(name="LtwtConcScreed_6.5cm", thickness=".065", conductivity=".580", density="900", spec_heat="1000", roughness="Rough")  # -> mat; plug-in component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

opaquemat_281 = HBOpaqueMaterial(name="CeramicTile", thickness="0.015", conductivity="1.470", density="1700", spec_heat="1000", roughness="MediumSmooth")  # -> mat; plug-in component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

opaquemat_282 = HBOpaqueMaterial(name="CementMortar", thickness="0.020", conductivity="1.400", density="2000", spec_heat="1000", roughness="Rough")  # -> mat; plug-in component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

opaquemat_283 = HBOpaqueMaterial(name="CementMortar", thickness="0.020", conductivity="1.400", density="2000", spec_heat="1000", roughness="Rough")  # -> mat; plug-in component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

opaquemat_284 = HBOpaqueMaterial(
    name="InternalPlaster",
    thickness="0.020",
    conductivity="0.700",
    density="1400",
    spec_heat="1000",
    roughness="MediumSmooth")  # -> mat; plug-in component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

opaquemat_285 = HBOpaqueMaterial(
    name="InternalPlaster",
    thickness="0.020",
    conductivity="0.700",
    density="1400",
    spec_heat="1000",
    roughness="MediumSmooth")  # -> mat; plug-in component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

opaquemat_286 = HBOpaqueMaterial(
    name="InternalPlaster",
    thickness="0.020",
    conductivity="0.700",
    density="1400",
    spec_heat="1000",
    roughness="MediumSmooth")  # -> mat; plug-in component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

opaquemat_287 = HBOpaqueMaterial(
    name="Slab_BrickBlkConc_24cm",
    thickness=".240",
    conductivity="0.715",
    density="900",
    spec_heat="1000",
    roughness="Rough")  # -> mat; plug-in component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

opaquemat_288 = HBOpaqueMaterial(name="SolidBrick", thickness=".270", conductivity="0.720", density="1800", spec_heat="1000", roughness="Rough")  # -> mat; plug-in component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

opaquemat_289 = HBOpaqueMaterial(name="CeramicTile", thickness="0.015", conductivity="1.470", density="1700", spec_heat="1000", roughness="MediumSmooth")  # -> mat; plug-in component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

opaquemat_290 = HBOpaqueMaterial(name="CementMortar_Thick", thickness="0.030", conductivity="1.400", density="2000", spec_heat="1000", roughness="Rough")  # -> mat; plug-in component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

opaquemat_291 = HBOpaqueMaterial(name="HollowBricks_Mod", thickness="0.250", conductivity="0.420", density="1000", spec_heat="1000", roughness="Rough")  # -> mat; plug-in component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

opaquemat_292 = HBOpaqueMaterial(
    name="InternalPlaster",
    thickness="0.020",
    conductivity="0.700",
    density="1400",
    spec_heat="1000",
    roughness="MediumSmooth")  # -> mat; plug-in component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

opaquemat_293 = HBOpaqueMaterial(name="Concrete_Reg", thickness="0.100", conductivity="1.160", density="2000", spec_heat="1000", roughness="Rough")  # -> mat; plug-in component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

opaquemat_294 = HBOpaqueMaterial(name="CementMortar", thickness="0.020", conductivity="1.400", density="2000", spec_heat="1000", roughness="Rough")  # -> mat; plug-in component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

opaquemat_295 = HBOpaqueMaterial(name="GravelRiverStone", thickness=".147", conductivity="1.200", density="1700", spec_heat="1000", roughness="VeryRough")  # -> mat; plug-in component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

opaquemat_296 = HBOpaqueMaterial(name="CeramicTile", thickness="0.015", conductivity="1.470", density="1700", spec_heat="1000", roughness="MediumSmooth")  # -> mat; plug-in component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

opaquemat_297 = HBOpaqueMaterial(
    name="Slab_BrickBlkConc_24cm",
    thickness=".240",
    conductivity="0.715",
    density="900",
    spec_heat="1000",
    roughness="Rough")  # -> mat; plug-in component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

opaquemat_298 = HBOpaqueMaterial(name="LtwtConcScreed_6.5cm", thickness=".065", conductivity=".580", density="900", spec_heat="1000", roughness="Rough")  # -> mat; plug-in component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

opaquemat_299 = HBOpaqueMaterial(name="CementMortar", thickness="0.020", conductivity="1.400", density="2000", spec_heat="1000", roughness="Rough")  # -> mat; plug-in component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

opaquemat_300 = HBOpaqueMaterial(name="CeramicTile", thickness="0.015", conductivity="1.470", density="1700", spec_heat="1000", roughness="MediumSmooth")  # -> mat; plug-in component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

opaquemat_301 = HBOpaqueMaterial(name="CementMortar_Thick", thickness="0.030", conductivity="1.400", density="2000", spec_heat="1000", roughness="Rough")  # -> mat; plug-in component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

opaquemat_302 = HBOpaqueMaterial(name="Concrete_Reg", thickness="0.100", conductivity="1.160", density="2000", spec_heat="1000", roughness="Rough")  # -> mat; plug-in component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

opaquemat_303 = HBOpaqueMaterial(name="GravelRiverStone", thickness=".147", conductivity="1.200", density="1700", spec_heat="1000", roughness="VeryRough")  # -> mat; plug-in component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

opaquemat_304 = HBOpaqueMaterial(name="CementMortar", thickness="0.020", conductivity="1.400", density="2000", spec_heat="1000", roughness="Rough")  # -> mat; plug-in component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

opaquemat_305 = HBOpaqueMaterial(name="HollowBricks_Mod", thickness="0.250", conductivity="0.420", density="1000", spec_heat="1000", roughness="Rough")  # -> mat; plug-in component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

opaquemat_306 = HBOpaqueMaterial(name="CeramicTile", thickness="0.015", conductivity="1.470", density="1700", spec_heat="1000", roughness="MediumSmooth")  # -> mat; plug-in component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

# ----
# R5SF
opaquemat_307 = HBOpaqueMaterial(name="ExternalPlaster_Thin", thickness=".010", conductivity="0.900", density="1800", spec_heat="1000", roughness="Rough")  # -> mat; plug-in component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

opaquemat_308 = HBOpaqueMaterial(name="CementMortar_Thick", thickness="0.030", conductivity="1.400", density="2000", spec_heat="1000", roughness="Rough")  # -> mat; plug-in component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

opaquemat_309 = HBOpaqueMaterial(
    name="InternalPlaster_Thin",
    thickness="0.010",
    conductivity="0.700",
    density="1400",
    spec_heat="1000",
    roughness="MediumSmooth")  # -> mat; plug-in component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

opaquemat_310 = HBOpaqueMaterial(name="Concrete_Reg", thickness="0.100", conductivity="1.160", density="2000", spec_heat="1000", roughness="Rough")  # -> mat; plug-in component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

opaquemat_311 = HBOpaqueMaterial(name="GravelRiverStone", thickness=".147", conductivity="1.200", density="1700", spec_heat="1000", roughness="VeryRough")  # -> mat; plug-in component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

opaquemat_312 = HBOpaqueMaterial(name="ReinforcedConcrete", thickness="0.040", conductivity="1.910", density="2400", spec_heat="1000", roughness="Rough")  # -> mat; plug-in component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

opaquemat_313 = HBOpaqueMaterial(
    name="Slab_BrickBlkConc_16cm",
    thickness=".160",
    conductivity="0.582",
    density="900",
    spec_heat="1000",
    roughness="Rough")  # -> mat; plug-in component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

# ----
# Hard code window
# U 1.40, g 0.35, VT 0.55
panel_79 = Panel("0.55")
windowmat_9 = HBWindowMaterial(name="U 1.40 Dbl LoE", u_factor="1.40", shgc="0.35", t_vis=panel_79)  # -> mat; plug-in component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
windowconstr_9 = HBWindowConstruction(name="U 1.40 Dbl LoE", materials=windowmat_9)  # -> constr; plug-in component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
decnstrconstr_9 = HBDeconstructConstruction(constr=windowconstr_9)  # -> materials, layers, r_val_si, r_val_ip, u_fac_si, u_fac_ip, shgc, t_sol, t_vis; plug-in component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
panel_80 = Panel([decnstrconstr_9.r_val_si, decnstrconstr_9.u_fac_si, decnstrconstr_9.shgc, decnstrconstr_9.t_sol, decnstrconstr_9.t_vis])
subfacesubset_9 = HBSubfaceSubset(window=windowconstr_9, skylight=windowconstr_9, operable=windowconstr_9, glass_door=windowconstr_9)  # -> subface_set; plug-in component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

opaquemat_314 = HBOpaqueMaterial(name="LtwtConcScreed_6.5cm", thickness=".065", conductivity=".580", density="900", spec_heat="1000", roughness="Rough")  # -> mat; plug-in component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

opaquemat_315 = HBOpaqueMaterial(name="CeramicTile", thickness="0.015", conductivity="1.470", density="1700", spec_heat="1000", roughness="MediumSmooth")  # -> mat; plug-in component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

opaquemat_316 = HBOpaqueMaterial(name="CementMortar", thickness="0.020", conductivity="1.400", density="2000", spec_heat="1000", roughness="Rough")  # -> mat; plug-in component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

opaquemat_317 = HBOpaqueMaterial(name="CementMortar", thickness="0.020", conductivity="1.400", density="2000", spec_heat="1000", roughness="Rough")  # -> mat; plug-in component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

opaquemat_318 = HBOpaqueMaterial(
    name="InternalPlaster",
    thickness="0.020",
    conductivity="0.700",
    density="1400",
    spec_heat="1000",
    roughness="MediumSmooth")  # -> mat; plug-in component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

opaquemat_319 = HBOpaqueMaterial(name="CeramicTile", thickness="0.015", conductivity="1.470", density="1700", spec_heat="1000", roughness="MediumSmooth")  # -> mat; plug-in component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

opaquemat_320 = HBOpaqueMaterial(name="CementMortar_Thick", thickness="0.030", conductivity="1.400", density="2000", spec_heat="1000", roughness="Rough")  # -> mat; plug-in component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

opaquemat_321 = HBOpaqueMaterial(
    name="InternalPlaster",
    thickness="0.020",
    conductivity="0.700",
    density="1400",
    spec_heat="1000",
    roughness="MediumSmooth")  # -> mat; plug-in component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

opaquemat_322 = HBOpaqueMaterial(
    name="InternalPlaster",
    thickness="0.020",
    conductivity="0.700",
    density="1400",
    spec_heat="1000",
    roughness="MediumSmooth")  # -> mat; plug-in component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

opaquemat_323 = HBOpaqueMaterial(
    name="Slab_BrickBlkConc_24cm",
    thickness=".240",
    conductivity="0.715",
    density="900",
    spec_heat="1000",
    roughness="Rough")  # -> mat; plug-in component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

opaquemat_324 = HBOpaqueMaterial(name="SolidBrick", thickness=".270", conductivity="0.720", density="1800", spec_heat="1000", roughness="Rough")  # -> mat; plug-in component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

opaquemat_325 = HBOpaqueMaterial(name="CeramicTile", thickness="0.015", conductivity="1.470", density="1700", spec_heat="1000", roughness="MediumSmooth")  # -> mat; plug-in component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

# ----
# R5TH
opaquemat_326 = HBOpaqueMaterial(name="ExternalPlaster_Thin", thickness=".010", conductivity="0.900", density="1800", spec_heat="1000", roughness="Rough")  # -> mat; plug-in component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

opaquemat_327 = HBOpaqueMaterial(name="Concrete_Reg", thickness="0.100", conductivity="1.160", density="2000", spec_heat="1000", roughness="Rough")  # -> mat; plug-in component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

opaquemat_328 = HBOpaqueMaterial(name="CementMortar_Thick", thickness="0.030", conductivity="1.400", density="2000", spec_heat="1000", roughness="Rough")  # -> mat; plug-in component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

opaquemat_329 = HBOpaqueMaterial(
    name="InternalPlaster",
    thickness="0.020",
    conductivity="0.700",
    density="1400",
    spec_heat="1000",
    roughness="MediumSmooth")  # -> mat; plug-in component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

opaquemat_330 = HBOpaqueMaterial(name="HollowBricks_Mod", thickness="0.250", conductivity="0.420", density="1000", spec_heat="1000", roughness="Rough")  # -> mat; plug-in component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

opaquemat_331 = HBOpaqueMaterial(name="GravelRiverStone", thickness=".147", conductivity="1.200", density="1700", spec_heat="1000", roughness="VeryRough")  # -> mat; plug-in component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

opaquemat_332 = HBOpaqueMaterial(name="HollowBricks_Mod", thickness="0.250", conductivity="0.420", density="1000", spec_heat="1000", roughness="Rough")  # -> mat; plug-in component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

opaquemat_333 = HBOpaqueMaterial(name="Concrete_Reg", thickness="0.100", conductivity="1.160", density="2000", spec_heat="1000", roughness="Rough")  # -> mat; plug-in component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

opaquemat_334 = HBOpaqueMaterial(name="GravelRiverStone", thickness=".147", conductivity="1.200", density="1700", spec_heat="1000", roughness="VeryRough")  # -> mat; plug-in component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

opaquemat_335 = HBOpaqueMaterial(
    name="InternalPlaster_Thin",
    thickness="0.010",
    conductivity="0.700",
    density="1400",
    spec_heat="1000",
    roughness="MediumSmooth")  # -> mat; plug-in component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

opaquemat_336 = HBOpaqueMaterial(name="CementMortar", thickness="0.020", conductivity="1.400", density="2000", spec_heat="1000", roughness="Rough")  # -> mat; plug-in component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

opaquemat_337 = HBOpaqueMaterial(name="CeramicTile", thickness="0.015", conductivity="1.470", density="1700", spec_heat="1000", roughness="MediumSmooth")  # -> mat; plug-in component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

opaquemat_338 = HBOpaqueMaterial(
    name="Slab_BrickBlkConc_24cm",
    thickness=".240",
    conductivity="0.715",
    density="900",
    spec_heat="1000",
    roughness="Rough")  # -> mat; plug-in component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

opaquemat_339 = HBOpaqueMaterial(name="LtwtConcScreed_6.5cm", thickness=".065", conductivity=".580", density="900", spec_heat="1000", roughness="Rough")  # -> mat; plug-in component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

opaquemat_340 = HBOpaqueMaterial(
    name="Slab_BrickBlkConc_16cm",
    thickness=".160",
    conductivity="0.740",
    density="900",
    spec_heat="1000",
    roughness="Rough")  # -> mat; plug-in component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

opaquemat_341 = HBOpaqueMaterial(name="CementMortar", thickness="0.020", conductivity="1.400", density="2000", spec_heat="1000", roughness="Rough")  # -> mat; plug-in component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

opaquemat_342 = HBOpaqueMaterial(name="CementMortar", thickness="0.020", conductivity="1.400", density="2000", spec_heat="1000", roughness="Rough")  # -> mat; plug-in component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

opaquemat_343 = HBOpaqueMaterial(
    name="InternalPlaster",
    thickness="0.020",
    conductivity="0.700",
    density="1400",
    spec_heat="1000",
    roughness="MediumSmooth")  # -> mat; plug-in component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

opaquemat_344 = HBOpaqueMaterial(
    name="ReinforcedConcrete_Poured",
    thickness=".040",
    conductivity="1.910",
    density="2400",
    spec_heat="1000",
    roughness="Rough")  # -> mat; plug-in component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

opaquemat_345 = HBOpaqueMaterial(name="CeramicTile", thickness="0.015", conductivity="1.470", density="1700", spec_heat="1000", roughness="MediumSmooth")  # -> mat; plug-in component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

opaquemat_346 = HBOpaqueMaterial(name="CementMortar_Thick", thickness="0.030", conductivity="1.400", density="2000", spec_heat="1000", roughness="Rough")  # -> mat; plug-in component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

opaquemat_347 = HBOpaqueMaterial(name="Concrete_Reg", thickness="0.100", conductivity="1.160", density="2000", spec_heat="1000", roughness="Rough")  # -> mat; plug-in component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

opaquemat_348 = HBOpaqueMaterial(name="GravelRiverStone", thickness=".147", conductivity="1.200", density="1700", spec_heat="1000", roughness="VeryRough")  # -> mat; plug-in component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

# ----
# Hard code window
# U 1.40, g 0.35, VT 0.55
panel_81 = Panel("0.55")
windowmat_10 = HBWindowMaterial(name="U 1.40 Dbl LoE", u_factor="1.40", shgc="0.35", t_vis=panel_81)  # -> mat; plug-in component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
windowconstr_10 = HBWindowConstruction(name="U 1.40 Dbl LoE", materials=windowmat_10)  # -> constr; plug-in component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
decnstrconstr_10 = HBDeconstructConstruction(constr=windowconstr_10)  # -> materials, layers, r_val_si, r_val_ip, u_fac_si, u_fac_ip, shgc, t_sol, t_vis; plug-in component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
panel_82 = Panel([decnstrconstr_10.r_val_si, decnstrconstr_10.u_fac_si, decnstrconstr_10.shgc, decnstrconstr_10.t_sol, decnstrconstr_10.t_vis])
subfacesubset_10 = HBSubfaceSubset(window=windowconstr_10, skylight=windowconstr_10, operable=windowconstr_10, glass_door=windowconstr_10)  # -> subface_set; plug-in component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

merge_65 = Merge(Data1=opaquemat_295, Data2=opaquemat_293, Data3=opaquemat_290, Data4=opaquemat_289)
opaqueconstr_73 = HBOpaqueConstruction(name="Floor_01.04_GRfloor", materials=merge_65)  # -> constr; plug-in component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

merge_66 = Merge(Data1=opaquemat_285, Data2=opaquemat_291, Data3=opaquemat_286)
opaqueconstr_74 = HBOpaqueConstruction(name="Wall_04.02_Interior", materials=merge_66)  # -> constr; plug-in component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

merge_67 = Merge(Data1=opaquemat_300, Data2=opaquemat_301, Data3=opaquemat_302, Data4=opaquemat_303)
opaqueconstr_75 = HBOpaqueConstruction(name="Floor_01.04_GRroof", materials=merge_67)  # -> constr; plug-in component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

# ----
# Ground Subset -
# same as interior floors,
# ground & roof must be inverse.
# 
# Base ground & roof construction
# on exterior floor for same archetype
# Make this same thickness as W1
panel_83 = Panel("Wall_04.02_UGwall")
opaqueconstr_76 = HBOpaqueConstruction(name=panel_83, materials=opaquemat_288)  # -> constr; plug-in component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
groundsubset_9 = HBGroundConstructionSubset(ground_wall=opaqueconstr_76, ground_roof=opaqueconstr_75, ground_floor=opaqueconstr_73)  # -> ground_set; plug-in component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
decnstrmat_17 = HBDeconstructMaterial(mat=groundsubset_9)  # -> values, attr_names, r_val_si, r_val_ip; plug-in component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
panel_84 = Panel(groundsubset_9)
panel_85 = Panel(decnstrmat_17.r_val_si)

merge_68 = Merge(Data1=opaquemat_274, Data2=opaquemat_275, Data3=opaquemat_307, Data4=opaquemat_305, Data5=opaquemat_309)
opaqueconstr_77 = HBOpaqueConstruction(name="Wall_04.02", materials=merge_68)  # -> constr; plug-in component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

merge_69 = Merge(
    Data1=opaquemat_281,
    Data2=opaquemat_282,
    Data3=opaquemat_280,
    Data4=opaquemat_283,
    Data5=opaquemat_287,
    Data6=opaquemat_284)
opaqueconstr_78 = HBOpaqueConstruction(name="Floor_03.01_IntClg", materials=merge_69)  # -> constr; plug-in component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

merge_70 = Merge(Data1=opaquemat_276, Data2=opaquemat_304, Data3=opaquemat_312, Data4=opaquemat_313)
opaqueconstr_79 = HBOpaqueConstruction(name="Roof_03.01", materials=merge_70)  # -> constr; plug-in component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

merge_71 = Merge(Data1=opaquemat_311, Data2=opaquemat_310, Data3=opaquemat_308, Data4=opaquemat_306)
opaqueconstr_80 = HBOpaqueConstruction(name="Floor_01.04", materials=merge_71)  # -> constr; plug-in component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

merge_72 = Merge(
    Data1=opaquemat_292,
    Data2=opaquemat_297,
    Data3=opaquemat_294,
    Data4=opaquemat_298,
    Data5=opaquemat_299,
    Data6=opaquemat_296)
opaqueconstr_81 = HBOpaqueConstruction(name="Floor_03.01_IntFlr", materials=merge_72)  # -> constr; plug-in component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

merge_73 = Merge(Data1=opaquemat_334, Data2=opaquemat_333, Data3=opaquemat_328, Data4=opaquemat_325)
opaqueconstr_82 = HBOpaqueConstruction(name="Floor_01.04_GRfloor", materials=merge_73)  # -> constr; plug-in component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

merge_74 = Merge(Data1=opaquemat_321, Data2=opaquemat_332, Data3=opaquemat_322)
opaqueconstr_83 = HBOpaqueConstruction(name="Wall_04.02_Interior", materials=merge_74)  # -> constr; plug-in component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

merge_75 = Merge(Data1=opaquemat_345, Data2=opaquemat_346, Data3=opaquemat_347, Data4=opaquemat_348)
opaqueconstr_84 = HBOpaqueConstruction(name="Floor_01.04_GRroof", materials=merge_75)  # -> constr; plug-in component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

# ----
# Ground Subset -
# same as interior floors,
# ground & roof must be inverse.
# 
# Base ground & roof construction
# on exterior floor for same archetype
# Make this same thickness as W1
panel_86 = Panel("Wall_04.02_UGwall")
opaqueconstr_85 = HBOpaqueConstruction(name=panel_86, materials=opaquemat_324)  # -> constr; plug-in component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
groundsubset_10 = HBGroundConstructionSubset(ground_wall=opaqueconstr_85, ground_roof=opaqueconstr_84, ground_floor=opaqueconstr_82)  # -> ground_set; plug-in component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
decnstrmat_18 = HBDeconstructMaterial(mat=groundsubset_10)  # -> values, attr_names, r_val_si, r_val_ip; plug-in component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
panel_87 = Panel(groundsubset_10)
panel_88 = Panel(decnstrmat_18.r_val_si)

merge_76 = Merge(Data1=opaquemat_278, Data2=opaquemat_279, Data3=opaquemat_326, Data4=opaquemat_330, Data5=opaquemat_335)
opaqueconstr_86 = HBOpaqueConstruction(name="Wall_04.02", materials=merge_76)  # -> constr; plug-in component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

merge_77 = Merge(Data1=opaquemat_277, Data2=opaquemat_341, Data3=opaquemat_344, Data4=opaquemat_340, Data5=opaquemat_343)
opaqueconstr_87 = HBOpaqueConstruction(name="Roof_03.02", materials=merge_77)  # -> constr; plug-in component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

merge_78 = Merge(Data1=opaquemat_331, Data2=opaquemat_327, Data4=opaquemat_320, Data5=opaquemat_319)
opaqueconstr_88 = HBOpaqueConstruction(name="Floor_01.04", materials=merge_78)  # -> constr; plug-in component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

merge_79 = Merge(
    Data1=opaquemat_315,
    Data2=opaquemat_316,
    Data3=opaquemat_314,
    Data4=opaquemat_317,
    Data5=opaquemat_323,
    Data6=opaquemat_318)
opaqueconstr_89 = HBOpaqueConstruction(name="Floor_03.01_IntClg", materials=merge_79)  # -> constr; plug-in component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

# ----
# Interior Subset -
# Note interior floors & ceilings must
# be inverse of each other
interiorsubset_9 = HBInteriorConstructionSubset(interior_wall=opaqueconstr_74, ceiling=opaqueconstr_78, interior_floor=opaqueconstr_81)  # -> interior_set; plug-in component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
panel_89 = Panel(interiorsubset_9)

# ----
# Exterior Subset
exteriorsubset_9 = HBExteriorConstructionSubset(exterior_wall=opaqueconstr_77, exterior_roof=opaqueconstr_79, exposed_floor=opaqueconstr_80)  # -> exterior_set; plug-in component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
panel_90 = Panel(exteriorsubset_9)
decnstrmat_19 = HBDeconstructMaterial(mat=exteriorsubset_9)  # -> values, attr_names, r_val_si, r_val_ip; plug-in component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
panel_91 = Panel(decnstrmat_19.r_val_si)

merge_80 = Merge(
    Data1=opaquemat_329,
    Data2=opaquemat_338,
    Data3=opaquemat_336,
    Data4=opaquemat_339,
    Data5=opaquemat_342,
    Data6=opaquemat_337)
opaqueconstr_90 = HBOpaqueConstruction(name="Floor_03.01_IntFlr", materials=merge_80)  # -> constr; plug-in component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

# ----
# Interior Subset -
# Note interior floors & ceilings must
# be inverse of each other
interiorsubset_10 = HBInteriorConstructionSubset(interior_wall=opaqueconstr_83, ceiling=opaqueconstr_89, interior_floor=opaqueconstr_90)  # -> interior_set; plug-in component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
panel_92 = Panel(interiorsubset_10)

# ----
# Exterior Subset
exteriorsubset_10 = HBExteriorConstructionSubset(exterior_wall=opaqueconstr_86, exterior_roof=opaqueconstr_87, exposed_floor=opaqueconstr_88)  # -> exterior_set; plug-in component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
panel_93 = Panel(exteriorsubset_10)
decnstrmat_20 = HBDeconstructMaterial(mat=exteriorsubset_10)  # -> values, attr_names, r_val_si, r_val_ip; plug-in component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
panel_94 = Panel(decnstrmat_20.r_val_si)

# ----
# EXPORT TO JSON
panel_95 = Panel("pre_1980::ClimateZone4::Mass")
constructionset_9 = HBConstructionSet(
    name="R5SF_g0.35WinHC",
    base_constr_set=panel_95,
    exterior_subset=exteriorsubset_9,
    ground_subset=groundsubset_9,
    interior_subset=interiorsubset_9,
    subface_subset=subfacesubset_9)  # -> constr_set; plug-in component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
objtostr_9 = HBObjectToString(hb_obj=constructionset_9)  # -> hb_str; plug-in component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

panel_96 = Panel(objtostr_9)

# ----
# EXPORT TO JSON
panel_97 = Panel("pre_1980::ClimateZone4::Mass")
constructionset_10 = HBConstructionSet(
    name="R5TH_g0.35WinHC",
    base_constr_set=panel_97,
    exterior_subset=exteriorsubset_10,
    ground_subset=groundsubset_10,
    interior_subset=interiorsubset_10,
    subface_subset=subfacesubset_10)  # -> constr_set; plug-in component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
objtostr_10 = HBObjectToString(hb_obj=constructionset_10)  # -> hb_str; plug-in component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

panel_98 = Panel(objtostr_10)

opaquemat_349 = HBOpaqueMaterial(name="ExternalPlaster", thickness=".020", conductivity="0.900", density="1800", spec_heat="1000", roughness="Rough")  # -> mat; plug-in component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

opaquemat_350 = HBOpaqueMaterial(name="WallInsul_MW_Ext", thickness=".100", conductivity="0.034", density="80", spec_heat="1030", roughness="Rough")  # -> mat; plug-in component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

opaquemat_351 = HBOpaqueMaterial(name="FloorInsul_MW", thickness=".100", conductivity="0.034", density="80", spec_heat="1030", roughness="Rough")  # -> mat; plug-in component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

opaquemat_352 = HBOpaqueMaterial(name="FloorInsul_MW", thickness=".100", conductivity="0.034", density="80", spec_heat="1030", roughness="Rough")  # -> mat; plug-in component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

opaquemat_353 = HBOpaqueMaterial(
    name="RoofInsul_MW_ExtSheets",
    thickness=".140",
    conductivity="0.036",
    density="140",
    spec_heat="1030",
    roughness="Rough")  # -> mat; plug-in component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

opaquemat_354 = HBOpaqueMaterial(
    name="RoofInsul_MW_ExtSheets",
    thickness=".140",
    conductivity="0.036",
    density="140",
    spec_heat="1030",
    roughness="Rough")  # -> mat; plug-in component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

opaquemat_355 = HBOpaqueMaterial(name="FloorInsul_MW", thickness=".100", conductivity="0.034", density="80", spec_heat="1030", roughness="Rough")  # -> mat; plug-in component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

opaquemat_356 = HBOpaqueMaterial(name="ExternalPlaster", thickness=".020", conductivity="0.900", density="1800", spec_heat="1000", roughness="Rough")  # -> mat; plug-in component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

opaquemat_357 = HBOpaqueMaterial(name="WallInsul_MW_Ext", thickness=".100", conductivity="0.034", density="80", spec_heat="1030", roughness="Rough")  # -> mat; plug-in component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

opaquemat_358 = HBOpaqueMaterial(name="FloorInsul_MW", thickness=".100", conductivity="0.034", density="80", spec_heat="1030", roughness="Rough")  # -> mat; plug-in component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

opaquemat_359 = HBOpaqueMaterial(name="CeramicTile", thickness="0.015", conductivity="1.470", density="1700", spec_heat="1000", roughness="MediumSmooth")  # -> mat; plug-in component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

opaquemat_360 = HBOpaqueMaterial(name="CementMortar", thickness="0.020", conductivity="1.400", density="2000", spec_heat="1000", roughness="Rough")  # -> mat; plug-in component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

opaquemat_361 = HBOpaqueMaterial(name="LtwtConcScreed_2cm", thickness=".020", conductivity=".580", density="400", spec_heat="1000", roughness="Rough")  # -> mat; plug-in component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

opaquematnomass_6 = HBOpaqueMaterialNoMass(name="FictitiousLayer_R0.3", r_value="0.3")  # -> mat; plug-in component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

opaquemat_362 = HBOpaqueMaterial(
    name="InsulationPanel",
    thickness="0.017",
    conductivity="0.045",
    density="30",
    spec_heat="1220",
    roughness="MediumSmooth")  # -> mat; plug-in component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

opaquematnomass_7 = HBOpaqueMaterialNoMass(name="FictitiousLayer_R0.3", r_value="0.3")  # -> mat; plug-in component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

opaquemat_363 = HBOpaqueMaterial(name="LtwtConcScreed_2cm", thickness=".020", conductivity=".580", density="400", spec_heat="1000", roughness="Rough")  # -> mat; plug-in component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

opaquemat_364 = HBOpaqueMaterial(name="CementMortar", thickness="0.020", conductivity="1.400", density="2000", spec_heat="1000", roughness="Rough")  # -> mat; plug-in component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

opaquemat_365 = HBOpaqueMaterial(
    name="Slab_BrickBlkConc_16cm",
    thickness=".160",
    conductivity="0.560",
    density="900",
    spec_heat="1000",
    roughness="Rough")  # -> mat; plug-in component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

opaquemat_366 = HBOpaqueMaterial(name="ExternalPlaster", thickness=".020", conductivity="0.900", density="1800", spec_heat="1000", roughness="Rough")  # -> mat; plug-in component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

opaquemat_367 = HBOpaqueMaterial(
    name="InternalPlaster",
    thickness=".020",
    conductivity="0.700",
    density="1400",
    spec_heat="1000",
    roughness="MediumSmooth")  # -> mat; plug-in component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

opaquemat_368 = HBOpaqueMaterial(name="HollowBrick_12cm", thickness="0.120", conductivity="0.387", density="800", spec_heat="1000", roughness="Rough")  # -> mat; plug-in component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

opaquemat_369 = HBOpaqueMaterial(
    name="Slab_BrickBlkConc_16cm",
    thickness=".160",
    conductivity="0.560",
    density="900",
    spec_heat="1000",
    roughness="Rough")  # -> mat; plug-in component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

opaquemat_370 = HBOpaqueMaterial(name="CementMortar", thickness="0.020", conductivity="1.400", density="2000", spec_heat="1000", roughness="Rough")  # -> mat; plug-in component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

opaquemat_371 = HBOpaqueMaterial(name="SolidBrick", thickness=".382", conductivity="0.720", density="1800", spec_heat="1000", roughness="Rough")  # -> mat; plug-in component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

opaquemat_372 = HBOpaqueMaterial(
    name="InternalPlaster",
    thickness="0.020",
    conductivity="0.700",
    density="1400",
    spec_heat="1000",
    roughness="MediumSmooth")  # -> mat; plug-in component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

opaquemat_373 = HBOpaqueMaterial(name="CeramicTile", thickness="0.015", conductivity="1.470", density="1700", spec_heat="1000", roughness="MediumSmooth")  # -> mat; plug-in component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

opaquemat_374 = HBOpaqueMaterial(name="ExternalPlaster", thickness=".020", conductivity="0.900", density="1800", spec_heat="1000", roughness="Rough")  # -> mat; plug-in component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

opaquemat_375 = HBOpaqueMaterial(
    name="InsulationPanel",
    thickness="0.017",
    conductivity="0.045",
    density="30",
    spec_heat="1220",
    roughness="MediumSmooth")  # -> mat; plug-in component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

opaquemat_376 = HBOpaqueMaterial(name="CementMortar", thickness="0.020", conductivity="1.400", density="2000", spec_heat="1000", roughness="Rough")  # -> mat; plug-in component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

opaquemat_377 = HBOpaqueMaterial(name="LtwtConcScreed_2cm", thickness=".020", conductivity=".580", density="400", spec_heat="1000", roughness="Rough")  # -> mat; plug-in component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

opaquemat_378 = HBOpaqueMaterial(
    name="InternalPlaster",
    thickness="0.020",
    conductivity="0.700",
    density="1400",
    spec_heat="1000",
    roughness="MediumSmooth")  # -> mat; plug-in component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

# ----
# R6SF
opaquemat_379 = HBOpaqueMaterial(name="ExternalPlaster", thickness=".020", conductivity="0.900", density="1800", spec_heat="1000", roughness="Rough")  # -> mat; plug-in component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

opaquemat_380 = HBOpaqueMaterial(name="HollowBrick_12cm", thickness="0.120", conductivity="0.387", density="800", spec_heat="1000", roughness="Rough")  # -> mat; plug-in component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

opaquemat_381 = HBOpaqueMaterial(
    name="InternalPlaster",
    thickness="0.020",
    conductivity="0.700",
    density="1400",
    spec_heat="1000",
    roughness="MediumSmooth")  # -> mat; plug-in component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

opaquemat_382 = HBOpaqueMaterial(name="CeramicTile", thickness="0.015", conductivity="1.470", density="1700", spec_heat="1000", roughness="MediumSmooth")  # -> mat; plug-in component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

opaquemat_383 = HBOpaqueMaterial(name="SemiSolidBrick_25cm", thickness="0.250", conductivity="0.400", density="1000", spec_heat="1000", roughness="Rough")  # -> mat; plug-in component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

opaquemat_384 = HBOpaqueMaterial(name="InsulatedCavity", thickness="0.0124", conductivity="0.045", density="30", spec_heat="570", roughness="Rough")  # -> mat; plug-in component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

opaquemat_385 = HBOpaqueMaterial(
    name="InternalPlaster",
    thickness="0.020",
    conductivity="0.700",
    density="1400",
    spec_heat="1000",
    roughness="MediumSmooth")  # -> mat; plug-in component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

opaquemat_386 = HBOpaqueMaterial(name="CementMortar", thickness="0.020", conductivity="1.400", density="2000", spec_heat="1000", roughness="Rough")  # -> mat; plug-in component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

opaquemat_387 = HBOpaqueMaterial(
    name="Slab_BrickBlkConc_16cm",
    thickness=".160",
    conductivity="0.560",
    density="900",
    spec_heat="1000",
    roughness="Rough")  # -> mat; plug-in component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

opaquemat_388 = HBOpaqueMaterial(name="HollowBrick_8cm", thickness="0.080", conductivity="0.400", density="800", spec_heat="1000", roughness="Rough")  # -> mat; plug-in component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

opaquemat_389 = HBOpaqueMaterial(name="CementMortar", thickness="0.020", conductivity="1.400", density="2000", spec_heat="1000", roughness="Rough")  # -> mat; plug-in component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

opaquemat_390 = HBOpaqueMaterial(
    name="Slab_BrickBlkConc_16cm",
    thickness=".160",
    conductivity="0.560",
    density="900",
    spec_heat="1000",
    roughness="Rough")  # -> mat; plug-in component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

opaquemat_391 = HBOpaqueMaterial(name="CementMortar", thickness="0.020", conductivity="1.400", density="2000", spec_heat="1000", roughness="Rough")  # -> mat; plug-in component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

opaquemat_392 = HBOpaqueMaterial(name="CementMortar", thickness="0.020", conductivity="1.400", density="2000", spec_heat="1000", roughness="Rough")  # -> mat; plug-in component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

opaquemat_393 = HBOpaqueMaterial(name="CeramicTile", thickness="0.015", conductivity="1.470", density="1700", spec_heat="1000", roughness="MediumSmooth")  # -> mat; plug-in component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

opaquemat_394 = HBOpaqueMaterial(name="LtwtConcScreed_2cm", thickness=".020", conductivity=".580", density="400", spec_heat="1000", roughness="Rough")  # -> mat; plug-in component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

opaquemat_395 = HBOpaqueMaterial(
    name="InsulationPanel",
    thickness="0.0173",
    conductivity="0.045",
    density="30",
    spec_heat="1220",
    roughness="MediumSmooth")  # -> mat; plug-in component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

opaquemat_396 = HBOpaqueMaterial(name="CementMortar", thickness="0.020", conductivity="1.400", density="2000", spec_heat="1000", roughness="Rough")  # -> mat; plug-in component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

opaquematnomass_8 = HBOpaqueMaterialNoMass(name="FictitiousLayer_R0.3", r_value="0.3")  # -> mat; plug-in component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

opaquemat_397 = HBOpaqueMaterial(name="CeramicTile", thickness="0.015", conductivity="1.470", density="1700", spec_heat="1000", roughness="MediumSmooth")  # -> mat; plug-in component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

opaquemat_398 = HBOpaqueMaterial(name="CementMortar", thickness="0.020", conductivity="1.400", density="2000", spec_heat="1000", roughness="Rough")  # -> mat; plug-in component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

opaquemat_399 = HBOpaqueMaterial(name="LtwtConcScreed_2cm", thickness=".020", conductivity=".580", density="400", spec_heat="1000", roughness="Rough")  # -> mat; plug-in component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

opaquemat_400 = HBOpaqueMaterial(
    name="InternalPlaster",
    thickness="0.020",
    conductivity="0.700",
    density="1400",
    spec_heat="1000",
    roughness="MediumSmooth")  # -> mat; plug-in component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

opaquemat_401 = HBOpaqueMaterial(name="ReinforcedConcrete", thickness="0.040", conductivity="1.910", density="2400", spec_heat="1000", roughness="Rough")  # -> mat; plug-in component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

opaquemat_402 = HBOpaqueMaterial(
    name="Slab_BrickBlkConc_16cm",
    thickness=".160",
    conductivity="0.543",
    density="900",
    spec_heat="1000",
    roughness="Rough")  # -> mat; plug-in component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

opaquemat_403 = HBOpaqueMaterial(name="ExternalPlaster", thickness=".020", conductivity="0.900", density="1800", spec_heat="1000", roughness="Rough")  # -> mat; plug-in component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

opaquemat_404 = HBOpaqueMaterial(
    name="InsulationPanel",
    thickness="0.017",
    conductivity="0.045",
    density="30",
    spec_heat="1220",
    roughness="MediumSmooth")  # -> mat; plug-in component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

opaquemat_405 = HBOpaqueMaterial(
    name="Slab_BrickBlkConc_16cm",
    thickness=".160",
    conductivity="0.560",
    density="900",
    spec_heat="1000",
    roughness="Rough")  # -> mat; plug-in component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

opaquemat_406 = HBOpaqueMaterial(name="CementMortar", thickness="0.020", conductivity="1.400", density="2000", spec_heat="1000", roughness="Rough")  # -> mat; plug-in component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

# ----
# Hard code window
# U 1.40, g 0.35, VT 0.55
panel_99 = Panel("0.55")
windowmat_11 = HBWindowMaterial(name="U 1.40 Dbl LoE", u_factor="1.40", shgc="0.35", t_vis=panel_99)  # -> mat; plug-in component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
windowconstr_11 = HBWindowConstruction(name="U 1.40 Dbl LoE", materials=windowmat_11)  # -> constr; plug-in component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
decnstrconstr_11 = HBDeconstructConstruction(constr=windowconstr_11)  # -> materials, layers, r_val_si, r_val_ip, u_fac_si, u_fac_ip, shgc, t_sol, t_vis; plug-in component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
panel_100 = Panel([decnstrconstr_11.r_val_si, decnstrconstr_11.u_fac_si, decnstrconstr_11.shgc, decnstrconstr_11.t_sol, decnstrconstr_11.t_vis])
subfacesubset_11 = HBSubfaceSubset(window=windowconstr_11, skylight=windowconstr_11, operable=windowconstr_11, glass_door=windowconstr_11)  # -> subface_set; plug-in component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

opaquemat_407 = HBOpaqueMaterial(
    name="InternalPlaster",
    thickness=".020",
    conductivity="0.700",
    density="1400",
    spec_heat="1000",
    roughness="MediumSmooth")  # -> mat; plug-in component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

opaquemat_408 = HBOpaqueMaterial(name="HollowBrick_12cm", thickness="0.120", conductivity="0.387", density="800", spec_heat="1000", roughness="Rough")  # -> mat; plug-in component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

opaquemat_409 = HBOpaqueMaterial(
    name="Slab_BrickBlkConc_16cm",
    thickness=".160",
    conductivity="0.560",
    density="900",
    spec_heat="1000",
    roughness="Rough")  # -> mat; plug-in component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

opaquemat_410 = HBOpaqueMaterial(
    name="InternalPlaster",
    thickness="0.020",
    conductivity="0.700",
    density="1400",
    spec_heat="1000",
    roughness="MediumSmooth")  # -> mat; plug-in component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

opaquemat_411 = HBOpaqueMaterial(name="CementMortar", thickness="0.020", conductivity="1.400", density="2000", spec_heat="1000", roughness="Rough")  # -> mat; plug-in component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

opaquemat_412 = HBOpaqueMaterial(name="LtwtConcScreed_2cm", thickness=".020", conductivity=".580", density="400", spec_heat="1000", roughness="Rough")  # -> mat; plug-in component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

opaquemat_413 = HBOpaqueMaterial(
    name="InternalPlaster",
    thickness="0.020",
    conductivity="0.700",
    density="1400",
    spec_heat="1000",
    roughness="MediumSmooth")  # -> mat; plug-in component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

opaquemat_414 = HBOpaqueMaterial(name="HollowBrick_12cm", thickness="0.120", conductivity="0.387", density="800", spec_heat="1000", roughness="Rough")  # -> mat; plug-in component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

opaquemat_415 = HBOpaqueMaterial(
    name="InternalPlaster",
    thickness="0.020",
    conductivity="0.700",
    density="1400",
    spec_heat="1000",
    roughness="MediumSmooth")  # -> mat; plug-in component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

opaquemat_416 = HBOpaqueMaterial(name="CeramicTile", thickness="0.015", conductivity="1.470", density="1700", spec_heat="1000", roughness="MediumSmooth")  # -> mat; plug-in component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

opaquemat_417 = HBOpaqueMaterial(name="CementMortar", thickness="0.020", conductivity="1.400", density="2000", spec_heat="1000", roughness="Rough")  # -> mat; plug-in component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

opaquemat_418 = HBOpaqueMaterial(
    name="Slab_BrickBlkConc_16cm",
    thickness=".160",
    conductivity="0.560",
    density="900",
    spec_heat="1000",
    roughness="Rough")  # -> mat; plug-in component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

opaquemat_419 = HBOpaqueMaterial(name="CementMortar", thickness="0.020", conductivity="1.400", density="2000", spec_heat="1000", roughness="Rough")  # -> mat; plug-in component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

opaquemat_420 = HBOpaqueMaterial(name="CementMortar", thickness="0.020", conductivity="1.400", density="2000", spec_heat="1000", roughness="Rough")  # -> mat; plug-in component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

opaquemat_421 = HBOpaqueMaterial(name="CeramicTile", thickness="0.015", conductivity="1.470", density="1700", spec_heat="1000", roughness="MediumSmooth")  # -> mat; plug-in component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

opaquemat_422 = HBOpaqueMaterial(name="LtwtConcScreed_2cm", thickness=".020", conductivity=".580", density="400", spec_heat="1000", roughness="Rough")  # -> mat; plug-in component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

opaquemat_423 = HBOpaqueMaterial(name="CeramicTile", thickness="0.015", conductivity="1.470", density="1700", spec_heat="1000", roughness="MediumSmooth")  # -> mat; plug-in component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

opaquemat_424 = HBOpaqueMaterial(name="CementMortar", thickness="0.020", conductivity="1.400", density="2000", spec_heat="1000", roughness="Rough")  # -> mat; plug-in component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

opaquemat_425 = HBOpaqueMaterial(name="LtwtConcScreed_2cm", thickness=".020", conductivity=".580", density="400", spec_heat="1000", roughness="Rough")  # -> mat; plug-in component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

opaquematnomass_9 = HBOpaqueMaterialNoMass(name="FictitiousLayer_R0.3", r_value="0.3")  # -> mat; plug-in component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

opaquemat_426 = HBOpaqueMaterial(
    name="InsulationPanel",
    thickness="0.017",
    conductivity="0.045",
    density="30",
    spec_heat="1220",
    roughness="MediumSmooth")  # -> mat; plug-in component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

opaquematnomass_10 = HBOpaqueMaterialNoMass(name="FictitiousLayer_R0.3", r_value="0.3")  # -> mat; plug-in component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

opaquemat_427 = HBOpaqueMaterial(name="LtwtConcScreed_2cm", thickness=".020", conductivity=".580", density="400", spec_heat="1000", roughness="Rough")  # -> mat; plug-in component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

opaquemat_428 = HBOpaqueMaterial(name="CementMortar", thickness="0.020", conductivity="1.400", density="2000", spec_heat="1000", roughness="Rough")  # -> mat; plug-in component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

opaquemat_429 = HBOpaqueMaterial(
    name="Slab_BrickBlkConc_16cm",
    thickness=".160",
    conductivity="0.560",
    density="900",
    spec_heat="1000",
    roughness="Rough")  # -> mat; plug-in component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

opaquemat_430 = HBOpaqueMaterial(name="ExternalPlaster", thickness=".020", conductivity="0.900", density="1800", spec_heat="1000", roughness="Rough")  # -> mat; plug-in component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

opaquemat_431 = HBOpaqueMaterial(name="CementMortar", thickness="0.020", conductivity="1.400", density="2000", spec_heat="1000", roughness="Rough")  # -> mat; plug-in component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

opaquemat_432 = HBOpaqueMaterial(name="SolidBrick", thickness=".382", conductivity="0.720", density="1800", spec_heat="1000", roughness="Rough")  # -> mat; plug-in component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

opaquemat_433 = HBOpaqueMaterial(name="CeramicTile", thickness="0.015", conductivity="1.470", density="1700", spec_heat="1000", roughness="MediumSmooth")  # -> mat; plug-in component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

opaquemat_434 = HBOpaqueMaterial(name="ExternalPlaster", thickness=".020", conductivity="0.900", density="1800", spec_heat="1000", roughness="Rough")  # -> mat; plug-in component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

opaquemat_435 = HBOpaqueMaterial(
    name="InsulationPanel",
    thickness="0.017",
    conductivity="0.045",
    density="30",
    spec_heat="1220",
    roughness="MediumSmooth")  # -> mat; plug-in component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

opaquemat_436 = HBOpaqueMaterial(name="CementMortar", thickness="0.020", conductivity="1.400", density="2000", spec_heat="1000", roughness="Rough")  # -> mat; plug-in component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

opaquemat_437 = HBOpaqueMaterial(
    name="Slab_BrickBlkConc_16cm",
    thickness=".160",
    conductivity="0.560",
    density="900",
    spec_heat="1000",
    roughness="Rough")  # -> mat; plug-in component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

opaquemat_438 = HBOpaqueMaterial(name="CeramicTile", thickness="0.015", conductivity="1.470", density="1700", spec_heat="1000", roughness="MediumSmooth")  # -> mat; plug-in component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

opaquemat_439 = HBOpaqueMaterial(name="CementMortar", thickness="0.020", conductivity="1.400", density="2000", spec_heat="1000", roughness="Rough")  # -> mat; plug-in component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

opaquemat_440 = HBOpaqueMaterial(name="LtwtConcScreed_2cm", thickness=".020", conductivity=".580", density="400", spec_heat="1000", roughness="Rough")  # -> mat; plug-in component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

opaquemat_441 = HBOpaqueMaterial(name="ExternalPlaster", thickness=".020", conductivity="0.900", density="1800", spec_heat="1000", roughness="Rough")  # -> mat; plug-in component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

opaquemat_442 = HBOpaqueMaterial(
    name="InsulationPanel",
    thickness="0.017",
    conductivity="0.045",
    density="30",
    spec_heat="1220",
    roughness="MediumSmooth")  # -> mat; plug-in component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

opaquematnomass_11 = HBOpaqueMaterialNoMass(name="FictitiousLayer_R0.3", r_value="0.3")  # -> mat; plug-in component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

opaquemat_443 = HBOpaqueMaterial(
    name="InsulationPanel",
    thickness="0.035",
    conductivity="0.045",
    density="30",
    spec_heat="1220",
    roughness="MediumSmooth")  # -> mat; plug-in component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

opaquemat_444 = HBOpaqueMaterial(name="WoodPlanking", thickness="0.020", conductivity="0.150", density="550", spec_heat="1600", roughness="Rough")  # -> mat; plug-in component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

# ----
# R6TH
opaquemat_445 = HBOpaqueMaterial(name="ExternalPlaster", thickness=".020", conductivity="0.900", density="1800", spec_heat="1000", roughness="Rough")  # -> mat; plug-in component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

opaquemat_446 = HBOpaqueMaterial(name="SemiSolidBrick_25cm", thickness="0.250", conductivity="0.400", density="1000", spec_heat="1000", roughness="Rough")  # -> mat; plug-in component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

opaquemat_447 = HBOpaqueMaterial(name="InsulatedCavity", thickness="0.0124", conductivity="0.045", density="30", spec_heat="570", roughness="Rough")  # -> mat; plug-in component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

opaquemat_448 = HBOpaqueMaterial(
    name="InternalPlaster",
    thickness="0.020",
    conductivity="0.700",
    density="1400",
    spec_heat="1000",
    roughness="MediumSmooth")  # -> mat; plug-in component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

opaquemat_449 = HBOpaqueMaterial(name="CementMortar", thickness="0.020", conductivity="1.400", density="2000", spec_heat="1000", roughness="Rough")  # -> mat; plug-in component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

opaquemat_450 = HBOpaqueMaterial(name="HollowBrick_8cm", thickness="0.080", conductivity="0.400", density="800", spec_heat="1000", roughness="Rough")  # -> mat; plug-in component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

opaquemat_451 = HBOpaqueMaterial(
    name="Slab_BrickBlkConc_16cm",
    thickness=".160",
    conductivity="0.560",
    density="900",
    spec_heat="1000",
    roughness="Rough")  # -> mat; plug-in component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

# ----
# Hard code window
# U 1.40, g 0.35, VT 0.55
panel_101 = Panel("0.55")
windowmat_12 = HBWindowMaterial(name="U 1.40 Dbl LoE", u_factor="1.40", shgc="0.35", t_vis=panel_101)  # -> mat; plug-in component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
windowconstr_12 = HBWindowConstruction(name="U 1.40 Dbl LoE", materials=windowmat_12)  # -> constr; plug-in component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
decnstrconstr_12 = HBDeconstructConstruction(constr=windowconstr_12)  # -> materials, layers, r_val_si, r_val_ip, u_fac_si, u_fac_ip, shgc, t_sol, t_vis; plug-in component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
panel_102 = Panel([decnstrconstr_12.r_val_si, decnstrconstr_12.u_fac_si, decnstrconstr_12.shgc, decnstrconstr_12.t_sol, decnstrconstr_12.t_vis])
subfacesubset_12 = HBSubfaceSubset(window=windowconstr_12, skylight=windowconstr_12, operable=windowconstr_12, glass_door=windowconstr_12)  # -> subface_set; plug-in component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

merge_81 = Merge(Data1=opaquemat_372, Data2=opaquemat_380, Data3=opaquemat_368, Data4=opaquemat_381)
opaqueconstr_91 = HBOpaqueConstruction(name="Wall_06.02Mod_Interior", materials=merge_81)  # -> constr; plug-in component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

merge_82 = Merge(
    Data1=opaquemat_349,
    Data2=opaquemat_350,
    Data3=opaquemat_379,
    Data4=opaquemat_383,
    Data5=opaquemat_384,
    Data6=opaquemat_388,
    Data7=opaquemat_385)
opaqueconstr_92 = HBOpaqueConstruction(name="Wall_06.02", materials=merge_82)  # -> constr; plug-in component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

merge_83 = Merge(
    Data1=opaquemat_353,
    Data2=opaquemat_395,
    Data3=opaquemat_396,
    Data4=opaquemat_401,
    Data5=opaquemat_402,
    Data6=opaquemat_400)

merge_84 = Merge(
    Data1=opaquemat_373,
    Data2=opaquemat_370,
    Data3=opaquemat_363,
    Data4=opaquemat_362,
    Data5=opaquemat_364,
    Data6=opaquemat_365,
    Data7=opaquemat_366,
    Data8=opaquemat_351,
    Data9=opaquematnomass_7)
opaqueconstr_93 = HBOpaqueConstruction(name="Floor_06.01_GRroof", materials=merge_84)  # -> constr; plug-in component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

merge_85 = Merge(
    Data1=opaquemat_393,
    Data2=opaquemat_389,
    Data3=opaquemat_394,
    Data4=opaquemat_392,
    Data5=opaquemat_390,
    Data6=opaquemat_378)
opaqueconstr_94 = HBOpaqueConstruction(name="Floor_06.01_IntClg", materials=merge_85)  # -> constr; plug-in component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

merge_86 = Merge(
    Data1=opaquematnomass_6,
    Data2=opaquemat_351,
    Data3=opaquemat_374,
    Data4=opaquemat_387,
    Data5=opaquemat_386,
    Data6=opaquemat_375,
    Data7=opaquemat_361,
    Data8=opaquemat_360,
    Data9=opaquemat_359)
opaqueconstr_95 = HBOpaqueConstruction(name="Floor_06.01_GRfloor", materials=merge_86)  # -> constr; plug-in component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

# ----
# Ground Subset -
# same as interior floors,
# ground & roof must be inverse.
# 
# Base ground & roof construction
# on exterior floor for same archetype
# Make this same thickness as W1
panel_103 = Panel("Wall_06.02_UGwall")
opaqueconstr_96 = HBOpaqueConstruction(name=panel_103, materials=opaquemat_371)  # -> constr; plug-in component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
groundsubset_11 = HBGroundConstructionSubset(ground_wall=opaqueconstr_96, ground_roof=opaqueconstr_93, ground_floor=opaqueconstr_95)  # -> ground_set; plug-in component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
decnstrmat_21 = HBDeconstructMaterial(mat=groundsubset_11)  # -> values, attr_names, r_val_si, r_val_ip; plug-in component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
panel_104 = Panel(groundsubset_11)
panel_105 = Panel(decnstrmat_21.r_val_si)

merge_87 = Merge(Data1=opaquemat_410, Data2=opaquemat_414, Data3=opaquemat_408, Data4=opaquemat_415)
opaqueconstr_97 = HBOpaqueConstruction(name="Wall_06.02Mod_Interior", materials=merge_87)  # -> constr; plug-in component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

opaqueconstr_98 = HBOpaqueConstruction(name="Roof_06.02", materials=merge_83)  # -> constr; plug-in component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

merge_88 = Merge(
    Data1=opaquemat_367,
    Data2=opaquemat_369,
    Data3=opaquemat_376,
    Data5=opaquemat_377,
    Data6=opaquemat_391,
    Data7=opaquemat_382)
opaqueconstr_99 = HBOpaqueConstruction(name="Floor_06.01_IntFlr", materials=merge_88)  # -> constr; plug-in component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

merge_89 = Merge(
    Data1=opaquematnomass_8,
    Data2=opaquemat_352,
    Data3=opaquemat_403,
    Data4=opaquemat_405,
    Data5=opaquemat_406,
    Data6=opaquemat_404,
    Data7=opaquemat_399,
    Data8=opaquemat_398,
    Data9=opaquemat_397)
opaqueconstr_100 = HBOpaqueConstruction(name="Floor_06.01", materials=merge_89)  # -> constr; plug-in component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

merge_90 = Merge(
    Data1=opaquemat_356,
    Data2=opaquemat_357,
    Data3=opaquemat_445,
    Data4=opaquemat_446,
    Data5=opaquemat_447,
    Data6=opaquemat_450,
    Data7=opaquemat_448)
opaqueconstr_101 = HBOpaqueConstruction(name="Wall_06.02", materials=merge_90)  # -> constr; plug-in component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

merge_91 = Merge(
    Data1=opaquemat_421,
    Data2=opaquemat_417,
    Data3=opaquemat_422,
    Data4=opaquemat_420,
    Data5=opaquemat_418,
    Data6=opaquemat_413)
opaqueconstr_102 = HBOpaqueConstruction(name="Floor_06.01_IntClg", materials=merge_91)  # -> constr; plug-in component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

merge_92 = Merge(Data1=opaquemat_354, Data2=opaquemat_443, Data3=opaquemat_444)
opaqueconstr_103 = HBOpaqueConstruction(name="Roof_06.01", materials=merge_92)  # -> constr; plug-in component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

merge_93 = Merge(
    Data1=opaquemat_433,
    Data2=opaquemat_431,
    Data3=opaquemat_427,
    Data4=opaquemat_426,
    Data5=opaquemat_428,
    Data6=opaquemat_429,
    Data7=opaquemat_430,
    Data8=opaquemat_355,
    Data9=opaquematnomass_10)
opaqueconstr_104 = HBOpaqueConstruction(name="Floor_06.01_GRroof", materials=merge_93)  # -> constr; plug-in component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

merge_94 = Merge(
    Data1=opaquematnomass_9,
    Data2=opaquemat_355,
    Data3=opaquemat_434,
    Data4=opaquemat_437,
    Data5=opaquemat_436,
    Data6=opaquemat_435,
    Data7=opaquemat_425,
    Data8=opaquemat_424,
    Data9=opaquemat_423)
opaqueconstr_105 = HBOpaqueConstruction(name="Floor_06.01_GRfloor", materials=merge_94)  # -> constr; plug-in component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

# ----
# Ground Subset -
# same as interior floors,
# ground & roof must be inverse.
# 
# Base ground & roof construction
# on exterior floor for same archetype
# Make this same thickness as W1
panel_106 = Panel("Wall_06.02_UGwall")
opaqueconstr_106 = HBOpaqueConstruction(name=panel_106, materials=opaquemat_432)  # -> constr; plug-in component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
groundsubset_12 = HBGroundConstructionSubset(ground_wall=opaqueconstr_106, ground_roof=opaqueconstr_104, ground_floor=opaqueconstr_105)  # -> ground_set; plug-in component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
decnstrmat_22 = HBDeconstructMaterial(mat=groundsubset_12)  # -> values, attr_names, r_val_si, r_val_ip; plug-in component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
panel_107 = Panel(groundsubset_12)
panel_108 = Panel(decnstrmat_22.r_val_si)

# ----
# Interior Subset -
# Note interior floors & ceilings must
# be inverse of each other
interiorsubset_11 = HBInteriorConstructionSubset(interior_wall=opaqueconstr_91, ceiling=opaqueconstr_94, interior_floor=opaqueconstr_99)  # -> interior_set; plug-in component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
panel_109 = Panel(interiorsubset_11)

merge_95 = Merge(
    Data1=opaquemat_407,
    Data2=opaquemat_409,
    Data3=opaquemat_411,
    Data5=opaquemat_412,
    Data6=opaquemat_419,
    Data7=opaquemat_416)
opaqueconstr_107 = HBOpaqueConstruction(name="Floor_06.01_IntFlr", materials=merge_95)  # -> constr; plug-in component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

# ----
# Exterior Subset
exteriorsubset_11 = HBExteriorConstructionSubset(exterior_wall=opaqueconstr_92, exterior_roof=opaqueconstr_98, exposed_floor=opaqueconstr_100)  # -> exterior_set; plug-in component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
panel_110 = Panel(exteriorsubset_11)
decnstrmat_23 = HBDeconstructMaterial(mat=exteriorsubset_11)  # -> values, attr_names, r_val_si, r_val_ip; plug-in component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
panel_111 = Panel(decnstrmat_23.r_val_si)

merge_96 = Merge(
    Data1=opaquematnomass_11,
    Data2=opaquemat_358,
    Data3=opaquemat_441,
    Data4=opaquemat_451,
    Data5=opaquemat_449,
    Data6=opaquemat_442,
    Data7=opaquemat_440,
    Data8=opaquemat_439,
    Data9=opaquemat_438)
opaqueconstr_108 = HBOpaqueConstruction(name="Floor_06.01", materials=merge_96)  # -> constr; plug-in component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

# ----
# Interior Subset -
# Note interior floors & ceilings must
# be inverse of each other
interiorsubset_12 = HBInteriorConstructionSubset(interior_wall=opaqueconstr_97, ceiling=opaqueconstr_102, interior_floor=opaqueconstr_107)  # -> interior_set; plug-in component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
panel_112 = Panel(interiorsubset_12)

# ----
# Exterior Subset
exteriorsubset_12 = HBExteriorConstructionSubset(exterior_wall=opaqueconstr_101, exterior_roof=opaqueconstr_103, exposed_floor=opaqueconstr_108)  # -> exterior_set; plug-in component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
panel_113 = Panel(exteriorsubset_12)
decnstrmat_24 = HBDeconstructMaterial(mat=exteriorsubset_12)  # -> values, attr_names, r_val_si, r_val_ip; plug-in component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
panel_114 = Panel(decnstrmat_24.r_val_si)

# ----
# EXPORT TO JSON
panel_115 = Panel("pre_1980::ClimateZone4::Mass")
constructionset_11 = HBConstructionSet(
    name="R6SF_g0.35WinHC",
    base_constr_set=panel_115,
    exterior_subset=exteriorsubset_11,
    ground_subset=groundsubset_11,
    interior_subset=interiorsubset_11,
    subface_subset=subfacesubset_11)  # -> constr_set; plug-in component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
objtostr_11 = HBObjectToString(hb_obj=constructionset_11)  # -> hb_str; plug-in component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